# Grasshopper definition Pf_02-Color.gh (Grasshopper 0.9.76)
# plug-ins: Pufferfish

# Col @
# index 0
number_slider = Slider(1.5, range=0..2)
# Determines how the tween is interpolated, for colors the difference is usually in subtle
# changes of the color, depending on the location of the color in relation to the other colors.
# Factor from 0 to 1 determines the color
# between each input as a list. So 0.5 will
# be halfway between each input
# consecutively through the list.
# You can use lists / mutiple factors as well.
number_slider_2 = Slider(0, range=0..3)
# 01-Tween Two Colors
# Factor from 0 to 1 determines the color
# between inputs. So 0.5 will be halfway
# between the inputs. You can use lists /
# mutiple factors as well.
number_slider_3 = Slider(0.5, range=0..1)
# Determines how the tween is interpolated, for colors the difference is usually in subtle
# changes of the color, depending on the location of the color in relation to the other colors.
# Factor from 0 to the last index. This
# can be considered like a timeline.
# This lets each color have an equally
# controllable section of the slider between.
# As opposed to going from 0 to 1 where
# it would be hard to control with many inputs.
# This lets you easily pinpoint your location.
# You can use lists / mutiple factors as well.
number_slider_4 = Slider(0, range=0..3)
# If change to true the alpha
# transparency will also be inverted
toggle = BooleanToggle(False)
# 02-Tween Consecutive Colors
swatch = ColourSwatch(SwatchColor=RGB(224, 185, 29))
# 04-Invert Color
swatch_2 = ColourSwatch(SwatchColor=RGB(255, 0, 0))
# Col @
# index 1
# Col @
# index 2
swatch_3 = ColourSwatch(SwatchColor=RGB(202, 193, 232))
# 05-Mirror Combine Colors
swatch_4 = ColourSwatch(SwatchColor=RGB(255, 255, 255))
# The index to cut the list and
# mirror at.Try with negative
# index also to see how it
# effects the list.
swatch_5 = ColourSwatch(SwatchColor=RGB(0, 47, 255))
# 03-Tween Through Colors
swatch_6 = ColourSwatch(SwatchColor=RGB(161, 8, 77))
# 06-Mirror Cut Colors
swatch_7 = ColourSwatch(SwatchColor=RGB(255, 255, 255))
# 0 = Reflected - Mirrors the exact values
# 1 = Inverted - Mirrors as inverted
# Joins the list at the seam so the duplicate color is removed
# where the mirror list meets the input list. Make it true and see how
# the result list changes at the seam.
# Determines if the list mirrors at the start or end
number_slider_5 = Slider(0, range=0..1)
# 0 = Reflected - Mirrors the exact values
# 1 = Inverted - Mirrors as inverted
# Joins the list at the seam so the duplicate color is removed
# where the mirror list meets the input list. Make it true and see how
# the result list changes at the seam.
# Determines if the list mirrors at the start or end
number_slider_6 = Slider(0, range=0..1)
# Pf_02-Color
swatch_8 = ColourSwatch(SwatchColor=RGB(255, 255, 255))
# Optional to tween alpha
swatch_9 = ColourSwatch(SwatchColor=RGB(255, 0, 0))
# List of colors
col = Colour([swatch_4, ColourSwatch(SwatchColor=RGB(255, 0, 0)), ColourSwatch(SwatchColor=RGB(255, 196, 0)), ColourSwatch(SwatchColor=RGB(119, 255, 0)), ColourSwatch(SwatchColor=RGB(0, 255, 221)), ColourSwatch(SwatchColor=RGB(0, 47, 255))])
# List of colors
col_2 = Colour([swatch_7, ColourSwatch(SwatchColor=RGB(255, 0, 0)), ColourSwatch(SwatchColor=RGB(255, 196, 0)), ColourSwatch(SwatchColor=RGB(119, 255, 0)), ColourSwatch(SwatchColor=RGB(0, 255, 221)), swatch_5])
# Optional to tween alpha
twnconcols = TweenConsecutiveColors(
    Colors=[swatch, ColourSwatch(SwatchColor=RGB(61, 138, 121)), ColourSwatch(SwatchColor=RGB(75, 29, 224))],
    Factor=Slider(0.5, range=0..1),
    InterpolationType=number_slider_2,
    Alpha=True)
# Pufferfish
# By: Michael Pryor
twn2cols = TweenTwoColors(ColorA=swatch_8, ColorB=swatch_9, Factor=number_slider_3, Alpha=True)
twnthrucols = TweenThroughColors(
    Colors=[swatch_6, ColourSwatch(SwatchColor=RGB(30, 212, 172)), swatch_3],
    Factor=number_slider,
    InterpolationType=number_slider_4,
    Alpha=True)
# Optional invert alpha
invcol = InvertColor(Color=swatch_2, Alpha=toggle)
# Optional mirror alpha
mircomcols = MirrorCombineColors(Colors=col, Flip=Toggle(False), Join=Toggle(False), MirrorType=number_slider_5, Alpha=False)  # -> Mirrored, SplitIndex
mircutcols = MirrorCutColors(
    Colors=col_2,
    MirrorIndex=Slider(3, range=-10..10),
    Flip=Toggle(False),
    Join=Toggle(False),
    MirrorType=number_slider_6,
    Alpha=False)  # -> MirrorCut, SplitIndex, Intersected
# Works with transparency too
legend = Legend(Colour=twn2cols, Tags="Tween Color", LegendType=1)
legend_2 = Legend(Colour=invcol, Tags="Inverted Color", LegendType=1)
# Optional to tween alpha
legend_3 = Legend(Colour=twnthrucols, Tags="Tween Color", LegendType=1)
legend_4 = Legend(Colour=twnconcols, Tags=["Tween Color 1", "Tween Color 2"], LegendType=1)
legend_5 = Legend(Colour=mircomcols.Mirrored, Tags="Colors", LegendType=1)
legend_6 = Legend(Colour=col_2, Tags="Colors", LegendType=1)
# List cut
# and mirrored
# Optional mirror alpha
panel = Panel(mircutcols.Intersected)
# List mirrored
# and combined
legend_7 = Legend(Colour=mircomcols.Mirrored, Tags="Colors", LegendType=1)
legend_8 = Legend(Colour=mircutcols.MirrorCut, Tags="Colors", LegendType=1)
# All the Tween Colors
# components do
number_slider_7 = Slider(0.516, range=0..1)
# with alpha set to true the
# color transparencies will
# also tween. If it is false only
# the colors will tween.
toggle_2 = BooleanToggle(True)
# this color is transparent
swatch_10 = ColourSwatch(SwatchColor=RGBA(255, 255, 255, 0))
twn2cols_2 = TweenTwoColors(ColorA=swatch_10, ColorB=ColourSwatch(SwatchColor=RGB(255, 0, 0)), Factor=number_slider_7, Alpha=toggle_2)
# Splitting the list
number_slider_8 = Slider(3, range=-10..10)
# Splitting the list
swatch_11 = ColourSwatch(SwatchColor=RGB(0, 47, 255))
legend_9 = Legend(Colour=twn2cols_2, Tags="Tween Color", LegendType=1)
col_3 = Colour([ColourSwatch(SwatchColor=RGB(255, 255, 255)), ColourSwatch(SwatchColor=RGB(255, 0, 0)), ColourSwatch(SwatchColor=RGB(255, 196, 0)), ColourSwatch(SwatchColor=RGB(119, 255, 0)), ColourSwatch(SwatchColor=RGB(0, 255, 221)), ColourSwatch(SwatchColor=RGB(0, 47, 255))])
col_4 = Colour([ColourSwatch(SwatchColor=RGB(255, 255, 255)), ColourSwatch(SwatchColor=RGB(255, 0, 0)), ColourSwatch(SwatchColor=RGB(255, 196, 0)), ColourSwatch(SwatchColor=RGB(119, 255, 0)), ColourSwatch(SwatchColor=RGB(0, 255, 221)), swatch_11])
mircutcols_2 = MirrorCutColors(
    Colors=col_3,
    MirrorIndex=number_slider_8,
    Flip=Toggle(False),
    Join=Toggle(False),
    MirrorType=Slider(0, range=0..1),
    Alpha=False)  # -> MirrorCut, SplitIndex, Intersected
# If  join is false you can use this index
# to split the list at the mirror seam.
mircomcols_2 = MirrorCombineColors(Colors=col_4, Flip=Toggle(False), Join=Toggle(False), MirrorType=Slider(0, range=0..1), Alpha=False)  # -> Mirrored, SplitIndex
split = SplitList(List=mircomcols_2.Mirrored, Index=mircomcols_2.SplitIndex)  # -> ListA, ListB
# If  join is false you can use this index
# to split the list at the mirror seam.
split_2 = SplitList(List=mircutcols_2.MirrorCut, Index=mircutcols_2.SplitIndex)  # -> ListA, ListB
legend_10 = Legend(Colour=split.ListA, Tags="Colors", LegendType=1)
# Repeating the list
# for repeating patterns
legend_11 = Legend(Colour=split.ListB, Tags="Colors", LegendType=1)
legend_12 = Legend(Colour=split_2.ListA, Tags="Colors", LegendType=1)
# Repeating the list
# for repeating patterns
legend_13 = Legend(Colour=split_2.ListB, Tags="Colors", LegendType=1)
col_5 = Colour([ColourSwatch(SwatchColor=RGB(255, 255, 255)), ColourSwatch(SwatchColor=RGB(255, 0, 0)), ColourSwatch(SwatchColor=RGB(255, 196, 0)), ColourSwatch(SwatchColor=RGB(119, 255, 0)), ColourSwatch(SwatchColor=RGB(0, 255, 221)), ColourSwatch(SwatchColor=RGB(0, 47, 255))])
col_6 = Colour([ColourSwatch(SwatchColor=RGB(255, 255, 255)), ColourSwatch(SwatchColor=RGB(255, 0, 0)), ColourSwatch(SwatchColor=RGB(255, 196, 0)), ColourSwatch(SwatchColor=RGB(119, 255, 0)), ColourSwatch(SwatchColor=RGB(0, 255, 221)), ColourSwatch(SwatchColor=RGB(0, 47, 255))])
mircutcols_3 = MirrorCutColors(
    Colors=col_5,
    MirrorIndex=Slider(3, range=-10..10),
    Flip=Toggle(False),
    Join=Toggle(False),
    MirrorType=Slider(0, range=0..1),
    Alpha=False)  # -> MirrorCut, SplitIndex, Intersected
mircomcols_3 = MirrorCombineColors(Colors=col_6, Flip=Toggle(False), Join=Toggle(False), MirrorType=Slider(0, range=0..1), Alpha=False)  # -> Mirrored, SplitIndex
# Move the slider to shorten or lengthen the pattern
number_slider_9 = Slider(48, range=0..200)
# Move the slider to shorten or lengthen the pattern
number_slider_10 = Slider(48, range=0..200)
# By repeating the mirror combine list data
# you can make repeating patterns.
repeat = RepeatData(Data=mircomcols_3.Mirrored, Length=number_slider_9)
# By repeating the mirror combine list data
# you can make repeating patterns.
repeat_2 = RepeatData(Data=mircutcols_3.MirrorCut, Length=number_slider_10)
legend_14 = Legend(Colour=repeat, Tags="Colors", LegendType=2)
legend_15 = Legend(Colour=repeat_2, Tags="Colors", LegendType=2)
