# Grasshopper definition Pf_03-Vector.gh (Grasshopper 0.9.76)
# plug-ins: Pufferfish

# 07-Vector Star
# The vector star and vector world are
# good to use as the target vectors of
# closest vector component.
number_slider = Slider(3, range=0..10)
# Vec @
# index 0
number_slider_2 = Slider(1.5, range=0..2)
# 01-Tween Two Vectors
# Factor from 0 to 1 determines the vector
# between inputs. So 0.5 will be halfway
# between the inputs. You can use lists /
# mutiple factors as well.
number_slider_3 = Slider(0.5, range=0..1)
# 04-Closest Vector
crv = Curve(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)
# 06-Mirror Cut Vectors
# The index to cut the list and
# mirror at.Try with negative
# index also to see how it
# effects the list.
number_slider_4 = Slider(4, range=-10..10)
# Target vectors (in this case as curves)
crv_2 = Curve(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)
# 08-Vector World
# The vector star and vector world are
# good to use as the target vectors of
# closest vector component.
number_slider_5 = Slider(2, range=0..2)
# Determines how the tween is interpolated.
# Factor from 0 to 1 determines the vector
# between each input as a list. So 0.5 will
# be halfway between each input
# consecutively through the list.
# You can use lists / mutiple factors as well.
number_slider_6 = Slider(0, range=0..3)
# Determines how the tween is interpolated.
# Factor from 0 to the last index. This
# can be considered like a timeline.
# This lets each vector have an equally
# controllable section of the slider between.
# As opposed to going from 0 to 1 where
# it would be hard to control with many inputs.
# This lets you easily pinpoint your location.
# You can use lists / mutiple factors as well.
number_slider_7 = Slider(0, range=0..3)
merge = Merge(Data1=crv, Data2=crv_2)
# 0 = Reflected - Mirrors the exact values
# 1 = Inverted - Mirrors the inverse, so
# positives become negatives and vice versa.
# Joins the list at the seam so the
# duplicate vector is removed
# where the mirror list meets the
# input list. Make it true and see how
# the result list changes at the seam.
number_slider_8 = Slider(0, range=0..1)
# 0 = Reflected - Mirrors the exact values
# 1 = Inverted - Mirrors the inverse, so
# positives become negatives and vice versa.
# Joins the list at the seam so the
# duplicate vector is removed
# where the mirror list meets the
# input list. Make it true and see how
# the result list changes at the seam.
number_slider_9 = Slider(0, range=0..1)
# Boolean toggle to switch
# between 3D or 2D star
# Cubic or spherical star type
toggle = BooleanToggle(False)
# Boolean toggle to switch
# between 3D or 2D star
# Cardial, InterCardial, or both world types
toggle_2 = BooleanToggle(False)
vec = Vector(Vector(-40.29144489, 0, 0))
# 02-Tween Consecutive Vectors
vec_2 = Vector(Vector(30.0055933, 0, 0))
vec_3 = Vector(Vector(0, 51.53545939, 0))
# Vec @
# index 1
# Vec @
# index 2
vec_4 = Vector(Vector(-40.29144489, 0, 0))
# Pf_03-Vector
vec_5 = Vector(Vector(30.0055933, 0, 0))
vec_6 = Vector(Vector(0, 51.53545939, 0))
# 03-Tween Through Vectors
vec_7 = Vector(Vector(30.0055933, 0, 0))
vec_8 = Vector(Vector(0, 51.53545939, 0))
pl = Plane(PlaneXY(405.7385566, -40.44130523, 0))
pl_2 = Plane(PlaneXY(419.2711959, -40.99914008, 0))
end = EndPoints(Curve=merge)  # -> Start, End
# 05-Mirror Combine Vectors
# List of vectors
vec_9 = Vector([Vector(0, 1, 0), Vector(0.1244053565, 0.9922314787, 0), Vector(0.2842769683, 0.9587421996, 0), Vector(0.4831086444, 0.8755604135, 0), Vector(0.6803059523, 0.7329282443, 0), Vector(0.80542675, 0.5926953268, 0), Vector(0.9179587771, 0.3966757915, 0), Vector(0.9834874623, 0.180976273, 0), Vector(1, 0, 0)])
# List of vectors
vec_10 = Vector([Vector(0, 1, 0), Vector(0.1244053565, 0.9922314787, 0), Vector(0.2842769683, 0.9587421996, 0), Vector(0.4831086444, 0.8755604135, 0), Vector(0.6803059523, 0.7329282443, 0), Vector(0.80542675, 0.5926953268, 0), Vector(0.9179587771, 0.3966757915, 0), Vector(0.9834874623, 0.180976273, 0), Vector(1, 0, 0)])
twn2vecs = TweenTwoVectors(VectorA=vec_5, VectorB=vec_6, Factor=number_slider_3)
twnconvecs = TweenConsecutiveVectors(Vectors=[vec_2, vec_3, vec], Factor=Slider(0.5, range=0..1), InterpolationType=number_slider_6)
twnthruvecs = TweenThroughVectors(Vectors=[vec_7, vec_8, vec_4], Factor=number_slider_2, InterpolationType=number_slider_7)
# Change this slider to change
# the reference vector location.
pline = PolyLine(Vertices=end.End, Closed=False)
vecworld = VectorWorld(Plane=pl_2, WorldType=number_slider_5, Dimensionality=toggle_2)  # -> Vectors, Lines
vecstar = VectorStar(Plane=pl, Resolution=number_slider, StarType=Slider(0, range=0..1), Dimensionality=toggle)  # -> Vectors, Lines
# Determines if the list
# mirrors at the start or end
# Optional plane to mirror the
# vector directions when in
# reflected mode. Without a plane
# only the list order is mirrored. Plug
# this plane in and see the results.
yz = YZPlane(Origin=Point(0, 0, 0))
# Determines if the list
# mirrors at the start or end
# Optional plane to mirror the
# vector directions when in
# reflected mode. Without a plane
# only the list order is mirrored. Plug
# this plane in and see the results.
yz_2 = YZPlane(Origin=Point(0, 0, 0))
curvepoint = PointOnCurve(pline, parameter=0.749)
mircutvecs = MirrorCutVectors(Vectors=vec_10, MirrorIndex=number_slider_4, Flip=Toggle(False), Join=Toggle(False), MirrorType=number_slider_9)  # -> MirrorCut, SplitIndex, Intersected
mircomvecs = MirrorCombineVectors(Vectors=vec_9, Flip=Toggle(True), Join=Toggle(False), MirrorType=number_slider_8)  # -> Mirrored, SplitIndex
# if true, the result closest target vector
# will have the length of the reference vector.
toggle_3 = BooleanToggle(False)
# Look at Rhino window
# to preview results
vdisex = VectorDisplayEx(Point="150,0,0", Vector=twnconvecs, Colour=RGB(0, 0, 0), Width=2)
# Look at Rhino window
# to preview results
vdisex_2 = VectorDisplayEx(Point="300,0,0", Vector=twnthruvecs, Colour=RGB(0, 0, 0), Width=2)
vdis = VectorDisplay(Anchor="150,0,0", Vector=[vec_2, vec_3, vec])
vdis_2 = VectorDisplay(Anchor="300,0,0", Vector=[vec_7, vec_8, vec_4])
# Look at Rhino window
# to preview results
vdisex_3 = VectorDisplayEx(Point="0,0,0", Vector=twn2vecs, Colour=RGB(0, 0, 0), Width=2)
# Pufferfish
# By: Michael Pryor
vdis_3 = VectorDisplay(Anchor="0,0,0", Vector=[vec_5, vec_6])
# Line representation
# of result vectors
line = Line(vecstar.Lines)
# Line representation
# of result vectors
line_2 = Line(vecworld.Lines)
panel = Panel(vecworld.Vectors)
panel_2 = Panel(vecstar.Vectors)
panel_3 = Panel(vec_9)
panel_4 = Panel(vec_10)
# Reference vector
ln = Line(StartPoint=Point(405.4249471, -4.159345701, 0), EndPoint=curvepoint)
amp = Amplitude(Vector=mircomvecs.Mirrored, Amplitude=60)
amp_2 = Amplitude(Vector=mircutvecs.MirrorCut, Amplitude=60)
# Index of closest vector
cvec = ClosestVector(Reference=ln, Targets=merge, KeepLength=toggle_3)  # -> Closest, Index, Angle
# Look at Rhino window
# to preview results
vdis_4 = VectorDisplay(Anchor=pl, Vector=vecstar.Vectors)
# Look at Rhino window
# to preview results
vdis_5 = VectorDisplay(Anchor=pl_2, Vector=vecworld.Vectors)
# Look at Rhino
# to preview results
vdis_6 = VectorDisplay(Anchor=Point(552.8286294, -4.991244429, 0), Vector=amp)
# Look at Rhino
# to preview results
vdis_7 = VectorDisplay(Anchor=Point(690.1851545, -4.991244429, 0), Vector=amp_2)
# Angle between reference
# and closest target
panel_5 = Panel(cvec.Angle)
panel_6 = Panel(cvec.Index)
# List mirrored
# and combined
panel_7 = Panel(mircomvecs.Mirrored)
# List cut
# and mirrored
panel_8 = Panel(mircutvecs.MirrorCut)
line_3 = LineSDL(Start=Point(405.4249471, -4.159345701, 0), Direction=cvec.Closest, Length=75)
pipe = Pipe(Curve=merge, Radius=1, Caps=0)
pipe_2 = Pipe(Curve=line_3, Radius=0.5, Caps=0)
pipe_3 = Pipe(Curve=ln, Radius=0.5, Caps=0)
# Look at Rhino window
# to preview results
# Visualization of the target vectors
# Look at Rhino window
# to preview results
preview = CustomPreview(Geometry=pipe, Shader=ColourSwatch(SwatchColor=RGB(255, 0, 0)))
# Visualization of the closest vector result.
# You will see the closest target vector
# to the reference vector gets selected
# as you change the reference vector direction.
preview_2 = CustomPreview(Geometry=pipe_2, Shader=ColourSwatch(SwatchColor=RGB(43, 255, 28)))
# Visualization of the reference vector
# Look at Rhino window
# to preview results
preview_3 = CustomPreview(Geometry=pipe_3, Shader=ColourSwatch(SwatchColor=RGB(0, 0, 0)))
# Splitting the list
toggle_4 = BooleanToggle(False)
# Splitting the list
toggle_5 = BooleanToggle(False)
vec_11 = Vector([Vector(0, 1, 0), Vector(0.1244053565, 0.9922314787, 0), Vector(0.2842769683, 0.9587421996, 0), Vector(0.4831086444, 0.8755604135, 0), Vector(0.6803059523, 0.7329282443, 0), Vector(0.80542675, 0.5926953268, 0), Vector(0.9179587771, 0.3966757915, 0), Vector(0.9834874623, 0.180976273, 0), Vector(1, 0, 0)])
vec_12 = Vector([Vector(0, 1, 0), Vector(0.1244053565, 0.9922314787, 0), Vector(0.2842769683, 0.9587421996, 0), Vector(0.4831086444, 0.8755604135, 0), Vector(0.6803059523, 0.7329282443, 0), Vector(0.80542675, 0.5926953268, 0), Vector(0.9179587771, 0.3966757915, 0), Vector(0.9834874623, 0.180976273, 0), Vector(1, 0, 0)])
mircutvecs_2 = MirrorCutVectors(
    Vectors=vec_11,
    MirrorIndex=Slider(4, range=-10..10),
    Flip=Toggle(False),
    Join=toggle_4,
    MirrorType=Slider(0, range=0..1))  # -> MirrorCut, SplitIndex, Intersected
# If  join is false you can use this index
# to split the list at the mirror seam.
mircomvecs_2 = MirrorCombineVectors(Vectors=vec_12, Flip=Toggle(False), Join=toggle_5, MirrorType=Slider(0, range=0..1))  # -> Mirrored, SplitIndex
split = SplitList(List=mircomvecs_2.Mirrored, Index=mircomvecs_2.SplitIndex)  # -> ListA, ListB
# If  join is false you can use this index
# to split the list at the mirror seam.
split_2 = SplitList(List=mircutvecs_2.MirrorCut, Index=mircutvecs_2.SplitIndex)  # -> ListA, ListB
panel_9 = Panel(split.ListA)
panel_10 = Panel(split_2.ListA)
panel_11 = Panel(split.ListB)
panel_12 = Panel(split_2.ListB)
# Repeating the list
# for repeating patterns
toggle_6 = BooleanToggle(False)
# Repeating the list
# for repeating patterns
toggle_7 = BooleanToggle(False)
# Change the index value to shrink or grow the wave
vec_13 = Vector([Vector(0, 1, 0), Vector(0.1244053565, 0.9922314787, 0), Vector(0.2842769683, 0.9587421996, 0), Vector(0.4831086444, 0.8755604135, 0), Vector(0.6803059523, 0.7329282443, 0), Vector(0.80542675, 0.5926953268, 0), Vector(0.9179587771, 0.3966757915, 0), Vector(0.9834874623, 0.180976273, 0), Vector(1, 0, 0)])
vec_14 = Vector([Vector(0, 1, 0), Vector(0.1244053565, 0.9922314787, 0), Vector(0.2842769683, 0.9587421996, 0), Vector(0.4831086444, 0.8755604135, 0), Vector(0.6803059523, 0.7329282443, 0), Vector(0.80542675, 0.5926953268, 0), Vector(0.9179587771, 0.3966757915, 0), Vector(0.9834874623, 0.180976273, 0), Vector(1, 0, 0)])
mircomvecs_3 = MirrorCombineVectors(Vectors=vec_14, Flip=Toggle(False), Join=toggle_7, MirrorType=Slider(0, range=0..1))  # -> Mirrored, SplitIndex
mircutvecs_3 = MirrorCutVectors(
    Vectors=vec_13,
    MirrorIndex=Slider(4, range=-10..10),
    Flip=Toggle(False),
    Join=toggle_6,
    MirrorType=Slider(0, range=0..1))  # -> MirrorCut, SplitIndex, Intersected
# Move the slider to shorten or lengthen the wave
number_slider_10 = Slider(74, range=0..200)
# Move the slider to shorten or lengthen the wave
number_slider_11 = Slider(74, range=0..200)
# By repeating the mirror combine list data
# you can make patterns such as waves.
amp_3 = Amplitude(Vector=mircomvecs_3.Mirrored, Amplitude=10)
# By repeating the mirror combine list data
# you can make patterns such as waves.
amp_4 = Amplitude(Vector=mircutvecs_3.MirrorCut, Amplitude=10)
repeat = RepeatData(Data=amp_3, Length=number_slider_10)
repeat_2 = RepeatData(Data=amp_4, Length=number_slider_11)
series = Series(Start=0, Step=1, Count=number_slider_10)
series_2 = Series(Start=0, Step=1, Count=number_slider_11)
Y = UnitY(Factor=series)
Y_2 = UnitY(Factor=series_2)
pt = Point(Point(553.9670907, 68.17972828, 0))
pt_2 = Point(Point(690.7392917, 68.17972828, 0))
panel_13 = Panel(repeat)
panel_14 = Panel(repeat_2)
move = Move(Geometry=pt, Motion=Y)  # -> Geometry, Transform
move_2 = Move(Geometry=pt_2, Motion=Y_2)  # -> Geometry, Transform
move_3 = Move(Geometry=move.Geometry, Motion=repeat)  # -> Geometry, Transform
move_4 = Move(Geometry=move_2.Geometry, Motion=repeat_2)  # -> Geometry, Transform
# Look at Rhino
# to preview results
pt_3 = Point(move_4.Geometry)
# Look at Rhino
# to preview results
pt_4 = Point(move_3.Geometry)
