# Grasshopper definition Pf_08-Mesh.gh (Grasshopper 0.9.76)
# plug-ins: Pufferfish

# 12-Reduce Mesh By Faces
number_slider = Slider(20, range=0..100)
# Change the slider value to move the
# mirror plane and see how it effects the
# mirror cutting.
# Change the slider value to rotate the
# mirror plane and see how it effects the
# mirror cutting.
number_slider_2 = Slider(-2.6, range=-100..100)
# Msh @
# index 0
number_slider_3 = Slider(1.5, range=0..2)
# Ajust the weights, If one has all the weight
# then the result is that mesh. If all have same
# weight then the result is same as average.
number_slider_4 = Slider(0.409, range=0..1)
# 09-Parameter Surface Mesh
number_slider_5 = Slider(6, range=0..10)
# Flips the mirror direction to
# cut the other side instead.
number_slider_6 = Slider(0, range=0..10)
# 08-Offset Mesh
number_slider_7 = Slider(5.625, range=0..10)
# 03-Tween Two Meshes
# Factor from 0 to 1 determines the mesh
# between inputs. So 0.5 will be halfway
# between the inputs. You can use lists /
# mutiple factors as well.
number_slider_8 = Slider(0.5, range=0..1)
# 04-Tween Consecutive Meshes
number_slider_9 = Slider(0.415, range=0..1)
# Determines how the tween is interpolated.
# Factor from 0 to the last index. This
# can be considered like a timeline.
# This lets each mesh have an equally
# controllable section of the slider between.
# As opposed to going from 0 to 1 where
# it would be hard to control with many inputs.
# This lets you easily pinpoint your location.
# You can use lists / mutiple factors as well.
number_slider_10 = Slider(0, range=0..3)
# 11-Rebuild Mesh
# Many options to
# clean and fix a mesh
number_slider_11 = Slider(0, range=0..1)
# Determines how the tween is interpolated.
# Factor from 0 to 1 determines the mesh
# between each input as a list. So 0.5 will
# be halfway between each input
# consecutively through the list.
# You can use lists / mutiple factors as well.
number_slider_12 = Slider(0, range=0..3)
# The mesh that will get
# trimmed (turn its preview
# on to see the original mesh)
# Plane that trims
# Look at Rhino window
# to preview input
O = Origin(Point(498.194458, 536.5426636, 2.482121468))
# 06-Close Mesh
# Try and make quads
# 07-Mirror Cut Mesh
toggle = BooleanToggle(True)
# 10-Polyline To Mesh
# Try and make quads
toggle_2 = BooleanToggle(True)
# Different types of
# mesh trimming
# 13-Trim Mesh With Plane
toggle_3 = BooleanToggle(False)
mesh = Mesh(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)
# 14-Is Mesh Closed
mesh_2 = Mesh(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)
# 02-Weighted Average Mesh
# Multiple meshes input
mesh_3 = Mesh([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])
# Pf_08-Mesh
# 01-Average Mesh
# Multiple meshes input
mesh_4 = Mesh([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])
# Open mesh input
mesh_5 = Mesh(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)
# Closed mesh
yz = YZPlane(Origin=O)
# With weld you use a value for distance.
# If set to 0 there is no welding. If set
# greater then zero then vertices within that
# numbers proximity to eachother will weld.
# Try increasing the slider and see how the
# gap of the mesh welds together in Rhino.
toggle_4 = BooleanToggle(False)
mesh_6 = Mesh(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)
mesh_7 = Mesh(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)
mesh_8 = Mesh(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)
# 05-Tween Through Meshes
mesh_9 = Mesh(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)
mesh_10 = Mesh(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)
# Msh @
# index 1
# Msh @
# index 2
mesh_11 = Mesh(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)
# Offset mesh can do both sides and solid.
mesh_12 = Mesh(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)
crv = Curve(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)
mesh_13 = Mesh(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)
mesh_14 = Mesh(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)
# Enable mesh component to run reduce component.
mesh_15 = Mesh(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)  # disabled
# Triangulate
# Unlike grasshoppers native iso
# trim component, this component uses
# parameter values along the u and v
# surface domains. Here we use range
# components to generate the lists
# of parameters. The native grasshopper
# component uses a division value which
# always makes an even grid on surface.
# By using parameter values there can be
# more customization of the grid spacing.
toggle_5 = BooleanToggle(False)
# Opened mesh
# Look at Rhino window
# to preview input
number_slider_13 = Slider(0, range=0..10)
# Plane
yz_2 = YZPlane(Origin=Point(504.0497437, 172.2830658, 0))
X = UnitX(Factor=number_slider_2)
range = Range(Domain=Domain(0, 1), Steps=Slider(5, range=0..10))
range_2 = Range(Domain=Domain(0, 1), Steps=number_slider_5)
mesh_16 = Mesh(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)
mesh_17 = Mesh(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)
S = Surface(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)
# The reach distance determines how
# far from the mirror plane that the cutting
# reaches. Anything within that distance
# from the mirror plane will be additionally
# cut away. Set it to zero and the cutting will
# only happen exactly at the mirror plane.
number_slider_14 = Slider(2.724, range=0..10)
avrmsh = AverageMesh(Meshes=mesh_4)
wavmsh = WeightedAverageMesh(Meshes=mesh_3, Weights=[Slider(0.935, range=0..1), Slider(0.122, range=0..1), number_slider_4])
offmsh = OffsetMesh(Mesh=mesh_12, Distance=number_slider_7, BothSides=Toggle(True), CreateSolid=Toggle(True))
pline2msh = PolylineToMesh(Polyline=crv, Quadrangulate=toggle_2)
mshclsd = IsMeshClosed(Mesh=mesh_2)
clsmsh = CloseMesh(Mesh=mesh_5, Quadrangulate=toggle)  # -> Closed, R
mshclsd_2 = IsMeshClosed(Mesh=mesh)
twn2mshs = TweenTwoMeshes(MeshA=mesh_7, MeshB=mesh_6, Factor=number_slider_8)
move = Move(Geometry=yz_2, Motion=X)  # -> Geometry, Transform
# Flips the mirror direction to
# cut the other side instead.
# The offser distance determines how
# far to offset the cut. It does not do any
# additional cut removing like
# the reach plane, it just moves the
# actual cut away from the mirror plane.
# Set it to zero and there will be no
# additional gap in the mirror cut.
toggle_6 = BooleanToggle(False)
twnthrumshs = TweenThroughMeshes(Meshes=[mesh_9, mesh_10, mesh_11], Factor=number_slider_3, InterpolationType=number_slider_10)
# You can see a progress meter
# of the mesh reduction in the
# Rhino command line.
redumshfaces = ReduceMeshByFaces(
    Mesh=mesh_15,
    FaceCount=number_slider,
    Accuracy=Slider(1, range=0..10),
    FaceType=number_slider_6,
    Distort=Toggle(True),
    Normalize=toggle_3)  # -> Reduced, CountDifference
paramsrfmsh = ParameterSurfaceMesh(Surface=S, ParametersU=range_2, ParametersV=range, Triangulate=toggle_5)
twnconmshs = TweenConsecutiveMeshes(Meshes=[mesh_13, mesh_14, mesh_8], Factor=number_slider_9, InterpolationType=number_slider_12)
trimmshpln = TrimMeshWithPlane(Mesh=mesh_17, Plane=yz, Flip=Toggle(False), TrimType=number_slider_13)  # -> Trimmed, R
rebmsh = RebuildMesh(
    Mesh=mesh_16,
    RebuildNormals=Toggle(False),
    CullUnused=Toggle(False),
    IdenticalCombine=Toggle(False),
    WeldVertices=number_slider_11,
    UnifyNormals=Toggle(False),
    FlipNormals=toggle_4)
# Look at Rhino window
# to preview results
preview = CustomPreview(
    Geometry=wavmsh,
    Shader={ambient=RGB(0, 0, 0), diffuse=RGB(255, 105, 180), emission=RGB(76, 32, 54), shine=0.5, specular=RGB(255, 255, 255), transparency=0})
# Look at Rhino window
# to preview results
preview_2 = CustomPreview(
    Geometry=pline2msh,
    Shader={ambient=RGB(0, 0, 0), diffuse=RGB(255, 105, 180), emission=RGB(76, 32, 54), shine=0.5, specular=RGB(255, 255, 255), transparency=0})
# Pufferfish
# By: Michael Pryor
# Look at Rhino window
# to preview results
preview_3 = CustomPreview(
    Geometry=avrmsh,
    Shader={ambient=RGB(0, 0, 0), diffuse=RGB(255, 105, 180), emission=RGB(76, 32, 54), shine=0.5, specular=RGB(255, 255, 255), transparency=0})
# Using as the mirror plane
deplane = DeconstructPlane(Plane=move.Geometry)  # -> Origin, XAxis, YAxis, ZAxis
# Look at Rhino window
# to preview results
preview_4 = CustomPreview(
    Geometry=twn2mshs,
    Shader={ambient=RGB(0, 0, 0), diffuse=RGB(255, 105, 180), emission=RGB(76, 32, 54), shine=0.5, specular=RGB(255, 255, 255), transparency=0})
# Look at Rhino window
# to preview results
preview_5 = CustomPreview(
    Geometry=offmsh,
    Shader={ambient=RGB(0, 0, 0), diffuse=RGB(255, 105, 180), emission=RGB(76, 32, 54), shine=0.5, specular=RGB(255, 255, 255), transparency=0})
panel = Panel(range_2)
panel_2 = Panel(range)
panel_3 = Panel(mshclsd)
panel_4 = Panel(mshclsd_2)
# Look at Rhino window
# to preview results
# True if mesh was closed
panel_5 = Panel(clsmsh.R)
preview_6 = CustomPreview(
    Geometry=clsmsh.Closed,
    Shader={ambient=RGB(0, 0, 0), diffuse=RGB(255, 105, 180), emission=RGB(76, 32, 54), shine=0.5, specular=RGB(255, 255, 255), transparency=0})
panel_6 = Panel(trimmshpln.R)
# Look at Rhino window
# to preview results
preview_7 = CustomPreview(
    Geometry=twnconmshs,
    Shader={ambient=RGB(0, 0, 0), diffuse=RGB(255, 105, 180), emission=RGB(76, 32, 54), shine=0.5, specular=RGB(255, 255, 255), transparency=0})
# Look at Rhino window
# to preview results
preview_8 = CustomPreview(
    Geometry=twnthrumshs,
    Shader={ambient=RGB(0, 0, 0), diffuse=RGB(255, 105, 180), emission=RGB(76, 32, 54), shine=0.5, specular=RGB(255, 255, 255), transparency=0})
# This allows the start and end of the mesh
# to be altered on the surface so grids can
# exist only on parts of the surface.
# Look at Rhino window
# to preview results
preview_9 = CustomPreview(
    Geometry=paramsrfmsh,
    Shader={ambient=RGB(0, 0, 0), diffuse=RGB(255, 105, 180), emission=RGB(76, 32, 54), shine=0.5, specular=RGB(255, 255, 255), transparency=0})
# Look at Rhino window
# to preview results
preview_10 = CustomPreview(
    Geometry=trimmshpln.Trimmed,
    Shader={ambient=RGB(0, 0, 0), diffuse=RGB(255, 105, 180), emission=RGB(76, 32, 54), shine=0.5, specular=RGB(255, 255, 255), transparency=0})
# Look at Rhino window
# to preview results
# Face count difference
panel_7 = Panel(redumshfaces.CountDifference)
preview_11 = CustomPreview(
    Geometry=redumshfaces.Reduced,
    Shader={ambient=RGB(0, 0, 0), diffuse=RGB(255, 105, 180), emission=RGB(76, 32, 54), shine=0.5, specular=RGB(255, 255, 255), transparency=0})
# Look at Rhino window
# to preview results
preview_12 = CustomPreview(
    Geometry=rebmsh,
    Shader={ambient=RGB(0, 0, 0), diffuse=RGB(255, 105, 180), emission=RGB(76, 32, 54), shine=0.5, specular=RGB(255, 255, 255), transparency=0})
rot3d = Rotate3D(Geometry=move.Geometry, Angle=degrees(Slider(77, range=0..360)), Center=deplane.Origin, Axis=deplane.YAxis)  # -> Geometry, Transform
# Join makes the
# two mirror sides
# into one mesh.
# If true the entire input
# mesh is mirrored
# normally if it is mirror
# cut into non existance.
toggle_7 = BooleanToggle(False)
# Bulge factor for the connection mesh
# When mirror cuts have a reach or offset
# that is not zero, they can create a connection
# mesh between the mirror cut sides, which
# blends them together. There are various types.
number_slider_15 = Slider(-0.596, range=-1..1)
# The mesh that will get
# mirror cut (turn its preview
# on to see the original mesh)
mesh_18 = Mesh(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)
# Adjusting the start and end domains
# of the ranges positions the grid on
# specified parts of the surface.
number_slider_16 = Slider(0.537, range=0..1)
# Number of mesh face divisions
# along the connection mesh
number_slider_17 = Slider(4, range=0..10)
mircutmsh = MirrorCutMesh(
    Mesh=mesh_18,
    MirrorPlane=rot3d.Geometry,
    Reach=number_slider_14,
    Offset=Slider(24.145, range=0..100),
    Flip=toggle_6,
    Join=Toggle(True),
    Keep=toggle_7,
    ConnectionType=Slider(2, range=0..10),
    Bulge=number_slider_15,
    Divisions=number_slider_17,
    WeldTolerance=0.01)  # -> MirrorCut, SplitIndex, ReachPlane, OffsetPlane, Intersected
dom = ConstructDomain(DomainStart=Slider(0.25, range=0..1), DomainEnd=Slider(0.801, range=0..1))
dom_2 = ConstructDomain(DomainStart=Slider(0.13, range=0..1), DomainEnd=number_slider_16)
# Welding tolerance for join. You usually
# won't need to change this unless for
# some reason the mesh does not weld.
panel_8 = Panel(mircutmsh.Intersected)
range_3 = Range(Domain=dom_2, Steps=Slider(5, range=0..10))
range_4 = Range(Domain=dom, Steps=Slider(6, range=0..10))
S_2 = Surface(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)
# Triangulate
toggle_8 = BooleanToggle(False)
# Look at Rhino window
# to preview results
# Result mirror cut mesh
preview_13 = CustomPreview(
    Geometry=mircutmsh.MirrorCut,
    Shader={ambient=RGB(0, 0, 0), diffuse=RGB(255, 105, 180), emission=RGB(76, 32, 54), shine=0.5, specular=RGB(255, 255, 255), transparency=0})
preview_14 = CustomPreview(Geometry=mircutmsh.ReachPlane, Shader=ColourSwatch(SwatchColor=RGB(10, 255, 210)))
# Reach plane (this plane essentially does the cutting)
# Offset plane (offsets the cuts from the mirror plane)
preview_15 = CustomPreview(Geometry=mircutmsh.OffsetPlane, Shader=ColourSwatch(SwatchColor=RGB(10, 22, 255)))
paramsrfmsh_2 = ParameterSurfaceMesh(Surface=S_2, ParametersU=range_4, ParametersV=range_3, Triangulate=toggle_8)
# Using unevenly spaced parameter
# values will result in uneven spaced
# grids. The grid spacing can be
# controlled with custom values
# such as values from graph mappers.
# Look at Rhino window
# to preview results
preview_16 = CustomPreview(
    Geometry=paramsrfmsh_2,
    Shader={ambient=RGB(0, 0, 0), diffuse=RGB(255, 105, 180), emission=RGB(76, 32, 54), shine=0.5, specular=RGB(255, 255, 255), transparency=0})
# Splitting the list
number_slider_18 = Slider(20, range=-20..20)
range_5 = Range(Domain=Domain(0, 1), Steps=Slider(10, range=0..10))
range_6 = Range(Domain=Domain(0, 1), Steps=Slider(10, range=0..10))
S_3 = Surface(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)
graph = GraphMapper(
    range_6,
    x0=0,
    x1=1,
    y0=0,
    y1=1,
    container_name="Bezier",
    cpx=[0, 0.7955461144, 0.533728838, 1],
    cpy=[0, 0.104544878, 0.4652709961, 1])
# Graphmappers creating gradient grid spacing.
graph_2 = GraphMapper(
    range_5,
    x0=0,
    x1=1,
    y0=0,
    y1=1,
    container_name="Bezier",
    cpx=[0, 0.161364466, 0.3795443475, 1],
    cpy=[0, 0.5532698631, 0.9518182874, 1])
yz_3 = YZPlane(Origin=Point(504.0497437, 352.1925049, 0))
X_2 = UnitX(Factor=number_slider_18)
move_2 = Move(Geometry=yz_3, Motion=X_2)  # -> Geometry, Transform
# Triangulate
toggle_9 = BooleanToggle(False)
paramsrfmsh_3 = ParameterSurfaceMesh(Surface=S_3, ParametersU=graph, ParametersV=graph_2, Triangulate=toggle_9)
deplane_2 = DeconstructPlane(Plane=move_2.Geometry)  # -> Origin, XAxis, YAxis, ZAxis
# Look at Rhino window
# to preview results
preview_17 = CustomPreview(
    Geometry=paramsrfmsh_3,
    Shader={ambient=RGB(0, 0, 0), diffuse=RGB(255, 105, 180), emission=RGB(76, 32, 54), shine=0.5, specular=RGB(255, 255, 255), transparency=0})
rot3d_2 = Rotate3D(Geometry=move_2.Geometry, Angle=degrees(Slider(204, range=0..360)), Center=deplane_2.Origin, Axis=deplane_2.YAxis)  # -> Geometry, Transform
mesh_19 = Mesh(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)
mircutmsh_2 = MirrorCutMesh(
    Mesh=mesh_19,
    MirrorPlane=rot3d_2.Geometry,
    Reach=Slider(5.648, range=0..10),
    Offset=Slider(47.976, range=0..100),
    Flip=Toggle(False),
    Join=Toggle(False),
    Keep=Toggle(False),
    ConnectionType=Slider(1, range=0..10),
    Bulge=Slider(-0.634, range=-1..1),
    Divisions=Slider(4, range=0..10),
    WeldTolerance=0.01)  # -> MirrorCut, SplitIndex, ReachPlane, OffsetPlane, Intersected
split = SplitList(List=mircutmsh_2.MirrorCut, Index=mircutmsh_2.SplitIndex)  # -> ListA, ListB
# If  join is false you can use this index
# to split the list at the mirror seam.
swatch = ColourSwatch(SwatchColor=RGB(10, 22, 255))
preview_18 = CustomPreview(Geometry=split.ListA, Shader=ColourSwatch(SwatchColor=RGB(10, 255, 210)))
# Look at Rhino window
# to preview results
preview_19 = CustomPreview(Geometry=split.ListB, Shader=swatch)
