# Grasshopper definition Pf_09-Twisted Box.gh (Grasshopper 0.9.76)
# plug-ins: Pufferfish

# 13-Twisted Box Curve
# This component uses parameter values
# along the curve domain. Here we use a
# range component to generate the lists
# of parameters. By using parameter
# values there can be more customization
# of the spacing.
number_slider = Slider(20, range=0..100)
# 22-Domain Twisted Box
number_slider_2 = Slider(-11, range=-30..30)
# 29-Transform Twisted Box
number_slider_3 = Slider(46, range=0..100)
# Factor from 0 to 1 determines the twisted box
# between inputs. So 0.5 will be halfway
# between the inputs. You can use lists /
# mutiple factors as well.
number_slider_4 = Slider(0.5, range=0..1)
# Non quadrilateral
# Direction - can be Vector, Curve, or Point
number_slider_5 = Slider(42, range=0..100)
# 16-Twisted Box Loft
number_slider_6 = Slider(5, range=0..10)
# 23-Reference Twisted Box
number_slider_7 = Slider(10, range=-30..30)
# TB @
# index 0
number_slider_8 = Slider(0.499, range=0..2)
# 25-Deconstruct Twisted Box
# Change the integer to select
# which part of the twisted box
# to deconstruct. Either the
# corner points, edge lines,
# or face polylines.
number_slider_9 = Slider(0, range=0..10)
# Ajust the weights, If one has all the weight
# then the result is that twisted box. If all have
# same weight then the result is same as average.
# 03-Tween Two Twisted Boxes
number_slider_10 = Slider(0.93, range=0..1)
number_slider_11 = Slider(16, range=0..100)
# 15-Twisted Box Extrude
panel = Panel("1")
# 21-Center Twisted Box
number_slider_12 = Slider(14, range=0..100)
# Vector for each corner point to deform
# (in this case 2 vectors because 2 points)
# 27-Subdivide Twisted Box
number_slider_13 = Slider(40, range=0..100)
# 18-Twisted Box Pipe Variable
number_slider_14 = Slider(28, range=0..100)
# Determines how the tween is interpolated.
# Factor from 0 to the last index. This
# can be considered like a timeline.
# This lets each twisted box have an equally
# controllable section of the slider between.
# As opposed to going from 0 to 1 where
# it would be hard to control with many inputs.
# This lets you easily pinpoint your location.
# You can use lists / mutiple factors as well.
number_slider_15 = Slider(0, range=0..3)
# 19-Twisted Box Sweep
panel_2 = Panel("1")
# Determines how the tween is interpolated.
# Factor from 0 to 1 determines the twisted box
# between each input as a list. So 0.5 will
# be halfway between each input
# consecutively through the list.
# You can use lists / mutiple factors as well.
number_slider_16 = Slider(0, range=0..3)
# 12-Twisted Box Array
# Box defines the size of the array.
# Any box can be used.
number_slider_17 = Slider(50, range=0..100)
# Decides if Parameters T are used
# as normalized lengths (.5 = middle of curves length)
# or as curve parameters (.5 = middle of the curves domain)
number_slider_18 = Slider(15, range=0..100)
# 14-Twisted Box Curve Variable
number_slider_19 = Slider(0, range=0..1000)
# 30-Evaluate Twisted Box
number_slider_20 = Slider(0.574, range=0..1)
# Set to true to
# make a closed loft.
toggle = BooleanToggle(False)
# 17-Twisted Box Pipe
number_slider_21 = Slider(13, range=0..100)
# This component uses parameter values
# along the mesh thickness domain. Here we
# use a range component to generate the lists
# of parameters. By using parameter values
# there can be more customization of the spacing.
number_slider_22 = Slider(2, range=0..10)
# This component uses parameter values
# along the surface domain. Here we use
# range components to generate the lists
# of parameters. By using parameter
# values there can be more customization
# of the spacing.
number_slider_23 = Slider(2, range=0..10)
# This component uses parameter values
# along the box domain. Here we use
# range components to generate the lists
# of parameters. By using parameter
# values there can be more customization
# of the spacing.
number_slider_24 = Slider(5, range=0..10)
# 08-Twisted Box Two Meshes
# This component uses parameter values
# between the meshes thickness domain. Here we
# use a range component to generate the lists
# of parameters. By using parameter values
# there can be more customization of the spacing.
number_slider_25 = Slider(2, range=0..10)
# 09-Twisted Box Two Surfaces
number_slider_26 = Slider(3, range=0..100)
# w Parameter from 0 to the last index.
# This lets each mesh have an equally
# controllable section of parameters between.
# As opposed to going from 0 to 1 where
# it would be hard to control with many meshes.
# This lets you easily pinpoint your location.
# So if there is 3 meshes, parameters
# from 0 to 1 would be between mesh 1 and 2.
# Parameters from 1 to 2 would be between
# mesh 2 and 3
number_slider_27 = Slider(6, range=0..10)
# 31-Twisted Box Centers
# Change the integer to select
# which part of the twisted box
# to get the center of. Either the
# corner points, edge lines,
# or face polylines.
number_slider_28 = Slider(0, range=0..10)
# 10-Twisted Box Through Meshes
mesh = Mesh([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])
# Resolution is the subdivision
# iteration. Be careful as resolution
# is exponetial and can quickly
# generate a lot of geometry.
# 28-Thicken Twisted Box
number_slider_29 = Slider(2, range=0..10)
# 11-Twisted Box Through Surfaces
srf = Surface([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])
# Determines how the twisted boxes are interpolated.
number_slider_30 = Slider(1, range=0..3)
addition = Addition(A=number_slider_11, B=panel)
# 32-Twisted Box Corners
# Input can be
# a box also
# Faster than converting to Brep
# and keeps the corner point order
tbox = TwistedBox({C=Point(9.434291702, -451.3340058, 3.42147918), C=Point(29.08855508, -451.3340058, 10.31291601), C=Point(29.08855508, -424.1094375, 10.31291601), C=Point(9.434291702, -424.1094375, 3.42147918), C=Point(-18.21964268, -457.0595706, 31.31779612), C=Point(4.728705022, -454.1233813, 43.10665076), C=Point(15.58320709, -429.156265, 43.10665076), C=Point(-2.441331509, -421.320062, 31.31779612)})
# 24-Construct Twisted Box
# Each list of 8 points
# will make a twisted box
pt = Point([Point(36.799002, -262.8733535, -6.770521539), Point(67.13795178, -258.5800082, -1.834673377), Point(60.67299073, -235.0701612, -5.130762752), Point(47.38449389, -210.626525, -10.85627703), Point(36.01440544, -255.6552959, 22.47890964), Point(53.94523378, -254.887404, 19.32843667), Point(61.14259391, -228.1635375, 18.89532396), Point(33.8362313, -228.9942799, 11.84655581)])
# 33-Twisted Box Volume
# Input can be
# a box also
tbox_2 = TwistedBox({C=Point(80.68216627, -450.7589373, 3.42147918), C=Point(100.3364296, -463.9627252, 10.31291601), C=Point(115.6246692, -423.5343691, 10.31291601), C=Point(80.68216627, -423.5343691, 3.42147918), C=Point(62.20306794, -456.4845022, 31.31779612), C=Point(81.04492082, -453.5483129, 43.10665076), C=Point(91.89942289, -428.5811965, 43.10665076), C=Point(73.87488428, -420.7449935, 31.31779612)})
# Multiple types
# of curves work.
crv = Curve([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])
addition_2 = Addition(A=number_slider_14, B=panel_2)
# Pf_09-Twisted Box
# 01-Average Twisted Box
# Inputs can be
# a box also
tbox_3 = TwistedBox({C=Point(0.2767163542, -2.885417957, 2.848093993), C=Point(11.98361996, -0.6798435998, 8.131637228), C=Point(11.77944181, 5.034487917, -0.8745563705), C=Point(0.2767163542, 7.042854922, -1.296386917), C=Point(0.8508071702, 3.732387969, 18.70131772), C=Point(12.35353262, 7.113097098, 16.87352001), C=Point(12.19686514, 11.70660347, 9.87581275), C=Point(0.9104268514, 12.02702404, 17.17204554)})
tbox_4 = TwistedBox({C=Point(-4.853529641, 37.64169373, 14.8223935), C=Point(-0.5781370408, 30.93001684, 14.19478221), C=Point(7.448365413, 37.40224869, 15.27984079), C=Point(1.090906942, 46.08260893, 17.84926463), C=Point(-11.80844474, 30.04218679, 22.30910542), C=Point(-1.567506245, 31.98562418, 28.50821515), C=Point(-8.327535232, 39.75976106, 31.04952635), C=Point(-12.47271797, 37.52423645, 26.14588654)})
# 02-Weighted Average Twisted Box
tbox_5 = TwistedBox({C=Point(31.55401253, 37.64169373, 7.15216462), C=Point(35.82940513, 30.93001684, 6.52455333), C=Point(43.85590758, 37.40224869, 7.609611906), C=Point(37.49844911, 46.08260893, 3.013852335), C=Point(23.58224597, 41.23451945, 14.63887654), C=Point(21.26124436, 31.07249595, 20.83798627), C=Point(34.36312396, 34.1528845, 23.37929747), C=Point(33.97499093, 43.56728227, 18.47565766)})
# Inputs can be
# a box also
tbox_6 = TwistedBox({C=Point(95.27671635, -2.885417957, 2.848093993), C=Point(106.98362, -0.6798435998, 8.131637228), C=Point(106.7794418, 5.034487917, -0.8745563705), C=Point(95.27671635, 7.042854922, -1.296386917), C=Point(95.85080717, 3.732387969, 18.70131772), C=Point(107.3535326, 7.113097098, 16.87352001), C=Point(107.1968651, 11.70660347, 9.87581275), C=Point(95.91042685, 12.02702404, 17.17204554)})
tbox_7 = TwistedBox({C=Point(90.14647036, 37.64169373, 14.8223935), C=Point(94.42186296, 30.93001684, 14.19478221), C=Point(102.4483654, 37.40224869, 15.27984079), C=Point(96.09090694, 46.08260893, 17.84926463), C=Point(83.19155526, 30.04218679, 22.30910542), C=Point(93.43249375, 31.98562418, 28.50821515), C=Point(86.67246477, 39.75976106, 31.04952635), C=Point(82.52728203, 37.52423645, 26.14588654)})
tbox_8 = TwistedBox({C=Point(126.5540125, 37.64169373, 7.15216462), C=Point(130.8294051, 30.93001684, 6.52455333), C=Point(138.8559076, 37.40224869, 7.609611906), C=Point(132.4984491, 46.08260893, 3.013852335), C=Point(118.582246, 41.23451945, 14.63887654), C=Point(116.2612444, 31.07249595, 20.83798627), C=Point(129.363124, 34.1528845, 23.37929747), C=Point(128.9749909, 43.56728227, 18.47565766)})
# Inputs can be
# a box also
tbox_9 = TwistedBox({C=Point(190.1464704, 37.64169373, 14.8223935), C=Point(194.421863, 30.93001684, 14.19478221), C=Point(202.4483654, 37.40224869, 15.27984079), C=Point(196.0909069, 46.08260893, 17.84926463), C=Point(183.1915553, 30.04218679, 22.30910542), C=Point(193.4324938, 31.98562418, 28.50821515), C=Point(186.6724648, 39.75976106, 31.04952635), C=Point(182.527282, 37.52423645, 26.14588654)})
tbox_10 = TwistedBox({C=Point(226.5540125, 37.64169373, 7.15216462), C=Point(230.8294051, 30.93001684, 6.52455333), C=Point(238.8559076, 37.40224869, 7.609611906), C=Point(232.4984491, 46.08260893, 3.013852335), C=Point(218.582246, 41.23451945, 14.63887654), C=Point(216.2612444, 31.07249595, 20.83798627), C=Point(229.363124, 34.1528845, 23.37929747), C=Point(228.9749909, 43.56728227, 18.47565766)})
# 04-Tween Consecutive Twisted Boxes
# Inputs can be
# a box also
tbox_11 = TwistedBox({C=Point(319.2767164, -2.885417957, 2.848093993), C=Point(330.98362, -0.6798435998, 8.131637228), C=Point(330.7794418, 5.034487917, -0.8745563705), C=Point(319.2767164, 7.042854922, -1.296386917), C=Point(319.8508072, 3.732387969, 18.70131772), C=Point(331.3535326, 7.113097098, 16.87352001), C=Point(331.1968651, 11.70660347, 9.87581275), C=Point(319.9104269, 12.02702404, 17.17204554)})
tbox_12 = TwistedBox({C=Point(314.1464704, 37.64169373, 14.8223935), C=Point(318.421863, 30.93001684, 14.19478221), C=Point(326.4483654, 37.40224869, 15.27984079), C=Point(320.0909069, 46.08260893, 17.84926463), C=Point(307.1915553, 30.04218679, 22.30910542), C=Point(317.4324938, 31.98562418, 28.50821515), C=Point(310.6724648, 39.75976106, 31.04952635), C=Point(306.527282, 37.52423645, 26.14588654)})
tbox_13 = TwistedBox({C=Point(350.5540125, 37.64169373, 7.15216462), C=Point(354.8294051, 30.93001684, 6.52455333), C=Point(362.8559076, 37.40224869, 7.609611906), C=Point(356.4984491, 46.08260893, 3.013852335), C=Point(342.582246, 41.23451945, 14.63887654), C=Point(340.2612444, 31.07249595, 20.83798627), C=Point(353.363124, 34.1528845, 23.37929747), C=Point(352.9749909, 43.56728227, 18.47565766)})
# 05-Tween Through Twisted Boxes
# Inputs can be
# a box also
tbox_14 = TwistedBox({C=Point(444.2767164, -2.885417957, 2.848093993), C=Point(455.98362, -0.6798435998, 8.131637228), C=Point(455.7794418, 5.034487917, -0.8745563705), C=Point(444.2767164, 7.042854922, -1.296386917), C=Point(444.8508072, 3.732387969, 18.70131772), C=Point(456.3535326, 7.113097098, 16.87352001), C=Point(456.1968651, 11.70660347, 9.87581275), C=Point(444.9104269, 12.02702404, 17.17204554)})
tbox_15 = TwistedBox({C=Point(439.1464704, 37.64169373, 14.8223935), C=Point(443.421863, 30.93001684, 14.19478221), C=Point(451.4483654, 37.40224869, 15.27984079), C=Point(445.0909069, 46.08260893, 17.84926463), C=Point(432.1915553, 30.04218679, 22.30910542), C=Point(442.4324938, 31.98562418, 28.50821515), C=Point(435.6724648, 39.75976106, 31.04952635), C=Point(431.527282, 37.52423645, 26.14588654)})
# TB@
# index 1
# TB @
# index 2
tbox_16 = TwistedBox({C=Point(475.5540125, 37.64169373, 7.15216462), C=Point(479.8294051, 30.93001684, 6.52455333), C=Point(487.8559076, 37.40224869, 7.609611906), C=Point(481.4984491, 46.08260893, 3.013852335), C=Point(467.582246, 41.23451945, 14.63887654), C=Point(465.2612444, 31.07249595, 20.83798627), C=Point(478.363124, 34.1528845, 23.37929747), C=Point(477.9749909, 43.56728227, 18.47565766)})
# Look at Rhino window
# to preview input
# Brep that was initially made with a
# Rhino Box.
geo = Geometry(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)
# 20-2Pt Twisted Box
pt_2 = Point(Point(-0.7132974382, -148.0944444, 0))
pt_3 = Point(Point(17.38468439, -162.7949443, 27.36352223))
# Decides if Parameters U are used
# as normalized lengths (.5 = middle of curves length)
# or as curve parameters (.5 = middle of the curves domain)
number_slider_31 = Slider(30, range=0..100)
# 06-Twisted Box Mesh
number_slider_32 = Slider(30, range=0..100)
# 07-Twisted Box Surface
number_slider_33 = Slider(10, range=0..100)
lng = ListLength(List=srf)  # -> expr("x-1", Length)
lng_2 = ListLength(List=mesh)  # -> expr("x-1", Length)
# Determines how the twisted boxes are interpolated.
number_slider_34 = Slider(1, range=0..3)
# Decides whether to use the t parameters
# as normalized lengths or curve domains.
toggle_2 = BooleanToggle(True)
# 26-Deform Twisted Box
# Input can be
# a box also
tbox_17 = TwistedBox({C=Point(-3.584041856, -627.4952361, 3.638681958), C=Point(35.05237618, -627.4952361, 3.638681958), C=Point(35.05237618, -592.621845, 3.638681958), C=Point(-3.584041856, -592.621845, 3.638681958), C=Point(-3.584041856, -627.4952361, 35.43837563), C=Point(35.05237618, -627.4952361, 35.43837563), C=Point(35.05237618, -592.621845, 35.43837563), C=Point(-3.584041856, -592.621845, 35.43837563)})
# Corner points to deform,
# or points that deform the
# closest corner point.
pt_4 = Point([Point(-5.50551615, -629.4579956, 0), Point(26.87759787, -594.7407118, 51.55892794)])
# Thickness factor
# This component uses parameter values
# along the thickness domain. Here we use
# a range component to generate the lists
# of parameters. By using parameter
# values there can be more customization
# of the spacing.
number_slider_35 = Slider(0.823, range=0..1)
# Surface
srf_2 = Surface(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)
# The curve should be quadrilateral. If it
# is not, it will be converted. Triangles are
# also acceptable. Curves can be opened
# or closed. Can be surfaces also.
# Quadrilateral
crv_2 = Curve(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)
# Triangle
crv_3 = Curve(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)
crv_4 = Curve(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)
# Opened
crv_5 = Curve(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)
# Input can be
# a box also
tbox_18 = TwistedBox({C=Point(-8.683444932, -370.2027664, 0), C=Point(10.97081845, -370.2027664, 0), C=Point(10.97081845, -342.9781981, 0), C=Point(-8.683444932, -342.9781981, 0), C=Point(-18.21964268, -375.9283312, 32.79373475), C=Point(4.728705022, -372.9921419, 32.79373475), C=Point(15.58320709, -348.0250256, 32.79373475), C=Point(-2.441331509, -340.1888226, 32.79373475)})
range = Range(Domain=Domain(0, 1), Steps=number_slider)
# Rail curves
crv_6 = Curve(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)
crv_7 = Curve(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)
crv_8 = Curve(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)
crv_9 = Curve(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)
range_2 = Range(Domain=Domain(0, 1), Steps=Slider(8, range=0..10))
# Input can be
# a box also
tbox_19 = TwistedBox({C=Point(-63.200998, -262.8733535, -6.770521539), C=Point(-32.86204822, -258.5800082, -1.834673377), C=Point(-39.32700927, -235.0701612, -5.130762752), C=Point(-52.61550611, -210.626525, -10.85627703), C=Point(-63.98559456, -255.6552959, 22.47890964), C=Point(-46.05476622, -254.887404, 19.32843667), C=Point(-38.85740609, -228.1635375, 18.89532396), C=Point(-66.1637687, -228.9942799, 11.84655581)})
range_3 = Range(Domain=Domain(0, 1), Steps=number_slider_6)
range_4 = Range(Domain=Domain(0, 1), Steps=Slider(3, range=0..10))
# This component uses parameter values
# along the extrusion domain. Here we use a
# range component to generate the lists
# of parameters. By using parameter
# values there can be more customization
# of the spacing.
Z = UnitZ(Factor=number_slider_5)
crv_10 = Curve(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)
# All transformation components have an
# X output with transform data. This is the
# data the Transform Twisted Box component
# uses. The components with transform data
# are components like Move, Scale, Rotate,
# Project, Mirror, Orient, Array, and other
# components in Grasshoppers Transform tab.
Z_2 = UnitZ(Factor=number_slider_3)
item = ListItem(List=srf, Index=0, Wrap=True)  # -> Item, Item1
X = UnitX(Factor=Slider(-36, range=-100..100))
# Input can be
# a box also
tbox_20 = TwistedBox({C=Point(-63.200998, -327.8733535, -6.770521539), C=Point(-32.86204822, -323.5800082, -1.834673377), C=Point(-39.32700927, -300.0701612, -5.130762752), C=Point(-52.61550611, -275.626525, -10.85627703), C=Point(-63.98559456, -320.6552959, 22.47890964), C=Point(-46.05476622, -319.887404, 19.32843667), C=Point(-38.85740609, -293.1635375, 18.89532396), C=Point(-66.1637687, -293.9942799, 11.84655581)})
Z_3 = UnitZ(Factor=number_slider_13)
# Input can be
# a box also
tbox_21 = TwistedBox({C=Point(-13.50944187, -703.3949996, 0), C=Point(27.88634463, -703.3949996, 0), C=Point(27.88634463, -679.2792878, 0), C=Point(-13.50944187, -679.2792878, 0), C=Point(-3.885490883, -711.9873967, 24.87455473), C=Point(30.62051802, -691.3954473, 34.82031316), C=Point(18.26239364, -670.6868907, 34.82031316), C=Point(-16.24361526, -691.2788401, 24.87455473)})
wavtbox = WeightedAverageTwistedBox(TwistedBoxes=[tbox_6, tbox_7, tbox_8], Weights=[Slider(0.36, range=0..1), Slider(0.13, range=0..1), number_slider_10])
avrtbox = AverageTwistedBox(TwistedBoxes=[tbox_3, tbox_4, tbox_5])
reftbox = ReferenceTwistedBox(Polysurface=geo)
_2pttbox = _2PtTwistedBox(PointA=pt_2, PointB=pt_3, Plane=PlaneXY(0, 0, 0))
centbox = CenterTwistedBox(Plane=PlaneXY(-57.1195639, -161.453227, 0), X=number_slider_12, Y=Slider(15, range=0..100), Z=Slider(12, range=0..100))
tbox_corners = TwistedBoxCorners(TwistedBox=tbox)  # -> CornerA, CornerB, CornerC, CornerD, CornerE, CornerF, CornerG, CornerH
# Faster than converting to Brep
tboxvol = TwistedBoxVolume(TwistedBox=tbox_2)  # -> Volume, Centroid
twnthrutboxs = TweenThroughTwistedBoxes(TwistedBoxes=[tbox_14, tbox_15, tbox_16], Factor=number_slider_8, InterpolationType=number_slider_15)
tboxloft = TwistedBoxLoft(Sections=crv, Closed=toggle)
cotbox = ConstructTwistedBox(Corners=pt)
twncontboxs = TweenConsecutiveTwistedBoxes(TwistedBoxes=[tbox_11, tbox_12, tbox_13], Factor=Slider(0.5, range=0..1), InterpolationType=number_slider_16)
range_5 = Range(Domain=Domain(0, 1), Steps=number_slider_24)
range_6 = Range(Domain=Domain(0, 1), Steps=Slider(2, range=0..10))
range_7 = Range(Domain=Domain(0, 1), Steps=number_slider_22)
range_8 = Range(Domain=Domain(0, 1), Steps=number_slider_23)
range_9 = Range(Domain=Domain(0, 1), Steps=Slider(2, range=0..10))
# w Parameter from 0 to the last index.
# This lets each surface have an equally
# controllable section of parameters between.
# As opposed to going from 0 to 1 where
# it would be hard to control with many surfaces.
# This lets you easily pinpoint your location.
# So if there is 3 surfaces, parameters
# from 0 to 1 would be between surface 1 and 2.
# Parameters from 1 to 2 would be between
# surface 2 and 3
range_10 = Range(Domain=lng, Steps=Slider(10, range=0..10))
range_11 = Range(Domain=Domain(0, 1), Steps=Slider(6, range=0..10))
# Look at Rhino window
# to preview results
preview = CustomPreview(Geometry=crv, Shader=ColourSwatch(SwatchColor=RGB(255, 0, 255)))
range_12 = Range(Domain=Domain(0, 1), Steps=Slider(5, range=0..10))
range_13 = Range(Domain=Domain(0, 1), Steps=Slider(6, range=0..10))
range_14 = Range(Domain=Domain(0, 1), Steps=number_slider_25)
range_15 = Range(Domain=Domain(0, 1), Steps=Slider(6, range=0..10))
range_16 = Range(Domain=lng_2, Steps=number_slider_27)
range_17 = Range(Domain=Domain(0, 1), Steps=Slider(6, range=0..10))
range_18 = Range(Domain=Domain(0, 1), Steps=Slider(3, range=0..100))
range_19 = Range(Domain=Domain(0, 1), Steps=number_slider_21)
twn2tboxs = TweenTwoTwistedBoxes(TwistedBoxA=tbox_9, TwistedBoxB=tbox_10, Factor=number_slider_4)
range_20 = Range(Domain=Domain(0, 1), Steps=Slider(3, range=0..100))
range_21 = Range(Domain=Domain(0, 1), Steps=number_slider_26)
range_22 = Range(Domain=Domain(0, 1), Steps=Slider(3, range=0..100))
box = CenterBox(Base=PlaneXY(1628.048772, 71.39929591, 0), X=number_slider_17, Y=Slider(58, range=0..100), Z=Slider(43, range=0..100))
dom = ConstructDomain(DomainStart=Slider(-6, range=-30..30), DomainEnd=number_slider_7)
dom_2 = ConstructDomain(DomainStart=number_slider_2, DomainEnd=Slider(16, range=-30..30))
dom_3 = ConstructDomain(DomainStart=Slider(-18, range=-30..30), DomainEnd=Slider(29, range=-30..30))
mesh_2 = Mesh(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)
srf_3 = Surface(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)
srf_4 = Surface(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)
srf_5 = Surface(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)
mesh_3 = Mesh(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)
mesh_4 = Mesh(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)
crv_11 = Curve(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)
# Decides whether to have a
# twisted box in the center or not.
toggle_3 = BooleanToggle(True)
# Faster than converting to Brep
# 0 to 1 is inside the Brep form of the twisted box
# but converting to Brep is slow so we don't do that.
brep = Brep(tbox_19)
# Input can be
# a box also
tbox_22 = TwistedBox({C=Point(-8.140568303, -773.3943285, 0), C=Point(22.88415037, -773.3943285, 0), C=Point(22.88415037, -747.8405088, 0), C=Point(-8.140568303, -747.8405088, 0), C=Point(-8.140568303, -773.3943285, 26.13464867), C=Point(22.88415037, -773.3943285, 26.13464867), C=Point(22.88415037, -747.8405088, 26.13464867), C=Point(-8.140568303, -747.8405088, 26.13464867)})
move = Move(Motion=Z_2)  # -> Geometry, Transform
# Input can be
# a box also
tbox_23 = TwistedBox({C=Point(415.1203054, -211.7145157, 1.156565081), C=Point(435.3837311, -200.6285795, 9.479581455), C=Point(430.9927095, -186.1118553, 15.77316987), C=Point(423.0764437, -186.1118553, 0.8928165596), C=Point(411.2790807, -215.3821515, 20.74403083), C=Point(420.422878, -204.4398758, 39.74034011), C=Point(415.5975135, -182.4442196, 23.75699097), C=Point(392.3186956, -193.3864953, 25.02020467)})
merge = Merge(Data1=item.Item, Data2=item.Item1)
wires = BrepWireframe(Brep=box, Density=-1)
geo_2 = Geometry(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)
geo_3 = Geometry(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)
geo_4 = Geometry(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)
geo_5 = Geometry(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)
detbox = DeconstructTwistedBox(TwistedBox=tbox_18, DeconstructType=number_slider_9)
geo_6 = Geometry(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)
geo_7 = Geometry(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)
geo_8 = Geometry(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)
geo_9 = Geometry(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)
geo_10 = Geometry(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)
tboxsweep = TwistedBoxSweep(R¹=crv_6, R²=crv_7, R³=crv_8, R⁴=crv_9, t=range_2, N=toggle_2)
geo_11 = Geometry(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)
deformtbox = DeformTwistedBox(TwistedBox=tbox_17, Corners=pt_4, Motions=[X, Z_3])  # -> Deformed, Index
subdivtbox = SubdivideTwistedBox(TwistedBox=tbox_21, Resolution=number_slider_29)
evaltbox = EvaluateTwistedBox(
    TwistedBox=tbox_19,
    ParameterU=number_slider_20,
    ParameterV=Slider(0.248, range=0..1),
    ParameterW=Slider(0.785, range=0..1))  # -> Evaluation, R
# Faster than converting to Brep
tboxcents = TwistedBoxCenters(TwistedBox=tbox_20, CenterType=number_slider_28)
# Pufferfish
# By: Michael Pryor
geo_12 = Geometry(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)
range_23 = Range(Domain=Domain(0, 1), Steps=number_slider_11)
# This component has the same functionality
# as the regular Twisted Box Curve so be
# sure to see the notes above for that. The
# difference is that this component can have
# variable sizes and rotations of the twisted
# boxes along the curve. You can also use
# graph mappers for these lists.
series = Series(Start=1, Step=Slider(30, range=0..100), Count=addition)
# Look at Rhino window
# to preview inputs
preview_2 = CustomPreview(Geometry=[crv_6, crv_7, crv_8, crv_9], Shader=ColourSwatch(SwatchColor=RGB(255, 0, 255)))
series_2 = Series(Start=1, Step=Slider(1, range=0..5), Count=addition)
series_3 = Series(Start=1, Step=Slider(2, range=0..5), Count=addition)
range_24 = Range(Domain=Domain(0, 1), Steps=number_slider_14)
range_25 = Range(Domain=Domain(0, 1), Steps=Slider(6, range=0..100))
range_26 = Range(Domain=Domain(0, 1), Steps=Slider(2, range=0..100))
# This component has the same functionality
# as the regular Twisted Box Pipe so be
# sure to see the notes above for that. The
# difference is that this component can have
# variable sizes, thicknesses and rotations
# of the twisted box pipe. You can also use
# graph mappers for these lists.
series_4 = Series(Start=1, Step=Slider(12.8, range=0..100), Count=addition_2)
series_5 = Series(Start=0.05, Step=Slider(0.232, range=0..5), Count=addition_2)
crv_12 = Curve(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)
series_6 = Series(Start=1, Step=Slider(1, range=0..5), Count=addition_2)
# Variable version
# of this component
crv_13 = Curve(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)
# Look at Rhino window
# to preview inputs
preview_3 = CustomPreview(Geometry=[crv_2, crv_3, crv_4, crv_5], Shader=ColourSwatch(SwatchColor=RGB(255, 0, 255)))
panel_3 = Panel(tboxvol.Volume)
bbox = BoundingBox(Content=geo_11, Plane=PlaneXY(0, 0, 0))  # -> Box, Box_2
bbox_2 = BoundingBox(Content=geo_5, Plane=PlaneXY(0, 0, 0))  # -> Box, Box_2
bbox_3 = BoundingBox(Content=geo_6, Plane=PlaneXY(0, 0, 0))  # -> Box, Box_2
bbox_4 = BoundingBox(Content=geo_2, Plane=PlaneXY(0, 0, 0))  # -> Box, Box_2
bbox_5 = BoundingBox(Content=geo_4, Plane=PlaneXY(0, 0, 0))  # -> Box, Box_2
geo_13 = Geometry(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)
bbox_6 = BoundingBox(Content=geo_3, Plane=PlaneXY(0, 0, 0))  # -> Box, Box_2
tboxthrumshs = TwistedBoxThroughMeshes(Mesh=mesh, ParametersW=range_16, InterpolationType=number_slider_34)
tboxthrusrfs = TwistedBoxThroughSurfaces(Surface=srf, ParametersU=range_22, ParametersV=range_17, ParametersW=range_10, InterpolationType=number_slider_30)
# Look at Rhino window
# to preview results
preview_4 = CustomPreview(Geometry=wires, Shader=ColourSwatch(SwatchColor=RGB(255, 0, 255)))
bbox_7 = BoundingBox(Content=geo_7, Plane=PlaneXY(0, 0, 0))  # -> Box, Box_2
bbox_8 = BoundingBox(Content=geo_8, Plane=PlaneXY(0, 0, 0))  # -> Box, Box_2
tboxmsh = TwistedBoxMesh(Mesh=mesh_2, Thickness=number_slider_32, ParametersW=range_7)
bbox_9 = BoundingBox(Content=geo_12, Plane=PlaneXY(0, 0, 0))  # -> Box, Box_2
bbox_10 = BoundingBox(Content=geo_9, Plane=PlaneXY(0, 0, 0))  # -> Box, Box_2
bbox_11 = BoundingBox(Content=geo_10, Plane=PlaneXY(0, 0, 0))  # -> Box, Box_2
tbox2mshs = TwistedBoxTwoMeshes(MeshA=mesh_3, MeshB=mesh_4, ParametersW=range_14)
# Unlike grasshoppers native
# Blend Box component, This
# Twisted Box Two Surface component
# can also do layers of twisted boxes
# in the thickness {w} direction.
tbox2srfs = TwistedBoxTwoSurfaces(SurfaceA=srf_4, SurfaceB=srf_5, ParametersU=range_21, ParametersV=range_15, ParametersW=range_9)
domtbox = DomainTwistedBox(Plane=PlaneXY(110.3625391, -162.2494292, 0), X=dom_2, Y=dom_3, Z=dom)
# Unlike grasshoppers native
# Surface Box component, This
# Twisted Box Surface component
# can also do layers of twisted boxes
# in the thickness {w} direction.
tboxsrf = TwistedBoxSurface(Surface=srf_3, Thickness=number_slider_33, ParametersU=range_20, ParametersV=range_13, ParametersW=range_8)
tboxcrv = TwistedBoxCurve(
    Curve=crv_10,
    ParametersT=range,
    Normalized=Toggle(True),
    SizeX=number_slider_18,
    SizeY=Slider(15, range=0..100),
    Rotation=number_slider_19)
tboxextr = TwistedBoxExtrude(Profile=[crv_2, crv_3, crv_4, crv_5, srf_2], Direction=Z, ParametersT=range_3, Normalized=True)
tboxpipe = TwistedBoxPipe(
    Curve=crv_11,
    ParametersU=range_19,
    ParametersV=range_12,
    ParametersW=range_6,
    Normalized=Toggle(True),
    Diameter=number_slider_31,
    Thickness=Slider(8, range=0..100),
    Rotation=Slider(45, range=0..1000))
tboxarr = TwistedBoxArray(Box=box, ParametersX=range_18, ParametersY=range_11, ParametersZ=range_5)
thicktbox = ThickenTwistedBox(TwistedBox=tbox_22, ParametersW=range_4, Thickness=number_slider_35, Hollow=toggle_3)
# Faster than converting to Brep
trantbox = TransformTwistedBox(TwistedBox=tbox_23, Transform=move.Transform)
geo_14 = Geometry(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)
# Index of corner being deformed
panel_4 = Panel(deformtbox.Index)
geo_15 = Geometry(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)
panel_5 = Panel(detbox)
# Look at Rhino window
# to preview results
preview_5 = CustomPreview(Geometry=tboxvol.Centroid, Shader=ColourSwatch(SwatchColor=RGB(255, 255, 255)))
bbox_12 = BoundingBox(Content=geo_13, Plane=PlaneXY(0, 0, 0))  # -> Box, Box_2
geo_16 = Geometry(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)
geo_17 = Geometry(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)
# Look at Rhino window
# to preview results
preview_6 = CustomPreview(Geometry=cotbox, Shader=ColourSwatch(SwatchColor=RGB(255, 255, 255)))
# Look at Rhino window
# to preview results
preview_7 = CustomPreview(Geometry=wavtbox, Shader=ColourSwatch(SwatchColor=RGB(255, 255, 255)))
# Look at Rhino window
# to preview results
preview_8 = CustomPreview(Geometry=twn2tboxs, Shader=ColourSwatch(SwatchColor=RGB(255, 255, 255)))
tboxcrvvar = TwistedBoxCurveVariable(Curve=crv_12, ParametersT=range_23, Normalized=Toggle(True), SizesX=series_2, SizesY=series_3, Rotations=series)
# Look at Rhino window
# to preview results
preview_9 = CustomPreview(Geometry=centbox, Shader=ColourSwatch(SwatchColor=RGB(255, 255, 255)))
# Look at Rhino window
# to preview results
preview_10 = CustomPreview(Geometry=avrtbox, Shader=ColourSwatch(SwatchColor=RGB(255, 255, 255)))
# Look at Rhino window
# to preview results
preview_11 = CustomPreview(Geometry=twncontboxs, Shader=ColourSwatch(SwatchColor=RGB(255, 255, 255)))
# Look at Rhino window
# to preview results
preview_12 = CustomPreview(Geometry=twnthrutboxs, Shader=ColourSwatch(SwatchColor=RGB(255, 255, 255)))
geo_18 = Geometry(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)
geo_19 = Geometry(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)
geo_20 = Geometry(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)
geo_21 = Geometry(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)
geo_22 = Geometry(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)
geo_23 = Geometry(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)
geo_24 = Geometry(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)
# Look at Rhino window
# to preview results
preview_13 = CustomPreview(Geometry=_2pttbox, Shader=ColourSwatch(SwatchColor=RGB(255, 255, 255)))
# Look at Rhino window
# to preview results
preview_14 = CustomPreview(Geometry=tboxloft, Shader=ColourSwatch(SwatchColor=RGB(255, 255, 255)))
geo_25 = Geometry(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)
# Box Morphing
morph = BoxMorph(Geometry=geo_5, Reference=bbox_2.Box, Target=cotbox)
morph_2 = BoxMorph(Geometry=geo_6, Reference=bbox_3.Box, Target=deformtbox.Deformed)
# Box Morphing
morph_3 = BoxMorph(Geometry=geo_11, Reference=bbox.Box, Target=subdivtbox)
# Box Morphing
morph_4 = BoxMorph(Geometry=geo_2, Reference=bbox_4.Box, Target=centbox)
geo_26 = Geometry(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)
# Box Morphing
morph_5 = BoxMorph(Geometry=geo_4, Reference=bbox_5.Box, Target=_2pttbox)
bbox_13 = BoundingBox(Content=geo_14, Plane=PlaneXY(0, 0, 0))  # -> Box, Box_2
# Box Morphing
morph_6 = BoxMorph(Geometry=geo_3, Reference=bbox_6.Box, Target=tboxloft)
# Box Morphing
morph_7 = BoxMorph(Geometry=geo_7, Reference=bbox_7.Box, Target=wavtbox)
# Box Morphing
morph_8 = BoxMorph(Geometry=geo_8, Reference=bbox_8.Box, Target=twn2tboxs)
# Box Morphing
morph_9 = BoxMorph(Geometry=geo_9, Reference=bbox_10.Box, Target=twncontboxs)
# Box Morphing
morph_10 = BoxMorph(Geometry=geo_12, Reference=bbox_9.Box, Target=avrtbox)
# Box Morphing
morph_11 = BoxMorph(Geometry=geo_10, Reference=bbox_11.Box, Target=twnthrutboxs)
bbox_14 = BoundingBox(Content=geo_15, Plane=PlaneXY(0, 0, 0))  # -> Box, Box_2
panel_6 = Panel(evaltbox.R)
# This component works directly in
# relationship with Grasshoppers
# Twisted Box component.
# Look at Rhino window
# to preview results
preview_15 = CustomPreview(
    Geometry=[tbox_corners.CornerA, tbox_corners.CornerB, tbox_corners.CornerC, tbox_corners.CornerD, tbox_corners.CornerE, tbox_corners.CornerF, tbox_corners.CornerG, tbox_corners.CornerH],
    Shader=ColourSwatch(SwatchColor=RGB(255, 255, 255)))
# You can get this info like this but it
# is much slower as it converts to Brep
# and outputs all the geometry together.
# The other bad thing is it ruins the
# corner point order of the twisted box.
# However, this way you can get the
# faces as surfaces if you need them.
# Look at Rhino window
# to preview results
preview_16 = CustomPreview(Geometry=detbox, Shader=ColourSwatch(SwatchColor=RGB(255, 255, 255)))
# Variable version
# of this component
geo_27 = Geometry(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)
bbox_15 = BoundingBox(Content=geo_17, Plane=PlaneXY(0, 0, 0))  # -> Box, Box_2
geo_28 = Geometry(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)
bbox_16 = BoundingBox(Content=geo_16, Plane=PlaneXY(0, 0, 0))  # -> Box, Box_2
# Look at Rhino window
# to preview results
preview_17 = CustomPreview(Geometry=reftbox, Shader=ColourSwatch(SwatchColor=RGB(255, 255, 255)))
bbox_17 = BoundingBox(Content=geo_25, Plane=PlaneXY(0, 0, 0))  # -> Box, Box_2
bbox_18 = BoundingBox(Content=geo_18, Plane=PlaneXY(0, 0, 0))  # -> Box, Box_2
bbox_19 = BoundingBox(Content=geo_19, Plane=PlaneXY(0, 0, 0))  # -> Box, Box_2
bbox_20 = BoundingBox(Content=geo_20, Plane=PlaneXY(0, 0, 0))  # -> Box, Box_2
bbox_21 = BoundingBox(Content=geo_22, Plane=PlaneXY(0, 0, 0))  # -> Box, Box_2
tboxpipevar = TwistedBoxPipeVariable(
    Curve=crv_13,
    ParametersU=range_24,
    ParametersV=range_25,
    ParametersW=range_26,
    Normalized=Toggle(True),
    Diameters=series_6,
    Thicknesses=series_5,
    Rotations=series_4)
bbox_22 = BoundingBox(Content=geo_24, Plane=PlaneXY(0, 0, 0))  # -> Box, Box_2
bbox_23 = BoundingBox(Content=geo_21, Plane=PlaneXY(0, 0, 0))  # -> Box, Box_2
bbox_24 = BoundingBox(Content=geo_23, Plane=PlaneXY(0, 0, 0))  # -> Box, Box_2
# Look at Rhino window
# to preview results
preview_18 = CustomPreview(Geometry=tboxcents, Shader=ColourSwatch(SwatchColor=RGB(255, 255, 255)))
# Box Morphing
# The referenced Brep does not need to be
# a Box, It just needs to have started with
# a Rhino Box for the point order.
morph_12 = BoxMorph(Geometry=geo_13, Reference=bbox_12.Box, Target=reftbox)
# Box Morphing
# Deforming with indices
# Look at Rhino window
# to preview results
preview_19 = CustomPreview(Geometry=deformtbox.Deformed, Shader=ColourSwatch(SwatchColor=RGB(255, 255, 255)))
# Look at Rhino window
# to preview results
preview_20 = CustomPreview(Geometry=subdivtbox, Shader=ColourSwatch(SwatchColor=RGB(255, 255, 255)))
bbox_25 = BoundingBox(Content=geo_26, Plane=PlaneXY(0, 0, 0))  # -> Box, Box_2
# This allows the start and end of the twisted boxes
# to be altered on the rails so twisted boxes can
# exist only on parts of the rails.
# Look at Rhino window
# to preview results
preview_21 = CustomPreview(Geometry=tboxsweep, Shader=ColourSwatch(SwatchColor=RGB(255, 255, 255)))
# Box Morphing
morph_13 = BoxMorph(Geometry=geo_14, Reference=bbox_13.Box, Target=tboxsweep)
# Box Morphing
morph_14 = BoxMorph(Geometry=geo_15, Reference=bbox_14.Box, Target=thicktbox)
bbox_26 = BoundingBox(Content=geo_28, Plane=PlaneXY(0, 0, 0))  # -> Box, Box_2
bbox_27 = BoundingBox(Content=geo_27, Plane=PlaneXY(0, 0, 0))  # -> Box, Box_2
# Look at Rhino window
# to preview results
preview_22 = CustomPreview(Geometry=tboxarr, Shader=ColourSwatch(SwatchColor=RGB(255, 255, 255)))
# Look at Rhino window
# to preview results
preview_23 = CustomPreview(Geometry=evaltbox.Evaluation, Shader=ColourSwatch(SwatchColor=RGB(255, 255, 255)))
# Box Morphing
morph_15 = BoxMorph(Geometry=geo_17, Reference=bbox_15.Box, Target=tboxextr)
# Using unevenly spaced parameter
# values will result in uneven spaced
# twisted boxes. The spacing can be
# controlled with custom values
# such as values from graph mappers.
# Look at Rhino window
# to preview results
preview_24 = CustomPreview(Geometry=tboxextr, Shader=ColourSwatch(SwatchColor=RGB(255, 255, 255)))
# Box Morphing
morph_16 = BoxMorph(Geometry=geo_16, Reference=bbox_16.Box, Target=tboxcrv)
# Box Morphing
morph_17 = BoxMorph(Geometry=geo_19, Reference=bbox_19.Box, Target=tboxsrf)
geo_29 = Geometry(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)
# Box Morphing
morph_18 = BoxMorph(Geometry=geo_25, Reference=bbox_17.Box, Target=tboxpipe)
# Box Morphing
morph_19 = BoxMorph(Geometry=geo_18, Reference=bbox_18.Box, Target=tboxmsh)
# Box Morphing
morph_20 = BoxMorph(Geometry=geo_20, Reference=bbox_20.Box, Target=tbox2srfs)
# Box Morphing
morph_21 = BoxMorph(Geometry=geo_22, Reference=bbox_21.Box, Target=tboxthrusrfs)
# Look at Rhino window
# to preview results
preview_25 = CustomPreview(Geometry=domtbox, Shader=ColourSwatch(SwatchColor=RGB(255, 255, 255)))
# Box Morphing
morph_22 = BoxMorph(Geometry=geo_24, Reference=bbox_22.Box, Target=tbox2mshs)
# Box Morphing
# This allows the start and end of the array
# to be altered in the box so twisted boxes
# can exist only in parts of the box.
morph_23 = BoxMorph(Geometry=geo_23, Reference=bbox_24.Box, Target=tboxarr)
# Box Morphing
morph_24 = BoxMorph(Geometry=geo_21, Reference=bbox_23.Box, Target=tboxthrumshs)
# Box Morphing
morph_25 = BoxMorph(Geometry=geo_26, Reference=bbox_25.Box, Target=domtbox)
# This allows the twisted boxes to
# be placed at a specific portion of
# the mesh thickness.
# Look at Rhino window
# to preview results
preview_26 = CustomPreview(Geometry=tboxmsh, Shader=ColourSwatch(SwatchColor=RGB(255, 255, 255)))
# This allows the start and end of the grid
# to be altered on the surface so twisted boxes
# can exist only on parts of the surface.
# Look at Rhino window
# to preview results
preview_27 = CustomPreview(Geometry=tboxsrf, Shader=ColourSwatch(SwatchColor=RGB(255, 255, 255)))
# This allows the start and end of the grid
# to be altered on the surface so twisted boxes
# can exist only on parts of the surface.
# Look at Rhino window
# to preview results
preview_28 = CustomPreview(Geometry=tbox2srfs, Shader=ColourSwatch(SwatchColor=RGB(255, 255, 255)))
# This allows the start and end of the grid
# to be altered on the surface so twisted boxes
# can exist only on parts of the surface.
# Look at Rhino window
# to preview results
preview_29 = CustomPreview(Geometry=tboxthrusrfs, Shader=ColourSwatch(SwatchColor=RGB(255, 255, 255)))
# This allows the start and end of the twisted boxes
# to be altered on the curve so twisted boxes can
# exist only on parts of the curve.
# Look at Rhino window
# to preview results
preview_30 = CustomPreview(Geometry=tboxcrv, Shader=ColourSwatch(SwatchColor=RGB(255, 255, 255)))
# This allows the twisted boxes to
# be placed at a specific portion
# between the meshs .
# Look at Rhino window
# to preview results
preview_31 = CustomPreview(Geometry=tbox2mshs, Shader=ColourSwatch(SwatchColor=RGB(255, 255, 255)))
# This allows the twisted boxes to
# be placed at a specific portion
# between the meshs .
# Look at Rhino window
# to preview results
preview_32 = CustomPreview(Geometry=tboxthrumshs, Shader=ColourSwatch(SwatchColor=RGB(255, 255, 255)))
# This allows the start and end, revolution, and thickness
# of the twisted box pipe to be altered on the curve so
# twisted boxes can exist only on parts of the pipe.
# Look at Rhino window
# to preview results
preview_33 = CustomPreview(Geometry=tboxpipe, Shader=ColourSwatch(SwatchColor=RGB(255, 255, 255)))
# This allows the start and end of the twisted boxes
# to be altered on the thickness so twisted boxes
# can exist only on parts of the thickness.
# Look at Rhino window
# to preview results
preview_34 = CustomPreview(Geometry=thicktbox, Shader=ColourSwatch(SwatchColor=RGB(255, 255, 255)))
# Look at Rhino window
# to preview results
preview_35 = CustomPreview(Geometry=trantbox, Shader=ColourSwatch(SwatchColor=RGB(255, 255, 255)))
# Box Morphing
morph_26 = BoxMorph(Geometry=geo_28, Reference=bbox_26.Box, Target=trantbox)
# Box Morphing
morph_27 = BoxMorph(Geometry=geo_27, Reference=bbox_27.Box, Target=tboxcrvvar)
bbox_28 = BoundingBox(Content=geo_29, Plane=PlaneXY(0, 0, 0))  # -> Box, Box_2
# Look at Rhino window
# to preview results
preview_36 = CustomPreview(Geometry=tboxcrvvar, Shader=ColourSwatch(SwatchColor=RGB(255, 255, 255)))
# Box Morphing
morph_28 = BoxMorph(Geometry=geo_29, Reference=bbox_28.Box, Target=tboxpipevar)
# Look at Rhino window
# to preview results
preview_37 = CustomPreview(Geometry=tboxpipevar, Shader=ColourSwatch(SwatchColor=RGB(255, 255, 255)))
tbox_24 = TwistedBox({C=Point(9.434291702, -522.1123305, 3.42147918), C=Point(29.08855508, -522.1123305, 10.31291601), C=Point(29.08855508, -494.8877623, 10.31291601), C=Point(9.434291702, -494.8877623, 3.42147918), C=Point(-18.21964268, -527.8378954, 31.31779612), C=Point(4.728705022, -524.9017061, 43.10665076), C=Point(15.58320709, -499.9345897, 43.10665076), C=Point(-2.441331509, -492.0983867, 31.31779612)})
# Convert twisted box to Brep
tbox_25 = TwistedBox({C=Point(34.91655507, -370.2027664, 0), C=Point(54.57081845, -370.2027664, 0), C=Point(54.57081845, -342.9781981, 0), C=Point(34.91655507, -342.9781981, 0), C=Point(25.38035732, -375.9283312, 32.79373475), C=Point(48.32870502, -372.9921419, 32.79373475), C=Point(59.18320709, -348.0250256, 32.79373475), C=Point(41.15866849, -340.1888226, 32.79373475)})
# Index of corner to deform
number_slider_36 = Slider(5, range=0..10)
# Adjusting the start and end domains
# of the ranges positions the twisted
# boxes on specified parts of the surface.
number_slider_37 = Slider(0.839, range=0..1)
# Adjusting the start and end domains
# of the ranges positions the twisted
# boxes on specified parts of the surface.
number_slider_38 = Slider(0.814, range=0..1)
# Adjusting the start and end domains
# of the ranges positions the twisted
# boxes on specified parts of the surface.
number_slider_39 = Slider(1.715, range=0..2)
# Adjusting the start and end domains
# of the ranges positions the twisted
# boxes in specified parts of the box.
number_slider_40 = Slider(0.839, range=0..1)
tbox_corners_2 = TwistedBoxCorners(TwistedBox=tbox_24)  # -> CornerA, CornerB, CornerC, CornerD, CornerE, CornerF, CornerG, CornerH
# Adjusting the start and end domain
# of the range positions the twisted
# boxes on specified parts of the thickness.
number_slider_41 = Slider(0.592, range=0..1)
# Adjusting the start and end domain
# of the range positions the twisted
# boxes on specified parts
# between the meshes.
number_slider_42 = Slider(0.592, range=0..1)
# Adjusting the start and end domain
# of the range positions the twisted
# boxes on specified parts
# between the meshes.
number_slider_43 = Slider(1.688, range=0..2)
brep_2 = Brep(tbox_25)
# Look at Rhino window
# to preview input
# Brep that was initially made with a
# Rhino Box and then moving the
# solid control points to edit the corners.
# You could also deform the Rhino Box
# with a cage edit.
geo_30 = Geometry(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)
# Input can be
# a box also
tbox_26 = TwistedBox({C=Point(81.58377591, -627.4952361, 3.638681958), C=Point(120.2201939, -627.4952361, 3.638681958), C=Point(120.2201939, -592.621845, 3.638681958), C=Point(81.58377591, -592.621845, 3.638681958), C=Point(81.58377591, -627.4952361, 35.43837563), C=Point(120.2201939, -627.4952361, 35.43837563), C=Point(120.2201939, -592.621845, 35.43837563), C=Point(81.58377591, -592.621845, 35.43837563)})
# If you try transform components
# directly with twisted boxes it will
# not work. No transformation will occur.
number_slider_44 = Slider(46, range=0..100)
debrep = DeconstructBrep(Brep=brep_2)  # -> Faces, Edges, Vertices
# Adjusting the start and end domains
# of the range positions the twisted box on
# a specified part of the rails.
number_slider_45 = Slider(0.743, range=0..1)
# Box defines the size of the array.
# Any box can be used.
number_slider_46 = Slider(50, range=0..100)
X_2 = UnitX(Factor=Slider(-36, range=-100..100))
X_3 = UnitX(Factor=Slider(18, range=0..100))
Z_4 = UnitZ(Factor=Slider(26, range=0..100))
Z_5 = UnitZ(Factor=Slider(33, range=0..100))
reftbox_2 = ReferenceTwistedBox(Polysurface=geo_30)
# Determines how the twisted boxes are interpolated.
number_slider_47 = Slider(0, range=0..3)
tbox_27 = TwistedBox(geo_30)
# Adjusting the start and end domains
# of the range positions the twisted box on
# a specified part of the curve.
number_slider_48 = Slider(0.872, range=0..1)
dom_4 = ConstructDomain(DomainStart=Slider(0.061, range=0..1), DomainEnd=Slider(0.517, range=0..1))
dom_5 = ConstructDomain(DomainStart=Slider(0.335, range=0..1), DomainEnd=number_slider_37)
dom_6 = ConstructDomain(DomainStart=Slider(0.061, range=0..1), DomainEnd=Slider(0.517, range=0..1))
dom_7 = ConstructDomain(DomainStart=Slider(0.335, range=0..1), DomainEnd=number_slider_38)
dom_8 = ConstructDomain(DomainStart=Slider(0.061, range=0..1), DomainEnd=Slider(0.517, range=0..1))
dom_9 = ConstructDomain(DomainStart=Slider(0.335, range=0..1), DomainEnd=number_slider_39)
dom_10 = ConstructDomain(DomainStart=Slider(0.527, range=0..1), DomainEnd=Slider(0.007, range=0..1))
dom_11 = ConstructDomain(DomainStart=Slider(0.335, range=0..1), DomainEnd=number_slider_40)
# Determines how the twisted boxes are interpolated.
number_slider_49 = Slider(0, range=0..3)
# Adjusting the start and end domains
# of the ranges positions the twisted boxes on
# specified parts of the pipe around the curve.
number_slider_50 = Slider(0.895, range=0..1)
dom_12 = ConstructDomain(DomainStart=Slider(0.207, range=0..1), DomainEnd=Slider(0.592, range=0..1))
dom_13 = ConstructDomain(DomainStart=Slider(0.207, range=0..1), DomainEnd=Slider(0.592, range=0..1))
dom_14 = ConstructDomain(DomainStart=Slider(0.207, range=0..1), DomainEnd=Slider(0.592, range=0..1))
dom_15 = ConstructDomain(DomainStart=Slider(0.207, range=0..1), DomainEnd=Slider(0.486, range=0..1))
move_2 = Move(Geometry=tbox_corners_2.CornerF, Motion=X_3)  # -> Geometry, Transform
move_3 = Move(Geometry=tbox_corners_2.CornerG, Motion=Z_4)  # -> Geometry, Transform
# Perform some operations on specific
# corners and reconstruct the twisted box
# with Grasshoppers Twisted Box component.
move_4 = Move(Geometry=tbox_corners_2.CornerH, Motion=Z_5)  # -> Geometry, Transform
# Graphmappers creating gradient spacing.
range_27 = Range(Domain=Domain(0, 1), Steps=Slider(12, range=0..100))
srf_6 = Surface([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])
dom_16 = ConstructDomain(DomainStart=Slider(0.207, range=0..1), DomainEnd=number_slider_41)
geo_31 = Geometry(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)
dom_17 = ConstructDomain(DomainStart=Slider(0.207, range=0..1), DomainEnd=number_slider_42)
dom_18 = ConstructDomain(DomainStart=Slider(0.371, range=0..1), DomainEnd=number_slider_43)
deformtbox_2 = DeformTwistedBox(TwistedBox=tbox_26, Indices=number_slider_36, Motions=X_2)  # -> Deformed, Index
# If you try to use grasshoppers twisted box
# parameter it will only output the twisted box
# for the Breps bounding box.
# Look at Rhino window
# to preview results
preview_38 = CustomPreview(Geometry=tbox_27, Shader=ColourSwatch(SwatchColor=RGB(255, 0, 255)))
# Adjusting the start and end domains
# of the range positions the twisted box on
# a specified part of the thickness.
number_slider_51 = Slider(0.473, range=0..1)
Z_6 = UnitZ(Factor=Slider(71, range=0..100))
Z_7 = UnitZ(Factor=number_slider_44)
tbox_28 = TwistedBox({C=Point(415.1203054, -211.7145157, 1.156565081), C=Point(435.3837311, -200.6285795, 9.479581455), C=Point(430.9927095, -186.1118553, 15.77316987), C=Point(423.0764437, -186.1118553, 0.8928165596), C=Point(411.2790807, -215.3821515, 20.74403083), C=Point(420.422878, -204.4398758, 39.74034011), C=Point(415.5975135, -182.4442196, 23.75699097), C=Point(392.3186956, -193.3864953, 25.02020467)})
crv_14 = Curve(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)
geo_32 = Geometry(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)
bbox_29 = BoundingBox(Content=geo_31, Plane=PlaneXY(0, 0, 0))  # -> Box, Box_2
range_28 = Range(Domain=dom_5, Steps=Slider(2, range=0..10))
range_29 = Range(Domain=dom_7, Steps=Slider(2, range=0..10))
range_30 = Range(Domain=dom_9, Steps=Slider(6, range=0..10))
range_31 = Range(Domain=dom_11, Steps=Slider(1, range=0..10))
range_32 = Range(Domain=dom_4, Steps=Slider(6, range=0..10))
range_33 = Range(Domain=dom_6, Steps=Slider(6, range=0..10))
range_34 = Range(Domain=dom_8, Steps=Slider(6, range=0..10))
range_35 = Range(Domain=dom_10, Steps=Slider(5, range=0..10))
range_36 = Range(Domain=dom_16, Steps=Slider(3, range=0..100))
range_37 = Range(Domain=dom_12, Steps=Slider(3, range=0..100))
range_38 = Range(Domain=dom_13, Steps=Slider(3, range=0..100))
range_39 = Range(Domain=dom_14, Steps=Slider(3, range=0..100))
range_40 = Range(Domain=dom_15, Steps=Slider(5, range=0..100))
range_41 = Range(Domain=dom_17, Steps=Slider(3, range=0..100))
range_42 = Range(Domain=dom_18, Steps=Slider(8, range=0..100))
box_2 = CenterBox(Base=PlaneXY(1629.166302, -113.0696505, 0), X=number_slider_46, Y=Slider(58, range=0..100), Z=Slider(43, range=0..100))
graph = GraphMapper(
    range_27,
    x0=0,
    x1=1,
    y0=0,
    y1=1,
    container_name="Bezier",
    cpx=[0, 0.8319993615, 0.2199984491, 1],
    cpy=[0, 0.1687344909, 0.4554554224, 1])
dom_19 = ConstructDomain(DomainStart=Slider(0.248, range=0..1), DomainEnd=number_slider_45)
mesh_5 = Mesh(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)
mesh_6 = Mesh(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)
mesh_7 = Mesh(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)
srf_7 = Surface(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)
srf_8 = Surface(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)
srf_9 = Surface(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)
mesh_8 = Mesh([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])
# Index of corner being deformed
panel_7 = Panel(deformtbox_2.Index)
tbox_29 = TwistedBox(
    CornerA=tbox_corners_2.CornerA,
    CornerB=tbox_corners_2.CornerB,
    CornerC=tbox_corners_2.CornerC,
    CornerD=tbox_corners_2.CornerD,
    CornerE=tbox_corners_2.CornerE,
    CornerF=move_2.Geometry,
    CornerG=move_3.Geometry,
    CornerH=move_4.Geometry)
geo_33 = Geometry(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)
# Look at the result in Rhino and you
# will notice that no change occurs
# to the twisted box.
move_5 = Move(Geometry=tbox_28, Motion=Z_7)  # -> Geometry, Transform
wires_2 = BrepWireframe(Brep=box_2, Density=-1)
bbox_30 = BoundingBox(Content=geo_32, Plane=PlaneXY(0, 0, 0))  # -> Box, Box_2
morph_29 = BoxMorph(Geometry=geo_31, Reference=bbox_29.Box, Target=deformtbox_2.Deformed)
dom_20 = ConstructDomain(DomainStart=Slider(0.401, range=0..1), DomainEnd=number_slider_48)
# Rail curves
crv_15 = Curve(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)
crv_16 = Curve(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)
crv_17 = Curve(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)
crv_18 = Curve(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)
range_43 = Range(Domain=dom_19, Steps=Slider(8, range=0..10))
dom_21 = ConstructDomain(DomainStart=Slider(0, range=0..1), DomainEnd=Slider(0.567, range=0..1))
dom_22 = ConstructDomain(DomainStart=Slider(0.335, range=0..1), DomainEnd=number_slider_50)
bbox_31 = BoundingBox(Content=geo_33, Plane=PlaneXY(0, 0, 0))  # -> Box, Box_2
dom_23 = ConstructDomain(DomainStart=Slider(0.198, range=0..1), DomainEnd=Slider(0.608, range=0..1))
# Look at Rhino window
# to preview inputs
preview_39 = CustomPreview(Geometry=crv_14, Shader=ColourSwatch(SwatchColor=RGB(255, 0, 255)))
# Look at Rhino window
# to preview results
preview_40 = CustomPreview(Geometry=reftbox_2, Shader=ColourSwatch(SwatchColor=RGB(255, 255, 255)))
tboxmsh_2 = TwistedBoxMesh(Mesh=mesh_5, Thickness=Slider(70, range=0..100), ParametersW=range_36)
# Look at Rhino window
# to preview results
preview_41 = CustomPreview(Geometry=wires_2, Shader=ColourSwatch(SwatchColor=RGB(255, 0, 255)))
tboxthrumshs_2 = TwistedBoxThroughMeshes(Mesh=mesh_8, ParametersW=range_42, InterpolationType=number_slider_49)
tbox2mshs_2 = TwistedBoxTwoMeshes(MeshA=mesh_6, MeshB=mesh_7, ParametersW=range_41)
tbox2srfs_2 = TwistedBoxTwoSurfaces(SurfaceA=srf_7, SurfaceB=srf_8, ParametersU=range_38, ParametersV=range_33, ParametersW=range_29)
tboxsrf_2 = TwistedBoxSurface(Surface=srf_9, Thickness=Slider(10, range=0..100), ParametersU=range_37, ParametersV=range_32, ParametersW=range_28)
tboxarr_2 = TwistedBoxArray(Box=box_2, ParametersX=range_40, ParametersY=range_35, ParametersZ=range_31)
tboxextr_2 = TwistedBoxExtrude(Profile=crv_14, Direction=Z_6, ParametersT=graph, Normalized=True)
tboxthrusrfs_2 = TwistedBoxThroughSurfaces(Surface=srf_6, ParametersU=range_39, ParametersV=range_34, ParametersW=range_30, InterpolationType=number_slider_47)
# Box Morphing
# The Reference Twisted Box will not
# work for Grasshopper boxes. For that
# you can use Grasshoppers Twisted Box
# parameter or Twisted Box component.
morph_30 = BoxMorph(Geometry=geo_32, Reference=bbox_30.Box, Target=reftbox_2)
dom_24 = ConstructDomain(DomainStart=Slider(0.222, range=0..1), DomainEnd=number_slider_51)
# Box Morphing
# Look at Rhino window
# to preview results
preview_42 = CustomPreview(Geometry=deformtbox_2.Deformed, Shader=ColourSwatch(SwatchColor=RGB(255, 255, 255)))
range_44 = Range(Domain=dom_20, Steps=Slider(6, range=0..100))
crv_19 = Curve(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)
# Box Morphing
morph_31 = BoxMorph(Geometry=geo_33, Reference=bbox_31.Box, Target=tbox_29)
geo_34 = Geometry(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)
geo_35 = Geometry(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)
geo_36 = Geometry(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)
geo_37 = Geometry(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)
geo_38 = Geometry(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)
geo_39 = Geometry(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)
range_45 = Range(Domain=dom_22, Steps=Slider(2, range=0..10))
geo_40 = Geometry(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)
geo_41 = Geometry(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)
range_46 = Range(Domain=dom_21, Steps=Slider(7, range=0..10))
tboxsweep_2 = TwistedBoxSweep(R¹=crv_15, R²=crv_16, R³=crv_17, R⁴=crv_18, t=range_43, N=Toggle(True))
range_47 = Range(Domain=dom_23, Steps=Slider(10, range=0..100))
# Look at Rhino window
# to preview inputs
preview_43 = CustomPreview(Geometry=[crv_15, crv_16, crv_17, crv_18], Shader=ColourSwatch(SwatchColor=RGB(255, 0, 255)))
# Look at Rhino window
# to preview results
preview_44 = CustomPreview(Geometry=tbox_29, Shader=ColourSwatch(SwatchColor=RGB(255, 255, 255)))
crv_20 = Curve(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)
range_48 = Range(Domain=dom_24, Steps=Slider(3, range=0..10))
bbox_32 = BoundingBox(Content=geo_39, Plane=PlaneXY(0, 0, 0))  # -> Box, Box_2
bbox_33 = BoundingBox(Content=geo_34, Plane=PlaneXY(0, 0, 0))  # -> Box, Box_2
bbox_34 = BoundingBox(Content=geo_35, Plane=PlaneXY(0, 0, 0))  # -> Box, Box_2
bbox_35 = BoundingBox(Content=geo_36, Plane=PlaneXY(0, 0, 0))  # -> Box, Box_2
bbox_36 = BoundingBox(Content=geo_38, Plane=PlaneXY(0, 0, 0))  # -> Box, Box_2
bbox_37 = BoundingBox(Content=geo_41, Plane=PlaneXY(0, 0, 0))  # -> Box, Box_2
bbox_38 = BoundingBox(Content=geo_40, Plane=PlaneXY(0, 0, 0))  # -> Box, Box_2
bbox_39 = BoundingBox(Content=geo_37, Plane=PlaneXY(0, 0, 0))  # -> Box, Box_2
tboxcrv_2 = TwistedBoxCurve(
    Curve=crv_19,
    ParametersT=range_44,
    Normalized=True,
    SizeX=Slider(15, range=0..100),
    SizeY=Slider(15, range=0..100),
    Rotation=Slider(0, range=0..1000))
geo_42 = Geometry(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)
# Input can be
# a box also
tbox_30 = TwistedBox({C=Point(48, -773, 0), C=Point(77, -773, 0), C=Point(77, -748, 0), C=Point(48, -748, 0), C=Point(48, -773, 28), C=Point(77, -773, 28), C=Point(77, -748, 28), C=Point(48, -748, 28)})
geo_43 = Geometry(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)
tboxpipe_2 = TwistedBoxPipe(
    Curve=crv_20,
    ParametersU=range_47,
    ParametersV=range_46,
    ParametersW=range_45,
    Normalized=True,
    Diameter=Slider(30, range=0..100),
    Thickness=Slider(8, range=0..100),
    Rotation=Slider(270, range=0..1000))
# Box Morphing
morph_32 = BoxMorph(Geometry=geo_39, Reference=bbox_32.Box, Target=tboxextr_2)
# Look at Rhino window
# to preview results
preview_45 = CustomPreview(Geometry=tboxextr_2, Shader=ColourSwatch(SwatchColor=RGB(255, 255, 255)))
bbox_40 = BoundingBox(Content=geo_42, Plane=PlaneXY(0, 0, 0))  # -> Box, Box_2
# Box Morphing
morph_33 = BoxMorph(Geometry=geo_34, Reference=bbox_33.Box, Target=tboxmsh_2)
# Box Morphing
morph_34 = BoxMorph(Geometry=geo_35, Reference=bbox_34.Box, Target=tboxsrf_2)
# Box Morphing
morph_35 = BoxMorph(Geometry=geo_36, Reference=bbox_35.Box, Target=tbox2srfs_2)
# Box Morphing
morph_36 = BoxMorph(Geometry=geo_38, Reference=bbox_36.Box, Target=tboxthrusrfs_2)
# Box Morphing
morph_37 = BoxMorph(Geometry=geo_41, Reference=bbox_37.Box, Target=tboxarr_2)
# Box Morphing
morph_38 = BoxMorph(Geometry=geo_40, Reference=bbox_38.Box, Target=tbox2mshs_2)
# Box Morphing
morph_39 = BoxMorph(Geometry=geo_37, Reference=bbox_39.Box, Target=tboxthrumshs_2)
# Look at Rhino window
# to preview results
preview_46 = CustomPreview(Geometry=tboxmsh_2, Shader=ColourSwatch(SwatchColor=RGB(255, 255, 255)))
# Using unevenly spaced parameter
# values will result in uneven spaced
# twisted boxes. The spacing can be
# controlled with custom values
# such as values from graph mappers.
# Look at Rhino window
# to preview results
preview_47 = CustomPreview(Geometry=tboxsrf_2, Shader=ColourSwatch(SwatchColor=RGB(255, 255, 255)))
# Using unevenly spaced parameter
# values will result in uneven spaced
# twisted boxes. The spacing can be
# controlled with custom values
# such as values from graph mappers.
# Look at Rhino window
# to preview results
preview_48 = CustomPreview(Geometry=tbox2srfs_2, Shader=ColourSwatch(SwatchColor=RGB(255, 255, 255)))
# Look at Rhino window
# to preview results
preview_49 = CustomPreview(Geometry=tboxthrusrfs_2, Shader=ColourSwatch(SwatchColor=RGB(255, 255, 255)))
# Using unevenly spaced parameter
# values will result in uneven spaced
# twisted boxes. The spacing can be
# controlled with custom values
# such as values from graph mappers.
# Look at Rhino window
# to preview results
preview_50 = CustomPreview(Geometry=tboxarr_2, Shader=ColourSwatch(SwatchColor=RGB(255, 255, 255)))
# Look at Rhino window
# to preview results
preview_51 = CustomPreview(Geometry=tbox2mshs_2, Shader=ColourSwatch(SwatchColor=RGB(255, 255, 255)))
# Look at Rhino window
# to preview results
preview_52 = CustomPreview(Geometry=tboxthrumshs_2, Shader=ColourSwatch(SwatchColor=RGB(255, 255, 255)))
geo_44 = Geometry(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)
bbox_41 = BoundingBox(Content=geo_43, Plane=PlaneXY(0, 0, 0))  # -> Box, Box_2
thicktbox_2 = ThickenTwistedBox(TwistedBox=tbox_30, ParametersW=range_48, Thickness=Slider(0.823, range=0..1), Hollow=Toggle(True))
# Look at Rhino window
# to preview results
preview_53 = CustomPreview(Geometry=tboxsweep_2, Shader=ColourSwatch(SwatchColor=RGB(255, 255, 255)))
# Box Morphing
morph_40 = BoxMorph(Geometry=geo_42, Reference=bbox_40.Box, Target=tboxsweep_2)
geo_45 = Geometry(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)
bbox_42 = BoundingBox(Content=geo_44, Plane=PlaneXY(0, 0, 0))  # -> Box, Box_2
# Box Morphing
# Using unevenly spaced parameter
# values will result in uneven spaced
# twisted boxes. The spacing can be
# controlled with custom values
# such as values from graph mappers.
morph_41 = BoxMorph(Geometry=geo_43, Reference=bbox_41.Box, Target=tboxcrv_2)
bbox_43 = BoundingBox(Content=geo_45, Plane=PlaneXY(0, 0, 0))  # -> Box, Box_2
# Look at Rhino window
# to preview results
preview_54 = CustomPreview(Geometry=tboxcrv_2, Shader=ColourSwatch(SwatchColor=RGB(255, 255, 255)))
box_3 = CenterBox(Base=PlaneXY(180.2044702, -287.196372, 0), X=15, Y=15, Z=15)
# Box Morphing
morph_42 = BoxMorph(Geometry=geo_44, Reference=bbox_42.Box, Target=tboxpipe_2)
# Using unevenly spaced parameter
# values will result in uneven spaced
# twisted boxes. The spacing can be
# controlled with custom values
# such as values from graph mappers.
# Look at Rhino window
# to preview results
preview_55 = CustomPreview(Geometry=tboxpipe_2, Shader=ColourSwatch(SwatchColor=RGB(255, 255, 255)))
# Box Morphing
morph_43 = BoxMorph(Geometry=geo_45, Reference=bbox_43.Box, Target=thicktbox_2)
# Using unevenly spaced parameter
# values will result in uneven spaced
# twisted boxes. The spacing can be
# controlled with custom values
# such as values from graph mappers.
number_slider_52 = Slider(4, range=0..100)
# Using unevenly spaced parameter
# values will result in uneven spaced
# twisted boxes. The spacing can be
# controlled with custom values
# such as values from graph mappers.
# Look at Rhino window
# to preview results
preview_56 = CustomPreview(Geometry=thicktbox_2, Shader=ColourSwatch(SwatchColor=RGB(255, 255, 255)))
# Using unevenly spaced parameter
# values will result in uneven spaced
# twisted boxes. The spacing can be
# controlled with custom values
# such as values from graph mappers.
number_slider_53 = Slider(9, range=0..10)
# Using unevenly spaced parameter
# values will result in uneven spaced
# twisted boxes. The spacing can be
# controlled with custom values
# such as values from graph mappers.
number_slider_54 = Slider(3, range=0..10)
# Using unevenly spaced parameter
# values will result in uneven spaced
# twisted boxes. The spacing can be
# controlled with custom values
# such as values from graph mappers.
number_slider_55 = Slider(3, range=0..10)
reftbox_3 = ReferenceTwistedBox(Polysurface=box_3)
tbox_31 = TwistedBox(box_3)
# Using unevenly spaced parameter
# values will result in uneven spaced
# twisted boxes. The spacing can be
# controlled with custom values
# such as values from graph mappers.
number_slider_56 = Slider(12, range=0..100)
# Notice the point order does not work
# with Grasshopper box and the result
# is a criss crossed twisted box.
# You can use Grasshoppers
# twisted box parameter in this case.
# Look at Rhino window
# to preview results
preview_57 = CustomPreview(Geometry=tbox_31, Shader=ColourSwatch(SwatchColor=RGB(255, 0, 255)))
# Extrude along curve
number_slider_57 = Slider(5, range=0..10)
range_49 = Range(Domain=Domain(0, 1), Steps=Slider(10, range=0..10))
# Box defines the size of the array.
# Any box can be used.
number_slider_58 = Slider(50, range=0..100)
range_50 = Range(Domain=Domain(0, 1), Steps=Slider(6, range=0..10))
range_51 = Range(Domain=Domain(0, 1), Steps=number_slider_52)
range_52 = Range(Domain=Domain(0, 1), Steps=Slider(2, range=0..10))
range_53 = Range(Domain=Domain(0, 1), Steps=Slider(3, range=0..10))
range_54 = Range(Domain=Domain(0, 1), Steps=Slider(6, range=0..10))
range_55 = Range(Domain=Domain(0, 1), Steps=Slider(6, range=0..10))
range_56 = Range(Domain=Domain(0, 1), Steps=Slider(3, range=0..10))
range_57 = Range(Domain=Domain(0, 1), Steps=Slider(4, range=0..100))
range_58 = Range(Domain=Domain(0, 1), Steps=Slider(4, range=0..100))
range_59 = Range(Domain=Domain(0, 1), Steps=Slider(6, range=0..10))
range_60 = Range(Domain=Domain(0, 1), Steps=Slider(4, range=0..100))
# Graphmappers creating gradient spacing.
range_61 = Range(Domain=Domain(0, 1), Steps=number_slider_54)
# Graphmappers creating gradient spacing.
range_62 = Range(Domain=Domain(0, 1), Steps=number_slider_55)
# Graphmappers creating gradient spacing.
range_63 = Range(Domain=Domain(0, 1), Steps=number_slider_53)
range_64 = Range(Domain=Domain(0, 1), Steps=number_slider_56)
# Look at Rhino window
# to preview results
preview_58 = CustomPreview(Geometry=reftbox_3, Shader=ColourSwatch(SwatchColor=RGB(255, 255, 255)))
graph_2 = GraphMapper(range_51, x0=0, x1=1, y0=0, y1=1, container_name="Bezier", cpx=[0, 1, 0.2749994397, 1], cpy=[0, 0, 0.8804543018, 1])
graph_3 = GraphMapper(
    range_50,
    x0=0,
    x1=1,
    y0=0,
    y1=1,
    container_name="Bezier",
    cpx=[0, 0.8328191638, 0.4255454242, 1],
    cpy=[0, 0.1305431128, 0.758908391, 1])
# Graphmappers creating gradient spacing.
graph_4 = GraphMapper(
    range_49,
    x0=0,
    x1=1,
    y0=0,
    y1=1,
    container_name="Bezier",
    cpx=[0, 0.5540910363, 0.6268171668, 1],
    cpy=[0, 0.2577292919, 0.5195479393, 1])
# Decides whether to use the t parameters
# as normalized lengths or curve domains.
range_65 = Range(Domain=Domain(0, 1), Steps=number_slider_57)
graph_5 = GraphMapper(
    range_61,
    x0=0,
    x1=1,
    y0=0,
    y1=1,
    container_name="Bezier",
    cpx=[0, 0.7391828895, 0.628637135, 1],
    cpy=[0, 0.2603593469, 0.5803611279, 1])
graph_6 = GraphMapper(
    range_62,
    x0=0,
    x1=1,
    y0=0,
    y1=1,
    container_name="Bezier",
    cpx=[0, 0.7391828895, 0.628637135, 1],
    cpy=[0, 0.2603593469, 0.5803611279, 1])
graph_7 = GraphMapper(
    range_63,
    x0=0,
    x1=1,
    y0=0,
    y1=1,
    container_name="Bezier",
    cpx=[0, 0.7391828895, 0.628637135, 1],
    cpy=[0, 0.2603593469, 0.5803611279, 1])
graph_8 = GraphMapper(
    range_54,
    x0=0,
    x1=1,
    y0=0,
    y1=1,
    container_name="Bezier",
    cpx=[0, 0.8328191638, 0.4255454242, 1],
    cpy=[0, 0.1305431128, 0.758908391, 1])
graph_9 = GraphMapper(
    range_55,
    x0=0,
    x1=1,
    y0=0,
    y1=1,
    container_name="Bezier",
    cpx=[0, 0.8328191638, 0.4255454242, 1],
    cpy=[0, 0.1305431128, 0.758908391, 1])
# Graphmappers creating gradient spacing.
graph_10 = GraphMapper(
    range_56,
    x0=0,
    x1=1,
    y0=0,
    y1=1,
    container_name="Bezier",
    cpx=[0, 0.5887284875, 0.838911593, 1],
    cpy=[0, 0.2389970422, 0.5531810522, 1])
graph_11 = GraphMapper(range_57, x0=0, x1=1, y0=0, y1=1, container_name="Bezier", cpx=[0, 1, 0.2749994397, 1], cpy=[0, 0, 0.8804543018, 1])
# Graphmappers creating gradient spacing.
graph_12 = GraphMapper(
    range_52,
    x0=0,
    x1=1,
    y0=0,
    y1=1,
    container_name="Bezier",
    cpx=[0, 0.7920920849, 0.2108182013, 1],
    cpy=[0, 0.07999765873, 0.7866321802, 1])
graph_13 = GraphMapper(range_58, x0=0, x1=1, y0=0, y1=1, container_name="Bezier", cpx=[0, 1, 0.2749994397, 1], cpy=[0, 0, 0.8804543018, 1])
# Graphmappers creating gradient spacing.
graph_14 = GraphMapper(
    range_53,
    x0=0,
    x1=1,
    y0=0,
    y1=1,
    container_name="Bezier",
    cpx=[0, 0.5540910363, 0.6268171668, 1],
    cpy=[0, 0.2577292919, 0.5195479393, 1])
graph_15 = GraphMapper(
    range_59,
    x0=0,
    x1=1,
    y0=0,
    y1=1,
    container_name="Bezier",
    cpx=[0, 0.8328191638, 0.8231811523, 1],
    cpy=[0, 0.1305431128, 0.5109086037, 1])
# Curve to extrude along
crv_21 = Curve(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)
crv_22 = Curve(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)
graph_16 = GraphMapper(
    range_60,
    x0=0,
    x1=1,
    y0=0,
    y1=1,
    container_name="Bezier",
    cpx=[0, 0.7827259302, 0.6227278113, 1],
    cpy=[0, 0.2577292919, 0.4177274108, 1])
graph_17 = GraphMapper(range_64, x0=0, x1=1, y0=0, y1=1, container_name="Bezier", cpx=[0, 1, 0.2199984491, 1], cpy=[0, 0, 0.4554554224, 1])
# Graphmappers creating gradient spacing.
toggle_4 = BooleanToggle(False)
box_4 = CenterBox(Base=PlaneXY(1622.595655, -317.402594, 0), X=number_slider_58, Y=Slider(58, range=0..100), Z=Slider(43, range=0..100))
srf_10 = Surface(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)
mesh_9 = Mesh(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)
mesh_10 = Mesh(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)
mesh_11 = Mesh([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])
srf_11 = Surface([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])
mesh_12 = Mesh(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)
srf_12 = Surface(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)
srf_13 = Surface(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)
# Rail curves
crv_23 = Curve(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)
crv_24 = Curve(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)
crv_25 = Curve(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)
crv_26 = Curve(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)
wires_3 = BrepWireframe(Brep=box_4, Density=-1)
range_66 = Range(Domain=Domain(0, 1), Steps=Slider(12, range=0..100))
preview_59 = CustomPreview(Geometry=crv_21, Shader=ColourSwatch(SwatchColor=RGB(255, 0, 255)))
# Look at Rhino window
# to preview inputs
# Look at Rhino window
# to preview inputs
preview_60 = CustomPreview(Geometry=crv_22, Shader=ColourSwatch(SwatchColor=RGB(0, 255, 106)))
# Remap w parameters to be in the length
# of the list of amount of surfaces.
lng_3 = ListLength(List=srf_11)  # -> expr("x-1", Length)
# Graphmappers creating gradient spacing.
number_slider_59 = Slider(15, range=0..100)
tboxsweep_3 = TwistedBoxSweep(R¹=crv_23, R²=crv_24, R³=crv_25, R⁴=crv_26, t=graph_17, N=toggle_4)
tboxmsh_3 = TwistedBoxMesh(Mesh=mesh_12, Thickness=Slider(70, range=0..100), ParametersW=graph_5)
# Look at Rhino window
# to preview results
preview_61 = CustomPreview(Geometry=wires_3, Shader=ColourSwatch(SwatchColor=RGB(255, 0, 255)))
tboxsrf_3 = TwistedBoxSurface(Surface=srf_10, Thickness=Slider(10, range=0..100), ParametersU=graph_11, ParametersV=graph_8, ParametersW=graph_12)
tbox2mshs_3 = TwistedBoxTwoMeshes(MeshA=mesh_10, MeshB=mesh_9, ParametersW=graph_6)
tbox2srfs_3 = TwistedBoxTwoSurfaces(SurfaceA=srf_12, SurfaceB=srf_13, ParametersU=graph_13, ParametersV=graph_9, ParametersW=graph_14)
tboxextr_3 = TwistedBoxExtrude(Profile=crv_21, Direction=crv_22, ParametersT=range_65, Normalized=Toggle(True))
tboxarr_3 = TwistedBoxArray(Box=box_4, ParametersX=graph_16, ParametersY=graph_15, ParametersZ=graph_10)
# Look at Rhino window
# to preview inputs
preview_62 = CustomPreview(Geometry=[crv_23, crv_24, crv_25, crv_26], Shader=ColourSwatch(SwatchColor=RGB(255, 0, 255)))
# Remap w parameters to be in the length
# of the list of amount of meshes.
lng_4 = ListLength(List=mesh_11)  # -> expr("x-1", Length)
graph_18 = GraphMapper(range_66, x0=0, x1=1, y0=0, y1=1, container_name="Bezier", cpx=[0, 1, 0.2199984491, 1], cpy=[0, 0, 0.4554554224, 1])
geo_46 = Geometry(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)
geo_47 = Geometry(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)
geo_48 = Geometry(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)
geo_49 = Geometry(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)
geo_50 = Geometry(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)
geo_51 = Geometry(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)
bnd = Bounds(Numbers=graph_4)
dom_25 = ConstructDomain(DomainStart=0, DomainEnd=lng_3)
range_67 = Range(Domain=Domain(0, 1), Steps=Slider(2, range=0..10))
range_68 = Range(Domain=Domain(0, 1), Steps=Slider(7, range=0..10))
range_69 = Range(Domain=Domain(0, 1), Steps=Slider(17, range=0..100))
crv_27 = Curve(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)
geo_52 = Geometry(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)
bnd_2 = Bounds(Numbers=graph_7)
dom_26 = ConstructDomain(DomainStart=0, DomainEnd=lng_4)
bbox_44 = BoundingBox(Content=geo_50, Plane=PlaneXY(0, 0, 0))  # -> Box, Box_2
bbox_45 = BoundingBox(Content=geo_51, Plane=PlaneXY(0, 0, 0))  # -> Box, Box_2
bbox_46 = BoundingBox(Content=geo_47, Plane=PlaneXY(0, 0, 0))  # -> Box, Box_2
bbox_47 = BoundingBox(Content=geo_49, Plane=PlaneXY(0, 0, 0))  # -> Box, Box_2
bbox_48 = BoundingBox(Content=geo_48, Plane=PlaneXY(0, 0, 0))  # -> Box, Box_2
bbox_49 = BoundingBox(Content=geo_46, Plane=PlaneXY(0, 0, 0))  # -> Box, Box_2
# Graphmappers creating gradient spacing.
number_slider_60 = Slider(0.823, range=0..1)
remap = RemapNumbers(Value=graph_4, Source=bnd, Target=dom_25)  # -> Mapped, Clipped
bbox_50 = BoundingBox(Content=geo_52, Plane=PlaneXY(0, 0, 0))  # -> Box, Box_2
range_70 = Range(Domain=Domain(0, 1), Steps=Slider(3, range=0..10))
# Graphmappers creating gradient spacing.
number_slider_61 = Slider(30, range=0..100)
remap_2 = RemapNumbers(Value=graph_7, Source=bnd_2, Target=dom_26)  # -> Mapped, Clipped
graph_19 = GraphMapper(
    range_67,
    x0=0,
    x1=1,
    y0=0,
    y1=1,
    container_name="Bezier",
    cpx=[0, 0.7920920849, 0.08338234574, 1],
    cpy=[0, 0.07999765873, 0.9310413599, 1])
graph_20 = GraphMapper(
    range_68,
    x0=0,
    x1=1,
    y0=0,
    y1=1,
    container_name="Bezier",
    cpx=[0, 0.8328191638, 0.4368175268, 1],
    cpy=[0, 0.1305431128, 0.6513671875, 1])
graph_21 = GraphMapper(
    range_69,
    x0=0,
    x1=1,
    y0=0,
    y1=1,
    container_name="Bezier",
    cpx=[0, 0.679998219, 0.3599992096, 1],
    cpy=[0, 0.2050004601, 0.7140891552, 1])
tboxcrv_3 = TwistedBoxCurve(
    Curve=crv_27,
    ParametersT=graph_18,
    Normalized=True,
    SizeX=number_slider_59,
    SizeY=Slider(15, range=0..100),
    Rotation=Slider(30.72, range=0..1000))
# Box Morphing
morph_44 = BoxMorph(Geometry=geo_50, Reference=bbox_44.Box, Target=tboxextr_3)
# Look at Rhino window
# to preview results
preview_63 = CustomPreview(Geometry=tboxextr_3, Shader=ColourSwatch(SwatchColor=RGB(255, 255, 255)))
# Box Morphing
morph_45 = BoxMorph(Geometry=geo_51, Reference=bbox_45.Box, Target=tboxmsh_3)
# Box Morphing
morph_46 = BoxMorph(Geometry=geo_47, Reference=bbox_46.Box, Target=tboxsrf_3)
# Box Morphing
morph_47 = BoxMorph(Geometry=geo_49, Reference=bbox_47.Box, Target=tbox2srfs_3)
# Box Morphing
morph_48 = BoxMorph(Geometry=geo_48, Reference=bbox_48.Box, Target=tbox2mshs_3)
# Box Morphing
morph_49 = BoxMorph(Geometry=geo_46, Reference=bbox_49.Box, Target=tboxarr_3)
# Look at Rhino window
# to preview results
preview_64 = CustomPreview(Geometry=tboxsweep_3, Shader=ColourSwatch(SwatchColor=RGB(255, 255, 255)))
# Box Morphing
morph_50 = BoxMorph(Geometry=geo_52, Reference=bbox_50.Box, Target=tboxsweep_3)
crv_28 = Curve(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)
# Look at Rhino window
# to preview results
preview_65 = CustomPreview(Geometry=tboxmsh_3, Shader=ColourSwatch(SwatchColor=RGB(255, 255, 255)))
# Look at Rhino window
# to preview results
preview_66 = CustomPreview(Geometry=tboxsrf_3, Shader=ColourSwatch(SwatchColor=RGB(255, 255, 255)))
# Look at Rhino window
# to preview results
preview_67 = CustomPreview(Geometry=tbox2srfs_3, Shader=ColourSwatch(SwatchColor=RGB(255, 255, 255)))
# Look at Rhino window
# to preview results
preview_68 = CustomPreview(Geometry=tbox2mshs_3, Shader=ColourSwatch(SwatchColor=RGB(255, 255, 255)))
# Look at Rhino window
# to preview results
preview_69 = CustomPreview(Geometry=tboxarr_3, Shader=ColourSwatch(SwatchColor=RGB(255, 255, 255)))
graph_22 = GraphMapper(
    range_70,
    x0=0,
    x1=1,
    y0=0,
    y1=1,
    container_name="Bezier",
    cpx=[0, 0.8642356396, 0.007798628416, 1],
    cpy=[0, 0.2268953919, 0.9343816638, 1])
# Determines how the twisted boxes are interpolated.
number_slider_62 = Slider(0, range=0..3)
geo_53 = Geometry(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)
# Determines how the twisted boxes are interpolated.
number_slider_63 = Slider(0, range=0..3)
# Input can be
# a box also
tbox_32 = TwistedBox({C=Point(102, -773, 0), C=Point(131, -773, 0), C=Point(131, -748, 0), C=Point(102, -748, 0), C=Point(102, -773, 28), C=Point(131, -773, 28), C=Point(131, -748, 28), C=Point(102, -748, 28)})
tboxthrumshs_3 = TwistedBoxThroughMeshes(Mesh=mesh_11, ParametersW=remap_2.Mapped, InterpolationType=number_slider_63)
tboxthrusrfs_3 = TwistedBoxThroughSurfaces(Surface=srf_11, ParametersU=graph_2, ParametersV=graph_3, ParametersW=remap.Mapped, InterpolationType=number_slider_62)
bbox_51 = BoundingBox(Content=geo_53, Plane=PlaneXY(0, 0, 0))  # -> Box, Box_2
geo_54 = Geometry(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)
geo_55 = Geometry(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)
thicktbox_3 = ThickenTwistedBox(TwistedBox=tbox_32, ParametersW=graph_22, Thickness=number_slider_60, Hollow=Toggle(True))
tboxpipe_3 = TwistedBoxPipe(
    Curve=crv_28,
    ParametersU=graph_21,
    ParametersV=graph_20,
    ParametersW=graph_19,
    Normalized=True,
    Diameter=number_slider_61,
    Thickness=Slider(8, range=0..100),
    Rotation=Slider(45, range=0..1000))
# Box Morphing
morph_51 = BoxMorph(Geometry=geo_53, Reference=bbox_51.Box, Target=tboxcrv_3)
# Look at Rhino window
# to preview results
preview_70 = CustomPreview(Geometry=tboxcrv_3, Shader=ColourSwatch(SwatchColor=RGB(255, 255, 255)))
geo_56 = Geometry(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)
geo_57 = Geometry(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)
bbox_52 = BoundingBox(Content=geo_54, Plane=PlaneXY(0, 0, 0))  # -> Box, Box_2
bbox_53 = BoundingBox(Content=geo_55, Plane=PlaneXY(0, 0, 0))  # -> Box, Box_2
bbox_54 = BoundingBox(Content=geo_56, Plane=PlaneXY(0, 0, 0))  # -> Box, Box_2
bbox_55 = BoundingBox(Content=geo_57, Plane=PlaneXY(0, 0, 0))  # -> Box, Box_2
# Box Morphing
morph_52 = BoxMorph(Geometry=geo_54, Reference=bbox_52.Box, Target=tboxthrumshs_3)
# Box Morphing
morph_53 = BoxMorph(Geometry=geo_55, Reference=bbox_53.Box, Target=tboxthrusrfs_3)
# Look at Rhino window
# to preview results
preview_71 = CustomPreview(Geometry=tboxthrumshs_3, Shader=ColourSwatch(SwatchColor=RGB(255, 255, 255)))
# Look at Rhino window
# to preview results
preview_72 = CustomPreview(Geometry=tboxthrusrfs_3, Shader=ColourSwatch(SwatchColor=RGB(255, 255, 255)))
# Box Morphing
morph_54 = BoxMorph(Geometry=geo_56, Reference=bbox_54.Box, Target=thicktbox_3)
# Extrude to point
number_slider_64 = Slider(5, range=0..10)
# Box Morphing
morph_55 = BoxMorph(Geometry=geo_57, Reference=bbox_55.Box, Target=tboxpipe_3)
# Look at Rhino window
# to preview results
preview_73 = CustomPreview(Geometry=tboxpipe_3, Shader=ColourSwatch(SwatchColor=RGB(255, 255, 255)))
# Look at Rhino window
# to preview results
preview_74 = CustomPreview(Geometry=thicktbox_3, Shader=ColourSwatch(SwatchColor=RGB(255, 255, 255)))
range_71 = Range(Domain=Domain(0, 1), Steps=number_slider_64)
# Point  to extrude to
crv_29 = Curve(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)
pt_5 = Point(Point(436.0686286, -370.405151, 73.32144686))
preview_75 = CustomPreview(Geometry=crv_29, Shader=ColourSwatch(SwatchColor=RGB(255, 0, 255)))
# Look at Rhino window
# to preview inputs
# Look at Rhino window
# to preview inputs
preview_76 = CustomPreview(Geometry=pt_5, Shader=ColourSwatch(SwatchColor=RGB(0, 255, 106)))
tboxextr_4 = TwistedBoxExtrude(Profile=crv_29, Direction=pt_5, ParametersT=range_71, Normalized=True)
geo_58 = Geometry(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)
bbox_56 = BoundingBox(Content=geo_58, Plane=PlaneXY(0, 0, 0))  # -> Box, Box_2
# Box Morphing
morph_56 = BoxMorph(Geometry=geo_58, Reference=bbox_56.Box, Target=tboxextr_4)
# Look at Rhino window
# to preview results
preview_77 = CustomPreview(Geometry=tboxextr_4, Shader=ColourSwatch(SwatchColor=RGB(255, 255, 255)))
