# Grasshopper definition Pf_MirrorCutMeshBasic.gh (Grasshopper 0.9.76)
# plug-ins: Pufferfish

# ---- group: Mesh to mirror cut
mbox = MeshBox(Base={Plane=PlaneXY(0, 0, 0), X=Domain(-10, 10), Y=Domain(-10, 10), Z=Domain(-10, 10)}, XCount=10, YCount=10, ZCount=10)

mbox_2 = MeshBox(Base={Plane=PlaneXY(0, 0, 0), X=Domain(-10, 10), Y=Domain(-10, 10), Z=Domain(-10, 10)}, XCount=10, YCount=10, ZCount=10)

# ----
X = UnitX(Factor=100)

# ----
# Pufferfish
# By: Michael Pryor
# Pf_Mirror Cut Mesh Basic
# Mirror Cut Mesh - Basic
# Change the slider values to
# rotate the mirror cut plane
number_slider = Slider(26, range=0..360)

move = Move(Geometry=mbox_2, Motion=X)  # -> Geometry, Transform

# ---- group: Rotate mirror cut plane
volume = Volume(Geometry=mbox)  # -> Volume, Centroid
xy = XYPlane(Origin=volume.Centroid)
yz = YZPlane(Origin=volume.Centroid)
xz = XZPlane(Origin=volume.Centroid)
rotate = Rotate(Geometry=xy, Angle=degrees(Slider(210, range=0..360)), Plane=yz)  # -> Geometry, Transform
rotate_2 = Rotate(Geometry=rotate.Geometry, Angle=degrees(number_slider), Plane=xz)  # -> Geometry, Transform

# ----
# Mirror Cut Mesh  - Bridging
# Change the slider values to
# rotate the mirror cut plane
number_slider_2 = Slider(322, range=0..360)

# ---- group: Rotate mirror cut plane
volume_2 = Volume(Geometry=move.Geometry)  # -> Volume, Centroid
xy_2 = XYPlane(Origin=volume_2.Centroid)
yz_2 = YZPlane(Origin=volume_2.Centroid)
xz_2 = XZPlane(Origin=volume_2.Centroid)
rotate_3 = Rotate(Geometry=xy_2, Angle=degrees(Slider(166, range=0..360)), Plane=yz_2)  # -> Geometry, Transform
rotate_4 = Rotate(Geometry=rotate_3.Geometry, Angle=degrees(number_slider_2), Plane=xz_2)  # -> Geometry, Transform

# ----
# Change the slider value to
# move the mirror cut plane
number_slider_3 = Slider(8, range=-100..100)
# Change the slider value to
# move the mirror cut plane
number_slider_4 = Slider(16, range=-100..500)

# ---- group: Connection bridge options
number_slider_5 = Slider(2, range=0..10)
number_slider_6 = Slider(3, range=0..20)
number_slider_7 = Slider(-0.87, range=-1..2)

# ---- group: Controlling how much of mirror cut gets connection bridge
number_slider_8 = Slider(4.71, range=0..20)
number_slider_9 = Slider(9.626, range=0..40)

# ---- group: Flip mirror & Join option
toggle = BooleanToggle(True)
toggle_2 = BooleanToggle(False)

# ----
# Try the different
# connection types
number_slider_10 = Slider(2, range=0..10)

# ---- group: Move mirror cut plane
Z = UnitZ(Factor=number_slider_3)
move_2 = Move(Geometry=rotate_2.Geometry, Motion=Z)  # -> Geometry, Transform

Z_2 = UnitZ(Factor=number_slider_4)
move_3 = Move(Geometry=rotate_4.Geometry, Motion=Z_2)  # -> Geometry, Transform

# ---- group: Flip mirror & Join option
toggle_3 = BooleanToggle(True)
toggle_4 = BooleanToggle(False)

# ---- group: Mirror Preview
preview = CustomPreview(Geometry=move_3.Geometry, Shader=ColourSwatch(SwatchColor=RGB(0, 240, 140)))

# ----
mircutmsh = MirrorCutMesh(
    Mesh=move.Geometry,
    MirrorPlane=move_3.Geometry,
    Reach=number_slider_8,
    Offset=number_slider_9,
    Flip=toggle_2,
    Join=toggle,
    Keep=False,
    ConnectionType=number_slider_5,
    Bulge=number_slider_7,
    Divisions=number_slider_6,
    WeldTolerance=0.01)  # -> MirrorCut, SplitIndex, ReachPlane, OffsetPlane, Intersected
mircutmsh_2 = MirrorCutMesh(
    Mesh=mbox,
    MirrorPlane=move_2.Geometry,
    Reach=0,
    Offset=0,
    Flip=toggle_4,
    Join=toggle_3,
    Keep=False,
    ConnectionType=number_slider_10,
    Bulge=-0.5,
    Divisions=1,
    WeldTolerance=0.01)  # -> MirrorCut, SplitIndex, ReachPlane, OffsetPlane, Intersected
pln = Plane(mircutmsh.ReachPlane)
pln_2 = Plane(mircutmsh.OffsetPlane)

# ---- group: Mesh smoothing
msmooth = SmoothMesh(Mesh=mircutmsh.MirrorCut, Strength=Slider(0.415, range=0..1), SkipNaked=True, Iterations=Slider(10, range=0..10))

msmooth_2 = SmoothMesh(Mesh=mircutmsh_2.MirrorCut, Strength=Slider(0.415, range=0..1), SkipNaked=True, Iterations=Slider(10, range=0..10))

# ---- group: Result Preview
preview_2 = CustomPreview(Geometry=msmooth, Shader=ColourSwatch(SwatchColor=RGB(129, 216, 240)))

preview_3 = CustomPreview(
    Geometry=msmooth_2,
    Shader={ambient=RGB(0, 0, 0), diffuse=RGB(255, 105, 180), emission=RGB(76, 32, 54), shine=0.5, specular=RGB(255, 255, 255), transparency=0})
