# Grasshopper definition Pf_TweenCurves.gh (Grasshopper 0.9.76)
# plug-ins: Pufferfish

# Tween Curve On Surface - Basic
# Tween factor of curve blend on surface.
# 0 = curve A and 1 = curve B.
# Values can be lower than 0 and higher
# than 1 which will tween beyond
# curve A and B.
number_slider = Slider(0.608, range=0..1)
# Tween factor of curve blend along curve.
# 0 = curve A and 1 = curve B.
# Values can be lower than 0 and higher
# than 1 which will tween beyond
# curve A and B.
number_slider_2 = Slider(0.191, range=0..1)
# Tween Curve - Basic
# Tween factor of curve blend.
# 0 = curve  A and 1 = curve  B.
# Values can be lower than 0 and higher
# than 1 which will tween beyond
# curve  A and B.
factor = Slider(0.482, range=0..1)
# Consider these sliders like percentages.
# 0=0% and 1=100%
weights = Slider(0.13, range=0..1)
# Number of steps to do between
of_steps = Slider(19, range=0..100)
weights_2 = Slider(0.244, range=0..1)
weights_3 = Slider(1, range=0..1)
# Tween Curve On Surface - Multiple
crv = Curve(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)
crv_2 = Curve(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)
srf = Surface(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)
crv_3 = Curve(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)
# Tween Curve Along Curve - Multiple
crv_4 = Curve(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)
crv_5 = Curve(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)
crv_6 = Curve(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)
crv_7 = Curve(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)
crv_8 = Curve(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)
# Tween Curve Along Curve - Open to Closed
crv_9 = Curve(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)
crv_10 = Curve(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)
# Tween Curve Along Curve - Multiple Gradients
crv_11 = Curve(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)
crv_12 = Curve(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)
crv_13 = Curve(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)
# Tween Curve On Surface - Multiple Gradients
crv_14 = Curve(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)
crv_15 = Curve(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)
srf_2 = Surface(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)
# Number of steps to do between
of_steps_2 = Slider(10, range=0..100)
# Number of steps to do between
of_steps_3 = Slider(30, range=0..100)
# Number of steps to do between
of_steps_4 = Slider(34, range=0..100)
# Number of steps to do between
of_steps_5 = Slider(34, range=0..100)
# Number of steps to do between
of_steps_6 = Slider(34, range=0..100)
# Number of steps to do between
of_steps_7 = Slider(20, range=0..100)
# Guide 2 is optional.
# Unplug it to see the
# difference in tween.
crv_16 = Curve(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)
crv_17 = Curve(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)
srf_3 = Surface(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)
crv_18 = Curve(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)
crv_19 = Curve(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)
crv_20 = Curve(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)
# Tween Curve Along Curve - Basic
crv_21 = Curve(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)
# Pf_Tween Curves
crv_22 = Curve(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)
crv_23 = Curve(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)
# Tween Curve - Multiple
crv_24 = Curve(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)
crv_25 = Curve(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)
# Tween Curve - Multiple Gradient
crv_26 = Curve(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)
crv_27 = Curve(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)
# Tween Curve - To Weighted Average
crv_28 = Curve(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)
crv_29 = Curve(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)
crv_30 = Curve(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)
crv_31 = Curve(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)
curve_a = Data(crv_19)
curve_a_2 = Data(crv_21)
curve_b = Data(crv_17)
surface = Data(srf_3)
guide_2 = Data(crv_16)
factor_2 = Data(number_slider)
curve_b_2 = Data(crv_20)
guide_1 = Data(crv_18)
factor_3 = Data(number_slider_2)
curve_b2 = Data(crv_30)
curve_b3 = Data(crv_31)
curve_b1 = Data(crv_29)
curve_a_3 = Data(crv_22)
curve_b_3 = Data(crv_23)
factor_4 = Data(factor)
curve_a_4 = Data(crv_28)
# Setting to false will make the range
# never reach the start and end (0 or 1)
toggle = BooleanToggle(False)
# Setting to false will make the range
# never reach the start and end (0 or 1)
toggle_2 = BooleanToggle(False)
# Setting to false will make the range
# never reach the start and end (0 or 1)
toggle_3 = BooleanToggle(False)
# Setting to false will make the range
# never reach the start and end (0 or 1)
toggle_4 = BooleanToggle(False)
# Setting to false will make the range
# never reach the start and end (0 or 1)
toggle_5 = BooleanToggle(False)
# Setting to false will make the range
# never reach the start and end (0 or 1)
toggle_6 = BooleanToggle(False)
# Setting to false will make the range
# never reach the start and end (0 or 1)
toggle_7 = BooleanToggle(False)
# Pufferfish
# By: Michael Pryor
twn2crvs = TweenTwoCurves(CurveA=curve_a_3, CurveB=curve_b_3, Factor=factor_4, Refit=0, PointSample=0)
wavcrv = WeightedAverageCurve(Curves=[curve_b1, curve_b2, curve_b3], Weights=[weights_2, weights_3, weights], Refit=3, PointSample=0)
twn2crvscrv = TweenTwoCurvesAlongCurve(CurveA=curve_a_2, CurveB=curve_b_2, Guide1=guide_1, Guide2=guide_2, Factor=factor_3, Refit=0, PointSample=0)
twn2crvssrf = TweenTwoCurvesOnSurface(CurveA=curve_a, CurveB=curve_b, Surface=surface, Factor=factor_2, Refit=3, PointSample=0)
reprange = ReparameterizedRange(Steps=of_steps, Include=toggle)
reprange_2 = ReparameterizedRange(Steps=of_steps_2, Include=toggle_2)
# Optional Refit and Sample Point
# match methods. Read input descriptions.
swatch = ColourSwatch(SwatchColor=RGB(0, 229, 255))
# Use the graph to change the distribution
# of tweens as gradients between the surfaces
reprange_3 = ReparameterizedRange(Steps=of_steps_3, Include=toggle_3)
# Guide 2 is optional.
# Unplug it to see the
# difference in tween.
reprange_4 = ReparameterizedRange(Steps=of_steps_4, Include=toggle_4)
reprange_5 = ReparameterizedRange(Steps=of_steps_5, Include=toggle_5)
# Use the graph to change the distribution
# of tweens as gradients between the surfaces
reprange_6 = ReparameterizedRange(Steps=of_steps_6, Include=toggle_6)
# Use the graph to change the distribution
# of tweens as gradients between the surfaces
reprange_7 = ReparameterizedRange(Steps=of_steps_7, Include=toggle_7)
# So we get a weighted average (blend)
# of multiple curves and then tween to that.
preview = CustomPreview(
    Geometry=wavcrv,
    Shader={ambient=RGB(0, 0, 0), diffuse=RGB(255, 105, 180), emission=RGB(76, 32, 54), shine=0.5, specular=RGB(255, 255, 255), transparency=0})
# Optional Refit and Sample Point
# match methods. Read input descriptions.
swatch_2 = ColourSwatch(SwatchColor=RGB(0, 229, 255))
# Optional Refit and Sample Point
# match methods. Read input descriptions.
swatch_3 = ColourSwatch(SwatchColor=RGB(0, 229, 255))
twn2crvs_2 = TweenTwoCurves(CurveA=curve_a_4, CurveB=wavcrv, Factor=Slider(0.55, range=0..1), Refit=0, PointSample=0)
preview_2 = CustomPreview(Geometry=twn2crvs, Shader=swatch)
factor_5 = Data(reprange_4)
factor_6 = Data(reprange_5)
curve_a_5 = Data(crv)
curve_a_6 = Data(crv_4)
curve_b_4 = Data(crv_2)
surface_2 = Data(srf)
guide_2_2 = Data(crv_3)
curve_a_7 = Data(crv_9)
curve_b_5 = Data(crv_5)
guide_1_2 = Data(crv_6)
curve_b_6 = Data(crv_7)
guide_1_3 = Data(crv_8)
factor_7 = Data(reprange_2)
curve_a_8 = Data(crv_24)
curve_b_7 = Data(crv_25)
factor_8 = Data(reprange)
graph = GraphMapper(
    reprange_7,
    x0=0,
    x1=1,
    y0=0,
    y1=1,
    container_name="Bezier",
    cpx=[0, 0.4275220335, 0.9395222068, 1],
    cpy=[0, 0, 0.423953712, 1])
graph_2 = GraphMapper(
    reprange_3,
    x0=0,
    x1=1,
    y0=0,
    y1=1,
    container_name="Bezier",
    cpx=[0, 0.7020000815, 0.9580001831, 1],
    cpy=[0, 0.1009848714, 0.4979708195, 1])
# Guide 2 is optional.
# Unplug it to see the
# difference in tween.
graph_3 = GraphMapper(
    reprange_6,
    x0=0,
    x1=1,
    y0=0,
    y1=1,
    container_name="Bezier",
    cpx=[0, 0.7020000815, 0.9580001831, 1],
    cpy=[0, 0.1009848714, 0.4979708195, 1])
preview_3 = CustomPreview(Geometry=twn2crvssrf, Shader=swatch_2)
preview_4 = CustomPreview(Geometry=twn2crvscrv, Shader=swatch_3)
twn2crvssrf_2 = TweenTwoCurvesOnSurface(CurveA=curve_a_5, CurveB=curve_b_4, Surface=surface_2, Factor=factor_7, Refit=3, PointSample=0)
twn2crvs_3 = TweenTwoCurves(CurveA=curve_a_8, CurveB=curve_b_7, Factor=factor_8, Refit=0, PointSample=0)
twn2crvscrv_2 = TweenTwoCurvesAlongCurve(CurveA=curve_a_6, CurveB=curve_b_5, Guide1=guide_1_2, Guide2=guide_2_2, Factor=factor_5, Refit=0, PointSample=0)
twn2crvscrv_3 = TweenTwoCurvesAlongCurve(CurveA=curve_a_7, CurveB=curve_b_6, Guide1=guide_1_3, Factor=factor_6, Refit=0, PointSample=0)
preview_5 = CustomPreview(Geometry=twn2crvs_2, Shader=ColourSwatch(SwatchColor=RGB(0, 25, 255)))
# Optional Refit and Sample Point
# match methods. Read input descriptions.
swatch_4 = ColourSwatch(SwatchColor=RGB(0, 195, 255))
curve_a_9 = Data(crv_11)
guide_2_3 = Data(crv_10)
curve_b_8 = Data(crv_12)
guide_1_4 = Data(crv_13)
# Optional Refit and Sample Point
# match methods. Read input descriptions.
swatch_5 = ColourSwatch(SwatchColor=RGB(0, 195, 255))
factor_9 = Data(graph_3)
curve_a_10 = Data(crv_14)
curve_b_9 = Data(crv_15)
surface_3 = Data(srf_2)
factor_10 = Data(graph_2)
curve_a_11 = Data(crv_26)
curve_b_10 = Data(crv_27)
factor_11 = Data(graph)
# Optional Refit and Sample Point
# match methods. Read input descriptions.
swatch_6 = ColourSwatch(SwatchColor=RGB(0, 195, 255))
# Optional Refit and Sample Point
# match methods. Read input descriptions.
swatch_7 = ColourSwatch(SwatchColor=RGB(0, 195, 255))
preview_6 = CustomPreview(Geometry=twn2crvs_3, Shader=swatch_4)
preview_7 = CustomPreview(Geometry=twn2crvssrf_2, Shader=swatch_5)
twn2crvssrf_3 = TweenTwoCurvesOnSurface(CurveA=curve_a_10, CurveB=curve_b_9, Surface=surface_3, Factor=factor_10, Refit=3, PointSample=0)
twn2crvscrv_4 = TweenTwoCurvesAlongCurve(CurveA=curve_a_9, CurveB=curve_b_8, Guide1=guide_1_4, Guide2=guide_2_3, Factor=factor_9, Refit=0, PointSample=0)
twn2crvs_4 = TweenTwoCurves(CurveA=curve_a_11, CurveB=curve_b_10, Factor=factor_11, Refit=0, PointSample=0)
preview_8 = CustomPreview(Geometry=twn2crvscrv_2, Shader=swatch_6)
preview_9 = CustomPreview(Geometry=twn2crvscrv_3, Shader=swatch_7)
# Optional Refit and Sample Point
# match methods. Read input descriptions.
swatch_8 = ColourSwatch(SwatchColor=RGB(0, 141, 217))
# Optional Refit and Sample Point
# match methods. Read input descriptions.
swatch_9 = ColourSwatch(SwatchColor=RGB(0, 141, 217))
# Optional Refit and Sample Point
# match methods. Read input descriptions.
swatch_10 = ColourSwatch(SwatchColor=RGB(0, 195, 255))
preview_10 = CustomPreview(Geometry=twn2crvssrf_3, Shader=swatch_8)
preview_11 = CustomPreview(Geometry=twn2crvs_4, Shader=swatch_9)
preview_12 = CustomPreview(Geometry=twn2crvscrv_4, Shader=swatch_10)
