# Grasshopper definition 02-Listas.gh (Grasshopper 0.9.76)

panel = Panel("""0
1
2
3
4
5
6
7
8""")

# ---- group: Menor o mayor
slider = Slider(250, range=0..1000)
panel_2 = Panel("""300
200
100
560
250""")
larger = LargerThan(FirstNumber=panel_2, SecondNumber=slider)  # -> LargerThan, OrEqualTo
smaller = SmallerThan(FirstNumber=panel_2, SecondNumber=slider)  # -> SmallerThan, OrEqualTo
panel_3 = Panel(larger.LargerThan)

# ---- group: desplazar la lista
panel_4 = Panel(panel)
shift = ShiftList(List=panel_4, Shift=1, Wrap=Toggle(True))
panel_5 = Panel(shift)

# ---- group: crear ramas
partition = PartitionList(List=panel, Size=Slider(3, range=0..10))
panel_6 = Panel(partition)

# ---- group: separar con un patron
panel_7 = Panel("""false
true
true""")
panel_8 = Panel(panel)
dispatch = Dispatch(List=panel_8, DispatchPattern=panel_7)  # -> ListA, ListB
panel_9 = Panel(dispatch.ListA)
panel_10 = Panel(dispatch.ListB)

# ---- group: extraer de una lista
panel_11 = Panel("""0
1
2
3
4
5
6
7
8""")
cull_i = CullIndex(List=panel_11, Indices=Slider(1, range=0..10), Wrap=True)
panel_12 = Panel(cull_i)

# ---- group: insertar un valor
ins = ListInsert(List=panel, Item="000", Indices=Slider(7, range=0..10), Wrap=False)
panel_13 = Panel(ins)

# ---- group: invertir la lista
rev = ReverseList(List=panel)
panel_14 = Panel(rev)

# ---- group: longitud de lista
lng = ListLength(List=panel_4)
panel_15 = Panel(lng)

# ----
panel_16 = Panel(smaller.SmallerThan)

# ---- group: crear ramas / param viewer
viewer = ParamViewer(panel_6)

# ---- group: selecionar de una lista
slider_2 = Slider(6, range=0..10)

# ----
item = ListItem(List=panel, Index=slider_2, Wrap=True)

# ---- group: selecionar de una lista (continued)
panel_17 = Panel(item)
