# Grasshopper definition 03-Geometria-Lists.gh (Grasshopper 0.9.76)

box = CenterBox(Base=PlaneXY(0, 0, 0), X=Slider(20, range=0..100), Y=Slider(40, range=0..100), Z=Slider(50, range=0..100))
explode = BrepComponents(Brep=box)  # -> Faces, Edges, Vertices
panel = Panel(explode.Faces)
area = Area(Geometry=explode.Faces)  # -> Area, Centroid

# ---- group: numerar las caras
points = PointList(Points=area.Centroid, Tags=True, Lines=True, Size=Slider(5, range=0..10))

# ---- group: extraer directament de la lista
panel_2 = Panel("""4
5""")
cull_i = CullIndex(List=explode.Faces, Indices=panel_2, Wrap=False)
panel_3 = Panel(cull_i)

# ---- group: extraer las caras segun una condicion / S se ha reparametrizado
md_slider = MDSlider(
    slider_value=Point(0.5029535061, 0.4998645317, 0.5),
    SliderMode=0,
    x_domain=Domain(0, 1),
    y_domain=Domain(0, 1),
    z_domain=Domain(0, 1))
eval = EvaluateSurface(Surface=reparameterize(explode.Faces), Point=md_slider)  # -> Point, Normal, Frame

# ---- group: extraer las caras segun una condicion
Z = UnitZ(Factor=1)
angle = Angle(VectorA=eval.Normal, VectorB=Z)  # -> Angle, Reflex
panel_4 = Panel(angle.Angle)
deg = Degrees(Radians=angle.Angle)
panel_5 = Panel(deg)
equals = Equality(FirstNumber=deg, SecondNumber=Slider(90, range=0..100))  # -> Equality, Inequality
panel_6 = Panel(equals.Equality)
cull = CullPattern(List=explode.Faces, CullPattern=equals.Equality)
