# Grasshopper definition 05-DisplaceGeometryConect.gh (Grasshopper 0.9.76)

cir = Circle(Plane=PlaneXY(0, 0, 0), Radius=Slider(10, range=0..10))

# ---- group: make roof circle
Z = UnitZ(Factor=Slider(20, range=0..100))
move = Move(Geometry=cir, Motion=Z)  # -> Geometry, Transform

# ---- group: division of bottom and top circles
divide = DivideCurve(Curve=move.Geometry, Count=Slider(20, range=0..100), Kinks=False)  # -> Points, Tangents, Parameters
divide_2 = DivideCurve(Curve=cir, Count=Slider(20, range=0..100), Kinks=False)  # -> Points, Tangents, Parameters

# ---- group: shift the list
shift = ShiftList(List=divide.Points, Shift=Slider(7, range=0..10), Wrap=Toggle(True))

# ---- group: just to see the number of the points
slider = Slider(1, range=0..10)
points = PointList(Points=divide_2.Points, Tags=True, Lines=True, Size=slider)
points_2 = PointList(Points=shift, Tags=True, Lines=True, Size=slider)

# ---- group: separate the list of point one yes one not and move some of them
panel = Panel("""true
false""")
dispatch = Dispatch(List=divide_2.Points, DispatchPattern=panel)  # -> ListA, ListB
pt = Point(dispatch.ListA)
pt_2 = Point(dispatch.ListB)
Z_2 = UnitZ(Factor=Slider(2, range=0..10))
move_2 = Move(Geometry=pt, Motion=Z_2)  # -> Geometry, Transform

# ---- group: join both list keeping the alternating values
weave = Weave(Pattern=panel, Stream0=pt_2, Stream1=move_2.Geometry, NullGaps=False)

# ---- group: merge join both list but one after the other one, not mixing
merge = Merge(Data1=move_2.Geometry, Data2=pt_2)

# ----
ln = Line(StartPoint=shift, EndPoint=divide_2.Points)
loft_opt = LoftOptions(Closed=Toggle(True), Adjust=False, Rebuild=0, Refit=0, Type=0)
loft = Loft(Curves=ln, Options=loft_opt)
intcrv = Interpolate(Vertices=weave, Degree=3, Periodic=Toggle(True), KnotStyle=1)  # -> Curve, Length, Domain
