# Grasshopper definition 07-ParametricHinge.gh (Grasshopper 1.0.4)

# ---- group: Control box
espesor_de_extrusion = Slider(0.1, range=0.1..10)
offset_rectangulo = Slider(2, range=0..10)
espaciado_en_x = Slider(10, range=0..20)
espaciado_en_y = Slider(20, range=0..100)
copias_en_y = Slider(10, range=0..100)
copias_en_x = Slider(20, range=0..100)

# ----
rectangle = Rectangle(Plane=PlaneXY(0, 0, 0), XSize=Domain(-1, 1), YSize=Domain(-2, 2), Radius=0)  # -> Rectangle, Length

# ---- group: Input geometry
curve = Curve(<curve referenced from the Rhino model>)

# ---- group: insert here
geometry = Geometry(rectangle.Rectangle)

# ----
unit_x = UnitX(Factor=espaciado_en_x)
vector_xyz = VectorXYZ(XComponent=Slider(5, range=0..10), YComponent=Slider(10, range=0..100), ZComponent=0)  # -> Vector, Length
linear_array = LinearArray(Geometry=geometry, Direction=unit_x, Count=copias_en_x)  # -> Geometry, Transform
move = Move(Geometry=linear_array.Geometry, Motion=vector_xyz.Vector)  # -> Geometry, Transform
merge = Merge(Data1=linear_array.Geometry, Data2=move.Geometry)
unit_y = UnitY(Factor=espaciado_en_y)
linear_array_2 = LinearArray(Geometry=merge, Direction=unit_y, Count=copias_en_y)  # -> flatten(Geometry), Transform

panel = Panel(vector_xyz.Vector)
geometry_2 = Geometry(linear_array_2.Geometry)

# ---- group: RECTANGULO
divide_curve = DivideCurve(Curve=geometry_2, Count=Slider(20, range=0..100), Kinks=False)  # -> flatten(Points), Tangents, Parameters
panel_2 = Panel(divide_curve.Points)
deconstruct = Deconstruct(Point=divide_curve.Points)  # -> XComponent, YComponent, ZComponent
bounds = Bounds(Numbers=deconstruct.XComponent)
bounds_2 = Bounds(Numbers=deconstruct.YComponent)
deconstruct_domain = DeconstructDomain(Domain=bounds)  # -> Start, End
deconstruct_domain_2 = DeconstructDomain(Domain=bounds_2)  # -> Start, End
construct_point = ConstructPoint(XCoordinate=deconstruct_domain.End, YCoordinate=deconstruct_domain_2.End, ZCoordinate=0)
construct_point_2 = ConstructPoint(XCoordinate=deconstruct_domain.Start, YCoordinate=deconstruct_domain_2.Start, ZCoordinate=0)
rectangle_2pt = Rectangle2Pt(Plane=PlaneXY(0, 0, 0), PointA=construct_point_2, PointB=construct_point, Radius=0)  # -> Rectangle, Length
offset = Offset(Curve=rectangle_2pt.Rectangle, Distance=offset_rectangulo, Plane=PlaneXY(0, 0, 0), Corners=1)

# ---- group: Extrusion final
merge_2 = Merge(Data1=offset, Data2=geometry_2)  # -> flatten(Result)
unit_z = UnitZ(Factor=espesor_de_extrusion)
boundary_surfaces = BoundarySurfaces(Edges=merge_2)
extrude = Extrude(Base=boundary_surfaces, Direction=unit_z)

# ---- group: FINAL
geometria_final = Geometry(extrude)
