# Grasshopper definition inflation.gh (Grasshopper 1.0.4)
# plug-ins: Weaverbird, Kangaroo2 Components

W = WidthCount(6)
mbox = MeshBox(Base={Plane=PlaneXY(0, 0, 0), X=Domain(-10, 10), Y=Domain(-10, 10), Z=Domain(-10, 10)}, XCount=W, YCount=W, ZCount=W)
tri = Triangulate(Mesh=mbox)  # -> Mesh, Count
wbtriangles = WeaverbirdsSplitTrianglesSubdivision(MeshCurves=tri.Mesh, Level=Slider(2, range=0..10))
Z = UnitZ(Factor=W)
mesh = Mesh(wbtriangles)
hinge = Hinge(Strength=1)
nofoldthrough = NoFoldThrough(Strength=1)
clean = CombineClean(Meshes=mesh)
move = Move(Geometry=clean, Motion=Z)  # -> Geometry, Transform
neg = Negative(Value=Slider(0.02, range=0..0.1))
edgelengths = EdgeLengths(Mesh=move.Geometry, LengthFactor=1, Strength=Slider(10, range=0..10))
grab = Grab(On=True, Strength=1, Range=3)  # -> Grab, Anchors
smooth = Smooth(M=move.Geometry, Strength=1)
vertexloads = VertexLoads(Mesh=move.Geometry, Strength=neg)
floor = Floor(Strength=1)
pressure = Pressure(M=move.Geometry, Strength=Slider(0.08, range=0..1))
show = Show(G=move.Geometry)
merge = Merge(Data1=show, Data2=floor, Data3=pressure, Data4=edgelengths, Data5=smooth, Data6=vertexloads, Data7=grab.Grab)  # -> flatten(Result)
bouncysolver = BouncySolver(
    GoalObjects=merge,
    Reset=Button(),
    Threshold=1e-15,
    Tolerance=0.01,
    Damping=Slider(0.99, range=0..1),
    Iterations=Slider(20, range=0..100),
    On=Toggle(True))  # -> I, V, O
item = ListItem(List=bouncysolver.O, Index="1", Wrap=True)
data = Data(item)
