# Grasshopper definition 3d spiral.gh (Grasshopper 0.9.14)
# plug-ins: Silkworm

ratio_of_filament_to_nozzle = Slider(0.028727, range=0..0.1)
generator_sort_option = Slider(2, range=0..10)
starting_pressure = Slider(1.3, range=0..10)
speed = Slider(10, range=0..100)
loadsettings = LoadSettings(String=["absolute_extrudersteps = 1", "acceleration = 0", "bed_size = 200,200", "bed_temperature = 60", "bridge_fan_speed = 100", "bridge_flow_ratio = 1", "bridge_speed = 20", "brim_width = 3", "complete_objects = 0", "cooling = 0"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])

layer_height = Slider(0.3, range=0..1)
inner_loop_radius = Slider(31, range=0..100)
height = Slider(100, range=0..100)
# EXAMPLE - 3D Spiral
# 
# Create a single unsupported 3d spiral with low extrusion speeds.
# www.projectsilkworm.com/about
# info@projectsilkworm.com
outer_loop_radius = Slider(33, range=0..100)
max_pi = Slider(3.76, range=0..10)
min_pi = Slider(0, range=0..10)
max_spiral_radius = Slider(20, range=0..20)
min_spiral_radius = Slider(0, range=0..10)
pt = Point(Point(100.0805625, 101.5562758, 0))

division = Division(A=height, B=layer_height)
range = Range(Domain=Domain(0, 1), Steps=expr("N-1", division))
range_2 = Range(Domain=Domain(0, 1), Steps=expr("N-1", division))

graph = GraphMapper(
    range_2,
    x0=0,
    x1=1,
    y0=0,
    y1=1,
    container_name="Bezier",
    cpx=[0, 0.4852173328, 0.5084058046, 1],
    cpy=[0, 0.4828986526, 0.5023193359, 1])
graph_2 = GraphMapper(
    range,
    x0=0,
    x1=1,
    y0=0,
    y1=1,
    container_name="Sine Summation",
    Equation0_px=[0, 0.475976795],
    Equation0_py=[0, 0.1100292802],
    Equation1_px=[0.4700405896, 1],
    Equation1_py=[0.5360136628, 0])

# ----
# Create Flow Loops
cir = Circle(Plane=pt, Radius=outer_loop_radius)
cir_2 = Circle(Plane=pt, Radius=inner_loop_radius)
planar = PlanarSrf(Edges=[cir_2, cir])
filler = SilkwormFiller(SettingsDictionary=loadsettings, PlanarBreps=planar, InfillType=Slider(0, range=0..100))

pi = Pi(Factor=min_pi)
pi_2 = Pi(Factor=max_pi)
dom = Domain(DomainStart=min_spiral_radius, DomainEnd=max_spiral_radius)
# Create Spiral Geometry
dom_2 = Domain(DomainStart=pi, DomainEnd=pi_2)
remap = RemapNumbers(Value=graph, Source=Domain(0, 1), Target=dom_2)
series = Series(Start=0, Step=layer_height, Count=division)
remap_2 = RemapNumbers(Value=graph_2, Source=Domain(0, 1), Target=dom)
pt_2 = PointCylindrical(BasePlane=pt, Angle=remap, Radius=remap_2, Elevation=series)
intcrv = Interpolate(Vertices=pt_2, Degree=3, Periodic=False, KnotStyle=1)  # -> Curve, Length, Domain

delimiter = SilkwormMovementDelimiter(
    StartVec=Vector(0, 0, -1),
    StartSpd=360,
    StartPrs=starting_pressure,
    EndVec=Vector(0, 0, 1),
    EndSpd=360,
    EndPrs=-1,
    Travel=7200)
# Modify Print Properties
movement = SilkwormMovement(MovementGeometry=intcrv.Curve, SpeedParameter=speed, FlowParameter=ratio_of_filament_to_nozzle, Delimiter=delimiter)
merge = Merge(Data1=filler, Data2=movement)

silkworm = SilkwormGenerator(SettingsDictionary=loadsettings, Geometry=flatten(merge), Sort=generator_sort_option)  # -> GCode, SilkwormModel
silkworm_viewer = SilkwormViewer(
    SilkwormModel=silkworm.SilkwormModel,
    LayerStart=Slider(0, range=0..1),
    LayerEnd=Slider(0.98, range=0..1),
    DisplayValues=Toggle(False))
panel = Panel(silkworm.GCode)
