# Grasshopper definition stringing.gh (Grasshopper 0.9.14)
# plug-ins: Silkworm

vertical_shell_layers = Slider(4, range=0..10)
ratio_of_filament_to_nozzle = Slider(0.028727, range=0..0.1)
lift_height = Slider(0.3, range=0..1)
squashed_cross_section_ratio = Slider(0.66, range=0..1)
diameter_of_blob = Slider(5.87, range=0..25)
travel_speed = Slider(5600, range=0..10000)
speeds = Slider(59, range=0..1000)

# ----
# EXAMPLE - STRINGING BRACELET
# 
# Creates a technique for printing a non-solid object, using custom values at specific parts
# www.projectsilkworm.com/about
# info@projectsilkworm.com
loadsettings = LoadSettings(String=["absolute_extrudersteps = 1", "acceleration = 0", "bed_size = 200,200", "bed_temperature = 60", "bridge_fan_speed = 100", "bridge_flow_ratio = 1", "bridge_speed = 20", "brim_width = 3", "complete_objects = 0", "cooling = 0"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])
brep = Brep()
slicer = SilkwormSlicer(SettingsDictionary=loadsettings, BrepOrMesh=brep, ThicknessOfPlanarShell=0)  # -> SlicedRegions, OpenRegions
join = JoinCurves(Curves=slicer.OpenRegions, Preserve=False)

lng = ListLength(List=flatten(join))
subtraction = Subtraction(A=lng, B=vertical_shell_layers)
subtraction_2 = Subtraction(A=subtraction, B=vertical_shell_layers)
merge = Merge(Data1=vertical_shell_layers, Data2=subtraction_2, Data3=vertical_shell_layers, Data4=vertical_shell_layers)
partition = PartitionList(List=flatten(join), Size=merge)

bang = ExplodeTree(Data=partition)  # -> Branch0, Branch1, Branch2
explode = Explode(Curve=bang.Branch1, Recursive=True)  # -> simplify(graft(Segments)), simplify(graft(Vertices))

crv = Curve(flatten([bang.Branch0, bang.Branch2]))
offset = Offset(Curve=crv, Distance=squashed_cross_section_ratio, Plane=PlaneXY(0, 0, 0), Corners=1)  # -> simplify(Curve)
offset_2 = Offset(Curve=offset, Distance=expr("-D", squashed_cross_section_ratio), Plane=PlaneXY(0, 0, 0), Corners=1)  # -> simplify(Curve)
offset_3 = Offset(Curve=offset_2, Distance=expr("-D", squashed_cross_section_ratio), Plane=PlaneXY(0, 0, 0), Corners=1)  # -> simplify(Curve)
merge_2 = Merge(Data1=offset, Data2=offset_2, Data3=offset_3)

division = Division(A=graft(diameter_of_blob), B=flatten(squashed_cross_section_ratio))
rev = Reverse(Vector=explode.Segments)
multiplication = Multiplication(A=ratio_of_filament_to_nozzle, B=division)
delimiter = SilkwormMovementDelimiter(
    StartVec=rev,
    StartSpd=speeds,
    StartPrs=multiplication,
    EndVec=explode.Segments,
    EndSpd=speeds,
    EndPrs=0,
    Travel=travel_speed)  # -> simplify(Delimiters)
curvepoint = PointOnCurve(explode.Segments, parameter=1)
smove = SilkwormMovement(MovementSegments=curvepoint, Delimiter=delimiter)  # -> simplify(SilkwormMovement)

crv_2 = Curve(merge_2)
sort_option = Slider(2, range=1..3)
merge_3 = Merge(Data1=flatten(crv_2), Data2=flatten(smove))
clean = CleanTree(Data=merge_3, CleanInvalid=True, CleanEmpty=True)
silkworm = SilkwormGenerator(SettingsDictionary=loadsettings, Geometry=flatten(clean), Sort=sort_option)  # -> GCode, SilkwormModel
silkworm_viewer = SilkwormViewer(
    SilkwormModel=silkworm.SilkwormModel,
    LayerStart=Slider(0, range=0..1),
    LayerEnd=Slider(1, range=0..1),
    DisplayValues=Toggle(True))
panel = Panel(silkworm.GCode)
