# Grasshopper definition vector field weave.gh (Grasshopper 0.9.14)
# plug-ins: Silkworm

attraction_point_charge = Slider(1, range=0..1)
attraction_point_decay = Slider(1, range=0..10)
vortex_decay = Slider(1, range=0..10)
height_of_print = Slider(10, range=0..30)
custom_movement_speed = Slider(2400, range=0..10000)
generator_sort_option = Slider(2, range=0..10)
preview_start = Slider(0, range=0..1)
preview_end = Slider(1, range=0..1)
number_of_samples = Slider(1000, range=0..1000)
vortex_spin_radius = Slider(8, range=0..10)
layer_heights = Slider(0.3, range=0..1)
number_of_edge_points = Slider(5, range=0..100)
vortex_min_strength = Slider(0, range=0..1)
vortex_max_strength = Slider(0.5, range=0..10)
show_values = BooleanToggle(True)

start_flow = Slider(0.028727, range=0..0.1)
start_speed = Slider(240, range=0..1000)
end_flow = Slider(0.01, range=0..0.1)
end_speed = Slider(2400, range=0..10000)

boundary_curve = Curve(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)
# www.projectsilkworm.com/about
# info@projectsilkworm.com
bounding_box = Box({Plane=PlaneXY(20.96810889, 20.96810889, 0), X=Domain(0, 158.0637822), Y=Domain(0, 158.0637822), Z=Domain(0, 136.7078025)})
charge_pt = Point(Point(100, 100, 0))

# ----
# EXAMPLE - VECTOR FIELD WEAVE
# 
# Create a layered 3d pattern weave, based on the vector field component in grasshopper.
explode = BrepComponents(Brep=bounding_box)  # -> Faces, Edges, Vertices
item = ListItem(List=explode.Faces, Index=4, Wrap=False)
edges = BrepEdges(Brep=item)  # -> Naked, Interior, NonManifold
divide = DivideCurve(Curve=edges.Naked, Count=number_of_edge_points, Kinks=False)  # -> flatten(Points), Tangents, Parameters
cset = CreateSet(List=divide.Points)  # -> Set, Map

# ----
# Define Planar Alternating Patterns
dom = Domain(DomainStart=vortex_min_strength, DomainEnd=vortex_max_strength)
division = Division(A=height_of_print, B=layer_heights)
panel = Panel("""1
-1""")
range = Range(Domain=dom, Steps=expr("N-1", division))  # -> simplify(graft(Range))
repeat = RepeatData(Data=panel, Length=division)  # -> simplify(graft(Data))
series = Series(Start=0, Step=layer_heights, Count=division)  # -> simplify(graft(Series))
multiplication = Multiplication(A=range, B=repeat)

join = JoinCurves(Curves=edges.Naked, Preserve=False)

Z = UnitZ(Factor=series)
move = Move(Geometry=cset.Set, Motion=Z)  # -> Geometry, Transform
move_2 = Move(Geometry=charge_pt, Motion=Z)  # -> Geometry, Transform

# ----
# Create Vector Field from Charges and Points
pcharge = PointCharge(Point=move_2.Geometry, Charge=expr("-C", attraction_point_charge), Decay=attraction_point_decay, Bounds=bounding_box)  # -> simplify(Field)
fspin = SpinForce(Plane=move_2.Geometry, Strength=multiplication, Radius=vortex_spin_radius, Decay=vortex_decay, Bounds=bounding_box)  # -> simplify(Field)
mergef = MergeFields(Fields=[pcharge, fspin])
fline = FieldLine(Field=mergef, Point=move.Geometry, Steps=number_of_samples, Accuracy=0.1, Method=1)

curvepoint = PointOnCurve(fline, parameter=1)

# ----
# Reset Resolution of Curves
explode_2 = Explode(Curve=fline, Recursive=True)  # -> Segments, Vertices
intcrv = Interpolate(Vertices=explode_2.Vertices, Degree=3, Periodic=False, KnotStyle=1)  # -> Curve, Length, Domain
segmenter = Segmenter(
    Curves=intcrv.Curve,
    MainSegmentCount=0,
    SubSegmentCount=0,
    MaxAngleRadians=0.05,
    MaxChordLengthRatio=0.1,
    MaxAspectRatio=0,
    Tolerance=0,
    MinEdgeLength=0.1,
    MaxEdgeLength=0,
    KeepStartPoint=True)

pline = PolyLine(Vertices=curvepoint, Closed=True)
move_3 = Move(Geometry=join, Motion=Z)  # -> Geometry, Transform

# ----
# Default Delimiter (Lift)
delimiter = SilkwormMovementDelimiter(StartVec=Vector(0, 0, -1), StartSpd=360, StartPrs=1.1, EndVec=Vector(0, 0, 1), EndSpd=360, EndPrs=-1, Travel=7200)

merge = Merge(Data1=move_3.Geometry, Data2=simplify(pline))

# ----
# Create Custom Movement With Single Speed
explode_3 = Explode(Curve=merge, Recursive=True)  # -> Segments, Vertices
line = Line(explode_3.Segments)
lng = ListLength(List=line)
dup = DuplicateData(Data=custom_movement_speed, Number=lng, Order=True)
smove = SilkwormMovement(MovementSegments=line, SpeedParameter=dup, Delimiter=delimiter)

# ----
# Edit Speed and Flow Values
explode_4 = Explode(Curve=segmenter, Recursive=True)  # -> simplify(Segments), Vertices
lng_2 = ListLength(List=explode_4.Segments)
dom_2 = Domain(DomainStart=start_speed, DomainEnd=end_speed)
dom_3 = Domain(DomainStart=start_flow, DomainEnd=end_flow)
range_2 = Range(Domain=dom_3, Steps=expr("N-1", lng_2))
range_3 = Range(Domain=dom_2, Steps=expr("N-1", lng_2))
bnd = Bounds(Numbers=range_2)
bnd_2 = Bounds(Numbers=range_3)
remap = RemapNumbers(Value=range_2, Source=bnd, Target=Domain(0, 1))
remap_2 = RemapNumbers(Value=range_3, Source=bnd_2, Target=Domain(0, 1))
line_2 = Line(explode_4.Segments)

graph = GraphMapper(remap_2, x0=0, x1=1, y0=0, y1=1, container_name="Conic", Cx=0.2144927979, Cy=0.5521735549)
graph_2 = GraphMapper(remap, x0=0, x1=1, y0=0, y1=1, container_name="Conic", Cx=0.5, Cy=0.5)

remap_3 = RemapNumbers(Value=graph, Source=Domain(0, 1), Target=bnd_2)
remap_4 = RemapNumbers(Value=graph_2, Source=Domain(0, 1), Target=bnd)
movement = SilkwormMovement(MovementGeometry=line_2, SpeedParameter=remap_3, FlowParameter=remap_4, Delimiter=delimiter)

merge_2 = Merge(Data1=simplify(smove), Data2=simplify(movement))  # -> flatten(Result)

loadsettings = LoadSettings(String=["absolute_coordinates = 1", "absolute_extruder = 1", "acceleration = 0", "bed_size = 200,200", "bed_temperature = 60", "bridge_fan_speed = 100", "bridge_flow_ratio = 1", "bridge_speed = 20", "brim_width = 3", "complete_objects = 0"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])

silkworm = SilkwormGenerator(SettingsDictionary=loadsettings, Geometry=merge_2, Sort=generator_sort_option)  # -> GCode, SilkwormModel

panel_2 = Panel(silkworm.GCode)

silkworm_viewer = SilkwormViewer(SilkwormModel=silkworm.SilkwormModel, LayerStart=preview_start, LayerEnd=preview_end, DisplayValues=show_values)
