# Grasshopper definition wireframe.gh (Grasshopper 0.9.14)
# plug-ins: Silkworm

offset_to_outer_perimeter = Slider(5, range=0..10)
delimit_speed_mm_min = Slider(1800, range=0..10000)
offset_to_inner_perimeter = Slider(3, range=0..10)
travel_speed_mm_min = Slider(1800, range=0..10000)
generator_sort_mode = Slider(3, range=0..10)
preview_start = Slider(0, range=0..1)
bottom_speed = Slider(540, range=0..1000)
middle_speed = Slider(60, range=0..1000)
lift_mm = Slider(20, range=0..100)
preview_end = Slider(1, range=0..1)
middle_flow = Slider(0.018, range=0..1)
top_speed = Slider(300, range=0..1000)
show_delimit_arrows = BooleanToggle(True)
slider = Slider(70, range=0..100)
# EXAMPLE - WIREFRAME
# 
# Print the wireframe of a Brep.  Careful attention must be paid to the order in which the wireframe is built.
# 
# Later releases  of Silkworm will include a way to visualise the clearance of the printer frame and nozzle, so it will be easier to build this kind of geometry.
# www.projectsilkworm.com/about
# info@projectsilkworm.com
B = Base(PlaneXY(61.07745178, 73.22498068, 0))

box = DomainBox(Base=B, X=slider, Y=slider, Z=Slider(20, range=0..100))
wires = BrepWireframe(Brep=box, Density=-1)  # -> simplify(Wireframe)
volume = Volume(Geometry=box)  # -> Volume, Centroid
line = Line(wires)

# ----
# Seperate Elements of Wireframe
panel = Panel("0")
dom = Domain(DomainStart=panel, DomainEnd="3")
dom_2 = Domain(DomainStart="8", DomainEnd="11")
dom_3 = Domain(DomainStart="4", DomainEnd="7")
middle = SubList(List=line, Domain=dom_2, Cycle=False)  # -> simplify(List), Index
bottom = SubList(List=line, Domain=dom, Cycle=False)  # -> List, Index
top = SubList(List=line, Domain=dom_3, Cycle=False)  # -> List, Index

_1 = ListItem(List=middle.List, Index=1, Wrap=False)
_3 = ListItem(List=middle.List, Index=3, Wrap=False)
# Specify Order for Build
_0 = ListItem(List=middle.List, Index=0, Wrap=False)
_2 = ListItem(List=middle.List, Index=2, Wrap=False)
merge = Merge(Data1=_0, Data2=_1, Data3=_3, Data4=_2)  # -> simplify(graft(Result))

loadsettings = LoadSettings(String=["absolute_extrudersteps = 1", "acceleration = 0", "bed_size = 200,200", "bed_temperature = 60", "bridge_fan_speed = 100", "bridge_flow_ratio = 1", "bridge_speed = 20", "brim_width = 3", "complete_objects = 0", "cooling = 0"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])

join = JoinCurves(Curves=bottom.List, Preserve=False)
offset = Offset(Curve=join, Distance=offset_to_outer_perimeter, Plane=PlaneXY(0, 0, 0), Corners=1)
# Create Perimiter to Optimise Flow
offset_2 = Offset(Curve=join, Distance=offset_to_inner_perimeter, Plane=PlaneXY(0, 0, 0), Corners=1)
planar = PlanarSrf(Edges=flatten([offset, offset_2]))
filler = SilkwormFiller(SettingsDictionary=loadsettings, PlanarBreps=planar, InfillType=0)

end = EndPoints(Curve=merge)  # -> Start, End
vec2pt = Vector2Pt(PointA=volume.Centroid, PointB=end.End, Unitize=False)  # -> Vector, Length

start_pressure = Panel("""1.1
5.1
5.1
5.1""")
end_pressure = Panel("""-5
-5
-5
-5""")
start_pressure_2 = Panel("5.2")
end_pressure_2 = Panel("-5")
# Custom Delimiters
amp = Amplitude(Vector=vec2pt.Vector, Amplitude=lift_mm)
delimiter = SilkwormMovementDelimiter(
    StartVec=Vector(0, 0, -1),
    StartSpd=simplify(graft(delimit_speed_mm_min)),
    StartPrs=start_pressure,
    EndVec=amp,
    EndSpd=delimit_speed_mm_min,
    EndPrs=simplify(graft(end_pressure)),
    Travel=travel_speed_mm_min)
delimiter_2 = SilkwormMovementDelimiter(
    StartVec=Vector(0, 0, -1),
    StartSpd=360,
    StartPrs=start_pressure_2,
    EndVec=Vector(0, 0, 1),
    EndSpd=end_pressure_2,
    EndPrs=-1,
    Travel=7200)

# ----
# Default Delimiter(Lift)
delimiter_3 = SilkwormMovementDelimiter(StartVec=Vector(0, 0, -1), StartSpd=360, StartPrs=1.1, EndVec=Vector(0, 0, 1), EndSpd=360, EndPrs=-1, Travel=7200)
explode = Explode(Curve=filler, Recursive=True)  # -> Segments, Vertices

line_2 = Line(explode.Segments)
line_3 = Line(bottom.List)
line_4 = Line(merge)
line_5 = Line(top.List)
lng = ListLength(List=flatten(line_4))
lng_2 = ListLength(List=flatten(line_5))
dup = DuplicateData(Data=middle_speed, Number=lng, Order=True)  # -> simplify(graft(Data))
dup_2 = DuplicateData(Data=middle_flow, Number=lng, Order=True)  # -> simplify(graft(Data))
# Custom Movements
lng_3 = ListLength(List=flatten(line_2))
lng_4 = ListLength(List=flatten(line_3))
dup_3 = DuplicateData(Data=top_speed, Number=lng_2, Order=True)
dup_4 = DuplicateData(Data=bottom_speed, Number=lng_4, Order=True)  # -> simplify(Data)
dup_5 = DuplicateData(Data=bottom_speed, Number=lng_3, Order=True)  # -> simplify(Data)
smove = SilkwormMovement(LineSegments=simplify(line_2), SpeedParameter=dup_5, Delimiter=delimiter_3)
smove_2 = SilkwormMovement(LineSegments=simplify(line_3), SpeedParameter=dup_4, Delimiter=delimiter_3)
smove_3 = SilkwormMovement(LineSegments=simplify(line_4), SpeedParameter=dup, FlowParameter=dup_2, Delimiter=delimiter)
smove_4 = SilkwormMovement(MovementSegments=line_5, SpeedParameter=dup_3, Delimiter=delimiter_2)

merge_2 = Merge(Data1=flatten(smove), Data2=flatten(smove_2), Data3=flatten(smove_3), Data4=flatten(smove_4))
clean = CleanTree(Data=merge_2, CleanInvalid=True, CleanEmpty=False)
silkworm = SilkwormGenerator(SettingsDictionary=loadsettings, Geometry=flatten(clean), Sort=generator_sort_mode)  # -> GCode, SilkwormModel
silkworm_viewer = SilkwormViewer(SilkwormModel=silkworm.SilkwormModel, LayerStart=preview_start, LayerEnd=preview_end, DisplayValues=show_delimit_arrows)
panel_2 = Panel(silkworm.GCode)
