# Grasshopper definition SolidSlicingUltimaker.gh (Grasshopper 1.0.4)
# plug-ins: Silkworm

horizontal_shell_thickness_lines = Slider(3, range=0..10)
infill_angle_01 = Slider(45, range=0..100)
infill_angle_02 = Slider(140, range=0..360)
vertical_shell_thickness_layers = Slider(3, range=0..10)
shell_density = Slider(1, range=0..1)
infill_density = Slider(10, range=0..100)
custom_infill_speed = Slider(100, range=0..100)
brep = Brep(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)

# ---- group: PRINTER SETTING .INI
# Slice Solid into Perimeter
#         and Infill Regions
loadsettings = LoadSettings(String=["absolute_extrudersteps = 1", "acceleration = 0", "bed_size = 200,200", "bed_temperature = 60", "bridge_fan_speed = 100", "bridge_flow_ratio = 1", "bridge_speed = 20", "brim_width = 3", "complete_objects = 0", "cooling = 0"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])

# ----
# Slicer for Ultimaker
panel = Panel(loadsettings)

# ---- group: Remap to decimals
dom = ConstructDomain(DomainStart="0", DomainEnd="100")
dom_2 = ConstructDomain(DomainStart="0", DomainEnd="10")
remap = RemapNumbers(Value=infill_density, Source=dom, Target=dom_2)  # -> Mapped, Clipped
# Set Custom Infill Layer Pattern
int = Integer(remap.Mapped)
expression = Expression(x=int, Expression="X/10")

# ---- group: Calculate the nozzle diameter
# Set outer layers
data = Data(loadsettings)
item = ListItem(List=data, Index="44", Wrap=True)
split = TextSplit(Text=item, Separators="=")
trim = TextTrim(Text=split, Start=True, End=True)
item_2 = ListItem(List=trim, Index="1", Wrap=True)
panel_2 = Panel(trim)
num = Number(item_2)

# ----
# Final setup and visualization
data_2 = Data(loadsettings)
display_printer = BooleanToggle(True)
start_gcode = Slider(0.2, range=0..1)
end_gcode = Slider(0.72, range=0..1)

# ---- group: Machine bed Preview
data_3 = Data(data_2)
item_3 = ListItem(List=data_3, Index=Slider(2, range=0..10), Wrap=True)
split_2 = TextSplit(Text=item_3, Separators="=")
trim_2 = TextTrim(Text=split_2, Start=True, End=True)
split_3 = TextSplit(Text=trim_2, Separators=",")
bang = ExplodeTree(Data=split_3)  # -> Branch0, Branch1
item_4 = ListItem(List=bang.Branch1, Index=0, Wrap=True)  # -> Item, Item1
Z = UnitZ(Factor=1)
rectangle = Rectangle(Plane=PlaneXY(0, 0, 0), XSize=item_4.Item, YSize=item_4.Item1, Radius=0)  # -> Rectangle, Length
neg = Negative(Value=Z)
Z_2 = UnitZ(Factor=item_4.Item)
extr = Extrude(Base=rectangle.Rectangle, Direction=neg)
extr_2 = Extrude(Base=rectangle.Rectangle, Direction=Z_2)
cap = CapHoles(Brep=extr)
edges = BrepEdges(Brep=extr_2)  # -> Naked, Interior, NonManifold
preview = CustomPreview(Geometry=[cap, edges.Naked, edges.Interior], Material=ColourSwatch(SwatchColor=RGB(255, 255, 255)))

# ----
machine_height = Slider(200, range=0..1000)

slicer = SilkwormSlicer(SettingsDictionary=loadsettings, BrepOrMesh=brep, ThicknessOfPlanarShell=horizontal_shell_thickness_lines)  # -> SlicedRegions, OpenRegions
viewer = ParamViewer(slicer.SlicedRegions)

trim_3 = TrimTree(Tree=slicer.SlicedRegions, Depth=1)
item_5 = ListItem(List=trim_3, Index=0, Wrap=True)  # -> Item, Item1

panel_3 = Panel(trim_3)
clean = CleanTree(Data=item_5.Item, CleanInvalid=True, CleanEmpty=True)
clean_2 = CleanTree(Data=item_5.Item1, CleanInvalid=True, CleanEmpty=True)

# ---- group: Exterior shell
brep_2 = Brep(clean)

# ---- group: Infill Space
brep_3 = Brep(clean_2)

# ----
brep_4 = Brep(brep_3)
geo = Geometry(brep_2)

geo_2 = Geometry(geo)
edges_2 = BrepEdges(Brep=geo_2)  # -> Naked, Interior, NonManifold
num_2 = Number(horizontal_shell_thickness_lines)
join = JoinCurves(Curves=edges_2.Naked, Preserve=False)
item_6 = ListItem(List=join, Index=0, Wrap=True)  # -> Item, Item1
addition = Addition(A=num_2, B="1")
series = Series(Start=num, Step=num, Count=addition)
offset = OffsetCurve(Curve=item_6.Item1, Distance=series, Plane=PlaneXY(0, 0, 0), Corners=1)
trim_4 = TrimTree(Tree=offset, Depth=1)
explode = Explode(Curve=trim_4, Recursive=True)  # -> Segments, Vertices
trim_5 = TrimTree(Tree=explode.Segments, Depth=1)
panel_4 = Panel(trim_5)
connect = ConnectCurves(Curves=trim_5, Continuity=2, Close=False, Bulge="0")

lng = ListLength(List=flatten(brep_4))
repeat = RepeatData(Data=[infill_angle_01, infill_angle_02], Length=lng)  # -> simplify(graft(Data))
repeat_2 = RepeatData(Data=expression, Length=lng)
lng_2 = ListLength(List=repeat_2)
subtraction = Subtraction(A=lng_2, B=vertical_shell_thickness_layers)
series_2 = Series(Start=0, Step=1, Count=vertical_shell_thickness_layers)  # -> flatten(Series)
series_3 = Series(Start=subtraction, Step=1, Count=vertical_shell_thickness_layers)  # -> flatten(Series)
viewer_2 = ParamViewer(repeat)
viewer_3 = ParamViewer(brep_4)
merge = Merge(Data1=series_2, Data2=series_3)
replace = ListReplace(List=repeat_2, Item=shell_density, Indices=merge, Wrap=False)
num_3 = Number(simplify(graft(replace)))
replace_2 = ReplaceBranches(Data=num_3, Search=viewer_2, Replace=viewer_3)
replace_3 = ReplaceBranches(Data=repeat, Search=viewer_2, Replace=viewer_3)

filler = SilkwormFiller(SettingsDictionary=loadsettings, PlanarBreps=brep_4, InfillType="1", InfillDensity=replace_2, InfillRotation=replace_3)
filler_2 = SilkwormFiller(SettingsDictionary=loadsettings, PlanarBreps=geo_2, InfillType="1", InfillDensity="1")  # disabled

panel_5 = Panel(filler)
geo_3 = Geometry(connect)

explode_2 = Explode(Curve=filler, Recursive=True)  # -> Segments, Vertices
expression_2 = Expression(x=custom_infill_speed, Expression="x*10")
line = Line(explode_2.Segments)
clean_3 = CleanTree(Data=line, CleanInvalid=True, CleanEmpty=False)
lng_3 = ListLength(List=clean_3)
dup = DuplicateData(Data=expression_2, Number=lng_3, Order=True)
movement = SilkwormMovement(MovementGeometry=clean_3, SpeedParameter=dup)

explode_3 = Explode(Curve=geo_3, Recursive=True)  # -> Segments, Vertices
expression_3 = Expression(x=custom_infill_speed, Expression="x*10")
line_2 = Line(explode_3.Segments)
clean_4 = CleanTree(Data=line_2, CleanInvalid=True, CleanEmpty=False)
lng_4 = ListLength(List=clean_4)
dup_2 = DuplicateData(Data=expression_3, Number=lng_4, Order=True)
movement_2 = SilkwormMovement(MovementGeometry=clean_4, SpeedParameter=dup_2)

merge_2 = Merge(Data1=flatten(movement_2), Data2=flatten(movement))

silkworm = SilkwormGenerator(SettingsDictionary=data_2, Geometry=flatten(merge_2), Sort=1)  # -> GCode, SilkwormModel
silkworm_viewer = SilkwormViewer(
    SilkwormModel=silkworm.SilkwormModel,
    LayerStart=start_gcode,
    LayerEnd=end_gcode,
    DisplayValues=Toggle(False),
    DisplayValues_2=Toggle(False),
    DisplayMesh=False,
    DisplayPrinter=display_printer)
str = String(silkworm.GCode)

# ---- group: Ultimaker 2 Tweak
split_4 = SplitList(List=str, Index="8")  # -> ListA, ListB
lng_5 = ListLength(List=split_4.ListB)
subtraction_2 = Subtraction(A=lng_5, B="4")
split_5 = SplitList(List=split_4.ListB, Index=subtraction_2)  # -> ListA, ListB
startgcode = Panel(""";FLAVOR:UltiGCode
;TIME:0
;MATERIAL:0
;MATERIAL2:0
;NOZZLE_DIAMETER:0.4
;Generated with Love
M82 ;absolute extrusion mode

G92 E0
G10
;LAYER_COUNT:303
;LAYER:0
M107
G0 F3600 X59.258 Y59.234 Z0.3
;TYPE:SKIRT
G11""")
endgcode = Panel("""G10
M107

M82 ;absolute extrusion mode
;End of Gcode
;SETTING_3 {"extruder_quality": ["[general]\\nversion = 4\\nname = Draft #2\\nde
;SETTING_3 finition = ultimaker2\\n\\n[metadata]\\nposition = 0\\nquality_type =
;SETTING_3  draft\\nsetting_version = 5\\ntype = quality_changes\\n\\n[values]\\
;SETTING_3 n\\n"], "global_quality": "[general]\\nversion = 4\\nname = Draft #2\
;SETTING_3 \ndefinition = ultimaker2\\n\\n[metadata]\\nquality_type = draft\\nse
;SETTING_3 tting_version = 5\\ntype = quality_changes\\n\\n[values]\\nadhesion_t
;SETTING_3 ype = skirt\\n\\n"}""")

# ----
merge_3 = Merge(Data1=flatten(startgcode), Data2=flatten(split_5.ListA), Data3=flatten(endgcode))  # -> flatten(Result)
panel_6 = Panel(merge_3)
