# Grasshopper definition grain contours.gh (Grasshopper 0.9.14)
# plug-ins: Silkworm

# ----
# EXAMPLE - CONTOUR GRAINS
# 
# Create a contour pattern to describe a material grain.
# www.projectsilkworm.com/about
# info@projectsilkworm.com
vector_grid_resolution = Slider(9, range=0..10)
negative_decay = Slider(0.1, range=0..2)
negative_charge = Slider(-0.25, range=-1..1)
positive_decay = Slider(0.1, range=0..2)
squashed_cross_section_ratio = Slider(0.66, range=0..1)
positive_charge = Slider(0.25, range=-1..1)
filament_to_nozzle_ratio = Slider(0.02, range=-1..1)
bounding_box = Box({Plane=PlaneXY(33.5875805, 64.33283643, 0), X=Domain(0, 129.5550739), Y=Domain(0, 107.3622897), Z=Domain(0, 7.176595243)})
positivept = Point([Point(132.2856858, 111.1550184, 0), Point(145.9690443, 155.6950142, 0), Point(47.16179423, 155.7702481, 0), Point(109.2153798, 127.609744, 0), Point(126.5809555, 133.688603, 0), Point(137.5192148, 88.02656145, 0), Point(100.8006329, 96.80235405, 0), Point(73.30030814, 119.5263147, 0), Point(49.77870469, 79.46801936, 0)])
end_preview = Slider(1, range=0..1)
starting_line = Curve(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)
negativept = Point([Point(74.16582435, 159.6815247, 0), Point(101.4772567, 157.9318803, 0), Point(154.6171125, 85.48015823, 0), Point(146.5218014, 118.1760004, 0), Point(44.26687195, 122.1184785, 0), Point(72.25553484, 92.92726765, 0), Point(118.0497231, 92.70668316, 0), Point(93.09694304, 134.0660349, 0)])
start_preview = Slider(0, range=0..1)

box = BoxComponents(Box=bounding_box)  # -> Plane, X, Y, Z
# Bounds
domcomp = DomainComponents(Domain=box.X)  # -> Start, End
domcomp_2 = DomainComponents(Domain=box.Y)  # -> Start, End
division = Division(A=domcomp_2.End, B=vector_grid_resolution)
division_2 = Division(A=domcomp.End, B=vector_grid_resolution)
sqgrid = Square(Plane=bounding_box, Size=vector_grid_resolution, ExtentX=division_2, ExtentY=division)  # -> Cells, Points

Y = UnitY(Factor=1)
line = LineSDL(Start=sqgrid.Points, Direction=Y, Length=filament_to_nozzle_ratio)
# Create Vector Field
pcharge = PointCharge(Point=negativept, Charge=negative_charge, Decay=negative_decay, Bounds=bounding_box)
pcharge_2 = PointCharge(Point=positivept, Charge=positive_charge, Decay=positive_decay, Bounds=bounding_box)
fvector = VectorForce(Line=line, Bounds=bounding_box)
divlength = DivideLength(Curve=starting_line, Length=squashed_cross_section_ratio)  # -> Points, Tangents, Parameters
mergef = MergeFields(Fields=flatten([pcharge_2, fvector, pcharge]))
fline = FieldLine(Field=mergef, Point=divlength.Points, Steps=1000, Accuracy=0.1, Method=3)

# ----
# Flip every other curve
# to speed up print
dispatch = Dispatch(List=fline, DispatchPattern=[True, False])  # -> ListA, ListB
flip = Flip(Curve=dispatch.ListB)  # -> Curve, Flag
weave = Weave(Pattern=[0, 1], Stream0=dispatch.ListA, Stream1=flip.Curve, NullGaps=False)

# ----
# Make Polylines less complicated
explode = Explode(Curve=weave, Recursive=True)  # -> Segments, Vertices
intcrv = Interpolate(Vertices=explode.Vertices, Degree=3, Periodic=False, KnotStyle=1)  # -> Curve, Length, Domain
segmenter = Segmenter(
    Curves=intcrv.Curve,
    MainSegmentCount=0,
    SubSegmentCount=0,
    MaxAngleRadians=0.05,
    MaxChordLengthRatio=0.1,
    MaxAspectRatio=0,
    Tolerance=0,
    MinEdgeLength=0.1,
    MaxEdgeLength=0,
    KeepStartPoint=True)

loadsettings = LoadSettings(String=["# generated by Slic3r 0.9.1 on Mon Oct 15 16:09:15 2012", "acceleration = 0", "bed_size = 200,200", "bed_temperature = 60", "bridge_fan_speed = 100", "bridge_flow_ratio = 1", "bridge_speed = 20", "brim_width = 3", "complete_objects = 0", "cooling = 0"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])
silkworm = SilkwormGenerator(SettingsDictionary=loadsettings, Geometry=flatten(segmenter), Sort=1)  # -> GCode, SilkwormModel
silkworm_viewer = SilkwormViewer(SilkwormModel=silkworm.SilkwormModel, LayerStart=start_preview, LayerEnd=end_preview, DisplayValues=False)
panel = Panel(silkworm.GCode)
