# Grasshopper definition solid slicing.gh (Grasshopper 0.9.14)
# plug-ins: Silkworm

brep = Brep(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)
# EXAMPLE - SOLID BOX
# 
# Creates GCode for a Solid Geometry by slicing and filling horizontal layers according to Settings
# www.projectsilkworm.com/about
# info@projectsilkworm.com
# Using Default Imported Settings
loadsettings = LoadSettings(String=["# generated by Slic3r 0.9.1 on Mon Oct 15 16:09:15 2012", "acceleration = 0", "bed_size = 200,200", "bed_temperature = 60", "bridge_fan_speed = 100", "bridge_flow_ratio = 1", "bridge_speed = 20", "brim_width = 3", "complete_objects = 0", "cooling = 0"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])
silkworm = SilkwormGenerator(SettingsDictionary=loadsettings, Geometry=flatten(brep), Sort=1)  # -> GCode, SilkwormModel
silkworm_viewer = SilkwormViewer(
    SilkwormModel=silkworm.SilkwormModel,
    LayerStart=Slider(0.31, range=0..1),
    LayerEnd=Slider(0.33, range=0..1),
    DisplayValues=Toggle(True))
str = String(silkworm.GCode)

# ----
# Using Custom Settings
loadsettings_2 = LoadSettings(String=["# generated by Slic3r 0.9.1 on Mon Oct 15 16:09:15 2012", "acceleration = 0", "bed_size = 200,200", "bed_temperature = 60", "bridge_fan_speed = 100", "bridge_flow_ratio = 1", "bridge_speed = 20", "brim_width = 3", "complete_objects = 0", "cooling = 0"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])

horizontal_shell_thickness_lines = Slider(3, range=0..10)
custom_infill_speed = Slider(600, range=0..1000)
vertical_shell_thickness_layers = Slider(3, range=0..10)
brep_2 = Brep(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)
infill_angle_01 = Slider(45, range=0..100)
internal_density = Slider(0.3, range=0..1)
shell_density = Slider(1, range=0..1)
infill_angle_02 = Slider(140, range=0..360)

# ----
# Slice Solid into Perimeter and Infill Regions
slicer = SilkwormSlicer(SettingsDictionary=loadsettings_2, BrepOrMesh=brep_2, ThicknessOfPlanarShell=horizontal_shell_thickness_lines)  # -> SlicedRegions, OpenRegions
compare = BranchCompare(Branch=slicer.SlicedRegions, Pattern="{*;1}")
dispatch = Dispatch(List=slicer.SlicedRegions, DispatchPattern=compare)  # -> ListA, ListB
clean = CleanTree(Data=dispatch.ListB, CleanInvalid=True, CleanEmpty=True)
clean_2 = CleanTree(Data=dispatch.ListA, CleanInvalid=True, CleanEmpty=True)
brep_3 = Brep(clean_2)
brep_4 = Brep(clean)

lng = ListLength(List=flatten(brep_4))
repeat = RepeatData(Data=[infill_angle_01, infill_angle_02], Length=lng)  # -> simplify(graft(Data))
repeat_2 = RepeatData(Data=internal_density, Length=lng)
lng_2 = ListLength(List=repeat_2)
# Set Custom Infill Layer Pattern
subtraction = Subtraction(A=lng_2, B=vertical_shell_thickness_layers)
series = Series(Start=0, Step=1, Count=vertical_shell_thickness_layers)  # -> flatten(Series)
series_2 = Series(Start=subtraction, Step=1, Count=vertical_shell_thickness_layers)  # -> flatten(Series)
merge = Merge(Data1=series, Data2=series_2)
replace = ListReplace(List=repeat_2, Item=shell_density, Indices=merge, Wrap=False)
viewer = ParamViewer(repeat)
viewer_2 = ParamViewer(brep_4)
num = Number(simplify(graft(replace)))
replace_2 = ReplaceBranches(Data=num, Search=viewer, Replace=viewer_2)
replace_3 = ReplaceBranches(Data=repeat, Search=viewer, Replace=viewer_2)

filler = SilkwormFiller(SettingsDictionary=loadsettings_2, PlanarBreps=brep_4, InfillType=1, InfillDensity=replace_2, InfillRotation=replace_3)
# Infill
filler_2 = SilkwormFiller(SettingsDictionary=loadsettings_2, PlanarBreps=brep_3, InfillType=0)

# ----
# Set Custom Infill Speed
explode = Explode(Curve=filler, Recursive=True)  # -> Segments, Vertices
line = Line(explode.Segments)
clean_3 = CleanTree(Data=line, CleanInvalid=True, CleanEmpty=False)
lng_3 = ListLength(List=clean_3)
dup = DuplicateData(Data=custom_infill_speed, Number=lng_3, Order=True)
movement = SilkwormMovement(MovementGeometry=clean_3, SpeedParameter=dup)

merge_2 = Merge(Data1=flatten(filler_2), Data2=flatten(movement))
silkworm_2 = SilkwormGenerator(SettingsDictionary=loadsettings_2, Geometry=flatten(merge_2), Sort=1)  # -> GCode, SilkwormModel
silkworm_viewer_2 = SilkwormViewer(
    SilkwormModel=silkworm_2.SilkwormModel,
    LayerStart=Slider(0.38, range=0..1),
    LayerEnd=Slider(0.39, range=0..1),
    DisplayValues=Toggle(True))
str_2 = String(silkworm_2.GCode)
