# Grasshopper definition test.gh (Grasshopper 1.0.4)
# plug-ins: Silkworm

machine_height = Slider(200, range=0..1000)
machine_bed_height = Slider(200, range=0..1000)

# ----
# Using Default Imported Settings
loadsettings = LoadSettings(String=["# generated by Slic3r 0.9.1 on Mon Oct 15 16:09:15 2012", "acceleration = 0", "bed_size = 200,200", "bed_temperature = 60", "bridge_fan_speed = 100", "bridge_flow_ratio = 1", "bridge_speed = 20", "brim_width = 3", "complete_objects = 0", "cooling = 0"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])
brep = Brep(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)
silkworm = SilkwormGenerator(SettingsDictionary=loadsettings, Geometry=flatten(brep), Sort=1)  # -> GCode, SilkwormModel
silkworm_viewer = SilkwormViewer(
    SilkwormModel=silkworm.SilkwormModel,
    LayerStart=Slider(0.31, range=0..1),
    LayerEnd=Slider(0.33, range=0..1),
    DisplayValues=Toggle(True),
    DisplayValues_2=False,
    DisplayMesh=False,
    DisplayPrinter=False)
str = String(silkworm.GCode)

horizontal_shell_thickness_lines = Slider(3, range=0..10)
vertical_shell_thickness_layers = Slider(3, range=0..10)
shell_density = Slider(1, range=0..1)
internal_density = Slider(0.3, range=0..1)
infill_angle_01 = Slider(45, range=0..100)
infill_angle_02 = Slider(140, range=0..360)
custom_infill_speed = Slider(600, range=0..1000)
brep_2 = Brep(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)

# ----
# Using Custom Settings
loadsettings_2 = LoadSettings(String=["absolute_extrudersteps = 1", "acceleration = 0", "bed_size = 200,200", "bed_temperature = 60", "bridge_fan_speed = 100", "bridge_flow_ratio = 1", "bridge_speed = 20", "brim_width = 3", "complete_objects = 0", "cooling = 0"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])

# ---- group: Machine bed Preview
rectangle = Rectangle(Plane=PlaneXY(0, 0, 0), XSize=machine_bed_height, YSize=machine_bed_height, Radius=0)  # -> Rectangle, Length
Z = UnitZ(Factor=1)
neg = Negative(Value=Z)
Z_2 = UnitZ(Factor=machine_height)
extr = Extrude(Base=rectangle.Rectangle, Direction=neg)
extr_2 = Extrude(Base=rectangle.Rectangle, Direction=Z_2)
cap = CapHoles(Brep=extr)
edges = BrepEdges(Brep=extr_2)  # -> Naked, Interior, NonManifold
preview = CustomPreview(Geometry=[cap, edges.Naked, edges.Interior], Material=ColourSwatch(SwatchColor=RGB(255, 255, 255)))

# ----
# Slice Solid into Perimeter and Infill Regions
slicer = SilkwormSlicer(SettingsDictionary=loadsettings_2, BrepOrMesh=brep_2, ThicknessOfPlanarShell=horizontal_shell_thickness_lines)  # -> SlicedRegions, OpenRegions
compare = BranchCompare(Branch=slicer.SlicedRegions, Pattern="{*;1}")
dispatch = Dispatch(List=slicer.SlicedRegions, DispatchPattern=compare)  # -> ListA, ListB
clean = CleanTree(Data=dispatch.ListB, CleanInvalid=True, CleanEmpty=True)
clean_2 = CleanTree(Data=dispatch.ListA, CleanInvalid=True, CleanEmpty=True)
brep_3 = Brep(clean_2)
brep_4 = Brep(clean)

lng = ListLength(List=flatten(brep_4))
repeat = RepeatData(Data=[infill_angle_01, infill_angle_02], Length=lng)  # -> simplify(graft(Data))
repeat_2 = RepeatData(Data=internal_density, Length=lng)
lng_2 = ListLength(List=repeat_2)
# Set Custom Infill Layer Pattern
subtraction = Subtraction(A=lng_2, B=vertical_shell_thickness_layers)
series = Series(Start=0, Step=1, Count=vertical_shell_thickness_layers)  # -> flatten(Series)
series_2 = Series(Start=subtraction, Step=1, Count=vertical_shell_thickness_layers)  # -> flatten(Series)
merge = Merge(Data1=series, Data2=series_2)
replace = ListReplace(List=repeat_2, Item=shell_density, Indices=merge, Wrap=False)
viewer = ParamViewer(brep_4)
viewer_2 = ParamViewer(repeat)
num = Number(simplify(graft(replace)))
replace_2 = ReplaceBranches(Data=num, Search=viewer_2, Replace=viewer)
replace_3 = ReplaceBranches(Data=repeat, Search=viewer_2, Replace=viewer)

infill_density = Slider(0, range=0..100)
dom = ConstructDomain(DomainStart="0", DomainEnd="100")
brep_5 = Brep(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)
loadsettings_3 = LoadSettings(String=["# generated by Slic3r 0.9.1 on Mon Oct 15 16:09:15 2012", "acceleration = 0", "bed_size = 200,200", "bed_temperature = 60", "bridge_fan_speed = 100", "bridge_flow_ratio = 1", "bridge_speed = 20", "brim_width = 3", "complete_objects = 0", "cooling = 0"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])
remap = RemapNumbers(Value=infill_density, Source=dom, Target=Domain(0, 1))  # -> Mapped, Clipped
slicer_2 = SilkwormSlicer(SettingsDictionary=loadsettings_3, BrepOrMesh=brep_5, ThicknessOfPlanarShell=0)  # -> ClosedRegions, OpenRegions

filler = SilkwormFiller(SettingsDictionary=loadsettings_2, PlanarBreps=brep_4, InfillType=1, InfillDensity=replace_2, InfillRotation=replace_3)
# Infill
filler_2 = SilkwormFiller(SettingsDictionary=loadsettings_2, PlanarBreps=brep_3, InfillType=0, InfillDensity=remap.Mapped)

# ----
# Set Custom Infill Speed
explode = Explode(Curve=filler, Recursive=True)  # -> Segments, Vertices
line = Line(explode.Segments)
clean_3 = CleanTree(Data=line, CleanInvalid=True, CleanEmpty=False)
lng_3 = ListLength(List=clean_3)
dup = DuplicateData(Data=custom_infill_speed, Number=lng_3, Order=True)
movement = SilkwormMovement(MovementGeometry=clean_3, SpeedParameter=dup)

merge_2 = Merge(Data1=flatten(filler_2), Data2=flatten(movement))
silkworm_2 = SilkwormGenerator(SettingsDictionary=loadsettings_2, Geometry=flatten(merge_2), Sort=1)  # -> GCode, SilkwormModel
silkworm_viewer_2 = SilkwormViewer(
    SilkwormModel=silkworm_2.SilkwormModel,
    LayerStart=Slider(0.38, range=0..1),
    LayerEnd=Slider(0.39, range=0..1),
    DisplayValues=Toggle(True),
    DisplayValues_2=False,
    DisplayMesh=False,
    DisplayPrinter=Toggle(True))
str_2 = String(silkworm_2.GCode)

panel = Panel(str_2)
