# Grasshopper definition Pf_01-Number.gh (Grasshopper 0.9.76)
# plug-ins: Pufferfish

# 06-List Length Range
# Useful as Tween factor for the "Tween Through"
# components to have multiple tweens.
pt = Point([Point(-8.600549939, 1.066710505, 0), Point(-1.129117342, 6.531205964, 0), Point(5.871699566, 9.952918646, 0), Point(-2.289155114, -11.3673946, 0), Point(11.24568257, -7.669513508, 0), Point(13.25643308, 17.82787734, 0), Point(-4.202145939, 20.42746541, 0), Point(-1.129117342, 6.531205964, 0)])
# The index to cut the list and
# mirror at.Try with negative
# index also to see how it
# effects the list.
number_slider = Slider(3, range=-10..10)
# 22-Round To Decimal Place
number_slider_2 = Slider(7.816, range=0..10)
# 23-Round To Factor
number_slider_3 = Slider(8.63, range=0..10)
# 05-Last Index Range
# Useful as Tween factor for the "Tween Through"
# components to have multiple tweens.
pt_2 = Point([Point(-8.600549939, 1.066710505, 0), Point(-1.129117342, 6.531205964, 0), Point(5.871699566, 9.952918646, 0), Point(-2.289155114, -11.3673946, 0), Point(11.24568257, -7.669513508, 0), Point(13.25643308, 17.82787734, 0), Point(-4.202145939, 20.42746541, 0), Point(-1.129117342, 6.531205964, 0)])
# Plug this tolerance into t and it will be false
panel = Panel("0.00000000000000000001")
# 20-Partition Number
number_slider_4 = Slider(8, range=0..10)
# 11-Deconstruct Number
number_slider_5 = Slider(5.56, range=0..10)
# 26-X Minus One
number_slider_6 = Slider(10, range=0..10)
# Values to remap
number_slider_7 = Slider(0, range=0..10)
# Domain of the Y axis mapped values
# (bounds of what we are remapping to)
# If nothing is input then the Y axis
# domain is the bounds of the input
# values to be remapped.
number_slider_8 = Slider(5, range=0..10)
# 27-X Plus One
number_slider_9 = Slider(10, range=0..10)
# Pf_01-Number
# 01-Tween Two Numbers
number_slider_10 = Slider(0.5, range=0..1)
# 02-Tween Consecutive Numbers
number_slider_11 = Slider(0.5, range=0..1)
# Num @
# index 0
number_slider_12 = Slider(1.5, range=0..2)
# This can be a list of anything (in this case points).
# The component measures this list and uses the
# last index (list length -1) as the end of the
# domain for the range.
number_slider_13 = Slider(10, range=0..100)
# 07-Reparameterized Range
# Useful as Tween factor for the "Tween Two" and "Tween Consecutive"
# components to have multiple tweens.
number_slider_14 = Slider(10, range=0..100)
# This can be a list of anything (in this case points).
# The component measures this list and uses the
# list length as the end of the domain for the range.
number_slider_15 = Slider(10, range=0..100)
# 25-Two Way Domain
number_slider_16 = Slider(10, range=0..10)
# 12-Equality Within Tolerance
panel_2 = Panel("5.00000000000001")
# Proportional scale factors for the
# input planes axes. Use same value
# for all for uniform scaling. These values
# are more like weights which balance with
# eachother like percentage overall, as
# opposed to traditional scale factors.
# They are proportional.
# The area
# the geometry
# will scale to
number_slider_17 = Slider(0.665, range=0.1..1)
# The length
# the curve
# will scale to
number_slider_18 = Slider(0.694, range=0.1..1)
# The volume
# the geometry
# will scale to
number_slider_19 = Slider(1, range=0.1..1)
# 08-Scale To Area
# Any geometry that can have its area taken.
# Surface, Polysurface(Brep), Mesh, Curve
# Plane for scaling orientation
number_slider_20 = Slider(1000, range=0..1000)
# 09-Scale To Length
# Curve
# Plane for scaling orientation
number_slider_21 = Slider(100, range=0..1000)
# 10-Scale To Volume
# Any geometry that can have its volume
# taken. Surface, Polysurface(Brep), Mesh
# Plane for scaling orientation
number_slider_22 = Slider(5000, range=0..5000)
# 14-Item Index List
panel_3 = Panel("""Frog
Lamp
Hello
Dog
Picnic
Design
Shoe
Helmet
Blue
Triangle""")
# 24-Round To Nearest
panel_4 = Panel("""3
7
25
100
1000""")
panel_5 = Panel("""5
20""")
# 21-Reparameterize Numbers
panel_6 = Panel("""0
2
4
6
8
10
12
14
16
18
20""")
# Change boolean to True
# to keep result as integers
# Factor from 0 to 1 determines the number
# between inputs. So 0.5 will be halfway
# between the inputs. You can use lists /
# mutiple factors as well.
toggle = BooleanToggle(False)
# Change boolean to True
# to keep result as integers
# Factor from 0 to 1 determines the number
# between each input as a list. So 0.5 will
# be halfway between each input
# consecutively through the list.
# You can use lists / mutiple factors as well.
toggle_2 = BooleanToggle(False)
# Change boolean to True
# to keep result as integers
# Factor from 0 to the last index. This
# can be considered like a timeline.
# This lets each number have an equally
# controllable section of the slider between.
# As opposed to going from 0 to 1 where
# it would be hard to control with many inputs.
# This lets you easily pinpoint your location.
# You can use lists / mutiple factors as well.
# 04-Curve Graph Mapper
toggle_3 = BooleanToggle(False)
# 0 = Reflected - Mirrors the exact values
# 1 = Inverted - Mirrors the inverse, so
# positives become negatives and vice versa.
# Joins the list at the seam so the duplicate number is removed
# where the mirror list meets the input list. Make it true and see how
# the result list changes at the seam.
# Determines if the list mirrors at the start or end
number_slider_23 = Slider(0, range=0..1)
# 0 = Reflected - Mirrors the exact values
# 1 = Inverted - Mirrors the inverse, so
# positives become negatives and vice versa.
# Joins the list at the seam so the duplicate number is removed
# where the mirror list meets the input list. Make it true and see how
# the result list changes at the seam.
# Determines if the list mirrors after or before the index
number_slider_24 = Slider(0, range=0..1)
# 15-Last Index
# Some random list
pt_3 = Point([Point(-8.600549939, 1.066710505, 0), Point(-1.129117342, 6.531205964, 0), Point(5.871699566, 9.952918646, 0), Point(-2.289155114, -11.3673946, 0), Point(11.24568257, -7.669513508, 0), Point(13.25643308, 17.82787734, 0), Point(-4.202145939, 20.42746541, 0), Point(-1.129117342, 6.531205964, 0)])
# 18-Mirror Combine Numbers
# List of numbers
series = Series(Start=0, Step=1, Count=8)
# Set to false to output the
# division as doubles. Will
# just be the division result
# repeated the same amount
# as the division amount
toggle_4 = BooleanToggle(True)
# 17-Mass Subtraction
# Subtracts numbers in list order
panel_7 = Panel("""5
4
7
8
9""")
# 13-Highest & Lowest Numbers
panel_8 = Panel("""3
5
7
8
2
1
3
4""")
# 16-Mass Division
# Divides numbers in list order
panel_9 = Panel("""5
4
7
8
9""")
# Boolean to start at 0 and end at
# last index, or have a list between 0
# and last index but not reach 0 or
# last index.
toggle_5 = BooleanToggle(True)
# Boolean to start at 0 and end
# at 1, or have a list between 0
# and 1 but not reach 0 or 1.
toggle_6 = BooleanToggle(True)
# Boolean to start at 0 and end at
# list length, or have a list between 0
# and list length but not reach 0 or
# list length.
toggle_7 = BooleanToggle(True)
# 29-Document Angle Tolerance
docat = DocumentAngleTolerance()  # -> Degrees, Radians
# 31-Default Angle Tolerance
defat = DefaultAngleTolerance()  # -> Degrees, Radians
# 28-Document Distance Tolerance
docdt = DocumentDistanceTolerance()
# 30-Zero Distance Tolerance
zerdt = ZeroDistanceTolerance()
series_2 = Series(Start=0, Step=1, Count=11)
# Size of the graph label text
number_slider_25 = Slider(1.25, range=0..2)
# Rectangle which defines
# the plane and boundary
# of the graph. This rectangle
# can be oriented in any plane.
rec = Rectangle({Plane=PlaneXY(-2.843546302, 87.41839834, 0), Size=Domain2(u=0..59.91311751, v=0..33.18658091)})
# Good for rounding numbers
# to specific decimal intervals
panel_10 = Panel(".25")
# 03-Tween Through Numbers
panel_11 = Panel("5")
# Num @
# index 1
# Num @
# index 2
panel_12 = Panel("15")
# 19-Mirror Cut Numbers
# List of numbers
series_3 = Series(Start=0, Step=1, Count=8)
xy = XYPlane(Origin=Point(4.327286669, -47.54571542, 0))
xy_2 = XYPlane(Origin=Point(0, 0, 0))
crv = Curve(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)
xy_3 = XYPlane(Origin=Point(-0.6402722879, 50.28212892, 6.306471627))
geo = Geometry(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)
geo_2 = Geometry(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)
# Flip the X axis to be
# the top of the graph
toggle_8 = BooleanToggle(False)
# Resize graph by snapping to
# the extents of the graph curves
toggle_9 = BooleanToggle(False)
panel_13 = Panel(docat.Degrees)
# Outputs Rhino documents
# Angle tolerance.
panel_14 = Panel(docat.Radians)
panel_15 = Panel(defat.Degrees)
# Outputs Rhino.Math
# default angle tolerance
panel_16 = Panel(defat.Radians)
# The graph curve or curves to map with.
# One or multiple curves can be used.
# The curves do not need to be fully in
# the rectangle boundary but should be
# atleast partially inside. If the graph curves
# are not in plane with the rectangle boundary
# they will be projected to it.
crv_2 = Curve(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)
# Outputs Rhino documents
# Absolute distance tolerance.
panel_17 = Panel(docdt)
# Outputs Rhino.Math
# zero distance tolerance
panel_18 = Panel(zerdt)
roundf = RoundToFactor(NumberX=number_slider_3, Factor=panel_10, RoundType=Slider(0, range=0..10))  # -> Rounded, Difference, MultiplierR, MultiplierX
roundn = RoundToNearest(NumbersX=panel_4, NumbersY=panel_5, RemapX=False)  # -> Nearest, RemappedX
denum = DeconstructNumber(Number=number_slider_5)  # -> Whole, Remainder
# X+1 is a common operation in
# code, one example is using
# it for the U input on the
# Surface From Points component.
x_plus_one = XPlusOne(NumberX=number_slider_9)
mdiv = MassDivision(Numbers=panel_9)  # -> Divided, Partial
reparamnums = ReparameterizeNumbers(Numbers=panel_6)  # -> Reparameterized, Original
twnthrunums = TweenThroughNumbers(Numbers=[panel_11, "10", panel_12], Factor=number_slider_12, Integer=toggle_3)
lstrange = LastIndexRange(List=pt_2, Steps=number_slider_13, Include=toggle_5)
lngrange = ListLengthRange(List=pt, Steps=number_slider_15, Include=toggle_7)
equalst = EqualityWithinTolerance(FirstNumber=panel_2, SecondNumber="5.00000000000002", Tolerance="0.001")
hilo = HighestLowestNumbers(Numbers=panel_8)  # -> Highest, Lowest
# X-1 is a common operation in
# code, one example is using
# it for the getting the last index
# of a list
x_minus_one = XMinusOne(NumberX=number_slider_6)
twnconnums = TweenConsecutiveNumbers(Numbers=["5", "10", "15"], Factor=number_slider_11, Integer=toggle_2)
reprange = ReparameterizedRange(Number=number_slider_14, Include=toggle_6)
msub = MassSubtraction(Numbers=panel_7)  # -> Subtracted, Partial
partnum = PartitionNumber(Number=number_slider_4, Division=Slider(3, range=0..10), Integer=toggle_4)
# Actually rounds to the decimal,
# does not just chop the end of the
# number off.
roundd = RoundToDecimalPlace(NumberX=number_slider_2, DecimalPlace=Slider(2, range=0..10), RoundType=Slider(0, range=0..10))  # -> Rounded, Difference
# Pufferfish
# By: Michael Pryor
twn2nums = TweenTwoNumbers(NumberA="5", NumberB="10", Factor=number_slider_10, Integer=toggle)
# Good for geometry that needs to go
# outward from a center, like rectangles.
_2waydom = TwoWayDomain(Extent=number_slider_16, Direction=Toggle(True))
# Optional domain of the X axis.
# If nothing is input then the X axis
# domain is the bounds of the input
# values to be remapped.
dom = ConstructDomain(DomainStart=number_slider_7, DomainEnd=number_slider_8)
lstdex = LastIndex(List=pt_3)
idexlist = ItemIndexList(List=panel_3)
scale2len = ScaleToLength(
    Curve=crv,
    Plane=xy,
    Length=number_slider_21,
    FactorX=Slider(0.361, range=0.1..1),
    FactorY=Slider(0.161, range=0.1..1),
    FactorZ=number_slider_18)  # -> Scaled, Transform
scale2vol = ScaleToVolume(
    Geometry=geo_2,
    Plane=xy_3,
    Volume=number_slider_22,
    FactorX=Slider(0.248, range=0.1..1),
    FactorY=Slider(0.225, range=0.1..1),
    FactorZ=number_slider_19)  # -> Scaled, Transform
mircomnums = MirrorCombineNumbers(Numbers=series, Flip=Toggle(False), Join=Toggle(False), MirrorType=number_slider_23)  # -> Mirrored, SplitIndex
mircutnums = MirrorCutNumbers(Numbers=series_3, MirrorIndex=number_slider, Flip=Toggle(False), Join=Toggle(False), MirrorType=number_slider_24)  # -> MirrorCut, SplitIndex, Intersected
scale2area = ScaleToArea(
    Geometry=geo,
    Plane=xy_2,
    Area=number_slider_20,
    FactorX=Slider(0.361, range=0.1..1),
    FactorY=Slider(0.189, range=0.1..1),
    FactorZ=number_slider_17)  # -> Scaled, Transform
# Sometimes you need a list of the item index
# for things like replacing items ect. by culling
# or specifiying indexs from the item list.
panel_19 = Panel(lstdex)
# Splits numbers at
# the decimal point
panel_20 = Panel(denum.Remainder)
panel_21 = Panel(twnconnums)
panel_22 = Panel(twnthrunums)
panel_23 = Panel(denum.Whole)
panel_24 = Panel(twn2nums)
# Addition of the result = the input number
panel_25 = Panel(partnum)
panel_26 = Panel(reprange)
# Component is a shortcut for this
panel_27 = Panel(x_minus_one)
# Component is a shortcut for this
panel_28 = Panel(x_plus_one)
# Component is a shortcut for this
panel_29 = Panel(lstrange)
# Component is a shortcut for this
panel_30 = Panel(lngrange)
panel_31 = Panel(hilo.Lowest)
# Component is a shortcut for this
panel_32 = Panel(_2waydom)
panel_33 = Panel(hilo.Highest)
# With remap option on
panel_34 = Panel(roundn.Nearest)
# Component is a shortcut for this
panel_35 = Panel(equalst)
# Component is a shortcut for this
panel_36 = Panel(reparamnums.Reparameterized)
# The original range
# of the input numbers
panel_37 = Panel(reparamnums.Original)
panel_38 = Panel(pt_3)
# Difference
panel_39 = Panel(roundd.Difference)
# Result
panel_40 = Panel(roundd.Rounded)
panel_41 = Panel(mdiv.Divided)
panel_42 = Panel(mdiv.Partial)
panel_43 = Panel(msub.Subtracted)
panel_44 = Panel(msub.Partial)
panel_45 = Panel(roundf.MultiplierX)
panel_46 = Panel(roundf.MultiplierR)
# Component is a shortcut for this
panel_47 = Panel(idexlist)
# Result transform data for use
# with the transform component
panel_48 = Panel(scale2vol.Transform)
# Result transform data for use
# with the transform component
panel_49 = Panel(scale2area.Transform)
# Result transform data for use
# with the transform component
panel_50 = Panel(scale2len.Transform)
panel_51 = Panel(mircutnums.Intersected)
# Look at Rhino
# to preview results
crv_3 = Curve(scale2len.Scaled)
panel_52 = Panel(series)
panel_53 = Panel(series_3)
# Difference
# Number of times the
# factor fits into result
# and orginal number
panel_54 = Panel(roundf.Difference)
crvgraphmap = CurveGraphMapper(Curves=crv_2, Rectangle=rec, Values=series_2, YAxis=dom, Flip=toggle_8, Snap=toggle_9, TextSize=number_slider_25)  # -> Mapped, GraphCurves, GraphPoints, ValueLines, ValuePoints, MappedLines, MappedPoints, Boundary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
# Is input value outside
# of the X axis domain?
panel_55 = Panel(crvgraphmap.OutOfBounds)
# Look at Rhino
# to preview results
geo_3 = Geometry(scale2area.Scaled)
# Look at Rhino
# to preview results
geo_4 = Geometry(scale2vol.Scaled)
# Result
panel_56 = Panel(roundf.Rounded)
volume = Volume(Geometry=geo_4)  # -> Volume, Centroid
area = Area(Geometry=geo_3)  # -> Area, Centroid
len = Length(Curve=crv_3)
# List cut
# and mirrored
panel_57 = Panel(mircutnums.MirrorCut)
# List mirrored
# and combined
panel_58 = Panel(mircomnums.Mirrored)
# Visualize Graph
graph = QuickGraph(crvgraphmap.Mapped)
# Input Values
panel_59 = Panel(series_2)
# did input value intersect
# any of the graph curves?
panel_60 = Panel(crvgraphmap.Intersected)
# Area of result matches
# the input area to scale to
panel_61 = Panel(area.Area)
# Length of result matches
# the input length to scale to
panel_62 = Panel(len)
# Volume of result matches
# the input area to scale to
panel_63 = Panel(volume.Volume)
pt_4 = Point([Point(-8.600549939, 1.066710505, 0), Point(-1.129117342, 6.531205964, 0), Point(5.871699566, 9.952918646, 0), Point(-2.289155114, -11.3673946, 0), Point(11.24568257, -7.669513508, 0), Point(13.25643308, 17.82787734, 0), Point(-4.202145939, 20.42746541, 0), Point(-1.129117342, 6.531205964, 0)])
# This also doesnt have the boolean option
# to be between the domain rather than
# starting and ending on the domain.
number_slider_26 = Slider(10, range=0..100)
# This also doesnt have the boolean option
# to be between the domain rather than
# starting and ending on the domain.
number_slider_27 = Slider(10, range=0..100)
# Same at this
# But this doesnt have the boolean
# option to be between the domain rather
# than starting and ending on the domain.
number_slider_28 = Slider(10, range=0..100)
pt_5 = Point([Point(-8.600549939, 1.066710505, 0), Point(-1.129117342, 6.531205964, 0), Point(5.871699566, 9.952918646, 0), Point(-2.289155114, -11.3673946, 0), Point(11.24568257, -7.669513508, 0), Point(13.25643308, 17.82787734, 0), Point(-4.202145939, 20.42746541, 0), Point(-1.129117342, 6.531205964, 0)])
lng = ListLength(List=pt_4)
# With remap on the numbers in x get
# remapped to the domain of the numbers
# in y before rounding to nearest.
# The remapped x values are output
# in the Rx output. Remapping gets you a
# more even result when the x numbers
# are far outside of the y numbers domain
# as it fits them within.
toggle_10 = BooleanToggle(True)
panel_64 = Panel("""0
2
4
6
8
10
12
14
16
18
20""")
panel_65 = Panel("""3
7
25
100
1000""")
panel_66 = Panel("""5
20""")
# Mapped Values
panel_67 = Panel(crvgraphmap.Mapped)
lng_2 = ListLength(List=pt_5)
subtraction = Subtraction(A=lng, B="1")
number_slider_29 = Slider(10, range=0..10)
pipe = Pipe(Curve=crvgraphmap.GraphCurves, Radius=0.2, Caps=0)
subtraction_2 = Subtraction(A="5.00000000000001", B="5.00000000000002")
panel_68 = Panel("""Frog
Lamp
Hello
Dog
Picnic
Design
Shoe
Helmet
Blue
Triangle""")
bnd = Bounds(Numbers=panel_64)
# Component is a shortcut for this
pt_6 = Point([Point(-8.600549939, 1.066710505, 0), Point(-1.129117342, 6.531205964, 0), Point(5.871699566, 9.952918646, 0), Point(-2.289155114, -11.3673946, 0), Point(11.24568257, -7.669513508, 0), Point(13.25643308, 17.82787734, 0), Point(-4.202145939, 20.42746541, 0), Point(-1.129117342, 6.531205964, 0)])
range = Range(Domain=subtraction, Steps=number_slider_27)
range_2 = Range(Domain=lng_2, Steps=number_slider_26)
range_3 = Range(Domain=Domain(0, 1), Steps=number_slider_28)
swatch = ColourSwatch(SwatchColor=RGB(0, 55, 255))
swatch_2 = ColourSwatch(SwatchColor=RGB(255, 0, 0))
# Alternatively there is the gh native
# similarity component which uses a
# percent for tolerance but I think
# using an actual distance value is
# more relevant / understandable
# in some cases.
similar = Similarity(FirstNumber="5.00000000000001", SecondNumber="5.00000000000002", Threshold=Slider(0.1, range=0..100))  # -> Similarity, AbsoluteDifference
swatch_3 = ColourSwatch(SwatchColor=RGB(0, 255, 166))
subtraction_3 = Subtraction(A=Slider(10, range=0..10), B="1.0")
addition = Addition(A=Slider(10, range=0..10), B="1.0")
roundn_2 = RoundToNearest(NumbersX=panel_65, NumbersY=panel_66, RemapX=toggle_10)  # -> Nearest, RemappedX
boundary = BoundarySurfaces(Edges=crvgraphmap.Labels)
abs = Absolute(Value=subtraction_2)
lng_3 = ListLength(List=pt_6)
remap = RemapNumbers(Value=panel_64, Source=bnd, Target=Domain(0, 1))  # -> Mapped, Clipped
# Often in code you will need the last index (list length -1)
panel_69 = Panel("1")
panel_70 = Panel(range)
panel_71 = Panel(range_2)
panel_72 = Panel(range_3)
# Splitting the list
number_slider_30 = Slider(4, range=-10..10)
series_4 = Series(Start=0, Step=1, Count=8)
neg = Negative(Value=number_slider_29)
panel_73 = Panel(subtraction_3)
panel_74 = Panel(addition)
series_5 = Series(Start=0, Step=1, Count=8)
# Splitting the list
toggle_11 = BooleanToggle(False)
lng_4 = ListLength(List=panel_68)
panel_75 = Panel(similar.Similarity)
# Customize the
# graph visualization
preview = CustomPreview(Geometry=crvgraphmap.MappedLines, Shader=swatch)
dots = DotDisplay(Point=crvgraphmap.MappedPoints, Colour=swatch, Size=0.5)
preview_2 = CustomPreview(Geometry=crvgraphmap.Boundary, Shader=ColourSwatch(SwatchColor=RGB(255, 255, 255)))
# Using multiple graph curves
preview_3 = CustomPreview(Geometry=crvgraphmap.ValueLines, Shader=swatch_2)
preview_4 = CustomPreview(Geometry=boundary, Shader=ColourSwatch(SwatchColor=RGB(0, 0, 0)))
smaller = SmallerThan(FirstNumber=abs, SecondNumber="0.001")  # -> SmallerThan, OrEqualTo
preview_5 = CustomPreview(Geometry=pipe, Shader=swatch_3)
dots_2 = DotDisplay(Point=crvgraphmap.ValuePoints, Colour=swatch_2, Size=0.5)
dots_3 = DotDisplay(Point=crvgraphmap.GraphPoints, Colour=swatch_3, Size=1)
# This is really good for large attractor
# distances which you would like to use
# for a few specific sizes, potentially
# something like panel sizes.
panel_76 = Panel(roundn_2.Nearest)
# Remapped x numbers
# to the domain of the y numbers
panel_77 = Panel(roundn_2.RemappedX)
subtraction_4 = Subtraction(A=lng_3, B=panel_69)
panel_78 = Panel(remap.Mapped)
dom_2 = ConstructDomain(DomainStart=neg, DomainEnd=number_slider_29)
series_6 = Series(Start=0, Step=1, Count=lng_4)
panel_79 = Panel(smaller.OrEqualTo)
panel_80 = Panel(subtraction_4)
panel_81 = Panel(series_6)
mircutnums_2 = MirrorCutNumbers(Numbers=series_4, MirrorIndex=number_slider_30, Flip=Toggle(False), Join=Toggle(False), MirrorType=Slider(0, range=0..1))  # -> MirrorCut, SplitIndex, Intersected
# If  join is false you can use this index
# to split the list at the mirror seam.
mircomnums_2 = MirrorCombineNumbers(Numbers=series_5, Flip=toggle_11, Join=Toggle(False), MirrorType=Slider(0, range=0..1))  # -> Mirrored, SplitIndex
split = SplitList(List=mircomnums_2.Mirrored, Index=mircomnums_2.SplitIndex)  # -> ListA, ListB
# If  join is false you can use this index
# to split the list at the mirror seam.
split_2 = SplitList(List=mircutnums_2.MirrorCut, Index=mircutnums_2.SplitIndex)  # -> ListA, ListB
# GH native equality
panel_82 = Panel("5.00000000000001")
# Repeating the list
# for repeating patterns
panel_83 = Panel(split.ListB)
# Repeating the list
# for repeating patterns
panel_84 = Panel(split_2.ListB)
panel_85 = Panel(split.ListA)
panel_86 = Panel(split_2.ListA)
# Domain of the Y axis mapped values
# (bounds of what we are remapping to)
# If nothing is input then the Y axis
# domain is the bounds of the input
# values to be remapped.
number_slider_31 = Slider(5, range=0..10)
# Values to remap
number_slider_32 = Slider(0, range=0..10)
# GH native equality has a zero tolerance
# which makes it very accurate but is not
# good for floating point error of numbers
# with large decimal places or simply
# if you want to test if something is equal "enough".
# This is a common question on the gh forum
# when people are confused about why
# they get false when comparing 0 to 0.
# This is because behind the scenes
# those 0 might actually be something like
# 0.000000000001 and 0.000000000002
# which are technically not equal, but we
# don't usually care for that much precision
# in the real world.
equals = Equality(FirstNumber=panel_82, SecondNumber="5.00000000000002")  # -> Equality, Inequality
series_7 = Series(Start=0, Step=1, Count=11)
# Size of the graph label text
number_slider_33 = Slider(1.25, range=0..2)
# Rectangle which defines
# the plane and boundary
# of the graph. This rectangle
# can be oriented in any plane.
rec_2 = Rectangle({Plane=PlaneXY(79.36729653, 87.41839834, 0), Size=Domain2(u=0..59.91311751, v=0..33.18658091)})
panel_87 = Panel(equals.Equality)
# Flip the X axis to be
# the top of the graph
toggle_12 = BooleanToggle(False)
# Resize graph by snapping to
# the extents of the graph curves
toggle_13 = BooleanToggle(False)
crv_4 = Curve([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])
# Optional domain of the X axis.
# If nothing is input then the X axis
# domain is the bounds of the input
# values to be remapped.
dom_3 = ConstructDomain(DomainStart=number_slider_32, DomainEnd=number_slider_31)
series_8 = Series(Start=0, Step=1, Count=8)
# Change the index value to shrink or grow the wave
series_9 = Series(Start=0, Step=1, Count=8)
crvgraphmap_2 = CurveGraphMapper(Curves=crv_4, Rectangle=rec_2, Values=series_7, YAxis=dom_3, Flip=toggle_12, Snap=toggle_13, TextSize=number_slider_33)  # -> Mapped, GraphCurves, GraphPoints, ValueLines, ValuePoints, MappedLines, MappedPoints, Boundary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
# Is input value outside
# of the X axis domain?
panel_88 = Panel(crvgraphmap_2.OutOfBounds)
mircutnums_3 = MirrorCutNumbers(
    Numbers=series_9,
    MirrorIndex=Slider(6, range=-10..10),
    Flip=Toggle(False),
    Join=Toggle(False),
    MirrorType=Slider(0, range=0..1))  # -> MirrorCut, SplitIndex, Intersected
mircomnums_3 = MirrorCombineNumbers(Numbers=series_8, Flip=Toggle(False), Join=Toggle(False), MirrorType=Slider(0, range=0..1))  # -> Mirrored, SplitIndex
# Visualize Graph
graph_2 = QuickGraph(crvgraphmap_2.Mapped)
# Input Values
panel_89 = Panel(series_7)
# did input value intersect
# any of the graph curves?
panel_90 = Panel(crvgraphmap_2.Intersected)
# Move the slider to shorten or lengthen the wave
number_slider_34 = Slider(83, range=0..200)
# Move the slider to shorten or lengthen the wave
number_slider_35 = Slider(100, range=0..200)
# Mapped Values
panel_91 = Panel(crvgraphmap_2.Mapped)
# By repeating the mirror combine list data
# you can make patterns such as waves.
repeat = RepeatData(Data=mircutnums_3.MirrorCut, Length=number_slider_34)
# By repeating the mirror combine list data
# you can make patterns such as waves.
repeat_2 = RepeatData(Data=mircomnums_3.Mirrored, Length=number_slider_35)
pipe_2 = Pipe(Curve=crvgraphmap_2.GraphCurves, Radius=0.2, Caps=0)
series_10 = Series(Start=0, Step=1, Count=number_slider_34)
series_11 = Series(Start=0, Step=1, Count=number_slider_35)
swatch_4 = ColourSwatch(SwatchColor=RGB(0, 55, 255))
swatch_5 = ColourSwatch(SwatchColor=RGB(255, 0, 0))
swatch_6 = ColourSwatch(SwatchColor=RGB(0, 255, 166))
Y = UnitY(Factor=series_10)
Y_2 = UnitY(Factor=series_11)
boundary_2 = BoundarySurfaces(Edges=crvgraphmap_2.Labels)
pt_7 = Point(Point(112.3594873, -66.8176387, 0))
pt_8 = Point(Point(78.16022402, -66.8176387, 0))
panel_92 = Panel(repeat)
Z = UnitZ(Factor=repeat)
move = Move(Geometry=pt_7, Motion=Y)  # -> Geometry, Transform
panel_93 = Panel(repeat_2)
Z_2 = UnitZ(Factor=repeat_2)
move_2 = Move(Geometry=pt_8, Motion=Y_2)  # -> Geometry, Transform
# Customize the
# graph visualization
preview_6 = CustomPreview(Geometry=crvgraphmap_2.MappedLines, Shader=swatch_4)
dots_4 = DotDisplay(Point=crvgraphmap_2.MappedPoints, Colour=swatch_4, Size=0.5)
preview_7 = CustomPreview(Geometry=crvgraphmap_2.Boundary, Shader=ColourSwatch(SwatchColor=RGB(255, 255, 255)))
preview_8 = CustomPreview(Geometry=crvgraphmap_2.ValueLines, Shader=swatch_5)
preview_9 = CustomPreview(Geometry=boundary_2, Shader=ColourSwatch(SwatchColor=RGB(0, 0, 0)))
preview_10 = CustomPreview(Geometry=pipe_2, Shader=swatch_6)
dots_5 = DotDisplay(Point=crvgraphmap_2.ValuePoints, Colour=swatch_5, Size=0.5)
dots_6 = DotDisplay(Point=crvgraphmap_2.GraphPoints, Colour=swatch_6, Size=1)
move_3 = Move(Geometry=move.Geometry, Motion=Z)  # -> Geometry, Transform
move_4 = Move(Geometry=move_2.Geometry, Motion=Z_2)  # -> Geometry, Transform
# Look at Rhino
# to preview results
pt_9 = Point(move_3.Geometry)
# Look at Rhino
# to preview results
pt_10 = Point(move_4.Geometry)
