# Grasshopper definition Pf_04-Point.gh (Grasshopper 0.9.76)
# plug-ins: Pufferfish

# 15-Mirror Cut Points
# Change the slider value to move the
# mirror plane and see how it effects the
# mirror cutting.
# Change the slider value to rotate the
# mirror plane and see how it effects the
# mirror cutting.
number_slider = Slider(-3.38, range=-20..40)
# 02-Tween Consecutive Points
number_slider_2 = Slider(0.5, range=0..1)
# Factor from 0 to 1 determines the point
# between each input as a list. So 0.5 will
# be halfway between each input
# consecutively through the list.
# You can use lists / mutiple factors as well.
number_slider_3 = Slider(0.5, range=0..1)
# Unlike grasshoppers native surface
# divide component, this component uses
# parameter values along the u and v
# surface domains. Here we use range
# components to generate the lists
# of parameters. The native grasshopper
# component uses a division value which
# always makes an even grid on surface.
# By using parameter values there can be
# more customization of the grid spacing.
number_slider_4 = Slider(5, range=0..10)
# 10-Parameter Point Divide Surface
number_slider_5 = Slider(6, range=0..10)
# Pt @
# index 0
number_slider_6 = Slider(1.5, range=0..2)
# 05-Point Divide Curve Segments
# Curves that have segments.
# If curve has no segments
# it will divide the entire curve
# equally.
number_slider_7 = Slider(4, range=0..10)
# Pt @
# index 0
number_slider_8 = Slider(1.5, range=0..2)
# Pt @
# index 0
number_slider_9 = Slider(1.5, range=0..2)
# negative strengths spread
number_slider_10 = Slider(0.6, range=-1..1)
# 17-Pinch'n'Spread
sqgrid = Square(Plane=PlaneXY(296.0699263, 6.778350916, 0), Size=1, ExtentX=10, ExtentY=20)  # -> Cells, Points
# 01-Tween Two Points
# Factor from 0 to 1 determines the point
# between inputs. So 0.5 will be halfway
# between the inputs. You can use lists /
# mutiple factors as well.
number_slider_11 = Slider(0.5, range=0..1)
# 12-Tween Two Points On Surface
# Factor from 0 to 1 determines the point
# between inputs. So 0.5 will be halfway
# between the inputs. You can use lists /
# mutiple factors as well.
number_slider_12 = Slider(0.5, range=0..1)
# 07-Tween Two Points On Curve
# Factor from 0 to 1 determines the point
# between inputs. So 0.5 will be halfway
# between the inputs. You can use lists /
# mutiple factors as well.
number_slider_13 = Slider(0.5, range=0..1)
# The target division length
# to divide equally closest to.
number_slider_14 = Slider(0, range=0..2)
# Determines how the tween is interpolated.
# Factor from 0 to 1 determines the point
# between each input as a list. So 0.5 will
# be halfway between each input
# consecutively through the list.
# You can use lists / mutiple factors as well.
number_slider_15 = Slider(0, range=0..3)
# Determines how the tween is interpolated.
# Factor from 0 to 1 determines the point
# between each input as a list. So 0.5 will
# be halfway between each input
# consecutively through the list.
# You can use lists / mutiple factors as well.
number_slider_16 = Slider(0, range=0..3)
# Determines how the tween is interpolated.
# Factor from 0 to the last index. This
# can be considered like a timeline.
# This lets each point have an equally
# controllable section of the slider between.
# As opposed to going from 0 to 1 where
# it would be hard to control with many inputs.
# This lets you easily pinpoint your location.
# You can use lists / mutiple factors as well.
number_slider_17 = Slider(3, range=0..3)
# Determines how the tween is interpolated.
number_slider_18 = Slider(0, range=0..3)
# 19-Trim Points With Plane
toggle = BooleanToggle(False)
# 06-Point Divide Curve Target
number_slider_19 = Slider(6.57, range=0..10)
# Plane that trims
O = Origin(Point(109.9575421, 174.9278551, 8.970328456))
# 04-Curve Edit Points
# Points that make
# the interpolated curve
pt = Point([Point(-29.02972034, -37.7493154, 0), Point(-21.08704348, -24.2888909, 0), Point(-18.82805911, -41.56297066, 0), Point(-11.21430931, -38.46604538, 0), Point(-8.341026918, -27.89432168, 0), Point(-1.346393572, -28.82077906, 0), Point(-2.16486807, -33.89551287, 0)])
# 18-Reparameterize Points
pop3d = Populate3D(Region={Plane=PlaneXY(0, 0, 0), X=Domain(0, 10), Y=Domain(0, 10), Z=Domain(0, 2)}, Count=100, Seed=1)
# 16-Move 2Pt
# Any geometry
geo = Geometry(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)
pt_2 = Point(Point(259.9602786, 5.452049486, 0))
pt_3 = Point(Point(269.6197022, 23.9598674, -8.244404632))
pt_4 = Point([Point(298.2637905, 23.34915656, 0), Point(303.8596274, 18.52742326, 0), Point(299.2662198, 7.780096092, 0)])
pt_5 = Point(sqgrid.Points)
# Look at Rhino window
# to preview input
pt_6 = Point([Point(325.5520587, 31.57608545, 0), Point(323.8966654, 35.81595267, 0), Point(325.7606027, 40.8413618, 0), Point(323.6040234, 43.40561871, 0), Point(325.6045943, 46.47199461, 0)])
# Look at Rhino window
# to preview input
pt_7 = Point([Point(346.8049865, 43.05811251, 0), Point(360.1318976, 32.87852886, 5.551820468), Point(362.3969426, 39.3699745, 0), Point(355.8875511, 39.29368178, 5.968781172), Point(351.0927132, 35.19006957, 8.475941061), Point(345.9748615, 49.27502895, 3.885920796), Point(356.7796706, 46.63735712, 1.634975231), Point(362.5812773, 45.91734624, 0), Point(356.3655021, 42.26102496, 0), Point(345.7013584, 36.59335232, 4.48282604)])
# 22-Point Plane Side
# Look at Rhino window
# to preview input
P = Point([Point(386.6808249, 14.35611416, 0), Point(393.4243007, 26.41474937, 0), Point(397.0236269, 6.128508145, 0)])
# Look at Rhino window
# to preview input
pln = Plane(Plane(origin=(393.2790545, 16.56715766, 0), x=(0.8358830235, 0.5489076161, 0), y=(-0.1934579719, 0.2946000925, 0.9358337452)))
# 23-Point Surface Side
# Look at Rhino window
# to preview input
P_2 = Point([Point(434.1747247, 24.59822565, -6.164891909), Point(439.7942874, 17.40689664, 4.711794715), Point(438.6823186, 4.784021885, 0)])
# Look at Rhino window
# to preview input
srf = Surface(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)
# 21-Are Points Coplanar
# Look at Rhino window
# to preview input
pt_8 = Point([Point(346.2847634, 5.232681052, 0), Point(343.4994108, 11.35254045, 0), Point(354.2452198, 8.772409421, 0), Point(357.0595754, 12.71831237, 0), Point(351.2700316, 17.74632269, 0), Point(345.5279449, 18.69694115, 0), Point(349.5414901, 14.19521807, 0), Point(351.6576722, 5.765518158, 0), Point(358.2225393, 6.541713044, 0)])
# 20-Are Points Collinear
# Look at Rhino window
# to preview input
pt_9 = Point([Point(325.6664664, 9.052529564, 0), Point(325.6664664, 12.32449107, 0), Point(325.6664664, 15.19140289, 0), Point(325.6664664, 18.90055936, 0), Point(325.6664664, 22.69806613, 0)])
# This option includes the endpoint
# only for closed curves. If true with open
# curves nothing will happen.
# There are 3 division types.
# Closest, Ceiling, Floor
toggle_2 = BooleanToggle(False)
srf_2 = Surface(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)
pt_10 = Point(Point(20.01330408, 0.1258942597, 0))
pt_11 = Point(Point(23.31911307, 14.24566655, 0))
pt_12 = Point(Point(33.26946213, 4.963962088, 10.58820749))
# Pt @
# index 1
# Pt @
# index 2
pt_13 = Point(Point(70.62259451, 2.357067053, 12.45169359))
C = Curve(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)
pt_14 = Point(Point(161.6973641, 5.383579774, 6.396566713))
# Pf_04-Point
pt_15 = Point(Point(0, 0, 0))
pt_16 = Point(Point(-12.14069583, 8.722292686, 12.10213129))
# 03-Tween Through Points
pt_17 = Point(Point(55.57101076, -0.2038058289, 0))
pt_18 = Point(Point(58.98943748, 13.50022619, 0))
# 08-Tween Consecutive Points On Curve
pt_19 = Point(Point(155.2705652, -32.78540489, 5.10494556))
pt_20 = Point(Point(164.922715, -39.12393166, 5.681341046))
pt_21 = Point(Point(177.5028649, -35.85937778, 7.352637512))
crv = Curve(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)
# 09-Tween Through Points On Curve
pt_22 = Point(Point(214.1157338, -32.43889709, 6.72241149))
pt_23 = Point(Point(234.8998708, -35.34307548, 6.093886903))
# Pt @
# index 1
# Pt @
# index 2
crv_2 = Curve(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)
# 13-Tween Consecutive Points On Surface
pt_24 = Point(Point(157.2426826, 7.490051243, 19.87992176))
pt_25 = Point(Point(169.6480507, 2.164932681, 22.20601964))
# 14-Tween Through Points On Surface
pt_26 = Point(Point(212.6256624, 7.490051243, 19.87992176))
pt_27 = Point(Point(225.0310305, 2.164932681, 22.20601964))
pt_28 = Point(Point(217.0803439, 5.383579774, 6.396566713))
# Pt @
# index 1
# Pt @
# index 2
srf_3 = Surface(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)
pt_29 = Point(Point(217.5356104, -34.27453508, 9.529547685))
pt_30 = Point(Point(115.5878299, 2.164932681, 22.20601964))
pt_31 = Point(Point(107.6371433, 5.383579774, 6.396566713))
srf_4 = Surface(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)
pt_32 = Point(Point(102.4326287, -34.86945525, 9.432029348))
pt_33 = Point(Point(119.6495025, -35.6104692, 6.78547959))
crv_3 = Curve(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)
yz = YZPlane(Origin=O)
# Flips the mirror direction to
# cut the other side instead.
toggle_3 = BooleanToggle(False)
# Check in Rhino, the points are the same
intcrv = Interpolate(Vertices=pt, Degree=3, Periodic=False, KnotStyle=0)  # -> Curve, Length, Domain
C_2 = Curve(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)
# Plane
yz_2 = YZPlane(Origin=Point(11.90780968, 89.77094321, 12.959768))
range = Range(Domain=Domain(0, 1), Steps=number_slider_4)
range_2 = Range(Domain=Domain(0, 1), Steps=number_slider_5)
# The reach distance determines how
# far from the mirror plane that the cutting
# reaches. Anything within that distance
# from the mirror plane will be additionally
# cut away. Set it to zero and the cutting will
# only happen exactly at the mirror plane.
X = UnitX(Factor=number_slider)
# The point set that will get
# trimmed (turn its preview
# on to see the original point set)
pop3d_2 = Populate3D(
    Region={Plane=Plane(origin=(92.33638854, 159.5173607, 0), x=(0, 1, 0), y=(1, 0, 0)), X=Domain(0, 32.66751416), Y=Domain(0, 33.61439863), Z=Domain(-29.50894418, 0)},
    Count=500,
    Seed=1)
# When true you will get the exact points
# an interpolated curve intrpolated through.
# When false you get all the edit points like
# Rhino's EditPtOn command.
toggle_4 = BooleanToggle(True)
S = Surface(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)
# 11-Map Point To Surface
P_3 = Point([Point(236.2352132, 89.50113052, 0.02928425763), Point(248.5178667, 90.717984, 4.910189948), Point(257.1646837, 82.98160275, 0.0944416689), Point(244.8278706, 81.79918391, -6.44751132)])
S_2 = Source(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)
# Points to map. Keep in mind these points
# map to the surface space not the surface.
# So if the points are not on the source
# surface they will map in the same
# relationship offset from the target surface.
T = Target(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)
reparampts = ReparameterizePoints(Points=pop3d, Dimensionality=toggle)  # -> Reparameterized, OriginalX, OriginalY, OriginalZ
move2pt = Move2Pt(Geometry=geo, PointA=pt_2, PointB=pt_3)  # -> Moved, Vector, Transform
ptplnside = PointPlaneSide(Point=P, Plane=pln)  # -> Side, Front, Back, Distance
# This option includes the endpoint
# only for closed curves. If true with open
# curves nothing will happen.
ptdivcrvsegs = PointDivideCurveSegments(Curve=C, Number=number_slider_7, EndPoint=Toggle(False))  # -> Points, Tangents, Parameters
ptsrfside = PointSurfaceSide(Point=P_2, Surface=srf)  # -> Side, Front, Back, Distance
# Pufferfish
# By: Michael Pryor
twn2pts = TweenTwoPoints(PointA=pt_15, PointB=pt_16, Factor=number_slider_11)
twnthrupts = TweenThroughPoints(Points=[pt_17, pt_18, pt_13], Factor=number_slider_6, InterpolationType=number_slider_17)
twnconptscrv = TweenConsecutivePointsOnCurve(Points=[pt_19, pt_20, pt_21], Curve=crv, Factor=number_slider_3)
twnthruptscrv = TweenThroughPointsOnCurve(Points=[pt_22, pt_29, pt_23], Curve=crv_2, Factor=number_slider_9)
twnthruptssrf = TweenThroughPointsOnSurface(Points=[pt_26, pt_27, pt_28], Surface=srf_3, Factor=number_slider_8, InterpolationType=number_slider_18)
p_n_s = PinchNSpread(Location=pt_4, Points=pt_5, Radius=Slider(5, range=0..10), Strength=number_slider_10)
ptscolinr = ArePointsCollinear(Points=pt_6)
ptscoplnr = ArePointsCoplanar(Points=pt_8)
ptscoplnr_2 = ArePointsCoplanar(Points=pt_7)
twn2ptscrv = TweenTwoPointsOnCurve(PointA=pt_32, PointB=pt_33, Curve=crv_3, Factor=number_slider_13)
twn2ptssrf = TweenTwoPointsOnSurface(PointA=pt_30, PointB=pt_31, Surface=srf_4, Factor=number_slider_12)
ptscolinr_2 = ArePointsCollinear(Points=pt_9)
twnconpts = TweenConsecutivePoints(Points=[pt_10, pt_11, pt_12], Factor=number_slider_2, InterpolationType=number_slider_15)
twnconptssrf = TweenConsecutivePointsOnSurface(Points=[pt_24, pt_25, pt_14], Surface=srf_2, Factor=Slider(0.5, range=0..1), InterpolationType=number_slider_16)
move = Move(Geometry=yz_2, Motion=X)  # -> Geometry, Transform
ptdivcrvtarg = PointDivideCurveTargetLength(Curve=C_2, Target=number_slider_19, DivisionType=number_slider_14, EndPoint=toggle_2)  # -> Points, Tangents, Parameters, Length
trimptspln = TrimPointsWithPlane(Points=pop3d_2, Plane=yz, Flip=toggle_3)  # -> Trimmed, R
crveditpts = CurveEditPoints(Curve=intcrv.Curve, SpansOnly=toggle_4)  # -> Points, Tangents, Parameters
paramptdivsrf = ParameterPointDivideSurface(Surface=S, ParametersU=range_2, ParametersV=range)  # -> Points, Normals
mappt2srf = MapPointToSurface(Point=P_3, Source=S_2, Target=T)
panel = Panel(ptscolinr_2)
panel_2 = Panel(ptscolinr)
panel_3 = Panel(ptscoplnr)
panel_4 = Panel(ptscoplnr_2)
panel_5 = Panel(ptplnside.Distance)
# The point set that will get
# mirror cut (turn its preview
# on to see the original point set)
# Using as the mirror plane
deplane = DeconstructPlane(Plane=move.Geometry)  # -> Origin, XAxis, YAxis, ZAxis
panel_6 = Panel(ptplnside.Front)
panel_7 = Panel(ptplnside.Back)
panel_8 = Panel(ptsrfside.Front)
panel_9 = Panel(ptsrfside.Distance)
# Look at Rhino window
# to preview results
preview = CustomPreview(
    Geometry=twn2ptssrf,
    Shader={ambient=RGB(0, 0, 0), diffuse=RGB(255, 105, 180), emission=RGB(76, 32, 54), shine=0.5, specular=RGB(255, 255, 255), transparency=0})
panel_10 = Panel(ptplnside.Side)
panel_11 = Panel(ptsrfside.Side)
panel_12 = Panel(ptsrfside.Back)
# Look at Rhino window
# to preview results
preview_2 = CustomPreview(
    Geometry=twn2pts,
    Shader={ambient=RGB(0, 0, 0), diffuse=RGB(255, 105, 180), emission=RGB(76, 32, 54), shine=0.5, specular=RGB(255, 255, 255), transparency=0})
# Look at Rhino window
# to preview results
preview_3 = CustomPreview(
    Geometry=twnconpts,
    Shader={ambient=RGB(0, 0, 0), diffuse=RGB(255, 105, 180), emission=RGB(76, 32, 54), shine=0.5, specular=RGB(255, 255, 255), transparency=0})
# Look at Rhino window
# to preview results
preview_4 = CustomPreview(
    Geometry=twnthrupts,
    Shader={ambient=RGB(0, 0, 0), diffuse=RGB(255, 105, 180), emission=RGB(76, 32, 54), shine=0.5, specular=RGB(255, 255, 255), transparency=0})
# With closed segmented curves
# Look at Rhino window
# to preview results
preview_5 = CustomPreview(
    Geometry=ptdivcrvsegs.Points,
    Shader={ambient=RGB(0, 0, 0), diffuse=RGB(255, 105, 180), emission=RGB(76, 32, 54), shine=0.5, specular=RGB(255, 255, 255), transparency=0})
# Look at Rhino window
# to preview results
preview_6 = CustomPreview(
    Geometry=twn2ptscrv,
    Shader={ambient=RGB(0, 0, 0), diffuse=RGB(255, 105, 180), emission=RGB(76, 32, 54), shine=0.5, specular=RGB(255, 255, 255), transparency=0})
# Look at Rhino window
# to preview results
preview_7 = CustomPreview(
    Geometry=twnconptscrv,
    Shader={ambient=RGB(0, 0, 0), diffuse=RGB(255, 105, 180), emission=RGB(76, 32, 54), shine=0.5, specular=RGB(255, 255, 255), transparency=0})
# Look at Rhino window
# to preview results
preview_8 = CustomPreview(
    Geometry=twnthruptscrv,
    Shader={ambient=RGB(0, 0, 0), diffuse=RGB(255, 105, 180), emission=RGB(76, 32, 54), shine=0.5, specular=RGB(255, 255, 255), transparency=0})
panel_13 = Panel(range_2)
panel_14 = Panel(range)
# Look at Rhino window
# to preview results
preview_9 = CustomPreview(
    Geometry=twnconptssrf,
    Shader={ambient=RGB(0, 0, 0), diffuse=RGB(255, 105, 180), emission=RGB(76, 32, 54), shine=0.5, specular=RGB(255, 255, 255), transparency=0})
# Look at Rhino window
# to preview results
preview_10 = CustomPreview(
    Geometry=twnthruptssrf,
    Shader={ambient=RGB(0, 0, 0), diffuse=RGB(255, 105, 180), emission=RGB(76, 32, 54), shine=0.5, specular=RGB(255, 255, 255), transparency=0})
intcrv_2 = Interpolate(Vertices=p_n_s, Degree=3, Periodic=False, KnotStyle=1)  # -> Curve, Length, Domain
# Component is a shortcut for this
preview_11 = CustomPreview(
    Geometry=move2pt.Moved,
    Shader={ambient=RGB(0, 0, 0), diffuse=RGB(255, 105, 180), emission=RGB(76, 32, 54), shine=0.5, specular=RGB(255, 255, 255), transparency=0})
# Look at Rhino window
# to preview results
# Transformation data to use
# with the transform component
panel_15 = Panel(move2pt.Vector)
# Look at Rhino window
# to preview results
# With optional anchor points
preview_12 = CustomPreview(
    Geometry=p_n_s,
    Shader={ambient=RGB(0, 0, 0), diffuse=RGB(255, 105, 180), emission=RGB(76, 32, 54), shine=0.5, specular=RGB(255, 255, 255), transparency=0})
ln = Line(StartPoint=P_3, EndPoint=mappt2srf)
panel_16 = Panel(reparampts.OriginalX)
# Additional information
panel_17 = Panel(reparampts.OriginalY)
panel_18 = Panel(reparampts.OriginalZ)
# Look at Rhino window
# to preview results
preview_13 = CustomPreview(
    Geometry=reparampts.Reparameterized,
    Shader={ambient=RGB(0, 0, 0), diffuse=RGB(255, 105, 180), emission=RGB(76, 32, 54), shine=0.5, specular=RGB(255, 255, 255), transparency=0})
# This allows the start and end of the grid
# to be altered on the surface so grids can
# exist only on parts of the surface.
# Look at Rhino window
# to preview results
preview_14 = CustomPreview(
    Geometry=paramptdivsrf.Points,
    Shader={ambient=RGB(0, 0, 0), diffuse=RGB(255, 105, 180), emission=RGB(76, 32, 54), shine=0.5, specular=RGB(255, 255, 255), transparency=0})
# Just to visualize the relationship
# between input points and mapped points.
# Look at Rhino window
# to preview results
preview_15 = CustomPreview(
    Geometry=mappt2srf,
    Shader={ambient=RGB(0, 0, 0), diffuse=RGB(255, 105, 180), emission=RGB(76, 32, 54), shine=0.5, specular=RGB(255, 255, 255), transparency=0})
panel_19 = Panel(trimptspln.R)
# Look at Rhino window
# to preview results
preview_16 = CustomPreview(
    Geometry=trimptspln.Trimmed,
    Shader={ambient=RGB(0, 0, 0), diffuse=RGB(255, 105, 180), emission=RGB(76, 32, 54), shine=0.5, specular=RGB(255, 255, 255), transparency=0})
shatter = Shatter(Curve=C_2, Parameters=ptdivcrvtarg.Parameters)
# Look at Rhino window
# to preview results
# If we try and remake the interpolated curve.
preview_17 = CustomPreview(
    Geometry=crveditpts.Points,
    Shader={ambient=RGB(0, 0, 0), diffuse=RGB(255, 105, 180), emission=RGB(76, 32, 54), shine=0.5, specular=RGB(255, 255, 255), transparency=0})
# The offser distance determines how
# far to offset the cut. It does not do any
# additional cut removing like
# the reach plane, it just moves the
# actual cut away from the mirror plane.
# Set it to zero and there will be no gap
# in the mirror cut.
toggle_5 = BooleanToggle(False)
# The length that was
# used to divide the curve.
panel_20 = Panel(ptdivcrvtarg.Length)
# Look at Rhino window
# to preview results
preview_18 = CustomPreview(
    Geometry=ptdivcrvtarg.Points,
    Shader={ambient=RGB(0, 0, 0), diffuse=RGB(255, 105, 180), emission=RGB(76, 32, 54), shine=0.5, specular=RGB(255, 255, 255), transparency=0})
rot3d = Rotate3D(Geometry=move.Geometry, Angle=degrees(Slider(69, range=0..360)), Center=deplane.Origin, Axis=deplane.YAxis)  # -> Geometry, Transform
len = Length(Curve=shatter)
pop3d_3 = Populate3D(
    Region={Plane=Plane(origin=(-1.660426231, 77.85177226, 0), x=(0, 1, 0), y=(1, 0, 0)), X=Domain(0, 26.51413644), Y=Domain(0, 29.98173965), Z=Domain(-28.20855015, 0)},
    Count=500,
    Seed=1)
# Proof of equal lengths
# With closed segmented curves
panel_21 = Panel(len)
# Flips the mirror direction to
# cut the other side instead.
# If true the entire input point set is mirrored
# normally if it is mirror cut into non existance.
toggle_6 = BooleanToggle(False)
mircutpts = MirrorCutPoints(
    Points=pop3d_3,
    MirrorPlane=rot3d.Geometry,
    Reach=Slider(1.596, range=0..10),
    Offset=Slider(3.352, range=0..10),
    Flip=toggle_5,
    Keep=toggle_6)  # -> MirrorCut, SplitIndex, ReachPlane, OffsetPlane, Intersected
geo_2 = Geometry(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)
pt_34 = Point(Point(259.9602786, 5.452049486, 0))
pt_35 = Point(Point(273.6166618, 23.9598674, 0))
sqgrid_2 = Square(Plane=PlaneXY(297.1664411, 33.02169456, 0), Size=1, ExtentX=10, ExtentY=20)  # -> Cells, Points
# negative strengths spread
number_slider_20 = Slider(0.6, range=-1..1)
# Closed curve with segments
number_slider_21 = Slider(7, range=0..10)
panel_22 = Panel(mircutpts.Intersected)
# Adjusting the start and end domains
# of the ranges positions the grid on
# specified parts of the surface.
number_slider_22 = Slider(0.537, range=0..1)
vec2pt = Vector2Pt(PointA=pt_34, PointB=pt_35, Unitize=False)  # -> Vector, Length
pt_36 = Point([Point(299.323942, 50.2939864, 0), Point(304.8847094, 43.14808817, 0), Point(299.4633236, 35.43533383, 0)])
pt_37 = Point(sqgrid_2.Points)
move_2 = Move(Geometry=geo_2, Motion=vec2pt.Vector)  # -> Geometry, Transform
C_3 = Curve(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)
# Look at Rhino window
# to preview results
# Result mirror cut point set
preview_19 = CustomPreview(Geometry=mircutpts.MirrorCut, Shader=ColourSwatch(SwatchColor=RGB(255, 0, 0)))
# Reach plane (this plane essentially does the cutting)
preview_20 = CustomPreview(Geometry=mircutpts.ReachPlane, Shader=ColourSwatch(SwatchColor=RGB(10, 255, 210)))
# Offset plane (offsets the cuts from the mirror plane)
preview_21 = CustomPreview(Geometry=mircutpts.OffsetPlane, Shader=ColourSwatch(SwatchColor=RGB(10, 22, 255)))
# Anchor points from the points list
# to make as achor points which
# will not be moved by the Pinch'n'Spread.
item = ListItem(List=reverse(pt_37), Index=0, Wrap=True)
# Points that make
# the interpolated curve
pt_38 = Point([Point(-28.19519075, -59.89703666, 0), Point(-20.57113848, -51.82060688, 0), Point(-18.46523545, -64.78892227, 0), Point(-12.13263942, -63.84486467, 0), Point(-7.927496532, -51.6530219, 0), Point(0.857587239, -55.03540981, 0), Point(0.2808675506, -61.44473558, 0)])
item_2 = ListItem(List=pt_37, Index=0, Wrap=True)
# Closed curve
number_slider_23 = Slider(6.57, range=0..10)
intcrv_3 = Interpolate(Vertices=pt_38, Degree=3, Periodic=False, KnotStyle=0)  # -> Curve, Length, Domain
# Set to true the end point is added
# which is duplicate of the start point.
ptdivcrvsegs_2 = PointDivideCurveSegments(Curve=C_3, Number=number_slider_21, EndPoint=Toggle(True))  # -> Points, Tangents, Parameters
dom = ConstructDomain(DomainStart=Slider(0.25, range=0..1), DomainEnd=Slider(0.801, range=0..1))
dom_2 = ConstructDomain(DomainStart=Slider(0.13, range=0..1), DomainEnd=number_slider_22)
# Set to true the end point is added
# which is duplicate of the start point.
toggle_7 = BooleanToggle(True)
# The important thing here is that the new interpolated
# curve uses the same knot style as the original or the
# new curve wont match.
toggle_8 = BooleanToggle(True)
p_n_s_2 = PinchNSpread(Location=pt_36, Points=pt_37, Radius=Slider(5, range=0..10), Strength=number_slider_20, Anchors=[item_2, item])
C_4 = Curve(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)
range_3 = Range(Domain=dom_2, Steps=Slider(5, range=0..10))
range_4 = Range(Domain=dom, Steps=Slider(6, range=0..10))
lng = ListLength(List=ptdivcrvsegs_2.Points)
S_3 = Surface(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)
# Look at Rhino window
# to preview results
preview_22 = CustomPreview(
    Geometry=ptdivcrvsegs_2.Points,
    Shader={ambient=RGB(0, 0, 0), diffuse=RGB(255, 105, 180), emission=RGB(76, 32, 54), shine=0.5, specular=RGB(255, 255, 255), transparency=0})
crveditpts_2 = CurveEditPoints(Curve=intcrv_3.Curve, SpansOnly=toggle_8)  # -> Points, Tangents, Parameters
intcrv_4 = Interpolate(Vertices=p_n_s_2, Degree=3, Periodic=False, KnotStyle=1)  # -> Curve, Length, Domain
# Look at Rhino window
# to preview results
# End point (duplicate of start if End Points
# boolean is true), switch it to false to see
# the end point change.
item_3 = ListItem(List=ptdivcrvsegs_2.Points, Index=expr("x-1", lng), Wrap=False)
# Look at Rhino window
# to preview results
preview_23 = CustomPreview(
    Geometry=p_n_s_2,
    Shader={ambient=RGB(0, 0, 0), diffuse=RGB(255, 105, 180), emission=RGB(76, 32, 54), shine=0.5, specular=RGB(255, 255, 255), transparency=0})
# Look at Rhino window
# to preview results
# Start point
item_4 = ListItem(List=ptdivcrvsegs_2.Points, Index=0, Wrap=False)
ptdivcrvtarg_2 = PointDivideCurveTargetLength(Curve=C_4, Target=number_slider_23, DivisionType=Slider(0, range=0..2), EndPoint=toggle_7)  # -> Points, Tangents, Parameters, Length
paramptdivsrf_2 = ParameterPointDivideSurface(Surface=S_3, ParametersU=range_4, ParametersV=range_3)  # -> Points, Normals
# Look at Rhino window
# to preview results
# You will see the new
# interpolated curve is exact.
intcrv_5 = Interpolate(Vertices=crveditpts_2.Points, Degree=3, Periodic=False, KnotStyle=0)  # -> Curve, Length, Domain
# Look at Rhino window
# to preview results
# Keep in mind this only works in
# an exact way with intrpolated curves.
# You can still get the edit points of a
# nurbs curve but you wont be able to
# recreate it by interpolating the edit points.
preview_24 = CustomPreview(
    Geometry=crveditpts_2.Points,
    Shader={ambient=RGB(0, 0, 0), diffuse=RGB(255, 105, 180), emission=RGB(76, 32, 54), shine=0.5, specular=RGB(255, 255, 255), transparency=0})
# Using unevenly spaced parameter
# values will result in uneven spaced
# grids. The grid spacing can be
# controlled with custom values
# such as values from graph mappers.
# Look at Rhino window
# to preview results
preview_25 = CustomPreview(
    Geometry=paramptdivsrf_2.Points,
    Shader={ambient=RGB(0, 0, 0), diffuse=RGB(255, 105, 180), emission=RGB(76, 32, 54), shine=0.5, specular=RGB(255, 255, 255), transparency=0})
lng_2 = ListLength(List=ptdivcrvtarg_2.Points)
# Look at Rhino window
# to preview results
preview_26 = CustomPreview(
    Geometry=ptdivcrvtarg_2.Points,
    Shader={ambient=RGB(0, 0, 0), diffuse=RGB(255, 105, 180), emission=RGB(76, 32, 54), shine=0.5, specular=RGB(255, 255, 255), transparency=0})
# Look at Rhino window
# to preview results
# End point (duplicate of start if End Points
# boolean is true), switch it to false to see
# the end point change.
item_5 = ListItem(List=ptdivcrvtarg_2.Points, Index=expr("x-1", lng_2), Wrap=False)
# Look at Rhino window
# to preview results
# Start point
item_6 = ListItem(List=ptdivcrvtarg_2.Points, Index=0, Wrap=False)
# Splitting the list
number_slider_24 = Slider(-8.615, range=-20..20)
yz_3 = YZPlane(Origin=Point(11.89746159, 181.6583616, 15.38031074))
X_2 = UnitX(Factor=number_slider_24)
range_5 = Range(Domain=Domain(0, 1), Steps=Slider(10, range=0..10))
range_6 = Range(Domain=Domain(0, 1), Steps=Slider(10, range=0..10))
S_4 = Surface(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)
move_3 = Move(Geometry=yz_3, Motion=X_2)  # -> Geometry, Transform
# Points that make
# the interpolated curve
pt_39 = Point([Point(-29.26701831, -85.66265904, 0), Point(-22.82478216, -74.89169846, 0), Point(-15.30870553, -92.82720719, 0), Point(-10.71856417, -71.27924022, 0), Point(-3.982425891, -80.78145877, 0), Point(-1.213773113, -88.04379228, 0)])
deplane_2 = DeconstructPlane(Plane=move_3.Geometry)  # -> Origin, XAxis, YAxis, ZAxis
graph = GraphMapper(
    range_6,
    x0=0,
    x1=1,
    y0=0,
    y1=1,
    container_name="Bezier",
    cpx=[0, 0.7955461144, 0.533728838, 1],
    cpy=[0, 0.104544878, 0.4652709961, 1])
# Graphmappers creating gradient grid spacing.
graph_2 = GraphMapper(
    range_5,
    x0=0,
    x1=1,
    y0=0,
    y1=1,
    container_name="Bezier",
    cpx=[0, 0.161364466, 0.3795443475, 1],
    cpy=[0, 0.5532698631, 0.9518182874, 1])
# Using nurbs curve
nurbs = NurbsCurve(Vertices=pt_39, Degree=3, Periodic=False)  # -> Curve, Length, Domain
rot3d_2 = Rotate3D(Geometry=move_3.Geometry, Angle=degrees(Slider(33, range=0..360)), Center=deplane_2.Origin, Axis=deplane_2.YAxis)  # -> Geometry, Transform
# That's how you remake a nurbs curve
cp = ControlPoints(Curve=nurbs.Curve)  # -> Points, Weights, Knots
crveditpts_3 = CurveEditPoints(Curve=nurbs.Curve, SpansOnly=Toggle(False))  # -> Points, Tangents, Parameters
paramptdivsrf_3 = ParameterPointDivideSurface(Surface=S_4, ParametersU=graph, ParametersV=graph_2)  # -> Points, Normals
pop3d_4 = Populate3D(
    Region={Plane=PlaneXY(-0.9244912087, 168.3586188, 0), X=Domain(0, 29.53403581), Y=Domain(0, 26.07914594), Z=Domain(0, 28.27359997)},
    Count=500,
    Seed=1)
nurbs_2 = NurbsCurve(Vertices=cp.Points, Degree=3, Periodic=False)  # -> Curve, Length, Domain
# Look at Rhino window
# to preview results
preview_27 = CustomPreview(
    Geometry=paramptdivsrf_3.Points,
    Shader={ambient=RGB(0, 0, 0), diffuse=RGB(255, 105, 180), emission=RGB(76, 32, 54), shine=0.5, specular=RGB(255, 255, 255), transparency=0})
intcrv_6 = Interpolate(Vertices=crveditpts_3.Points, Degree=3, Periodic=False, KnotStyle=0)  # -> Curve, Length, Domain
# Look at Rhino window
# to preview results
preview_28 = CustomPreview(
    Geometry=crveditpts_3.Points,
    Shader={ambient=RGB(0, 0, 0), diffuse=RGB(255, 105, 180), emission=RGB(76, 32, 54), shine=0.5, specular=RGB(255, 255, 255), transparency=0})
mircutpts_2 = MirrorCutPoints(
    Points=pop3d_4,
    MirrorPlane=rot3d_2.Geometry,
    Reach=Slider(0, range=0..10),
    Offset=Slider(0, range=0..10),
    Flip=Toggle(False),
    Keep=Toggle(False))  # -> MirrorCut, SplitIndex, ReachPlane, OffsetPlane, Intersected
# You will see we can get close to the
# original nurbs curve but an interpolation
# of the edit points won't be exact. That is
# because to remake nurbs curves you
# should use nurbs control points, not edit points.
swatch = ColourSwatch(SwatchColor=RGB(0, 255, 208))
split = SplitList(List=mircutpts_2.MirrorCut, Index=mircutpts_2.SplitIndex)  # -> ListA, ListB
# You can use this index to
# split the list at the mirror seam.
swatch_2 = ColourSwatch(SwatchColor=RGB(10, 22, 255))
# Look at Rhino window
# to preview results
preview_29 = CustomPreview(Geometry=intcrv_6.Curve, Shader=swatch)
preview_30 = CustomPreview(Geometry=split.ListA, Shader=ColourSwatch(SwatchColor=RGB(10, 255, 210)))
# Look at Rhino window
# to preview results
preview_31 = CustomPreview(Geometry=split.ListB, Shader=swatch_2)
