# Grasshopper definition Pf_05-Plane.gh (Grasshopper 0.9.76)
# plug-ins: Pufferfish

# 15-Mirror Cut Planes
# Change the slider value to move the
# mirror plane and see how it effects the
# mirror cutting.
# Change the slider value to rotate the
# mirror plane and see how it effects the
# mirror cutting.
number_slider = Slider(-0.413, range=-20..40)
# Unlike grasshoppers native surface
# frames component, this component uses
# parameter values along the u and v
# surface domains. Here we use range
# components to generate the lists
# of parameters. The native grasshopper
# component uses a division value which
# always makes an even grid on surface.
# By using parameter values there can be
# more customization of the grid spacing.
number_slider_2 = Slider(5, range=0..10)
# Pln @
# index 0
number_slider_3 = Slider(1.724, range=0..2)
# 09-Parameter Plane Divide Surface
number_slider_4 = Slider(6, range=0..10)
# Pln @
# index 0
number_slider_5 = Slider(0.451, range=0..2)
# Ajust the weights, If one has all the weight
# then the result is that plane. If all have same
# weight then the result is same as average.
number_slider_6 = Slider(0.9, range=0..1)
# 04-Tween Consecutive Planes
number_slider_7 = Slider(0.5, range=0..1)
# Pln @
# index 0
number_slider_8 = Slider(1.5, range=0..2)
# Pick the axes to flip one or multiple
toggle = BooleanToggle(True)
# 03-Tween Two Planes
number_slider_9 = Slider(0.5, range=0..1)
# 10-Tween Two Planes On Surface
number_slider_10 = Slider(0.5, range=0..1)
# 06-Tween Two Planes On Curve
number_slider_11 = Slider(0.5, range=0..1)
# 16-Offset Plane
number_slider_12 = Slider(20, range=0..20)
# Determines how the tween is interpolated.
number_slider_13 = Slider(0, range=0..3)
# Determines how the tween is interpolated.
# Factor from 0 to 1 determines the plane
# between each input as a list. So 0.5 will
# be halfway between each input
# consecutively through the list.
# You can use lists / mutiple factors as well.
number_slider_14 = Slider(0, range=0..3)
# Determines how the tween is interpolated.
# Factor from 0 to the last index. This
# can be considered like a timeline.
# This lets each plane have an equally
# controllable section of the slider between.
# As opposed to going from 0 to 1 where
# it would be hard to control with many inputs.
# This lets you easily pinpoint your location.
# You can use lists / mutiple factors as well.
number_slider_15 = Slider(0, range=0..3)
# Determines how the tween is interpolated.
# Factor from 0 to 1 determines the plane
# between each input as a list. So 0.5 will
# be halfway between each input
# consecutively through the list.
# You can use lists / mutiple factors as well.
number_slider_16 = Slider(1, range=0..3)
# 17-Rotate Plane Euler
# Initial plane for rotation
pl = Plane(PlaneXY(674.878479, -1.78185614, 0))
# 18-Rotate Plane XYZ
# Initial plane that
# sets axis system
pl_2 = Plane(PlaneXY(689.4517227, -2.25803305, 0))
# 14-Flip Plane
pln = Plane(Plane(origin=(509.0176843, 3.71993896, 0), x=(0.5515451813, 0.8341450191, 0), y=(-0.3658788794, 0.241922841, 0.8986690073)))
# Plane that trims
O = Origin(Point(109.9575421, 174.9278551, 8.970328456))
# Factor from 0 to 1 determines the plane
# between inputs. So 0.5 will be halfway
# between the inputs. You can use lists /
# mutiple factors as well.
toggle_2 = BooleanToggle(True)
# Factor from 0 to 1 determines the plane
# between inputs. So 0.5 will be halfway
# between the inputs. You can use lists /
# mutiple factors as well.
toggle_3 = BooleanToggle(True)
# Factor from 0 to 1 determines the plane
# between inputs. So 0.5 will be halfway
# between the inputs. You can use lists /
# mutiple factors as well.
toggle_4 = BooleanToggle(True)
# Factor from 0 to 1 determines the plane
# between each input as a list. So 0.5 will
# be halfway between each input
# consecutively through the list.
# You can use lists / mutiple factors as well.
toggle_5 = BooleanToggle(True)
# Choose which axes / axis
# to search closest to
number_slider_17 = Slider(0, range=0..10)
# 13-Flip Plane
xy = XYPlane(Origin=Point(-42.32283853, 1.16858942, 0))
pln_2 = Plane(Plane(origin=(-49.70316237, 0.6955807437, 0), x=(0.8931045458, -0.449849164, 0), y=(0.449849164, 0.8931045458, 0)))
pln_3 = Plane(Plane(origin=(-35.37336724, 1.269585949, 0), x=(0.9957910869, 0.09165212115, 0), y=(-0.04617642761, 0.5017022461, 0.8638070351)))
# Boolean to offset both sides
toggle_6 = BooleanToggle(True)
# Pick the axes to offset one or multiple
toggle_7 = BooleanToggle(True)
pln_4 = Plane(Plane(origin=(28.70459467, -1.458042787, 0), x=(0.09744482705, 0.9952409285, 0), y=(0.9451207915, -0.09253752477, 0.313342458)))
# 02-Weighted Average Plane
pln_5 = Plane(Plane(origin=(18.02795071, 5.691999628, 9.683355431), x=(0.2092744119, -0.1703682675, -0.9629012794), y=(-0.07842530315, -0.9844578485, 0.1571375717)))
pln_6 = Plane(Plane(origin=(28.70459467, 13.2848896, 7.615453634), x=(0.2331936421, -0.2991602071, -0.9252696341), y=(0.5807611108, -0.7203288538, 0.3792662319)))
pln_7 = Plane(Plane(origin=(0.5350829356, 13.2848896, 7.615453634), x=(-0.2650539032, 0.9049229867, -0.3329576797), y=(0.7910964347, 0.006661239096, -0.6116551797)))
# Pf_05-Plane
# 01-Average Plane
pln_8 = Plane(Plane(origin=(-10.14156102, 5.691999628, 9.683355431), x=(-0.3423287673, -0.03880397349, -0.9387786037), y=(-0.187133028, -0.9763137502, 0.1085941576)))
pln_9 = Plane(Plane(origin=(0.5350829356, -1.458042787, 0), x=(0.06941446316, 0.9975879071, 0), y=(0.8708826552, -0.06059802005, 0.4877409976)))
# Pln @
# index 1
# Pln @
# index 2
pln_10 = Plane(Plane(origin=(129.484257, -1.458042787, 0), x=(-0.08412850365, 0.9964549136, 0), y=(-0.9703022239, -0.0819204894, -0.2276019063)))
pln_11 = Plane(Plane(origin=(50.10388678, 5.691999628, 9.683355431), x=(-0.4412853034, -0.0587326119, -0.8954427739), y=(-0.1468235353, -0.9796832856, 0.136614455)))
# Quaternion rotation for smoother rotation
# and avoiding the problem of gimbal lock
pln_12 = Plane(Plane(origin=(60.78053074, -1.458042787, 0), x=(-0.05910911822, 0.9982515275, 0), y=(0.9629792899, 0.05702055556, 0.2634758878)))
pln_13 = Plane(Plane(origin=(82.31233243, 5.691999628, 9.683355431), x=(-0.02632441466, -0.01401147991, -0.9995552529), y=(-0.130907067, -0.991242945, 0.01734254556)))
pln_14 = Plane(Plane(origin=(92.98897639, 13.2848896, 7.615453634), x=(0.03501033659, 0.9862317841, -0.1616203711), y=(0.3784848851, -0.1627579113, -0.9111855212)))
pln_15 = Plane(Plane(origin=(92.98897639, -1.458042787, 0), x=(0.04779175199, 0.9988573214, 0), y=(0.9129613143, -0.04368193512, 0.4057012783)))
# 05-Tween Through Planes
pln_16 = Plane(Plane(origin=(118.807613, 5.691999628, 9.683355431), x=(-0.3964995761, 0.1001865198, -0.9125517779), y=(0.1194809426, -0.979941018, -0.1594989203)))
pln_17 = Plane(Plane(origin=(129.484257, 13.2848896, 7.615453634), x=(-0.4462432887, 0.6372634326, -0.6283010781), y=(0.8064964076, -0.01790789928, -0.5909677248)))
# Quaternion rotation for smoother rotation
# and avoiding the problem of gimbal lock
crv = Curve(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)
pln_18 = Plane(Plane(origin=(316.7422027, 9.849798539, 5.257723452), x=(0.5705644234, 0.8096549495, -0.1375321831), y=(-0.5062826439, 0.2149133516, -0.8351587488)))
pln_19 = Plane(Plane(origin=(337.7591336, 8.230043081, 4.737708622), x=(0.8101150146, 0.159506923, -0.5641553019), y=(0.5860153839, -0.1919004783, 0.7872484845)))
# Quaternion rotation for smoother rotation
# and avoiding the problem of gimbal lock
srf = Surface(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)
pln_20 = Plane(Plane(origin=(390.0874412, -3.258845883, 5.062966611), x=(0.3520893553, -0.07737353009, -0.9327627902), y=(0.6472840504, 0.7399682982, 0.1829488337)))
pln_21 = Plane(Plane(origin=(401.3181017, 11.14042038, 5.436394497), x=(-0.4230717378, -0.8816993043, -0.2088459752), y=(-0.9060115126, 0.4084909177, 0.1108075325)))
srf_2 = Surface(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)
# 12-Tween Through Planes On Surface
pln_22 = Plane(Plane(origin=(440.791841, 8.671707823, 4.512409312), x=(0.7394749816, 0.5228463087, -0.4240383109), y=(-0.1962010593, 0.7699433386, 0.6072004608)))
pln_23 = Plane(Plane(origin=(451.185734, -3.258845883, 5.062966611), x=(-0.8749130118, 0.2987713508, -0.3811337058), y=(0.1476277854, -0.5850093281, -0.7974773495)))
pln_24 = Plane(Plane(origin=(462.4163945, 11.14042038, 5.436394497), x=(0.6639350175, -0.4054088828, -0.6283581227), y=(-0.2921473337, 0.6328812518, -0.7170155204)))
# Pln @
# index 1
# Pln @
# index 2
srf_3 = Surface(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)
pln_25 = Plane(Plane(origin=(166.0444679, 10.48298076, 8.223748801), x=(0.2451369972, 0.6742329159, -0.6966475635), y=(-0.006083244093, -0.717488457, -0.6965438308)))
pln_26 = Plane(Plane(origin=(183.498994, 7.993987947, 3.302492487), x=(0.9367912095, -0.2523010726, -0.242417818), y=(0.3318367439, 0.8603290943, 0.3869343934)))
# 07-Tween Consecutive Planes On Curve
pln_27 = Plane(Plane(origin=(208.2802532, 9.569250147, 3.361801303), x=(0.3097810368, 0.9108846922, -0.2726257266), y=(-0.9507409261, 0.293348984, -0.100190144)))
pln_28 = Plane(Plane(origin=(214.9939572, 6.558447939, 8.772649744), x=(0.07970821213, -0.1755344037, -0.9812411906), y=(0.07599507711, -0.9804382995, 0.1815640086)))
pln_29 = Plane(Plane(origin=(231.1810966, 7.071039603, 7.40667035), x=(0.4162149627, 0.6453690154, -0.6405184921), y=(-0.8198663932, 0.5709724164, 0.04253935884)))
# Quaternion rotation for smoother rotation
# and avoiding the problem of gimbal lock
crv_2 = Curve(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)
# 08-Tween Through Planes On Curve
pln_30 = Plane(Plane(origin=(258.8252888, 10.31282462, 8.707378783), x=(0.3859569913, 0.8495972293, -0.3594742674), y=(-0.7761949994, 0.5096589819, 0.3711725272)))
pln_31 = Plane(Plane(origin=(264.1781355, 5.117133478, 7.655244169), x=(0.1383274038, -0.3457121552, -0.9280887), y=(0.09374796898, -0.928319109, 0.3597706911)))
pln_32 = Plane(Plane(origin=(277.0534198, 8.023193651, 4.483513419), x=(0.5949214914, 0.7520427164, -0.283725522), y=(-0.5983204798, 0.6500502016, 0.4684520668)))
# Pln @
# index 1
# Pln @
# index 2
crv_3 = Curve(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)
# 11-Tween Consecutive Planes On Surface
pln_33 = Plane(Plane(origin=(378.6432815, 9.849798539, 5.257723452), x=(0.06513137794, -0.1274514836, -0.9897040077), y=(-0.9849188855, -0.1675256248, -0.04324296397)))
yz = YZPlane(Origin=O)
# Flips the mirror direction to
# cut the other side instead.
toggle_8 = BooleanToggle(False)
pln_34 = Plane(PlaneXY(615.5125038, 0.9560665738, 0))
# Quaternion rotation for smoother rotation
# and avoiding the problem of gimbal lock
toggle_9 = BooleanToggle(True)
# Quaternion rotation for smoother rotation
# and avoiding the problem of gimbal lock
toggle_10 = BooleanToggle(True)
# Rotation degrees for each axis
# The axis for each successive plane axis rotation.
# Common rotation patterns are:
# XYZ
# ZYX
# ZYZ
number_slider_18 = Slider(73.728, range=0..360)
flippln = FlipPlane(Plane=pln, FlipX=Toggle(False), FlipY=Toggle(False), FlipZ=toggle)  # -> Flipped, R
# Rotation degrees for each axis
# The axes to rotate around from the initial plane
number_slider_19 = Slider(73.728, range=0..360)
# Geometry to rotate
box = CenterBox(Base=pl, X=1, Y=2, Z=1)
# Geometry to rotate
box_2 = CenterBox(Base=pl_2, X=1, Y=2, Z=1)
# Quaternion rotation for smoother rotation
# and avoiding the problem of gimbal lock
toggle_11 = BooleanToggle(True)
# Plane
yz_2 = YZPlane(Origin=Point(11.90780968, 89.77094321, 12.959768))
range = Range(Domain=Domain(0, 1), Steps=number_slider_2)
range_2 = Range(Domain=Domain(0, 1), Steps=number_slider_4)
X = UnitX(Factor=number_slider)
# 19-Trim Planes With Plane
# The plane set that will get
# trimmed (turn its preview
# on to see the original plane set)
xy_2 = XYPlane(Origin=[Point(96.05898074, 167.6407452, 15.7279521), Point(125.677707, 159.9621094, 5.71583513), Point(124.1175268, 190.2224718, 18.83319647), Point(107.9649834, 184.0203346, 0.1135168602), Point(102.8716714, 190.5727291, 22.80505439), Point(116.9128021, 171.6323014, 28.09471141)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])
S = Surface(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)
# Quaternion rotation for smoother rotation
# and avoiding the problem of gimbal lock
toggle_12 = BooleanToggle(True)
# Quaternion rotation for smoother rotation
# and avoiding the problem of gimbal lock
toggle_13 = BooleanToggle(True)
wavpln = WeightedAveragePlane(Planes=[pln_5, pln_6, pln_4], Weights=[Slider(0.404, range=0..1), Slider(0.094, range=0..1), number_slider_6])
avrpln = AveragePlane(Planes=[pln_8, pln_9, pln_7])
twn2plnssrf = TweenTwoPlanesOnSurface(PlaneA=pln_18, PlaneB=pln_19, Surface=srf, Factor=number_slider_10, Quaternion=toggle_3)
twn2plns = TweenTwoPlanes(PlaneA=pln_11, PlaneB=pln_12, Factor=number_slider_9, Quaternion=toggle_2)
twn2plnscrv = TweenTwoPlanesOnCurve(PlaneA=pln_25, PlaneB=pln_26, Curve=crv, Factor=number_slider_11, Quaternion=toggle_4)
move = Move(Geometry=yz_2, Motion=X)  # -> Geometry, Transform
# The reach distance determines how
# far from the mirror plane that the cutting
# reaches. Anything within that distance
# from the mirror plane will be additionally
# cut away. Set it to zero and the cutting will
# only happen exactly at the mirror plane.
number_slider_20 = Slider(59, range=0..360)
deplane = DeconstructPlane(Plane=flippln.Flipped)  # -> Origin, XAxis, YAxis, ZAxis
twnconplns = TweenConsecutivePlanes(Planes=[pln_13, pln_14, pln_15], Factor=number_slider_7, InterpolationType=number_slider_14, Quaternion=toggle_9)
twnthruplns = TweenThroughPlanes(Planes=[pln_16, pln_17, pln_10], Factor=number_slider_3, InterpolationType=number_slider_15, Quaternion=toggle_13)
twnconplnscrv = TweenConsecutivePlanesOnCurve(Planes=[pln_27, pln_28, pln_29], Curve=crv_2, Factor=Slider(0.5, range=0..1), Quaternion=toggle_5)
twnconplnssrf = TweenConsecutivePlanesOnSurface(
    Planes=[pln_33, pln_20, pln_21],
    Surface=srf_2,
    Factor=Slider(0.5, range=0..1),
    InterpolationType=number_slider_16,
    Quaternion=toggle_10)
offpln = OffsetPlane(
    Plane=pln_34,
    Distance=number_slider_12,
    BothSides=toggle_6,
    OffsetX=Toggle(True),
    OffsetY=Toggle(True),
    OffsetZ=toggle_7)
twnthruplnscrv = TweenThroughPlanesOnCurve(Planes=[pln_30, pln_31, pln_32], Curve=crv_3, Factor=number_slider_8, Quaternion=toggle_11)
paramplndivsrf = ParameterPlaneDivideSurface(Surface=S, ParametersU=range_2, ParametersV=range)  # -> Planes, Normals
twnthruplnssrf = TweenThroughPlanesOnSurface(
    Planes=[pln_22, pln_23, pln_24],
    Surface=srf_3,
    Factor=number_slider_5,
    InterpolationType=number_slider_13,
    Quaternion=toggle_12)
cplnori = ClosestPlaneOrientation(Reference=xy, Targets=[pln_3, pln_2], Axis=number_slider_17)  # -> Closest, Index, AngleX, AngleY, AngleZ
deplane_2 = DeconstructPlane(Plane=pln)  # -> Origin, XAxis, YAxis, ZAxis
# Boolean if it flipped
panel = Panel(flippln.R)
trimplnspln = TrimPlanesWithPlane(Planes=xy_2, Plane=yz, Flip=toggle_8)  # -> Trimmed, R
pln_35 = Plane(flippln.Flipped)
# Pufferfish
# By: Michael Pryor
# Look at Rhino window
# to preview results
preview = CustomPreview(
    Geometry=avrpln,
    Shader={ambient=RGB(0, 0, 0), diffuse=RGB(255, 105, 180), emission=RGB(76, 32, 54), shine=0.5, specular=RGB(255, 255, 255), transparency=0})
# Look at Rhino window
# to preview results
preview_2 = CustomPreview(
    Geometry=wavpln,
    Shader={ambient=RGB(0, 0, 0), diffuse=RGB(255, 105, 180), emission=RGB(76, 32, 54), shine=0.5, specular=RGB(255, 255, 255), transparency=0})
# The plane set that will get
# mirror cut (turn its preview
# on to see the original plane set)
# Using as the mirror plane
deplane_3 = DeconstructPlane(Plane=move.Geometry)  # -> Origin, XAxis, YAxis, ZAxis
# Look at Rhino window
# to preview results
preview_3 = CustomPreview(
    Geometry=twn2plnssrf,
    Shader={ambient=RGB(0, 0, 0), diffuse=RGB(255, 105, 180), emission=RGB(76, 32, 54), shine=0.5, specular=RGB(255, 255, 255), transparency=0})
# Look at Rhino window
# to preview results
preview_4 = CustomPreview(
    Geometry=twn2plns,
    Shader={ambient=RGB(0, 0, 0), diffuse=RGB(255, 105, 180), emission=RGB(76, 32, 54), shine=0.5, specular=RGB(255, 255, 255), transparency=0})
panel_2 = Panel(range_2)
panel_3 = Panel(range)
# Look at Rhino window
# to preview results
preview_5 = CustomPreview(
    Geometry=twn2plnscrv,
    Shader={ambient=RGB(0, 0, 0), diffuse=RGB(255, 105, 180), emission=RGB(76, 32, 54), shine=0.5, specular=RGB(255, 255, 255), transparency=0})
# Result plane. Look at it when you
# change which axis to flip to watch how
# it changes. You will see the plane axis
# flip directions.
swatch = ColourSwatch(SwatchColor=RGB(255, 255, 255))
# The offser distance determines how
# far to offset the cut. It does not do any
# additional cut removing like
# the reach plane, it just moves the
# actual cut away from the mirror plane.
# Set it to zero and there will be no gap
# in the mirror cut.
number_slider_21 = Slider(2.56, range=0..10)
line = LineSDL(Start=deplane.Origin, Direction=deplane.ZAxis, Length=20)
line_2 = LineSDL(Start=deplane_2.Origin, Direction=deplane_2.ZAxis, Length=20)
# Look at Rhino window
# to preview results
preview_6 = CustomPreview(
    Geometry=twnthruplnssrf,
    Shader={ambient=RGB(0, 0, 0), diffuse=RGB(255, 105, 180), emission=RGB(76, 32, 54), shine=0.5, specular=RGB(255, 255, 255), transparency=0})
# This allows the start and end of the grid
# to be altered on the surface so grids can
# exist only on parts of the surface.
# Look at Rhino window
# to preview results
preview_7 = CustomPreview(
    Geometry=paramplndivsrf.Planes,
    Shader={ambient=RGB(0, 0, 0), diffuse=RGB(255, 105, 180), emission=RGB(76, 32, 54), shine=0.5, specular=RGB(255, 255, 255), transparency=0})
# Look at Rhino window
# to preview results
preview_8 = CustomPreview(
    Geometry=twnthruplns,
    Shader={ambient=RGB(0, 0, 0), diffuse=RGB(255, 105, 180), emission=RGB(76, 32, 54), shine=0.5, specular=RGB(255, 255, 255), transparency=0})
# Look at Rhino window
# to preview results
preview_9 = CustomPreview(
    Geometry=twnthruplnscrv,
    Shader={ambient=RGB(0, 0, 0), diffuse=RGB(255, 105, 180), emission=RGB(76, 32, 54), shine=0.5, specular=RGB(255, 255, 255), transparency=0})
# Look at Rhino window
# to preview results
preview_10 = CustomPreview(
    Geometry=twnconplnssrf,
    Shader={ambient=RGB(0, 0, 0), diffuse=RGB(255, 105, 180), emission=RGB(76, 32, 54), shine=0.5, specular=RGB(255, 255, 255), transparency=0})
# Look at Rhino window
# to preview results
preview_11 = CustomPreview(
    Geometry=twnconplns,
    Shader={ambient=RGB(0, 0, 0), diffuse=RGB(255, 105, 180), emission=RGB(76, 32, 54), shine=0.5, specular=RGB(255, 255, 255), transparency=0})
# Look at Rhino window
# to preview results
preview_12 = CustomPreview(
    Geometry=twnconplnscrv,
    Shader={ambient=RGB(0, 0, 0), diffuse=RGB(255, 105, 180), emission=RGB(76, 32, 54), shine=0.5, specular=RGB(255, 255, 255), transparency=0})
panel_4 = Panel(trimplnspln.R)
# Look at Rhino window
# to preview results
preview_13 = CustomPreview(
    Geometry=trimplnspln.Trimmed,
    Shader={ambient=RGB(0, 0, 0), diffuse=RGB(255, 105, 180), emission=RGB(76, 32, 54), shine=0.5, specular=RGB(255, 255, 255), transparency=0})
# Look at Rhino window
# to preview results
preview_14 = CustomPreview(
    Geometry=offpln,
    Shader={ambient=RGB(0, 0, 0), diffuse=RGB(255, 105, 180), emission=RGB(76, 32, 54), shine=0.5, specular=RGB(255, 255, 255), transparency=0})
roteuler = RotatePlaneEuler(
    Geometry=box,
    Plane=pl,
    Axis1=Slider(0, range=0..3),
    Axis2=Slider(1, range=0..3),
    Axis3=Slider(2, range=0..3),
    Degrees1=Slider(70.779, range=0..360),
    Degrees2=Slider(125.338, range=0..360),
    Degrees3=number_slider_18)  # -> Rotated, Plane1, Plane2, Plane3, Transform
rotxyz = RotatePlaneXYZ(
    Geometry=box_2,
    Plane=pl_2,
    Axis1=Slider(0, range=0..3),
    Axis2=Slider(1, range=0..3),
    Axis3=Slider(2, range=0..3),
    Degrees1=Slider(70.779, range=0..360),
    Degrees2=Slider(125.338, range=0..360),
    Degrees3=number_slider_19)  # -> Rotated, Plane1, Plane2, Plane3, Transform
rot3d = Rotate3D(Geometry=move.Geometry, Angle=degrees(number_slider_20), Center=deplane_3.Origin, Axis=deplane_3.YAxis)  # -> Geometry, Transform
# Index of closest plane
panel_5 = Panel(cplnori.Index)
panel_6 = Panel(cplnori.AngleX)
# angles between axes of reference
# and closest target plane
panel_7 = Panel(cplnori.AngleY)
panel_8 = Panel(cplnori.AngleZ)
# Flipped plane direction
# Look at Rhino window
# to preview results
preview_15 = CustomPreview(Geometry=line, Shader=ColourSwatch(SwatchColor=RGB(60, 255, 0)))
# Input plane direction
# Look at Rhino window
# to preview results
preview_16 = CustomPreview(Geometry=line_2, Shader=swatch)
xy_3 = XYPlane(Origin=[Point(1.65987086, 84.44500503, 15.03485597), Point(28.07774466, 78.21274639, 5.463950893), Point(26.68617078, 102.7731513, 18.00325907), Point(12.27920917, 97.73927245, 0.1085144228), Point(7.736323971, 103.0574329, 21.80008599), Point(20.26005022, 87.68469643, 26.8566395)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])
# Visualization of the reference plane
# Look at Rhino window
# to preview results
preview_17 = CustomPreview(Geometry=xy, Shader=ColourSwatch(SwatchColor=RGB(0, 0, 0)))
# Visualization of the closest plane result.
# Look at Rhino window
# to preview results
preview_18 = CustomPreview(Geometry=cplnori.Closest, Shader=ColourSwatch(SwatchColor=RGB(43, 255, 28)))
# The planes at each axis step
# of the rotation. Hidden by default.
# Transform data
swatch_2 = ColourSwatch(SwatchColor=RGB(0, 0, 255))
# The planes at each axis step
# of the rotation. Hidden by default.
# Transform data
swatch_3 = ColourSwatch(SwatchColor=RGB(0, 0, 255))
# Flips the mirror direction to
# cut the other side instead.
# If true the entire input plane set is mirrored
# normally if it is mirror cut into non existance.
toggle_14 = BooleanToggle(False)
mircutplns = MirrorCutPlanes(
    Planes=xy_3,
    MirrorPlane=rot3d.Geometry,
    Reach=Slider(0.896, range=0..10),
    Offset=number_slider_21,
    Flip=Toggle(False),
    Keep=toggle_14)  # -> MirrorCut, SplitIndex, ReachPlane, OffsetPlane, Intersected
# The plane at the final rotation
preview_19 = CustomPreview(Geometry=roteuler.Plane3, Shader=swatch_2)
# The plane at the final rotation
preview_20 = CustomPreview(Geometry=rotxyz.Plane3, Shader=swatch_3)
# The rotated geometry
# Look at Rhino window
# to preview results
preview_21 = CustomPreview(
    Geometry=roteuler.Rotated,
    Shader={ambient=RGB(0, 0, 0), diffuse=RGB(255, 105, 180), emission=RGB(76, 32, 54), shine=0.5, specular=RGB(255, 255, 255), transparency=0})
# The rotated geometry
# Look at Rhino window
# to preview results
preview_22 = CustomPreview(
    Geometry=rotxyz.Rotated,
    Shader={ambient=RGB(0, 0, 0), diffuse=RGB(255, 105, 180), emission=RGB(76, 32, 54), shine=0.5, specular=RGB(255, 255, 255), transparency=0})
panel_9 = Panel(mircutplns.Intersected)
# Adjusting the start and end domains
# of the ranges positions the grid on
# specified parts of the surface.
number_slider_22 = Slider(0.537, range=0..1)
# Using a guide plane
# to determine flipping
# Increase the rotation to be past  90 degrees
# and you will see the plane flips beyond that
# degree to keep direction with the guide plane.
number_slider_23 = Slider(90, range=0..360)
# Look at Rhino window
# to preview results
# Result mirror cut plane set
preview_23 = CustomPreview(Geometry=mircutplns.MirrorCut, Shader=ColourSwatch(SwatchColor=RGB(255, 0, 0)))
# Reach plane (this plane essentially does the cutting)
preview_24 = CustomPreview(Geometry=mircutplns.ReachPlane, Shader=ColourSwatch(SwatchColor=RGB(10, 255, 210)))
# Offset plane (offsets the cuts from the mirror plane)
preview_25 = CustomPreview(Geometry=mircutplns.OffsetPlane, Shader=ColourSwatch(SwatchColor=RGB(10, 22, 255)))
# Using as guide plane
pln_36 = Plane(Plane(origin=(559.0176843, 3.71993896, 0), x=(0.5515451813, 0.8341450191, 0), y=(-0.3658788794, 0.241922841, 0.8986690073)))
deplane_4 = DeconstructPlane(Plane=pln_36)  # -> Origin, XAxis, YAxis, ZAxis
dom = ConstructDomain(DomainStart=Slider(0.25, range=0..1), DomainEnd=Slider(0.801, range=0..1))
dom_2 = ConstructDomain(DomainStart=Slider(0.13, range=0..1), DomainEnd=number_slider_22)
# In this case we want to flip z with a guide
# plane. The flipping will be based off of
# the input planes z axis relationship to the
# guide planes z axis.
rot3d_2 = Rotate3D(Geometry=pln_36, Angle=degrees(number_slider_23), Center=pln_36, Axis=deplane_4.YAxis)  # -> Geometry, Transform
preview_26 = CustomPreview(
    Geometry=pln_36,
    Shader={ambient=RGB(0, 0, 0), diffuse=RGB(255, 105, 180), emission=RGB(76, 32, 54), shine=0.5, specular=RGB(255, 255, 255), transparency=0})
range_3 = Range(Domain=dom_2, Steps=Slider(5, range=0..10))
range_4 = Range(Domain=dom, Steps=Slider(6, range=0..10))
S_2 = Surface(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)
paramplndivsrf_2 = ParameterPlaneDivideSurface(Surface=S_2, ParametersU=range_4, ParametersV=range_3)  # -> Planes, Normals
flippln_2 = FlipPlane(Plane=rot3d_2.Geometry, Guide=pln_36, FlipX=False, FlipY=False, FlipZ=Toggle(True))  # -> Flipped, R
# Using unevenly spaced parameter
# values will result in uneven spaced
# grids. The grid spacing can be
# controlled with custom values
# such as values from graph mappers.
# Look at Rhino window
# to preview results
preview_27 = CustomPreview(
    Geometry=paramplndivsrf_2.Planes,
    Shader={ambient=RGB(0, 0, 0), diffuse=RGB(255, 105, 180), emission=RGB(76, 32, 54), shine=0.5, specular=RGB(255, 255, 255), transparency=0})
deplane_5 = DeconstructPlane(Plane=flippln_2.Flipped)  # -> Origin, XAxis, YAxis, ZAxis
# Boolean if it flipped
panel_10 = Panel(flippln_2.R)
deplane_6 = DeconstructPlane(Plane=pln_36)  # -> Origin, XAxis, YAxis, ZAxis
line_3 = LineSDL(Start=deplane_5.Origin, Direction=deplane_5.ZAxis, Length=20)
line_4 = LineSDL(Start=deplane_6.Origin, Direction=deplane_6.ZAxis, Length=20)
# Flipped plane direction
# Look at Rhino window
# to preview results
preview_28 = CustomPreview(Geometry=line_3, Shader=ColourSwatch(SwatchColor=RGB(60, 255, 0)))
# Input plane direction
# Look at Rhino window
# to preview results
# Using a guide plane to align the
# flow direction of multiple planes.
preview_29 = CustomPreview(Geometry=line_4, Shader=ColourSwatch(SwatchColor=RGB(255, 255, 255)))
# Splitting the list
number_slider_24 = Slider(-8.615, range=-20..20)
yz_3 = YZPlane(Origin=Point(11.89746159, 181.6583616, 15.38031074))
X_2 = UnitX(Factor=number_slider_24)
range_5 = Range(Domain=Domain(0, 1), Steps=Slider(6, range=0..10))
range_6 = Range(Domain=Domain(0, 1), Steps=Slider(6, range=0..10))
S_3 = Surface(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)
move_2 = Move(Geometry=yz_3, Motion=X_2)  # -> Geometry, Transform
deplane_7 = DeconstructPlane(Plane=move_2.Geometry)  # -> Origin, XAxis, YAxis, ZAxis
graph = GraphMapper(
    range_6,
    x0=0,
    x1=1,
    y0=0,
    y1=1,
    container_name="Bezier",
    cpx=[0, 0.7947276831, 0.7423650622, 1],
    cpy=[0, 0.1235435009, 0.4959078431, 1])
# Graphmappers creating gradient grid spacing.
graph_2 = GraphMapper(
    range_5,
    x0=0,
    x1=1,
    y0=0,
    y1=1,
    container_name="Bezier",
    cpx=[0, 0.161364466, 0.416546911, 1],
    cpy=[0, 0.5532698631, 0.8980879188, 1])
rot3d_3 = Rotate3D(Geometry=move_2.Geometry, Angle=degrees(Slider(33, range=0..360)), Center=deplane_7.Origin, Axis=deplane_7.YAxis)  # -> Geometry, Transform
# Toggle between true and false
# to see the flipping of planes that
# need to flip based on the guide plane
toggle_15 = BooleanToggle(True)
# multiple planes with
# mismatched planes
pln_37 = Plane([Plane(origin=(532.6960889, 63.24260337, 1.762088995), x=(0.4838429254, 0.4293453801, 0.7625998742), y=(0.5704056056, 0.5061580912, -0.6468704908)), Plane(origin=(524.2587246, 73.78243344, 2.532882972), x=(0.5856926779, 0.3010804855, 0.7525387885), y=(0.5739639962, 0.501497994, -0.6473523716)), Plane(origin=(517.6209294, 85.22671577, 5.226500612), x=(0.708031208, 0.08678709049, 0.7008279457), y=(0.5910006982, 0.4703894218, -0.6553258476)), Plane(origin=(514.5193296, 97.43141651, 9.986768906), x=(0.7834741053, -0.2112545908, 0.5844140863), y=(0.6198237498, 0.3331145285, -0.7105302458)), Plane(origin=(517.0852642, 109.9191735, 13.91923846), x=(0.7340559188, -0.4477520365, 0.5105683322), y=(0.4974323707, -0.1573049546, -0.8531214379)), Plane(origin=(526.1568799, 119.2094837, 11.56286222), x=(0.004431131315, -0.6775524925, -0.7354610697), y=(0.6378813242, -0.5644906529, 0.5238871243))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])
# Using as guide plane
xz = XZPlane(Origin=Point(0, 0, 0))
paramplndivsrf_3 = ParameterPlaneDivideSurface(Surface=S_3, ParametersU=graph, ParametersV=graph_2)  # -> Planes, Normals
pln_38 = Plane([PlaneXY(6.41969566, 171.2467271, 13.20407315), PlaneXY(24.37037126, 188.5361582, 2.512021712), PlaneXY(20.47483149, 193.4253272, 24.35336963), PlaneXY(26.07635927, 170.7539344, 21.27566244), PlaneXY(2.544183454, 192.5597444, 7.302793704), PlaneXY(2.197410525, 190.4952846, 27.84049319)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])
flippln_3 = FlipPlane(Plane=pln_37, Guide=xz, FlipX=False, FlipY=False, FlipZ=toggle_15)  # -> Flipped, R
# Look at Rhino window
# to preview results
preview_30 = CustomPreview(
    Geometry=paramplndivsrf_3.Planes,
    Shader={ambient=RGB(0, 0, 0), diffuse=RGB(255, 105, 180), emission=RGB(76, 32, 54), shine=0.5, specular=RGB(255, 255, 255), transparency=0})
mircutplns_2 = MirrorCutPlanes(
    Planes=pln_38,
    MirrorPlane=rot3d_3.Geometry,
    Reach=Slider(0, range=0..10),
    Offset=Slider(0, range=0..10),
    Flip=Toggle(False),
    Keep=Toggle(False))  # -> MirrorCut, SplitIndex, ReachPlane, OffsetPlane, Intersected
move_3 = Move(Geometry=pln_37, Motion=Vector(-40, 0, 0))  # -> Geometry, Transform
# Result plane. Look at it when you
# change which axis to flip to watch how
# it changes. You will see the plane axis
# flip directions.
pln_39 = Plane(flippln_3.Flipped)
deplane_8 = DeconstructPlane(Plane=flippln_3.Flipped)  # -> Origin, reverse(XAxis), YAxis, ZAxis
split = SplitList(List=mircutplns_2.MirrorCut, Index=mircutplns_2.SplitIndex)  # -> ListA, ListB
deplane_9 = DeconstructPlane(Plane=move_3.Geometry)  # -> Origin, XAxis, YAxis, ZAxis
# You can use this index to
# split the list at the mirror seam.
swatch_4 = ColourSwatch(SwatchColor=RGB(10, 22, 255))
line_5 = LineSDL(Start=deplane_9.Origin, Direction=deplane_9.ZAxis, Length=20)
line_6 = LineSDL(Start=deplane_8.Origin, Direction=deplane_8.ZAxis, Length=20)
preview_31 = CustomPreview(Geometry=split.ListA, Shader=ColourSwatch(SwatchColor=RGB(10, 255, 210)))
# Look at Rhino window
# to preview results
preview_32 = CustomPreview(Geometry=split.ListB, Shader=swatch_4)
# Look at Rhino window
# to preview results
preview_33 = CustomPreview(Geometry=line_5, Shader=ColourSwatch(SwatchColor=RGB(255, 255, 255)))
# Aligned flow planes
# Look at Rhino window
# to preview results
preview_34 = CustomPreview(Geometry=line_6, Shader=ColourSwatch(SwatchColor=RGB(60, 255, 0)))
# Input mismatched flow planes
# Boolean if it flipped
panel_11 = Panel(flippln_3.R)
