# Grasshopper definition Pf_06-Curve.gh (Grasshopper 0.9.76)
# plug-ins: Pufferfish

# Check out the different
# cap types and other settings.
number_slider = Slider(2, range=0..4)
# 03-Tween Two Curves
# Factor from 0 to 1 determines the curve
# between inputs. So 0.5 will be halfway
# between the inputs. You can use lists /
# mutiple factors as well.
number_slider_2 = Slider(0.5, range=0..1)
# 23-Close Curve
# Different close types.
# Try them out.
number_slider_3 = Slider(0, range=0..4)
# Curve degree to
# search segments
# Degree to fit the segments to
# that match the search degree
number_slider_4 = Slider(3, range=0..10)
# 06-Slide Curve Along Curve
# Guide curve to slide
# along. If does not even
# need to touch the curve
# to slide.
number_slider_5 = Slider(0.558, range=0..1)
# 07-Tween Two Curves Along Curve
# Guide curve to slide
# along. If does not even
# need to touch the curve
# to slide.
# Factor from 0 to 1 determines the curve
# between inputs. So 0.5 will be halfway
# between the inputs. You can use lists /
# mutiple factors as well.
number_slider_6 = Slider(0.333, range=0..1)
# 08-Tween Consecutive Curves Along Curve
# Guide curve to slide
# along. If does not even
# need to touch the curve
# to slide.
# Factor from 0 to 1 determines the curve
# between each input as a list. So 0.5 will
# be halfway between each input
# consecutively through the list.
# You can use lists / mutiple factors as well.
number_slider_7 = Slider(0.5, range=0..1)
# Change the slider value to move the
# mirror plane and see how it effects the
# mirror cutting.
# Change the slider value to rotate the
# mirror plane and see how it effects the
# mirror cutting.
number_slider_8 = Slider(4, range=-20..100)
# Curve degree to
# search segments
number_slider_9 = Slider(1, range=0..10)
# 16-Arc/Circle/Ellipse
number_slider_10 = Slider(2, range=0..3)
# Tolerance to output an arc, circle,
# or ellipse if possibe.
# 17-Bounding Rectangle
number_slider_11 = Slider(5, range=0..5)
# Crv @
# index 0
number_slider_12 = Slider(1.5, range=0..3)
# Crv @
# index 0
number_slider_13 = Slider(0.793, range=0..3)
# Crv @
# index 0
number_slider_14 = Slider(1.5, range=0..2)
# Ajust the weights, If one has all the weight
# then the result is that curve. If all have same
# weight then the result is same as average.
number_slider_15 = Slider(0.381, range=0..1)
# 28-Offset Curve
number_slider_16 = Slider(5.68, range=-5..10)
# This input changes the seam position of
# the first curve in the list. All other seams
# will follow this seam iteratively in order
# of the curve list.
number_slider_17 = Slider(0.853, range=0..1)
# 29-Open Curve
number_slider_18 = Slider(21.76, range=0..100)
# 10-Net On Surface
number_slider_19 = Slider(30, range=0..30)
# Change the seam parameter to
# change the location of the opening.
number_slider_20 = Slider(0, range=0..1)
# Increase the tolerance to see it read
# as an arc, circle, and ellipse.
number_slider_21 = Slider(0, range=0..5)
# Tolerance for closing. If set to 0 then
# the curve will close no matter what.
# If tolerance is anything above 0 the curve
# will not close unless the gap is smaller
# than the tolerance. Curves that are already
# closed will just be passed through with
# no change.
number_slider_22 = Slider(20.831, range=0..40)
crv = Curve(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)
# 38 - Curve Degree
crv_2 = Curve(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)
# Look at Rhino window
# to preview inputs
# 39-Curve Length At
crv_3 = Curve(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)
# 13-Tween Two Curves On Surface
# Factor from 0 to 1 determines the curve
# between inputs. So 0.5 will be halfway
# between the inputs. You can use lists /
# mutiple factors as well.
number_slider_23 = Slider(0.5, range=0..1)
# 31-Rebuild Curve
number_slider_24 = Slider(0, range=0..1)
# 30-Prude Curve
number_slider_25 = Slider(6.585, range=0..30)
# 41-Curve Spans
# Look at Rhino window
# to preview input
crv_4 = Curve(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)
# The blend length removes the kinks.
# It also knows to not go too far based
# on its neighboring curve segments. Try
# putting the length very high and you will
# see blends automatically stop at their
# local maximum possible curve blend.
number_slider_26 = Slider(0.5, range=0..1)
# Angle tolerance in degrees
# which will smooth kinks within
# this angle tolerance. Look at
# the kink parts of the curve to
# see the smoothing.
# 27-Mirror Cut Curves
number_slider_27 = Slider(180, range=0..180)
# 24-Compatibilize Polylines
# Multiple polylines set
# with varying control point counts
crv_5 = Curve([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])
# Determines how the tween is interpolated.
# Factor from 0 to 1 determines the curve
# between each input as a list. So 0.5 will
# be halfway between each input
# consecutively through the list.
# You can use lists / mutiple factors as well.
number_slider_28 = Slider(0, range=0..3)
# Determines how the tween is interpolated.
# Factor from 0 to the last index. This
# can be considered like a timeline.
# This lets each curve have an equally
# controllable section of the slider between.
# As opposed to going from 0 to 1 where
# it would be hard to control with many inputs.
# This lets you easily pinpoint your location.
# You can use lists / mutiple factors as well.
number_slider_29 = Slider(0, range=0..3)
# The curve that will get
# trimmed (turn its preview
# on to see the original curve)
# Plane that trims
O = Origin(Point(428.8772453, -544.0072538, 0))
# Look at Rhino window
# to preview inputs
# Option to normalize
# the length output
# 40-Curve Length Between
toggle = BooleanToggle(False)
# Look at Rhino window
# to preview inputs
# Option to normalize
# the length output
toggle_2 = BooleanToggle(False)
# Proportional scale factors for the
# input planes axes. Use same value
# for all for uniform scaling. These values
# are more like weights which balance with
# eachother like percentage overall, as
# opposed to traditional scale factors.
# They are proportional.
# The area
# the geometry
# will scale to
number_slider_30 = Slider(0.769, range=0..1)
# True to transfer
# properties from
# reference to target
toggle_3 = BooleanToggle(True)
# Preserve targets end tangents
# 36-Trim Curve With Plane
toggle_4 = BooleanToggle(False)
# If true the slide curve is always
# aligned to the input curve.
# Factor from 0 to 1 determines the curve
# slide. So 0.5 will be halfway
# along the curve. You can use lists /
# mutiple factors as well.
toggle_5 = BooleanToggle(False)
# 18-Constrained Area Rectangle
number_slider_31 = Slider(1000, range=0..1000)
cp = ControlPoints(Curve=crv_5)  # -> Points, Weights, Knots
# Switches which side
# gets trimmed away
toggle_6 = BooleanToggle(False)
# 26-Fit Curve Smooth
# Curve degree to
# fit the curve to
number_slider_32 = Slider(3, range=0..10)
# Boolean to
# flip direction
# of net on surface.
toggle_7 = BooleanToggle(False)
# 33-Reparameterize Curve
number_slider_33 = Slider(0.5, range=0..1)
# Unlike grasshoppers native iso curve component, this
# component uses parameter values along the u and v
# surface domains separately. Here we use range
# components to generate the lists of parameters.
# By using parameter values there can be
# more customization of the grid spacing.
number_slider_34 = Slider(5, range=0..10)
# Unlike grasshoppers native grid components, this
# component uses parameter values. Here we use range
# components to generate the lists of parameters.
# By using parameter values there can be
# more customization of the grid spacing.
number_slider_35 = Slider(8, range=0..10)
# Preserve end tangents
# Point count to rebuild the segments to
# that match the search degree
# Degree to rebuild the segments to
# that match the search degree
toggle_8 = BooleanToggle(False)
# 11-Parameter Curve Divide Surface
number_slider_36 = Slider(6, range=0..10)
# 12-Parameter Grid On Surface
number_slider_37 = Slider(9, range=0..10)
# 20-Parameter Rectangular Grid
number_slider_38 = Slider(9, range=0..10)
# 22-Align Curve Seams
crv_6 = Curve([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])
# Determines how the tween is interpolated.
number_slider_39 = Slider(0, range=0..3)
# Same as setting reparmeterize of curve
# inputs/outputs but sometimes it is nice
# to have a seperate component
crv_7 = Curve(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)
# 34-Seam To Curve Corner
# Curve with corners
crv_8 = Curve(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)
# Determines how the tween is interpolated.
# Factor from 0 to 1 determines the curve
# between each input as a list. So 0.5 will
# be halfway between each input
# consecutively through the list.
# You can use lists / mutiple factors as well.
number_slider_40 = Slider(0, range=0..3)
# Open curve can also shorten already opened curves
crv_9 = Curve(reparameterize(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))
# Try plugging this plane in to see how
# the bounding rectangle changes
# Deterimes which axis of the
# orientation plane to find the
# bounding rectangle along.
# Try changing the slider.
number_slider_41 = Slider(0, range=0..3)
# 05-Tween Through Curves
crv_10 = Curve(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)
crv_11 = Curve(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)
crv_12 = Curve(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)
crv_13 = Curve(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)
# Crv @
# index 1
# Crv @
# index 2
srf = Surface(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)
# 21-Rectangle Fit
# Move the points around to see
# how the rectangle changes.
pt = Point([Point(455.6325058, 163.4195474, 0.8564565973), Point(464.7466324, 169.7061396, 5.968911539), Point(466.8893769, 158.7729999, 4.185108293), Point(453.7158516, 155.6604277, 0.8564565973), Point(461.883234, 159.5429143, 4.185108293), Point(473.1051079, 163.6287158, 8.079935058), Point(477.166867, 158.3897425, 8.079935058), Point(467.1129028, 153.3235561, 0.8564565973), Point(459.3992502, 147.6553663, -0.5931314776), Point(465.6135799, 145.1439505, -0.5931314776), Point(473.1062934, 149.4019549, 0.8564565973), Point(449.2814238, 156.7334064, 0.8564565973), Point(459.3235496, 170.3275385, 5.736267949), Point(472.3990029, 169.9179975, 8.286852212)])
# 02-Weighted Average Curve
# Multiple curves set here
crv_14 = Curve([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])
# Crv @
# index 3
# Crv @
# index 1
# Crv @
# index 2
crv_15 = Curve(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)
# 15-Tween Through Curves On Surface
crv_16 = Curve(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)
crv_17 = Curve(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)
xy = XYPlane(Origin=Point(0, 0, 0))
# non kinked curve
# Look at Rhino window
# to preview input
crv_18 = Curve(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)
# non segmented curve
# Look at Rhino window
# to preview input
crv_19 = Curve(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)
# 35-Superimpose Curve
crv_20 = Curve(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)
crv_21 = Curve(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)
# non linear curve
# Look at Rhino window
# to preview input
crv_22 = Curve(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)
# Pf_06-Curve
# 01-Average Curve
# Multiple curves set here
crv_23 = Curve([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])
crv_24 = Curve(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)
crv_25 = Curve(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)
# 04-Tween Consecutive Curves
crv_26 = Curve(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)
crv_27 = Curve(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)
crv_28 = Curve(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)
crv_29 = Curve(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)
crv_30 = Curve(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)
pt_2 = Point(Point(535.6981531, -633.0888979, 0))
pt_3 = Point([Point(504.5375467, -666.5041904, 0), Point(519.225857, -661.7730781, 0), Point(547.8750715, -685.3530881, 0)])
# 42-Is Arc/Circle/Ellipse
# Look at Rhino window
# to preview input
crv_31 = Curve(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)
# Look at Rhino window
# to preview input
crv_32 = Curve(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)
# 43-Is Curve Kinky
# kinked curve
# Look at Rhino window
# to preview input
crv_33 = Curve(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)
crv_34 = Curve(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)
crv_35 = Curve(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)
# 09-Tween Through Curves Along Curve
# Guide curve to slide
# along. If does not even
# need to touch the curve
# to slide.
# Crv @
# index 3
# Crv @
# index 1
# Crv @
# index 2
crv_36 = Curve(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)
# 37-Trim Curve With Points
crv_37 = Curve(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)
crv_38 = Curve(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)
# 44-Is Curve Linear
# linear curve
# Look at Rhino window
# to preview input
crv_39 = Curve(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)
# 45-Is Curve Segmented
# segmented curve
# Look at Rhino window
# to preview input
crv_40 = Curve(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)
pt_4 = Point([Point(502.3658289, -525.3784359, 0), Point(538.9617975, -541.277041, 0)])
# 25-Fit Curve Segments
# Segment curve
crv_41 = Curve(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)
# 32-Rebuild Curve Segments
# Segment curve
crv_42 = Curve(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)
# 19-Discrete Polyline
pt_5 = Point([Point(595.1496153, -102.3323976, 0), Point(613.2041788, -56.85072473, 0), Point(641.4153483, -109.6828754, 0), Point(661.9444019, -77.798228, 0), Point(640.8873635, -68.31900634, 0), Point(662.1458276, -55.86640971, 0), Point(678.0820439, -66.01774496, 0)])
# The result discrete polyline will only
# be made up of these vectors angles.
# The vector star and vector world components
# are good to use for this input
crv_43 = Curve([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])
yz = YZPlane(Origin=O)
# Offset curve can do both sides and cap ends.
crv_44 = Curve(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)
# Look at Rhino window
# to preview input
crv_45 = Curve(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)
# 14-Tween Consecutive Curves On Surface
crv_46 = Curve(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)
crv_47 = Curve(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)
crv_48 = Curve(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)
srf_2 = Surface(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)
crv_49 = Curve(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)
crv_50 = Curve(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)
srf_3 = Surface(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)
srf_4 = Surface(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)
crv_51 = Curve(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)
# Input control point counts
# are all mismatched
lng = ListLength(List=cp.Points)  # -> flatten(Length)
crvspans = CurveSpans(Curve=crv_4)  # -> SubDomains, Amount, Lengths, Degrees, Parameters
crvdeg = CurveDegree(Curve=[crv_2, crv, crv_3])
# Open curve input
crv_52 = Curve(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)
# Plane the rectangle is on
xy_2 = XYPlane(Origin=Point(515.040441, 119.9787056, 0))
crv_53 = Curve(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)
crv_54 = Curve(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)
crv_55 = Curve([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])
crv_56 = Curve(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)
crv_57 = Curve([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])
# Plane
yz_2 = YZPlane(Origin=Point(664.0352788, 162.2578874, 0))
X = UnitX(Factor=number_slider_8)
# Orientation plane
xy_3 = XYPlane(Origin=Point(0, 0, 0))
# Curve with kinks
crv_58 = Curve(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)
crv_59 = Curve(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)
pln = Plane(Plane(origin=(453.4417163, 129.3432883, 0), x=(0.4160140161, 0.9093582014, 0), y=(-0.6180203613, 0.2827325163, 0.7335619655)))
# The reach distance determines how
# far from the mirror plane that the cutting
# reaches. Anything within that distance
# from the mirror plane will be additionally
# cut away. Set it to zero and the cutting will
# only happen exactly at the mirror plane.
number_slider_42 = Slider(2.276, range=0..10)
alicrvseams = AlignCurveSeams(Curves=reparameterize(crv_6), Seam=number_slider_17, Snap=False, Iterative=True)  # -> Aligned, Points, R
ace = ArcCircleEllipse(Curve=crv_45, GetType=number_slider_10, Tolerance=number_slider_11)
wavcrv = WeightedAverageCurve(Curves=crv_14, Weights=[Slider(0.347, range=0..1), Slider(0.572, range=0..1), number_slider_15], Refit=3, PointSample=0)
# Pufferfish
# By: Michael Pryor
avrcrv = AverageCurve(Curves=crv_23, Refit=3, PointSample=0)
# Union rectangle or separate rectangles
# Determines the location along the axis
# of the rectangle through the bounding volume.
# Try changing the slider.
toggle_9 = BooleanToggle(True)
rebcrvsegs = RebuildCurveSegments(Curve=crv_42, Search="2", Degree=number_slider_9, Count=Slider(4, range=0..10), EndTangents=toggle_8)  # -> Rebuilt, Amount, DegreesR, DegreesC, R
# Look at Rhino window
# to see input curves seam
end = EndPoints(Curve=crv_8)  # -> Start, End
fitcrvsegs = FitCurveSegments(Curve=crv_41, Search="2", Degree=number_slider_4, Tolerance=0.001)  # -> Fitted, Amount, DegreesF, DegreesC, R
complines = CompatibilizePolylines(Polylines=crv_5)  # -> Compatibilized, R
offcrv = OffsetCurve(
    Curve=crv_44,
    Distance=number_slider_16,
    Plane=xy,
    BothSides=Toggle(True),
    Kinks=Slider(1, range=0..4),
    CapType=number_slider)
crvkinky = IsCurveKinky(Curve=crv_18)  # -> Kinked, Amount, Lengths
crvsegs = IsCurveSegmented(Curve=crv_40)  # -> Segments, Amount, Lengths, Degrees
opncrv = OpenCurve(Curve=crv_9, Length=number_slider_18, Normalized=False, Seam=number_slider_20)  # -> Opened, R
reparamcrv = ReparameterizeCurve(Curve=crv_7)  # -> Reparameterized, Original
seam2crvcorn = SeamToCurveCorner(Curves=crv_8)  # -> Adjusted, Points, R
crvlenat = CurveLengthAt(Curve=crv_30, Point=pt_2, Normalized=toggle)  # -> Length, Parameter
crvlenbtwn = CurveLengthBetween(Curve=crv_38, Points=pt_3, Normalized=toggle_2)  # -> Lengths, Parameters
crvkinky_2 = IsCurveKinky(Curve=crv_33)  # -> Kinked, Amount, Lengths
crvsegs_2 = IsCurveSegmented(Curve=crv_19)  # -> Segments, Amount, Lengths, Degrees
twn2crvssrf = TweenTwoCurvesOnSurface(CurveA=crv_49, CurveB=crv_50, Surface=srf_3, Factor=number_slider_23, Refit=3, PointSample=0)
prudecrv = PrudeCurve(Curve=crv_51, Length=number_slider_25, BlendType=Slider(0, range=0..1), Bulge=number_slider_26)  # -> Prude, R
supercrv = SuperimposeCurve(Reference=crv_20, Target=crv_21, Points=Toggle(True), Degree=Toggle(True), Domain=toggle_3, EndTangents=toggle_4)
isace = IsArcCircleEllipse(Curve=crv_31, Tolerance=1e-12)  # -> Arc, Circle, Ellipse
twn2crvs = TweenTwoCurves(CurveA=crv_24, CurveB=crv_25, Factor=number_slider_2, Refit=0, PointSample=0)
isace_2 = IsArcCircleEllipse(Curve=crv_32, Tolerance=number_slider_21)  # -> Arc, Circle, Ellipse
netsrf = NetOnSurface(Surface=srf_4, UCount=number_slider_19, VCount=Slider(10, range=0..10), Flip=toggle_7)
trimcrvpts = TrimCurveWithPoints(Curve=crv_37, Points=pt_4, Alternate=toggle_6)  # -> Trimmed, SubDomains
crvlinr = IsCurveLinear(Curve=crv_39)
recfit = RectangleFit(Points=pt)
# The offser distance determines how
# far to offset the cut. It does not do any
# additional cut removing like
# the reach plane, it just moves the
# actual cut away from the mirror plane.
# Set it to zero and there will be no
# additional gap in the mirror cut.
number_slider_43 = Slider(5.238, range=0..10)
dom = ConstructDomain(DomainStart=number_slider_24, DomainEnd=Slider(5, range=0..5))
crvlinr_2 = IsCurveLinear(Curve=crv_22)
panel = Panel(lng)
crv_60 = Curve(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)
# Geometry to contain in rectangle
geo = Geometry([Point(456.32806, 115.5583201, 0), Point(469.1044244, 119.1683536, 0), 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, Point(464.7863506, 107.4306887, 0), Point(455.6049694, 109.6402123, 0), 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])
move = Move(Geometry=yz_2, Motion=X)  # -> Geometry, Transform
range = Range(Domain=Domain(0, 1), Steps=number_slider_34)
range_2 = Range(Domain=Domain(0, 1), Steps=number_slider_35)
range_3 = Range(Domain=Domain(0, 1), Steps=Slider(8, range=0..10))
range_4 = Range(Domain=Domain(0, 1), Steps=number_slider_36)
range_5 = Range(Domain=Domain(0, 1), Steps=number_slider_37)
range_6 = Range(Domain=Domain(0, 1), Steps=number_slider_38)
rec = Rectangle({Plane=PlaneXY(295.821564, 230.5437144, 0), Size=Domain2(u=0..20.23464176, v=0..32.60345045)})
S = Surface(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)
S_2 = Surface(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)
# Gets the degree value
# for different types of curves
panel_2 = Panel(crvdeg)
consarearec = ConstrainedAreaRectangle(Plane=xy_2, Area=number_slider_31, FactorX=Slider(0.31, range=0..1), FactorY=number_slider_30)  # -> Rectangle, DimensionX, DimensionY
fitcrvsmo = FitCurveSmooth(Curve=crv_58, Degree=number_slider_32, FitTolerance=0.001, AngleTolerance=number_slider_27)
# Flips the mirror direction to
# cut the other side instead.
toggle_10 = BooleanToggle(False)
twnthrucrvs = TweenThroughCurves(
    Curves=[crv_10, crv_11, crv_12, crv_15],
    Factor=number_slider_12,
    InterpolationType=number_slider_29,
    Refit=0,
    PointSample=0)
twnthrucrvscrv = TweenThroughCurvesAlongCurve(Curves=crv_57, Guide1=crv_36, Factor=number_slider_13, Refit=0, PointSample=0)
dpline = DiscretePolyline(References=pt_5, Targets=crv_43, KeepLength=Toggle(False))
clscrv = CloseCurve(Curve=crv_52, CloseType=number_slider_3, Bulge=Slider(0.5, range=0..1), Tolerance=number_slider_22)  # -> Closed, R
eval = EvaluateCurve(Curve=crv_7, Parameter=number_slider_33)  # -> Point, Tangent, Angle
twnconcrvs = TweenConsecutiveCurves(
    Curves=[crv_26, crv_27, crv_28],
    Factor=Slider(0.5, range=0..1),
    InterpolationType=number_slider_28,
    Refit=0,
    PointSample=0)
twnconcrvscrv = TweenConsecutiveCurvesAlongCurve(Curves=crv_55, Guide1=crv_35, Factor=number_slider_7, Refit=0, PointSample=0)
pline = PolyLine(Vertices=pt_5, Closed=False)
twn2crvscrv = TweenTwoCurvesAlongCurve(CurveA=crv_53, CurveB=crv_54, Guide1=crv_34, Factor=number_slider_6, Refit=0, PointSample=0)
# Flips the mirror direction to
# cut the other side instead.
trimcrvpln = TrimCurveWithPlane(Curve=crv_59, Plane=yz, Flip=Toggle(False))  # -> Trimmed, Parameters, R
slidecrvcrv = SlideCurveAlongCurve(Curve=crv_56, Guide1=crv_29, Factor=number_slider_5, Align=toggle_5, Refit=0, PointSample=0)
eval_2 = EvaluateCurve(Curve=reparameterize(crv_6), Parameter=0)  # -> Point, Tangent, Angle
# Optional Refit and Sample Point
# match methods. Read input descriptions.
swatch = ColourSwatch(SwatchColor=RGB(0, 0, 255))
# Optional Refit and Sample Point
# match methods. Read input descriptions.
swatch_2 = ColourSwatch(SwatchColor=RGB(0, 0, 255))
# Amount of spans
panel_3 = Panel(crvspans.Amount)
panel_4 = Panel(trimcrvpts.SubDomains)
# Optional Refit and Sample Point
# match methods. Read input descriptions.
swatch_3 = ColourSwatch(SwatchColor=RGB(0, 0, 255))
# The curves original domain
panel_5 = Panel(reparamcrv.Original)
cp_2 = ControlPoints(Curve=complines.Compatibilized)  # -> Points, Weights, Knots
# Optional Refit and Sample Point
# match methods. Read input descriptions.
swatch_4 = ColourSwatch(SwatchColor=RGB(0, 0, 255))
panel_6 = Panel(crvlenat.Length)
# Using parameters instead of points.
panel_7 = Panel(crvlenat.Parameter)
# The curve that will get
# mirror cut (turn its preview
# on to see the original curve)
# Using as the mirror plane
deplane = DeconstructPlane(Plane=move.Geometry)  # -> Origin, XAxis, YAxis, ZAxis
# Lengths along curve
# between points
panel_8 = Panel(crvlenbtwn.Lengths)
# Using parameters instead of points.
panel_9 = Panel(crvlenbtwn.Parameters)
panel_10 = Panel(crvkinky.Kinked)
panel_11 = Panel(crvkinky.Lengths)
# Segmented
panel_12 = Panel(crvsegs_2.Segments)
panel_13 = Panel(crvkinky.Amount)
panel_14 = Panel(crvlinr_2)
# Segment amount
panel_15 = Panel(crvsegs_2.Amount)
# Segment lengths
panel_16 = Panel(crvsegs_2.Lengths)
panel_17 = Panel(isace.Arc)
panel_18 = Panel(isace.Circle)
panel_19 = Panel(isace.Ellipse)
panel_20 = Panel(isace_2.Ellipse)
# Segment degrees
panel_21 = Panel(crvsegs_2.Degrees)
panel_22 = Panel(isace_2.Circle)
panel_23 = Panel(crvkinky_2.Kinked)
# Extracting the kink points
panel_24 = Panel(crvkinky_2.Amount)
panel_25 = Panel(crvkinky_2.Lengths)
panel_26 = Panel(crvlinr)
# Segmented
panel_27 = Panel(crvsegs.Segments)
# Segment amount
# Extracting the segments or points between segments
panel_28 = Panel(crvsegs.Amount)
panel_29 = Panel(isace_2.Arc)
# Segment lengths
panel_30 = Panel(crvsegs.Lengths)
# Segment degrees
panel_31 = Panel(crvsegs.Degrees)
rebcrv = RebuildCurve(Curve=crv_60, Count=Slider(5, range=0..10), Degree=Slider(3, range=0..10), Domain=dom, EndTangents=Toggle(False))
brec = BoundingRectangle(Geometry=geo, Plane=xy_3, Axis=number_slider_41, Slide=Slider(0, range=0..1), Union=toggle_9)
paramrecgrid = ParameterRectangularGrid(Rectangle=rec, ParametersX=range_6, ParametersY=range_3)  # -> Cells, Points
paramcrvdivsrf = ParameterCurveDivideSurface(Surface=S, ParametersU=range_4, ParametersV=range)  # -> CurvesU, CurvesV
twnthrucrvssrf = TweenThroughCurvesOnSurface(
    Curves=[crv_16, crv_17, crv_13],
    Surface=srf,
    Factor=number_slider_14,
    InterpolationType=number_slider_39,
    Refit=3,
    PointSample=0)
paramgridsrf = ParameterGridOnSurface(Surface=S_2, ParametersU=range_5, ParametersV=range_2)  # -> Cells, Points
twnconcrvssrf = TweenConsecutiveCurvesOnSurface(
    Curves=[crv_46, crv_47, crv_48],
    Surface=srf_2,
    Factor=Slider(0.5, range=0..1),
    InterpolationType=number_slider_40,
    Refit=3,
    PointSample=0)
panel_32 = Panel(complines.R)
domain = Domain(crv_20)
domain_2 = Domain(supercrv)
# Did segment
# of curve fit
panel_33 = Panel(fitcrvsegs.R)
# Did segment
# of curve rebuild
panel_34 = Panel(rebcrvsegs.R)
# Normal polyline through the vertices
swatch_5 = ColourSwatch(SwatchColor=RGB(0, 0, 255))
panel_35 = Panel(trimcrvpln.R)
# Optional Refit and Sample Point
# match methods. Read input descriptions.
swatch_6 = ColourSwatch(SwatchColor=RGB(0, 0, 255))
# Optional Refit and Sample Point
# match methods. Read input descriptions.
swatch_7 = ColourSwatch(SwatchColor=RGB(0, 0, 255))
# Look at Rhino window
# to preview results
panel_36 = Panel(alicrvseams.R)
# Original seams of the input curves,
# Using a guide point
preview = CustomPreview(Geometry=alicrvseams.Aligned, Shader=ColourSwatch(SwatchColor=RGB(0, 0, 255)))
# Look at Rhino window
# to preview results
# Aligned seams
preview_2 = CustomPreview(Geometry=alicrvseams.Points, Shader=ColourSwatch(SwatchColor=RGB(0, 0, 255)))
# Some notes about averaging / tweening curves:
# 
# 1.Tweens can work between all types of combinations of curves - open, closed, segmented, kinked, & polylines.
# 
# 2.Tweens always work best between polylines when they have the same control point count,
# control points make them easier to predict in results. All the tween curve components can
# automatically compatabilize polylines but you can make the results fit your specific look
# by making them have matching control points yourself before tweening. For non polyline curves
# this is not necessary.
# 
# 3.If no curve shows up or looks weird, try flipping one of your curves - tweens work based on curve direction.
# Look at Rhino window
# to preview results
preview_3 = CustomPreview(Geometry=avrcrv, Shader=swatch)
# Look at Rhino window
# to preview results
panel_37 = Panel(prudecrv.R)
# Look at Rhino window
# to preview results
preview_4 = CustomPreview(Geometry=wavcrv, Shader=swatch_2)
# Look at Rhino window
# to preview results
preview_5 = CustomPreview(Geometry=netsrf, Shader=ColourSwatch(SwatchColor=RGB(0, 0, 255)))
preview_6 = CustomPreview(Geometry=prudecrv.Prude, Shader=ColourSwatch(SwatchColor=RGB(0, 0, 255)))
# Look at Rhino window
# to preview results
preview_7 = CustomPreview(Geometry=recfit, Shader=ColourSwatch(SwatchColor=RGB(0, 0, 255)))
# Look at Rhino window
# to preview results
preview_8 = CustomPreview(Geometry=ace, Shader=ColourSwatch(SwatchColor=RGB(0, 0, 255)))
# Optional Refit and Sample Point
# match methods. Read input descriptions.
swatch_8 = ColourSwatch(SwatchColor=RGB(0, 0, 255))
# Optional Refit and Sample Point
# match methods. Read input descriptions.
swatch_9 = ColourSwatch(SwatchColor=RGB(0, 0, 255))
# Optional Refit and Sample Point
# match methods. Read input descriptions.
swatch_10 = ColourSwatch(SwatchColor=RGB(0, 0, 255))
# Optional Refit and Sample Point
# match methods. Read input descriptions.
swatch_11 = ColourSwatch(SwatchColor=RGB(0, 0, 255))
# True is made compatibile.
# False if already compatible.
lng_2 = ListLength(List=cp_2.Points)  # -> flatten(Length)
# Using Normalized Lengths
# Look at Rhino window
# to preview results
preview_9 = CustomPreview(Geometry=opncrv.Opened, Shader=ColourSwatch(SwatchColor=RGB(0, 0, 255)))
# True is closed.
# False if not or already closed.
panel_38 = Panel(clscrv.R)
panel_39 = Panel(consarearec.DimensionX)
# Result dimensions
# Since it is proportional:
# Dimension X / Dimension Y
# will equal the same number as
# Factor X / Factor Y
panel_40 = Panel(consarearec.DimensionY)
panel_41 = Panel(fitcrvsegs.Amount)
# Look at Rhino window
# to preview results
preview_10 = CustomPreview(Geometry=twn2crvssrf, Shader=swatch_3)
# Look at Rhino window
# to preview results
# Control points of resulting curve.
# See how they change when you
# change the degree.
cp_3 = ControlPoints(Curve=fitcrvsegs.Fitted)  # -> Points, Weights, Knots
# Look at Rhino window
# to preview results
# Control points of resulting curve.
# See how they change when you
# change the degree.
cp_4 = ControlPoints(Curve=fitcrvsmo)  # -> Points, Weights, Knots
# Look at Rhino window
# to preview results
panel_42 = Panel(rebcrvsegs.Amount)
# Using optional guide point
# Look at Rhino window
# to preview results
preview_11 = CustomPreview(Geometry=seam2crvcorn.Points, Shader=ColourSwatch(SwatchColor=RGB(0, 0, 255)))
# Look at Rhino window
# to preview results
preview_12 = CustomPreview(Geometry=supercrv, Shader=ColourSwatch(SwatchColor=RGB(0, 0, 255)))
# GH native Tween Curve comparison
# Look at Rhino window
# to preview results
preview_13 = CustomPreview(Geometry=twn2crvs, Shader=swatch_4)
area = Area(Geometry=consarearec.Rectangle)  # -> Area, Centroid
# See how the segments change
# when you change the degree
# and control point counts of
# the searched segments.
preview_14 = CustomPreview(Geometry=rebcrvsegs.Rebuilt, Shader=ColourSwatch(SwatchColor=RGB(0, 0, 255)))
# Look at Rhino window
# to preview results
preview_15 = CustomPreview(Geometry=trimcrvpts.Trimmed, Shader=ColourSwatch(SwatchColor=RGB(0, 0, 255)))
# Span curve sub-domains
panel_43 = Panel(crvspans.SubDomains)
# If true the entire input
# curve is mirrored
# normally if it is mirror
# cut into non existance.
# Look at Rhino window
# to preview results
preview_16 = CustomPreview(Geometry=offcrv, Shader=ColourSwatch(SwatchColor=RGB(0, 0, 255)))
rot3d = Rotate3D(Geometry=move.Geometry, Angle=degrees(Slider(54, range=0..360)), Center=deplane.Origin, Axis=deplane.YAxis)  # -> Geometry, Transform
preview_17 = CustomPreview(Geometry=fitcrvsegs.Fitted, Shader=ColourSwatch(SwatchColor=RGB(0, 0, 255)))
preview_18 = CustomPreview(Geometry=fitcrvsmo, Shader=ColourSwatch(SwatchColor=RGB(0, 0, 255)))
# Reference Domain
panel_44 = Panel(domain)
# Superimposed Domain
panel_45 = Panel(domain_2)
# Look at Rhino window
# to preview results
preview_19 = CustomPreview(Geometry=complines.Compatibilized, Shader=ColourSwatch(SwatchColor=RGB(0, 0, 255)))
# Amount of segments in curve
# Input curve
# segment degrees
panel_46 = Panel(fitcrvsegs.DegreesC)
# Optional Refit and Sample Point
# match methods. Read input descriptions.
swatch_12 = ColourSwatch(SwatchColor=RGB(0, 0, 255))
# Amount of segments in curve
# Input curve
# segment degrees
panel_47 = Panel(rebcrvsegs.DegreesC)
# Optional Refit and Sample Point
# match methods. Read input descriptions.
swatch_13 = ColourSwatch(SwatchColor=RGB(0, 0, 255))
# Look at Rhino window
# to preview results
panel_48 = Panel(range_4)
panel_49 = Panel(range)
# Look at Rhino window
# to preview results
panel_50 = Panel(range_5)
panel_51 = Panel(range_2)
# Look at Rhino window
# to preview results
panel_52 = Panel(range_6)
panel_53 = Panel(range_3)
# Look at Rhino window
# to preview results
# This allows the start and end of the grid
# to be altered on the surface so grids can
# exist only on parts of the surface.
preview_20 = CustomPreview(Geometry=paramcrvdivsrf.CurvesU, Shader=ColourSwatch(SwatchColor=RGB(0, 0, 255)))
# Look at Rhino window
# to preview results
# This allows the start and end of the grid
# to be altered on the surface so grids can
# exist only on parts of the surface.
preview_21 = CustomPreview(Geometry=paramgridsrf.Cells, Shader=ColourSwatch(SwatchColor=RGB(0, 0, 255)))
# Using keep lengths option
# Look at Rhino window
# to preview results
preview_22 = CustomPreview(Geometry=dpline, Shader=swatch_5)
preview_23 = CustomPreview(
    Geometry=paramcrvdivsrf.CurvesV,
    Shader={ambient=RGB(0, 0, 0), diffuse=RGB(255, 105, 180), emission=RGB(76, 32, 54), shine=0.5, specular=RGB(255, 255, 255), transparency=0})
preview_24 = CustomPreview(
    Geometry=paramgridsrf.Points,
    Shader={ambient=RGB(0, 0, 0), diffuse=RGB(255, 105, 180), emission=RGB(76, 32, 54), shine=0.5, specular=RGB(255, 255, 255), transparency=0})
preview_25 = CustomPreview(
    Geometry=paramrecgrid.Points,
    Shader={ambient=RGB(0, 0, 0), diffuse=RGB(255, 105, 180), emission=RGB(76, 32, 54), shine=0.5, specular=RGB(255, 255, 255), transparency=0})
# Look at Rhino window
# to preview results
# This allows the start and end of the grid
# to be altered in the rectangle so grids can
# exist only in parts of the rectangle.
preview_26 = CustomPreview(Geometry=paramrecgrid.Cells, Shader=ColourSwatch(SwatchColor=RGB(0, 0, 255)))
# Look at Rhino window
# to preview results
preview_27 = CustomPreview(Geometry=trimcrvpln.Trimmed, Shader=ColourSwatch(SwatchColor=RGB(0, 0, 255)))
# Look at Rhino window
# to preview results
preview_28 = CustomPreview(Geometry=twnconcrvs, Shader=swatch_6)
# Look at Rhino window
# to preview results
preview_29 = CustomPreview(Geometry=twnthrucrvs, Shader=swatch_7)
domain_3 = Domain(rebcrv)
# Look at Rhino window
# to preview results
preview_30 = CustomPreview(Geometry=consarearec.Rectangle, Shader=ColourSwatch(SwatchColor=RGB(0, 0, 255)))
# Join makes the
# two mirror sides
# into one curve.
toggle_11 = BooleanToggle(False)
# Result area matches
# input area exactly
panel_54 = Panel(area.Area)
# Output control point counts
# are matched and the polyline
# shapes were not changed.
panel_55 = Panel(lng_2)
crv_61 = Curve(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)
# Look at Rhino window
# to preview results
preview_31 = CustomPreview(Geometry=clscrv.Closed, Shader=ColourSwatch(SwatchColor=RGB(0, 0, 255)))
# Two guide curves to slide
# along and deform between
# Look at Rhino window
# to preview results
preview_32 = CustomPreview(Geometry=slidecrvcrv, Shader=swatch_8)
# Two guide curves to tween
# along and deform between
# Look at Rhino window
# to preview results
preview_33 = CustomPreview(Geometry=twn2crvscrv, Shader=swatch_9)
# Two guide curves to tween
# along and deform between
# Look at Rhino window
# to preview results
preview_34 = CustomPreview(Geometry=twnconcrvscrv, Shader=swatch_10)
# Two guide curves to tween
# along and deform between
# Look at Rhino window
# to preview results
preview_35 = CustomPreview(Geometry=twnthrucrvscrv, Shader=swatch_11)
# When curve is not reparameterized you
# can't evaluate from 0 to 1
eval_3 = EvaluateCurve(Curve=reparamcrv.Reparameterized, Parameter=Slider(0.5, range=0..1))  # -> Point, Tangent, Angle
# Look at Rhino window
# to preview results
preview_36 = CustomPreview(Geometry=brec, Shader=ColourSwatch(SwatchColor=RGB(0, 0, 255)))
# Domain
panel_56 = Panel(domain_3)
# Look at Rhino window
# to preview results
# Control Points
cp_5 = ControlPoints(Curve=rebcrv)  # -> Points, Weights, Knots
preview_37 = CustomPreview(Geometry=rebcrv, Shader=ColourSwatch(SwatchColor=RGB(0, 0, 255)))
# Look at Rhino window
# to preview results
preview_38 = CustomPreview(Geometry=twnconcrvssrf, Shader=swatch_12)
# Look at Rhino window
# to preview results
preview_39 = CustomPreview(Geometry=twnthrucrvssrf, Shader=swatch_13)
# Notice how we search for degree 2
# segments and how they change to the
# degree that is set in the degree input.
# Result curve
# segment degrees
panel_57 = Panel(fitcrvsegs.DegreesF)
# Notice how we search for degree 2
# segments and how they change to the
# degree that is set in the degree input.
# Result curve
# segment degrees
panel_58 = Panel(rebcrvsegs.DegreesR)
# Bulge factor for the connection curve
# When mirror cuts have a reach or offset
# that is not zero, they can create a connection
# curve between the mirror cut sides, which
# blends them together. There are various types.
number_slider_44 = Slider(0.595, range=-1..1)
number_slider_45 = Slider(0.472, range=0..1)
# Span lengths
panel_59 = Panel(crvspans.Lengths)
# Using multiple points to trim
# between every two points.
# Using division points to
# trim like a dash line.
number_slider_46 = Slider(18, range=0..100)
panel_60 = Panel("""5.3
16.9
84.6""")
mircutcrv = MirrorCutCurve(
    Curve=crv_61,
    MirrorPlane=rot3d.Geometry,
    Reach=number_slider_42,
    Offset=number_slider_43,
    Flip=toggle_10,
    Join=Toggle(True),
    Keep=toggle_11,
    ConnectionType=Slider(2, range=0..10),
    Bulge=number_slider_44)  # -> MirrorCut, SplitIndex, ReachPlane, OffsetPlane, Intersected
# Look at Rhino window
# to preview results
preview_40 = CustomPreview(Geometry=eval_3.Point, Shader=ColourSwatch(SwatchColor=RGB(0, 0, 255)))
crv_62 = Curve(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)
crv_63 = Curve(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)
# Look at Rhino window
# to preview input
crv_64 = Curve(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)
# kinked curve
# Look at Rhino window
# to preview input
crv_65 = Curve(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)
# Option to normalize
# the length output
# Optionally, you can use curve parameters
# instead of points. If both points and parameters
# are input the parameters will be used.
toggle_12 = BooleanToggle(False)
# Option to normalize
# the length output
# Optionally, you can use curve parameters
# instead of points. If both points and parameters
# are input the parameters will be used.
toggle_13 = BooleanToggle(False)
# Span degrees
panel_61 = Panel(crvspans.Degrees)
# 0 to 0.5 length used
# Normalized set to true
number_slider_47 = Slider(0.065, range=0..1)
# Change the seam parameter to
# change the location of the opening.
number_slider_48 = Slider(0, range=0..1)
# Switches which side
# gets trimmed away
toggle_14 = BooleanToggle(True)
# Adjusting the start and end domains
# of the ranges positions the grid on
# specified parts of the surface.
number_slider_49 = Slider(0.652, range=0..1)
# Adjusting the start and end domains
# of the ranges positions the grid on
# specified parts of the surface.
number_slider_50 = Slider(0.652, range=0..1)
# Adjusting the start and end domains
# of the ranges positions the grid on
# specified parts of the surface.
number_slider_51 = Slider(0.652, range=0..1)
crv_66 = Curve(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)
# Look at Rhino window
# to preview inputs
crv_67 = Curve(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)
# Look at Rhino window
# to preview inputs
crv_68 = Curve(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)
divide = DivideCurve(Curve=crv_66, Count=number_slider_46, Kinks=False)  # -> Points, Tangents, Parameters
# Parameters at span ends
# Extracting the spans or points between spans
panel_62 = Panel(crvspans.Parameters)
panel_63 = Panel(mircutcrv.Intersected)
twn2crvs_2 = TweenTwoCurves(CurveA=crv_62, CurveB=crv_63, Factor=number_slider_45, Refit=0, PointSample=0)
# GH native Tween
tweencrv = TweenCurve(CurveA=crv_62, CurveB=crv_63, Factor=number_slider_45, BlendType=0)
crvkinky_3 = IsCurveKinky(Curve=crv_65)  # -> Kinked, Amount, Lengths
crvsegs_3 = IsCurveSegmented(Curve=crv_64)  # -> Segments, Amount, Lengths, Degrees
# Curve with corners
crv_69 = Curve(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)
# Move the guide point around to see how
# the seam switches to different corners
pt_6 = Point(Point(436.4852136, -190.2950856, 0))
crv_70 = Curve(reparameterize(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))
pt_7 = Point([Point(595.1496153, -198.9540922, 0), Point(613.2041788, -153.4724193, 0), Point(641.4153483, -206.3045701, 0), Point(661.9444019, -174.4199226, 0), Point(640.8873635, -164.940701, 0), Point(662.1458276, -152.4881043, 0), Point(678.0820439, -162.6394396, 0)])
crv_71 = Curve([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])
crvlenat_2 = CurveLengthAt(Curve=crv_67, Parameter="59.8", Normalized=toggle_12)  # -> Length, Parameter
crv_72 = Curve([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])
# Optionally you can
# align the seams
# with a guide start
#  point. Move the
# point around to
# see the seams
# realign to it.
pt_8 = Point(Point(406.232057, -65.476253, 0))
crvlenbtwn_2 = CurveLengthBetween(Curve=crv_68, Parameters=panel_60, Normalized=toggle_13)  # -> Lengths, Parameters
trimcrvpts_2 = TrimCurveWithPoints(Curve=crv_66, Points=divide.Points, Alternate=toggle_14)  # -> Trimmed, SubDomains
# Look at Rhino window
# to preview results
# Result mirror cut curve
preview_41 = CustomPreview(Geometry=mircutcrv.MirrorCut, Shader=ColourSwatch(SwatchColor=RGB(255, 0, 0)))
# Reach plane (this plane essentially does the cutting)
preview_42 = CustomPreview(Geometry=mircutcrv.ReachPlane, Shader=ColourSwatch(SwatchColor=RGB(10, 255, 210)))
# Using the keep lengths option will make
# the result discrete polyline have the same
# length as the normal polyline through
# the vertices but the discrete polyline will
# deviate further from the reference vertices
toggle_15 = BooleanToggle(True)
# Offset plane (offsets the cuts from the mirror plane)
preview_43 = CustomPreview(Geometry=mircutcrv.OffsetPlane, Shader=ColourSwatch(SwatchColor=RGB(10, 22, 255)))
# Pf Tween
# GH has a native tween curve component
# however it sometimes outputs strange
# results, specifically when dealing with
# polylines (even with same control point
# counts). Pf's tween curve resolves this and
# acts more like Rhino's tween curve.
swatch_14 = ColourSwatch(SwatchColor=RGB(0, 0, 255))
# Look at Rhino window
# to preview guide point
preview_44 = CustomPreview(
    Geometry=pt_8,
    Shader={ambient=RGB(0, 0, 0), diffuse=RGB(255, 105, 180), emission=RGB(76, 32, 54), shine=0.5, specular=RGB(255, 255, 255), transparency=0})
# Look at Rhino window
# to see input curves seam
end_2 = EndPoints(Curve=crv_69)  # -> Start, End
# You can use the lengths with
# Grasshopper's Evalute Length
# component to extract the points
# at the kinks.
eval_4 = EvaluateLength(Curve=crv_65, Length=crvkinky_3.Lengths, Normalized=False)  # -> Point, Tangent, Parameter
# You can use the lengths with
# Grasshopper's Mass Addition
# + Evalute Length component to extract
# the points between the segments.
ma = MassAddition(Input=crvsegs_3.Lengths)  # -> Result, PartialResults
seam2crvcorn_2 = SeamToCurveCorner(Curves=crv_69, Guide=pt_6)  # -> Adjusted, Points, R
# When normalized is true then the
# length uses a normalized value for
# opening. So 0 is closed and 0.5 is all
# the way open (half the curve from
# both sides because the entire curves
# normalized length is 1)
opncrv_2 = OpenCurve(Curve=crv_70, Length=number_slider_47, Normalized=Toggle(True), Seam=number_slider_48)  # -> Opened, R
dom_2 = ConstructDomain(DomainStart=Slider(0.376, range=0..1), DomainEnd=Slider(0.664, range=0..1))
dom_3 = ConstructDomain(DomainStart=Slider(0.428, range=0..1), DomainEnd=number_slider_49)
dom_4 = ConstructDomain(DomainStart=Slider(0.376, range=0..1), DomainEnd=Slider(0.664, range=0..1))
dom_5 = ConstructDomain(DomainStart=Slider(0.428, range=0..1), DomainEnd=number_slider_50)
dom_6 = ConstructDomain(DomainStart=Slider(0.376, range=0..1), DomainEnd=Slider(0.664, range=0..1))
dom_7 = ConstructDomain(DomainStart=Slider(0.428, range=0..1), DomainEnd=number_slider_51)
# Second guide curve. When using two
# guide curves the tween curves will tween
# along them while deforming between them.
crv_73 = Curve(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)
crv_74 = Curve(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)
# Second guide curve. When using two
# guide curves the tween curves will tween
# along them while deforming between them.
crv_75 = Curve(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)
crv_76 = Curve(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)
# Second guide curve. When using two
# guide curves the tween curves will tween
# along them while deforming between them.
crv_77 = Curve(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)
crv_78 = Curve(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)
panel_64 = Panel(crvlenat_2.Length)
panel_65 = Panel(crvlenat_2.Parameter)
crv_79 = Curve(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)
# Second guide curve. When using two
# guide curves the slide curves will slide
# along them while deforming between them.
crv_80 = Curve(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)
# Lengths along curve
# between points
panel_66 = Panel(crvlenbtwn_2.Lengths)
panel_67 = Panel(crvlenbtwn_2.Parameters)
# Look at Rhino window
# to preview results
preview_45 = CustomPreview(Geometry=twn2crvs_2, Shader=swatch_14)
# Look at Rhino window
# to preview results
preview_46 = CustomPreview(Geometry=tweencrv, Shader=ColourSwatch(SwatchColor=RGB(255, 0, 0)))
eval_5 = EvaluateLength(Curve=crv_64, Length=ma.PartialResults, Normalized=False)  # -> Point, Tangent, Parameter
dpline_2 = DiscretePolyline(References=pt_7, Targets=crv_71, KeepLength=toggle_15)
alicrvseams_2 = AlignCurveSeams(Curves=crv_72, Guide=pt_8, Snap=False, Iterative=True)  # -> Aligned, Points, R
pline_2 = PolyLine(Vertices=pt_7, Closed=False)
crv_81 = Curve(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)
crv_82 = Curve(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)
crv_83 = Curve([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])
crv_84 = Curve([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])
crv_85 = Curve(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)
range_7 = Range(Domain=dom_3, Steps=Slider(5, range=0..10))
range_8 = Range(Domain=dom_5, Steps=Slider(5, range=0..10))
range_9 = Range(Domain=dom_7, Steps=Slider(5, range=0..10))
range_10 = Range(Domain=dom_2, Steps=Slider(5, range=0..10))
range_11 = Range(Domain=dom_4, Steps=Slider(5, range=0..10))
range_12 = Range(Domain=dom_6, Steps=Slider(5, range=0..10))
rec_2 = Rectangle({Plane=PlaneXY(331.0816594, 230.3581947, 0), Size=Domain2(u=0..19.36112898, v=0..33.2196213)})
S_3 = Surface(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)
S_4 = Surface(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)
panel_68 = Panel(eval_4.Point)
# Using parameters instead of points.
# Look at Rhino window
# to preview results
preview_47 = CustomPreview(Geometry=trimcrvpts_2.Trimmed, Shader=ColourSwatch(SwatchColor=RGB(0, 0, 255)))
eval_6 = EvaluateCurve(Curve=reparameterize(crv_72), Parameter=0)  # -> Point, Tangent, Angle
# Look at Rhino window
# to preview results
preview_48 = CustomPreview(Geometry=opncrv_2.Opened, Shader=ColourSwatch(SwatchColor=RGB(0, 0, 255)))
# Look at Rhino window
# to preview results
preview_49 = CustomPreview(Geometry=seam2crvcorn_2.Points, Shader=ColourSwatch(SwatchColor=RGB(0, 0, 255)))
len = Length(Curve=dpline_2)
# Normal polyline through the vertices
len_2 = Length(Curve=pline_2)
twn2crvscrv_2 = TweenTwoCurvesAlongCurve(CurveA=crv_81, CurveB=crv_82, Guide1=crv_73, Guide2=crv_74, Factor=Slider(0.551, range=0..1), Refit=0, PointSample=0)
twnconcrvscrv_2 = TweenConsecutiveCurvesAlongCurve(Curves=crv_83, Guide1=crv_77, Guide2=crv_78, Factor=Slider(0.5, range=0..1), Refit=0, PointSample=0)
slidecrvcrv_2 = SlideCurveAlongCurve(
    Curve=crv_85,
    Guide1=crv_80,
    Guide2=crv_79,
    Factor=Slider(0.467, range=0..1),
    Align=Toggle(False),
    Refit=0,
    PointSample=0)
twnthrucrvscrv_2 = TweenThroughCurvesAlongCurve(Curves=crv_84, Guide1=crv_75, Guide2=crv_76, Factor=Slider(2.616, range=0..3), Refit=0, PointSample=0)
paramcrvdivsrf_2 = ParameterCurveDivideSurface(Surface=S_3, ParametersU=range_10, ParametersV=range_7)  # -> CurvesU, CurvesV
paramrecgrid_2 = ParameterRectangularGrid(Rectangle=rec_2, ParametersX=range_12, ParametersY=range_9)  # -> Cells, Points
paramgridsrf_2 = ParameterGridOnSurface(Surface=S_4, ParametersU=range_11, ParametersV=range_8)  # -> Cells, Points
# You can then use
# Grasshoper's Shatter
# component to get each
# segment seperated.
shatter = Shatter(Curve=crv_64, Parameters=eval_5.Parameter)
panel_69 = Panel(eval_5.Point)
# Look at Rhino window
# to preview results
panel_70 = Panel(alicrvseams_2.R)
# Original seams of the input curves,
# Using iterative to progressively
# align along the flow of curves
preview_50 = CustomPreview(Geometry=alicrvseams_2.Aligned, Shader=ColourSwatch(SwatchColor=RGB(0, 0, 255)))
# Look at Rhino window
# to preview results
# Aligned seams
preview_51 = CustomPreview(Geometry=alicrvseams_2.Points, Shader=ColourSwatch(SwatchColor=RGB(0, 0, 255)))
# Look at Rhino window
# to preview results
preview_52 = CustomPreview(Geometry=dpline_2, Shader=ColourSwatch(SwatchColor=RGB(0, 0, 255)))
# Lengths are the same
panel_71 = Panel([len_2, len])
# Look at Rhino window
# to preview input
crv_86 = Curve(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)
panel_72 = Panel(shatter)
# Look at Rhino window
# to preview results
# Using unevenly spaced parameter
# values will result in uneven spaced
# grids. The grid spacing can be
# controlled with custom values
# such as values from graph mappers.
preview_53 = CustomPreview(Geometry=paramcrvdivsrf_2.CurvesU, Shader=ColourSwatch(SwatchColor=RGB(0, 0, 255)))
# Look at Rhino window
# to preview results
# Using unevenly spaced parameter
# values will result in uneven spaced
# grids. The grid spacing can be
# controlled with custom values
# such as values from graph mappers.
preview_54 = CustomPreview(Geometry=paramgridsrf_2.Cells, Shader=ColourSwatch(SwatchColor=RGB(0, 0, 255)))
# Look at Rhino window
# to preview results
# Using unevenly spaced parameter
# values will result in uneven spaced
# grids. The grid spacing can be
# controlled with custom values
# such as values from graph mappers.
preview_55 = CustomPreview(Geometry=paramrecgrid_2.Cells, Shader=ColourSwatch(SwatchColor=RGB(0, 0, 255)))
# Look at Rhino window
# to preview results
preview_56 = CustomPreview(
    Geometry=paramcrvdivsrf_2.CurvesV,
    Shader={ambient=RGB(0, 0, 0), diffuse=RGB(255, 105, 180), emission=RGB(76, 32, 54), shine=0.5, specular=RGB(255, 255, 255), transparency=0})
# Look at Rhino window
# to preview results
preview_57 = CustomPreview(
    Geometry=paramgridsrf_2.Points,
    Shader={ambient=RGB(0, 0, 0), diffuse=RGB(255, 105, 180), emission=RGB(76, 32, 54), shine=0.5, specular=RGB(255, 255, 255), transparency=0})
# Look at Rhino window
# to preview results
preview_58 = CustomPreview(
    Geometry=paramrecgrid_2.Points,
    Shader={ambient=RGB(0, 0, 0), diffuse=RGB(255, 105, 180), emission=RGB(76, 32, 54), shine=0.5, specular=RGB(255, 255, 255), transparency=0})
# Optional Refit and Sample Point
# match methods. Read input descriptions.
swatch_15 = ColourSwatch(SwatchColor=RGB(0, 0, 255))
crvspans_2 = CurveSpans(Curve=crv_86)  # -> SubDomains, Amount, Lengths, Degrees, Parameters
# Look at Rhino window
# to preview results
preview_59 = CustomPreview(Geometry=slidecrvcrv_2, Shader=ColourSwatch(SwatchColor=RGB(0, 0, 255)))
# Look at Rhino window
# to preview results
# Divisions along u results in iso curves along V.
# Divisions along v results in iso curves along U.
# Look at Rhino window
# to preview results
preview_60 = CustomPreview(Geometry=twn2crvscrv_2, Shader=ColourSwatch(SwatchColor=RGB(0, 0, 255)))
# Look at Rhino window
# to preview results
preview_61 = CustomPreview(Geometry=twnthrucrvscrv_2, Shader=swatch_15)
# Look at Rhino window
# to preview results
preview_62 = CustomPreview(Geometry=twnconcrvscrv_2, Shader=ColourSwatch(SwatchColor=RGB(0, 0, 255)))
# You can use the parameters with
# Grasshopper's Evaluate Curve
# component to extract the points
# between the spans.
eval_7 = EvaluateCurve(Curve=crv_86, Parameter=crvspans_2.Parameters)  # -> Point, Tangent, Angle
# You can use the sub-domains
# with Grasshopper's Sub Curve
# component to extract the spans
# as separate curves.
subcrv = SubCurve(BaseCurve=crv_86, Domain=crvspans_2.SubDomains)
# Splitting the list
number_slider_52 = Slider(-8.615, range=-20..20)
crv_87 = Curve(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)
# Optionally, you can use curve parameters
# instead of points. If both points and parameters
# are input the parameters will be used.
divide_2 = DivideCurve(Curve=crv_87, Count=Slider(16, range=0..100), Kinks=False)  # -> Points, Tangents, Parameters
panel_73 = Panel(subcrv)
panel_74 = Panel(eval_7.Point)
trimcrvpts_3 = TrimCurveWithPoints(Curve=crv_87, Parameters=divide_2.Parameters, Alternate=False)  # -> Trimmed, SubDomains
yz_3 = YZPlane(Origin=Point(656.1557064, 279.952923, 0))
X_2 = UnitX(Factor=number_slider_52)
# Switch iterative on and off to see
# the difference. Iterative aligning
# alignes each curves seam to the
# aligned seam of the previous curve
# in the list. If itaritive is false then all
# curve seams align directly to the start
# curves seam or the optional guide point.
toggle_16 = BooleanToggle(True)
crv_88 = Curve([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])
range_13 = Range(Domain=Domain(0, 1), Steps=Slider(10, range=0..10))
range_14 = Range(Domain=Domain(0, 1), Steps=Slider(10, range=0..10))
range_15 = Range(Domain=Domain(0, 1), Steps=Slider(10, range=0..10))
range_16 = Range(Domain=Domain(0, 1), Steps=Slider(10, range=0..10))
range_17 = Range(Domain=Domain(0, 1), Steps=Slider(10, range=0..10))
range_18 = Range(Domain=Domain(0, 1), Steps=Slider(10, range=0..10))
move_2 = Move(Geometry=yz_3, Motion=X_2)  # -> Geometry, Transform
S_5 = Surface(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)
rec_3 = Rectangle({Plane=PlaneXY(364.0304492, 229.9530635, 0), Size=Domain2(u=0..18.95352626, v=0..33.2196213)})
S_6 = Surface(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)
deplane_2 = DeconstructPlane(Plane=move_2.Geometry)  # -> Origin, XAxis, YAxis, ZAxis
# Look at Rhino window
# to preview results
preview_63 = CustomPreview(Geometry=trimcrvpts_3.Trimmed, Shader=ColourSwatch(SwatchColor=RGB(0, 0, 255)))
alicrvseams_3 = AlignCurveSeams(Curves=crv_88, Snap=False, Iterative=toggle_16)  # -> Aligned, Points, R
graph = GraphMapper(
    range_16,
    x0=0,
    x1=1,
    y0=0,
    y1=1,
    container_name="Bezier",
    cpx=[0, 0.7955461144, 0.533728838, 1],
    cpy=[0, 0.104544878, 0.4652709961, 1])
# Graphmappers creating gradient grid spacing.
graph_2 = GraphMapper(
    range_13,
    x0=0,
    x1=1,
    y0=0,
    y1=1,
    container_name="Bezier",
    cpx=[0, 0.161364466, 0.3795443475, 1],
    cpy=[0, 0.5532698631, 0.9518182874, 1])
graph_3 = GraphMapper(
    range_17,
    x0=0,
    x1=1,
    y0=0,
    y1=1,
    container_name="Bezier",
    cpx=[0, 0.7955461144, 0.533728838, 1],
    cpy=[0, 0.104544878, 0.4652709961, 1])
graph_4 = GraphMapper(
    range_18,
    x0=0,
    x1=1,
    y0=0,
    y1=1,
    container_name="Bezier",
    cpx=[0, 0.7955461144, 0.533728838, 1],
    cpy=[0, 0.104544878, 0.4652709961, 1])
# Graphmappers creating gradient grid spacing.
graph_5 = GraphMapper(
    range_14,
    x0=0,
    x1=1,
    y0=0,
    y1=1,
    container_name="Bezier",
    cpx=[0, 0.161364466, 0.3795443475, 1],
    cpy=[0, 0.5532698631, 0.9518182874, 1])
# Graphmappers creating gradient grid spacing.
graph_6 = GraphMapper(
    range_15,
    x0=0,
    x1=1,
    y0=0,
    y1=1,
    container_name="Bezier",
    cpx=[0, 0.161364466, 0.3795443475, 1],
    cpy=[0, 0.5532698631, 0.9518182874, 1])
rot3d_2 = Rotate3D(Geometry=move_2.Geometry, Angle=degrees(Slider(33, range=0..360)), Center=deplane_2.Origin, Axis=deplane_2.YAxis)  # -> Geometry, Transform
eval_8 = EvaluateCurve(Curve=reparameterize(crv_88), Parameter=0)  # -> Point, Tangent, Angle
crv_89 = Curve(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)
paramcrvdivsrf_3 = ParameterCurveDivideSurface(Surface=S_5, ParametersU=graph, ParametersV=graph_2)  # -> CurvesU, CurvesV
paramrecgrid_3 = ParameterRectangularGrid(Rectangle=rec_3, ParametersX=graph_4, ParametersY=graph_6)  # -> Cells, Points
paramgridsrf_3 = ParameterGridOnSurface(Surface=S_6, ParametersU=graph_3, ParametersV=graph_5)  # -> Cells, Points
# Look at Rhino window
# to preview results
panel_75 = Panel(alicrvseams_3.R)
# Original seams of the input curves,
preview_64 = CustomPreview(Geometry=alicrvseams_3.Aligned, Shader=ColourSwatch(SwatchColor=RGB(0, 0, 255)))
# Look at Rhino window
# to preview results
# Aligned seams
preview_65 = CustomPreview(Geometry=alicrvseams_3.Points, Shader=ColourSwatch(SwatchColor=RGB(0, 0, 255)))
# Look at Rhino window
# to preview results
# Using only one parameter input
# for one direction makes isocurve.
preview_66 = CustomPreview(Geometry=paramcrvdivsrf_3.CurvesU, Shader=ColourSwatch(SwatchColor=RGB(0, 0, 255)))
# Look at Rhino window
# to preview results
preview_67 = CustomPreview(Geometry=paramgridsrf_3.Cells, Shader=ColourSwatch(SwatchColor=RGB(0, 0, 255)))
# Look at Rhino window
# to preview results
preview_68 = CustomPreview(Geometry=paramrecgrid_3.Cells, Shader=ColourSwatch(SwatchColor=RGB(0, 0, 255)))
# Look at Rhino window
# to preview results
preview_69 = CustomPreview(
    Geometry=paramcrvdivsrf_3.CurvesV,
    Shader={ambient=RGB(0, 0, 0), diffuse=RGB(255, 105, 180), emission=RGB(76, 32, 54), shine=0.5, specular=RGB(255, 255, 255), transparency=0})
# Look at Rhino window
# to preview results
preview_70 = CustomPreview(
    Geometry=paramgridsrf_3.Points,
    Shader={ambient=RGB(0, 0, 0), diffuse=RGB(255, 105, 180), emission=RGB(76, 32, 54), shine=0.5, specular=RGB(255, 255, 255), transparency=0})
# Look at Rhino window
# to preview results
preview_71 = CustomPreview(
    Geometry=paramrecgrid_3.Points,
    Shader={ambient=RGB(0, 0, 0), diffuse=RGB(255, 105, 180), emission=RGB(76, 32, 54), shine=0.5, specular=RGB(255, 255, 255), transparency=0})
mircutcrv_2 = MirrorCutCurve(
    Curve=crv_89,
    MirrorPlane=rot3d_2.Geometry,
    Reach=Slider(5.36, range=0..10),
    Offset=Slider(1.676, range=0..10),
    Flip=Toggle(False),
    Join=Toggle(False),
    Keep=Toggle(False),
    ConnectionType=Slider(2, range=0..10),
    Bulge=Slider(0.313, range=-1..1))  # -> MirrorCut, SplitIndex, ReachPlane, OffsetPlane, Intersected
intcrv = Interpolate(Vertices=alicrvseams_3.Points, Degree=3, Periodic=False, KnotStyle=1)  # -> Curve, Length, Domain
split = SplitList(List=mircutcrv_2.MirrorCut, Index=mircutcrv_2.SplitIndex)  # -> ListA, ListB
# Using snap to snap aligned seams to corners
# Look at Rhino window
# to preview results
# Now the curve seams have a flowing
# orientation relationship along the set
# of curves in relation to eachother, rather
# than all facing the same direction in the
# world.
preview_72 = CustomPreview(
    Geometry=intcrv.Curve,
    Shader={ambient=RGB(0, 0, 0), diffuse=RGB(255, 105, 180), emission=RGB(76, 32, 54), shine=0.5, specular=RGB(255, 255, 255), transparency=0})
# If  join is false you can use this index
# to split the list at the mirror seam.
swatch_16 = ColourSwatch(SwatchColor=RGB(10, 22, 255))
preview_73 = CustomPreview(Geometry=split.ListA, Shader=ColourSwatch(SwatchColor=RGB(10, 255, 210)))
# Look at Rhino window
# to preview results
preview_74 = CustomPreview(Geometry=split.ListB, Shader=swatch_16)
S_7 = Surface(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)
paramcrvdivsrf_4 = ParameterCurveDivideSurface(Surface=S_7, ParametersU=Slider(0.375, range=0..1))  # -> CurvesU, CurvesV
# When snap is true, the seam alignes to
#  the closest corner for curves with corners.
# Toggle the boolean to see the difference.
toggle_17 = BooleanToggle(True)
crv_90 = Curve([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])
preview_75 = CustomPreview(
    Geometry=paramcrvdivsrf_4.CurvesV,
    Shader={ambient=RGB(0, 0, 0), diffuse=RGB(255, 105, 180), emission=RGB(76, 32, 54), shine=0.5, specular=RGB(255, 255, 255), transparency=0})
alicrvseams_4 = AlignCurveSeams(Curves=crv_90, Snap=toggle_17, Iterative=True)  # -> Aligned, Points, R
eval_9 = EvaluateCurve(Curve=reparameterize(crv_90), Parameter=0)  # -> Point, Tangent, Angle
# Look at Rhino window
# to preview results
panel_76 = Panel(alicrvseams_4.R)
# Look at Rhino window
# to preview results
# Aligned seams
preview_76 = CustomPreview(Geometry=alicrvseams_4.Points, Shader=ColourSwatch(SwatchColor=RGB(0, 0, 255)))
# Original seams of the input curves,
preview_77 = CustomPreview(Geometry=alicrvseams_4.Aligned, Shader=ColourSwatch(SwatchColor=RGB(0, 0, 255)))
