# Grasshopper definition Pf_07-Surface.gh (Grasshopper 0.9.76)
# plug-ins: Pufferfish

# 10-Loft Unsplit Surface
number_slider = Slider(100, range=0..100)
# 25-Extrude Tapered Polysurface
number_slider_2 = Slider(56, range=0..100)
# Change the slider value to move the
# mirror plane and see how it effects the
# mirror cutting.
# Change the slider value to rotate the
# mirror plane and see how it effects the
# mirror cutting.
number_slider_3 = Slider(10.125, range=-100..150)
# 29-Shell Polysurface
number_slider_4 = Slider(0, range=0..10)
# 11-Revolve Unsplit Surface
# Range of degrees to revolve
number_slider_5 = Slider(0, range=0..360)
# 17-Rebuild Surface
number_slider_6 = Slider(10, range=0..10)
# Change the slider value to move the
# mirror plane and see how it effects the
# mirror cutting.
# Change the slider value to rotate the
# mirror plane and see how it effects the
# mirror cutting.
number_slider_7 = Slider(4.849, range=-50..150)
# 16-Offset Surface
number_slider_8 = Slider(10, range=0..10)
# Srf @
# index 0
number_slider_9 = Slider(1.5, range=0..3)
# Unlike grasshoppers native iso
# trim component, this component uses
# parameter values along the u and v
# surface domains. Here we use range
# components to generate the lists
# of parameters. The native grasshopper
# component uses a division value which
# always makes an even grid on surface.
# By using parameter values there can be
# more customization of the grid spacing.
number_slider_10 = Slider(5, range=0..10)
# Ajust the weights, If one has all the weight
# then the result is that surface. If all have same
# weight then the result is same as average.
number_slider_11 = Slider(0.865, range=0..1)
# 20-Parameter Subdivide Surface
number_slider_12 = Slider(6, range=0..10)
# Loft types
# If you bake it, it will become
# a polysurface brep, or use the
# Split Kinky Surface component.
number_slider_13 = Slider(0, range=0..10)
# 03-Tween Two Surfaces
# Factor from 0 to 1 determines the surface
# between inputs. So 0.5 will be halfway
# between the inputs. You can use lists /
# mutiple factors as well.
number_slider_14 = Slider(0.5, range=0..1)
# 04-Tween Consecutive Surfaces
number_slider_15 = Slider(0.5, range=0..1)
# You can add more removal values to
# remove multiple faces but atleast one
# face must be removed for shelling.
number_slider_16 = Slider(9.899, range=0..15)
# Determines how the tween is interpolated.
# Factor from 0 to the last index. This
# can be considered like a timeline.
# This lets each surface have an equally
# controllable section of the slider between.
# As opposed to going from 0 to 1 where
# it would be hard to control with many inputs.
# This lets you easily pinpoint your location.
# You can use lists / mutiple factors as well.
number_slider_17 = Slider(0, range=0..3)
# True to transfer
# properties from
# reference to target
toggle = BooleanToggle(True)
# 22-Swap Surface Directions
toggle_2 = BooleanToggle(False)
# Change booleans to see how the
# UV directions of the surface change.
# 23-Trim Surface With Plane
toggle_3 = BooleanToggle(False)
# Determines how the tween is interpolated.
# Factor from 0 to 1 determines the surface
# between each input as a list. So 0.5 will
# be halfway between each input
# consecutively through the list.
# You can use lists / mutiple factors as well.
number_slider_18 = Slider(0, range=0..3)
# The surface that will get
# trimmed (turn its preview
# on to see the original surface)
# Can also be a polysurface
# Plane that trims
O = Origin(Point(799.3315675, 560.7123149, 0))
# Proportional scale factors for the
# input planes axes. Use same value
# for all for uniform scaling. These values
# are more like weights which balance with
# eachother like percentage overall, as
# opposed to traditional scale factors.
# They are proportional.
# The volume
# the geometry
# will scale to
number_slider_19 = Slider(0.631, range=0..1)
# 24-Constrained Volume Box
number_slider_20 = Slider(50000, range=0..50000)
# When the taper is outward you can
# have different corner options like
# rounded and smooth corners or sharp.
# Draft angle determines the taper,
# try negative value for outward taper
number_slider_21 = Slider(0, range=0..10)
# 27-Mesh To Polysurface
toggle_4 = BooleanToggle(False)
# Switch this boolean to true to
# merge coplanar faces into single faces.
# Be careful with this option on meshes
# with a lot of faces, it can be heavy.
# 28-Mirror Cut Polysurface
toggle_5 = BooleanToggle(False)
# Trimmed surface
srf = Surface(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)
# If true, a closed
# loft will be made
toggle_6 = BooleanToggle(False)
# Sections to loft
crv = Curve([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])
# 09-Extrude Unsplit Surface
# Profile to extrude
# Direction - can be Vector, Curve, or Point
crv_2 = Curve(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)
# 06-Automatic Edge Surface
# Edges that define
# the surface boundary
crv_3 = Curve([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])
# 07-Automatic Network Surface
# Curve network that
# defines the surface shape
# The surface curvature type,
# the difference is usually not noticable.
crv_4 = Curve([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])
# 08-Edge Unsplit Surface
# Edges that define
# the surface boundary
# If you bake it, it will become
# a polysurface brep, or use the
# Split Kinky Surface component.
crv_5 = Curve([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])
# One rail curve
# If you bake it, it will become
# a polysurface brep, or use the
# Split Kinky Surface component.
crv_6 = Curve(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)
# 21-Superimpose Surface
srf_2 = Surface(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)
srf_3 = Surface(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)
srf_4 = Surface(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)
# 26-Is Polysurface Closed
# Closed Polysurface
# Look at Rhino window
# to preview input
brep = Brep(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)
# Open Polysurface
# Look at Rhino window
# to preview input
brep_2 = Brep(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)
# 12-Sweep Unsplit Surface
# Sections to sweep
crv_7 = Curve([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])
# 13-Split Kinky Surface
srf_5 = Surface(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)
# 05-Tween Through Surfaces
srf_6 = Surface(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)
srf_7 = Surface(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)
srf_8 = Surface(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)
# Srf @
# index 3
# Srf @
# index 1
# Srf @
# index 2
srf_9 = Surface(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)
# 18-Reparameterize Surface
md_slider = MDSlider(slider_value=Point(0.5, 0.5, 0.5), SliderMode=0, x_domain=Domain(0, 1), y_domain=Domain(0, 1), z_domain=Domain(0, 1))
# 30-Is Surface Closed
# Surface with a
# closed side input
# Look at Rhino window
# to preview input
srf_10 = Surface(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)
# 02-Weighted Average Surface
# Multiple surfaces set here
srf_11 = Surface([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])
# 31-Is Surface Singular
# Surface with one edge
# collapsed, point 0 and 4
# overlap eachother
# Look at Rhino window
# to preview input
srf_12 = Surface(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)
# Pf_07-Surface
# 01-Average Surface
# Multiple surfaces set here
srf_13 = Surface([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])
# 15-Mirror Cut Surface
panel = Panel("1")
# 14-Fit Surface
# Surface with many
# unnecessary control
# points input
srf_14 = Surface(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)
mesh = Mesh(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)
# Same as setting reparmeterize of surface
# inputs/outputs but sometimes it is nice
# to have a seperate component
# 19-Shrink Trimmed Surface
srf_15 = Surface(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)
# Offset surface can do both sides and solid.
srf_16 = Surface(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)
yz = YZPlane(Origin=O)
srf_17 = Surface(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)
brep_3 = Brep(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)
srf_18 = Surface(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)
srf_19 = Surface(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)
srf_20 = Surface(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)
srf_21 = Surface(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)
srf_22 = Surface(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)
# Flips the mirror direction to
# cut the other side instead.
toggle_7 = BooleanToggle(False)
# 33-Is Surface Degree
# Look at Rhino window
# to preview input
srf_23 = Surface(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)
# 32-Is Surface Trimmed
# Trimmed surface
# Look at Rhino window
# to preview input
srf_24 = Surface(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)
# Untrimmed surface
# Look at Rhino window
# to preview input
srf_25 = Surface(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)
# Plane the rectangle is on
xy = XYPlane(Origin=Point(1387.067882, 345.9521907, 0))
# Plane
yz_2 = YZPlane(Origin=Point(520.4868808, 215.3928318, 0))
# Plane
yz_3 = YZPlane(Origin=Point(776.1584606, 222.8777354, 0))
X = UnitX(Factor=number_slider_3)
range = Range(Domain=Domain(0, 1), Steps=number_slider_10)
X_2 = UnitX(Factor=number_slider_7)
range_2 = Range(Domain=Domain(0, 1), Steps=number_slider_12)
Z = UnitZ(Factor=number_slider_2)
# Planar curve,
# closed or unclosed
crv_8 = Curve(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)
# True merges faces and removes corner
# faces made by the tapered extrude.
toggle_8 = BooleanToggle(True)
# Profile to revolve
crv_9 = Curve(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)
# Revolve axis
line = Line(Line((1052.357637, 1026.451159, 0), (1052.357637, 1026.451159, 95.88784566)))
srf_26 = Surface(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)
S = Surface(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)
# If you bake it, it will become
# a polysurface brep, or use the
# Split Kinky Surface component.
Z_2 = UnitZ(Factor=number_slider)
# The reach distance determines how
# far from the mirror plane that the cutting
# reaches. Anything within that distance
# from the mirror plane will be additionally
# cut away. Set it to zero and the cutting will
# only happen exactly at the mirror plane.
number_slider_22 = Slider(3.62, range=0..10)
# If you bake it, it will become
# a polysurface brep, or use the
# Split Kinky Surface component.
dom = ConstructDomain(DomainStart=number_slider_5, DomainEnd=Slider(250, range=0..360))
dom_2 = ConstructDomain(DomainStart=Slider(0, range=0..10), DomainEnd=Slider(5, range=0..10))
dom_3 = ConstructDomain(DomainStart=Slider(0, range=0..10), DomainEnd=Slider(10, range=0..10))
# Optional Refit and Sample Point
# match methods. Read input descriptions.
wavsrf = WeightedAverageSurface(Surfaces=srf_11, Weights=[Slider(0.64, range=0..1), Slider(0.658, range=0..1), number_slider_11], Refit=0, PointSample=0)
# Pufferfish
# By: Michael Pryor
# Optional Refit and Sample Point
# match methods. Read input descriptions.
avrsrf = AverageSurface(Surfaces=srf_13, Refit=0, PointSample=0)
msh2psrf = MeshToPolysurface(Mesh=mesh, Triangles=toggle_4, FaceMerge=toggle_5)
psrfclsd = IsPolysurfaceClosed(Polysurface=brep)
psrfclsd_2 = IsPolysurfaceClosed(Polysurface=brep_2)
reparamsrf = ReparameterizeSurface(Surface=srf_15)  # -> Reparameterized, OriginalU, OriginalV
swapsrfdir = SwapSurfaceDirections(Surface=srf_4, ReverseU=toggle_2, ReverseV=Toggle(False), SwapUV=toggle_3)
swpunsplit = SweepUnsplitSurface(Sections=crv_7, Rail1=crv_6)
supersrf = SuperimposeSurface(
    Reference=srf_2,
    Target=srf_3,
    PointsU=Toggle(True),
    PointsV=Toggle(True),
    DegreeU=Toggle(True),
    DegreeV=Toggle(True),
    DomainU=Toggle(True),
    DomainV=toggle)
offsrf = OffsetSurface(Surface=srf_16, Distance=number_slider_8, BothSides=Toggle(True), CreateSolid=Toggle(True))
splitkinkysrf = SplitKinkySurface(Surface=srf_5)  # -> Polysurface, R
fitsrf = FitSurface(Surface=srf_14, Tolerance=panel)  # -> Fitted, R
shellpsrf = ShellPolysurface(Polysurface=brep_3, Removal=number_slider_4, Thickness=number_slider_16, FaceMerge=False)
autonetsrf = AutomaticNetworkSurface(Network=crv_4, ContinuityType=Slider(1, range=0..10))
edgeunsplit = EdgeUnsplitSurface(Edges=crv_5)
shrinktrimsrf = ShrinkTrimmedSurface(Surface=srf)  # -> Shrunken, Underlying, R
loftunsplit = LoftUnsplitSurface(Sections=crv, Closed=toggle_6, LoftType=number_slider_13)
srfclsd = IsSurfaceClosed(Surface=srf_10)  # -> Closed, ClosedU, ClosedV
twn2srfs = TweenTwoSurfaces(SurfaceA=srf_18, SurfaceB=srf_19, Factor=number_slider_14, Refit=0, PointSample=0)
autoedgsrf = AutomaticEdgeSurface(Edges=crv_3)
srfsinglr = IsSurfaceSingular(Surface=srf_12)  # -> Singular0, Singular1, Singular2, Singular3
srfdeg = SurfaceDegree(Surface=srf_23)  # -> DegreeU, DegreeV
srftrimd = IsSurfaceTrimmed(Surface=srf_24)
srftrimd_2 = IsSurfaceTrimmed(Surface=srf_25)
# The offser distance determines how
# far to offset the cut. It does not do any
# additional cut removing like
# the reach plane, it just moves the
# actual cut away from the mirror plane.
# Set it to zero and there will be no
# additional gap in the mirror cut.
number_slider_23 = Slider(20, range=0..20)
move = Move(Geometry=yz_2, Motion=X)  # -> Geometry, Transform
move_2 = Move(Geometry=yz_3, Motion=X_2)  # -> Geometry, Transform
# Flips the mirror direction to
# cut the other side instead.
toggle_9 = BooleanToggle(False)
# Flips the mirror direction to
# cut the other side instead.
toggle_10 = BooleanToggle(False)
twnconsrfs = TweenConsecutiveSurfaces(Surfaces=[srf_20, srf_21, srf_22], Factor=number_slider_15, InterpolationType=number_slider_18, Refit=0, PointSample=0)
extrunsplit = ExtrudeUnsplitSurface(Profile=crv_2, Direction=Z_2)
extrtaper = ExtrudeTaperedPolysurface(Profile=crv_8, Direction=Z, Angle=Slider(15.12, range=-100..100), CornerType=number_slider_21, FaceMerge=toggle_8)
twnthrusrfs = TweenThroughSurfaces(
    Surfaces=[srf_6, srf_7, srf_8, srf_9],
    Factor=number_slider_9,
    InterpolationType=number_slider_17,
    Refit=0,
    PointSample=0)
revunsplit = RevolveUnsplitSurface(Profile=crv_9, Axis=line, Revolution=dom)
eval = EvaluateCurve(Curve=srf_15, Parameter=md_slider)  # -> Point, Tangent, Angle
paramsubdivsrf = ParameterSubdivideSurface(Surface=S, ParametersU=range_2, ParametersV=range)
trimsrfpln = TrimSurfaceWithPlane(Surface=srf_26, Plane=yz, Flip=toggle_7)  # -> Trimmed, R
consvolbox = ConstrainedVolumeBox(
    Plane=xy,
    Volume=number_slider_20,
    FactorX=Slider(0.165, range=0..1),
    FactorY=Slider(0.963, range=0..1),
    FactorZ=number_slider_19)  # -> Box, DimensionX, DimensionY, DimensionZ
panel_2 = Panel(reparamsrf.OriginalU)
# The surfaces original domains
panel_3 = Panel(reparamsrf.OriginalV)
# Using a polysurface brep
# that has some trimmed faces
panel_4 = Panel(srftrimd)
panel_5 = Panel(srftrimd_2)
panel_6 = Panel(psrfclsd)
panel_7 = Panel(psrfclsd_2)
# True if surface was fit
panel_8 = Panel(fitsrf.R)
srf_27 = Surface(swapsrfdir)
# The polysurface that will get
# mirror cut (turn its preview
# on to see the original polysurface)
# Using as the mirror plane
deplane = DeconstructPlane(Plane=move.Geometry)  # -> Origin, XAxis, YAxis, ZAxis
# Look at Rhino window
# to preview results
preview = CustomPreview(
    Geometry=wavsrf,
    Shader={ambient=RGB(0, 0, 0), diffuse=RGB(255, 105, 180), emission=RGB(76, 32, 54), shine=0.5, specular=RGB(255, 255, 255), transparency=0})
# The surface that will get
# mirror cut (turn its preview
# on to see the original surface)
# Using as the mirror plane
deplane_2 = DeconstructPlane(Plane=move_2.Geometry)  # -> Origin, XAxis, YAxis, ZAxis
# Look at Rhino window
# to preview results
preview_2 = CustomPreview(
    Geometry=avrsrf,
    Shader={ambient=RGB(0, 0, 0), diffuse=RGB(255, 105, 180), emission=RGB(76, 32, 54), shine=0.5, specular=RGB(255, 255, 255), transparency=0})
# Look at Rhino window
# to preview results
# Optional Refit and Sample Point
# match methods. Read input descriptions.
preview_3 = CustomPreview(
    Geometry=twn2srfs,
    Shader={ambient=RGB(0, 0, 0), diffuse=RGB(255, 105, 180), emission=RGB(76, 32, 54), shine=0.5, specular=RGB(255, 255, 255), transparency=0})
panel_9 = Panel(range_2)
panel_10 = Panel(range)
panel_11 = Panel(srfdeg.DegreeU)
panel_12 = Panel(srfdeg.DegreeV)
panel_13 = Panel(loftunsplit)
# The unsplit surface components
# make polysurface like single surfaces
# from kinked (polyline) curves so
# you can use surface components
# on them such as this divide surface
# component.
sdivide = DivideSurface(Surface=loftunsplit, UCount=10, VCount=10)  # -> Points, Normals, Parameters
# Look at Rhino window
# to preview results
preview_4 = CustomPreview(
    Geometry=loftunsplit,
    Shader={ambient=RGB(0, 0, 0), diffuse=RGB(255, 105, 180), emission=RGB(76, 32, 54), shine=0.5, specular=RGB(255, 255, 255), transparency=0})
panel_14 = Panel(shrinktrimsrf.R)
# Look at Rhino window
# to preview results
preview_5 = CustomPreview(
    Geometry=autoedgsrf,
    Shader={ambient=RGB(0, 0, 0), diffuse=RGB(255, 105, 180), emission=RGB(76, 32, 54), shine=0.5, specular=RGB(255, 255, 255), transparency=0})
# Look at Rhino window
# to preview results
preview_6 = CustomPreview(
    Geometry=autonetsrf,
    Shader={ambient=RGB(0, 0, 0), diffuse=RGB(255, 105, 180), emission=RGB(76, 32, 54), shine=0.5, specular=RGB(255, 255, 255), transparency=0})
panel_15 = Panel(edgeunsplit)
# The unsplit surface components
# make polysurface like single surfaces
# from kinked (polyline) curves so
# you can use surface components
# on them such as this divide surface
# component.
sdivide_2 = DivideSurface(Surface=edgeunsplit, UCount=10, VCount=10)  # -> Points, Normals, Parameters
# Look at Rhino window
# to preview results
preview_7 = CustomPreview(
    Geometry=edgeunsplit,
    Shader={ambient=RGB(0, 0, 0), diffuse=RGB(255, 105, 180), emission=RGB(76, 32, 54), shine=0.5, specular=RGB(255, 255, 255), transparency=0})
# Look at Rhino window
# to preview results
# The newly shrunk underlaying
# untrimmed surface. The output is hidden
# by default to not get in the way. Use a
# data component like it is done here
# to expose it in the viewport.
data = Data(shrinktrimsrf.Underlying)
panel_16 = Panel(splitkinkysrf.R)
preview_8 = CustomPreview(
    Geometry=shrinktrimsrf.Shrunken,
    Shader={ambient=RGB(0, 0, 0), diffuse=RGB(255, 105, 180), emission=RGB(76, 32, 54), shine=0.5, specular=RGB(255, 255, 255), transparency=0})
panel_17 = Panel(srfclsd.Closed)
# Just closed in this direction
panel_18 = Panel(srfclsd.ClosedU)
panel_19 = Panel(srfclsd.ClosedV)
panel_20 = Panel(splitkinkysrf.Polysurface)
# If true the entire input
# surface is mirrored
# normally if it is mirror
# cut into non existance.
# Also works for trimmed surfaces
# and surfaces with holes.
# Look at Rhino window
# to preview results
preview_9 = CustomPreview(
    Geometry=offsrf,
    Shader={ambient=RGB(0, 0, 0), diffuse=RGB(255, 105, 180), emission=RGB(76, 32, 54), shine=0.5, specular=RGB(255, 255, 255), transparency=0})
panel_21 = Panel(srfsinglr.Singular1)
panel_22 = Panel(srf_5)
# Look at Rhino window
# to preview results
preview_10 = CustomPreview(
    Geometry=msh2psrf,
    Shader={ambient=RGB(0, 0, 0), diffuse=RGB(255, 105, 180), emission=RGB(76, 32, 54), shine=0.5, specular=RGB(255, 255, 255), transparency=0})
panel_23 = Panel(srfsinglr.Singular0)
panel_24 = Panel(srfsinglr.Singular2)
# This edge is a singularity (collapsed)
panel_25 = Panel(srfsinglr.Singular3)
# Removing multiple faces.
# Look at Rhino window
# to preview results
preview_11 = CustomPreview(
    Geometry=shellpsrf,
    Shader={ambient=RGB(0, 0, 0), diffuse=RGB(255, 105, 180), emission=RGB(76, 32, 54), shine=0.5, specular=RGB(255, 255, 255), transparency=0})
panel_26 = Panel(swpunsplit)
rebsrf = RebuildSurface(
    Surface=srf_17,
    CountU=number_slider_6,
    CountV=Slider(10, range=0..10),
    DegreeU=Slider(3, range=0..10),
    DegreeV=Slider(3, range=0..10),
    DomainU=dom_2,
    DomainV=dom_3)
# The unsplit surface components
# make polysurface like single surfaces
# from kinked (polyline) curves so
# you can use surface components
# on them such as this divide surface
# component.
sdivide_3 = DivideSurface(Surface=swpunsplit, UCount=10, VCount=10)  # -> Points, Normals, Parameters
# Look at Rhino window
# to preview results
preview_12 = CustomPreview(
    Geometry=swpunsplit,
    Shader={ambient=RGB(0, 0, 0), diffuse=RGB(255, 105, 180), emission=RGB(76, 32, 54), shine=0.5, specular=RGB(255, 255, 255), transparency=0})
domain² = Domain²(srf_2)
domain²_2 = Domain²(supersrf)
# Look at Rhino window
# to preview results
preview_13 = CustomPreview(
    Geometry=supersrf,
    Shader={ambient=RGB(0, 0, 0), diffuse=RGB(255, 105, 180), emission=RGB(76, 32, 54), shine=0.5, specular=RGB(255, 255, 255), transparency=0})
panel_27 = Panel(trimsrfpln.R)
# This allows the start and end of the grid
# to be altered on the surface so grids can
# exist only on parts of the surface.
# Look at Rhino window
# to preview results
preview_14 = CustomPreview(
    Geometry=paramsubdivsrf,
    Shader={ambient=RGB(0, 0, 0), diffuse=RGB(255, 105, 180), emission=RGB(76, 32, 54), shine=0.5, specular=RGB(255, 255, 255), transparency=0})
# Look at Rhino window
# to preview results
# Optional Refit and Sample Point
# match methods. Read input descriptions.
preview_15 = CustomPreview(
    Geometry=twnthrusrfs,
    Shader={ambient=RGB(0, 0, 0), diffuse=RGB(255, 105, 180), emission=RGB(76, 32, 54), shine=0.5, specular=RGB(255, 255, 255), transparency=0})
# Look at Rhino window
# to preview results
# Optional Refit and Sample Point
# match methods. Read input descriptions.
preview_16 = CustomPreview(
    Geometry=twnconsrfs,
    Shader={ambient=RGB(0, 0, 0), diffuse=RGB(255, 105, 180), emission=RGB(76, 32, 54), shine=0.5, specular=RGB(255, 255, 255), transparency=0})
edges = BrepEdges(Brep=srf_27)  # -> Naked, Interior, NonManifold
panel_28 = Panel(extrunsplit)
# The unsplit surface components
# make polysurface like single surfaces
# from kinked (polyline) curves so
# you can use surface components
# on them such as this divide surface
# component.
sdivide_4 = DivideSurface(Surface=extrunsplit, UCount=10, VCount=10)  # -> Points, Normals, Parameters
# Look at Rhino window
# to preview results
preview_17 = CustomPreview(
    Geometry=extrunsplit,
    Shader={ambient=RGB(0, 0, 0), diffuse=RGB(255, 105, 180), emission=RGB(76, 32, 54), shine=0.5, specular=RGB(255, 255, 255), transparency=0})
panel_29 = Panel(revunsplit)
# The unsplit surface components
# make polysurface like single surfaces
# from kinked (polyline) curves so
# you can use surface components
# on them such as this divide surface
# component.
sdivide_5 = DivideSurface(Surface=revunsplit, UCount=10, VCount=10)  # -> Points, Normals, Parameters
# Look at Rhino window
# to preview results
preview_18 = CustomPreview(
    Geometry=revunsplit,
    Shader={ambient=RGB(0, 0, 0), diffuse=RGB(255, 105, 180), emission=RGB(76, 32, 54), shine=0.5, specular=RGB(255, 255, 255), transparency=0})
# Look at Rhino window
# to preview results
preview_19 = CustomPreview(
    Geometry=fitsrf.Fitted,
    Shader={ambient=RGB(0, 0, 0), diffuse=RGB(255, 105, 180), emission=RGB(76, 32, 54), shine=0.5, specular=RGB(255, 255, 255), transparency=0})
panel_30 = Panel(consvolbox.DimensionX)
# Result dimensions
panel_31 = Panel(consvolbox.DimensionY)
panel_32 = Panel(consvolbox.DimensionZ)
# Look at Rhino window
# to preview results
preview_20 = CustomPreview(
    Geometry=extrtaper,
    Shader={ambient=RGB(0, 0, 0), diffuse=RGB(255, 105, 180), emission=RGB(76, 32, 54), shine=0.5, specular=RGB(255, 255, 255), transparency=0})
volume = Volume(Geometry=consvolbox.Box)  # -> Volume, Centroid
rot3d = Rotate3D(Geometry=move.Geometry, Angle=degrees(Slider(44, range=0..360)), Center=deplane.Origin, Axis=deplane.YAxis)  # -> Geometry, Transform
rot3d_2 = Rotate3D(Geometry=move_2.Geometry, Angle=degrees(Slider(32, range=0..360)), Center=deplane_2.Origin, Axis=deplane_2.YAxis)  # -> Geometry, Transform
# Domains
panel_33 = Panel(domain²)
# Domains
panel_34 = Panel(domain²_2)
# Then untrimmed kinky surface
# became a Polysurface (Brep)
# Look at Rhino window
# to preview results
preview_21 = CustomPreview(
    Geometry=splitkinkysrf.Polysurface,
    Shader={ambient=RGB(0, 0, 0), diffuse=RGB(255, 105, 180), emission=RGB(76, 32, 54), shine=0.5, specular=RGB(255, 255, 255), transparency=0})
# When surface is not reparameterized you
# can't evaluate from 0 to 1
md_slider_2 = MDSlider(slider_value=Point(0.5, 0.5, 0.5), SliderMode=0, x_domain=Domain(0, 1), y_domain=Domain(0, 1), z_domain=Domain(0, 1))
srfpt = SurfacePoints(Surface=srf)  # -> Points, Weights, Greville, UCount, VCount
srfpt_2 = SurfacePoints(Surface=shrinktrimsrf.Shrunken)  # -> Points, Weights, Greville, UCount, VCount
# Look at Rhino window
# to preview results
preview_22 = CustomPreview(Geometry=trimsrfpln.Trimmed, Shader=ColourSwatch(SwatchColor=RGB(0, 0, 255)))
item = ListItem(List=edges.Naked, Index=0, Wrap=True)
# Join makes the
# two mirror sides
# into one surface.
toggle_11 = BooleanToggle(False)
# Join makes the
# two mirror sides
# into one polysurface.
# If true the entire input
# polysurface is mirrored
# normally if it is mirror
# cut into non existance.
toggle_12 = BooleanToggle(False)
# Look at Rhino window
# to preview results
preview_23 = CustomPreview(
    Geometry=consvolbox.Box,
    Shader={ambient=RGB(0, 0, 0), diffuse=RGB(255, 105, 180), emission=RGB(76, 32, 54), shine=0.5, specular=RGB(255, 255, 255), transparency=0})
# Result volume matches
# input volume exactly
panel_35 = Panel(volume.Volume)
brep_4 = Brep(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)
srf_28 = Surface(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)
domain²_3 = Domain²(rebsrf)
# View new control points
srfpt_3 = SurfacePoints(Surface=rebsrf)  # -> Points, Weights, Greville, UCount, VCount
# Look at Rhino window
# to preview results
preview_24 = CustomPreview(
    Geometry=rebsrf,
    Shader={ambient=RGB(0, 0, 0), diffuse=RGB(255, 105, 180), emission=RGB(76, 32, 54), shine=0.5, specular=RGB(255, 255, 255), transparency=0})
end = EndPoints(Curve=item)  # -> Start, End
evalsrf = EvaluateSurface(Surface=reparamsrf.Reparameterized, Point=md_slider_2)  # -> Point, Normal, Frame
pipe = Pipe(Curve=item, Radius=1, Caps=0)
# Bulge factor for the connection surface
# When mirror cuts have a reach or offset
# that is not zero, they can create a connection
# surface between the mirror cut sides, which
# blends them together. There are various types.
number_slider_24 = Slider(0.313, range=-1..1)
# Domains
panel_36 = Panel(domain²_3)
# Bulge factor for the connection surface
# When mirror cuts have a reach or offset
# that is not zero, they can create a connection
# polysurface between the mirror cut sides, which
# blends them together. There are various types.
number_slider_25 = Slider(-0.173, range=-1..1)
# Look at Rhino window
# to preview results
# Control points after shrinking
preview_25 = CustomPreview(Geometry=srfpt_2.Points, Shader=ColourSwatch(SwatchColor=RGB(30, 255, 0)))
# Look at Rhino window
# to preview results
# Control points before shrinking
preview_26 = CustomPreview(Geometry=srfpt.Points, Shader=ColourSwatch(SwatchColor=RGB(0, 98, 255)))
# Visual representation of the directions
# reversing and swapping.
sph = Sphere(Base=end.Start, Radius=5)
# Brep that has
# trimmed faces
# Look at Rhino window
# to preview input
brep_5 = Brep(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)
mircutsrf = MirrorCutSurface(
    Surface=srf_28,
    MirrorPlane=rot3d_2.Geometry,
    Reach=number_slider_22,
    Offset=number_slider_23,
    Flip=toggle_10,
    Join=Toggle(True),
    Keep=toggle_11,
    ConnectionType=Slider(1, range=0..10),
    Bulge=number_slider_24)  # -> MirrorCut, SplitIndex, ReachPlane, OffsetPlane, Intersected
mircutpsrf = MirrorCutPolysurface(
    Polysurface=brep_4,
    MirrorPlane=rot3d.Geometry,
    Reach=Slider(3.62, range=0..10),
    Offset=Slider(20, range=0..20),
    Flip=toggle_9,
    Join=Toggle(True),
    Keep=toggle_12,
    ConnectionType=Slider(1, range=0..10),
    Bulge=number_slider_25)  # -> MirrorCut, SplitIndex, ReachPlane, OffsetPlane, Intersected
# Switch this boolean to true to merge
# coplanar faces into single faces.
# Be careful with this option with a lot
# of coplanar faces, it can be heavy.
number_slider_26 = Slider(9.899, range=0..15)
# Adjusting the start and end domains
# of the ranges positions the grid on
# specified parts of the surface.
number_slider_27 = Slider(0.537, range=0..1)
# Look at Rhino window
# to preview results
preview_27 = CustomPreview(Geometry=evalsrf.Point, Shader=ColourSwatch(SwatchColor=RGB(0, 0, 255)))
srftrimd_3 = IsSurfaceTrimmed(Surface=brep_5)
srf_29 = Surface(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)
brep_6 = Brep(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)
panel_37 = Panel(mircutpsrf.Intersected)
panel_38 = Panel(mircutsrf.Intersected)
# Sphere which is a
# fully closed surface
# Fully closed surface
# Look at Rhino window
# to preview input
srf_30 = Surface(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)
# True are faces that are trimmed
panel_39 = Panel(srftrimd_3)
# Look at Rhino window
# to preview results
preview_28 = CustomPreview(Geometry=[pipe, sph], Shader=ColourSwatch(SwatchColor=RGB(0, 98, 255)))
debrep = DeconstructBrep(Brep=brep_5)  # -> Faces, Edges, Vertices
offsrf_2 = OffsetSurface(Surface=srf_29, Distance=Slider(10, range=0..10), BothSides=Toggle(True), CreateSolid=Toggle(True))
shellpsrf_2 = ShellPolysurface(
    Polysurface=brep_6,
    Removal=[Slider(0, range=0..10), Slider(1, range=0..10), Slider(2, range=0..10)],
    Thickness=number_slider_26,
    FaceMerge=Toggle(False))
# Look at Rhino window
# to preview results
# Result mirror cut polysurface
preview_29 = CustomPreview(
    Geometry=mircutpsrf.MirrorCut,
    Shader={ambient=RGB(0, 0, 0), diffuse=RGB(255, 105, 180), emission=RGB(76, 32, 54), shine=0.5, specular=RGB(255, 255, 255), transparency=0})
preview_30 = CustomPreview(Geometry=mircutpsrf.ReachPlane, Shader=ColourSwatch(SwatchColor=RGB(10, 255, 210)))
# Reach plane (this plane essentially does the cutting)
# Offset plane (offsets the cuts from the mirror plane)
preview_31 = CustomPreview(Geometry=mircutpsrf.OffsetPlane, Shader=ColourSwatch(SwatchColor=RGB(10, 22, 255)))
# Look at Rhino window
# to preview results
# Result mirror cut surface
preview_32 = CustomPreview(
    Geometry=mircutsrf.MirrorCut,
    Shader={ambient=RGB(0, 0, 0), diffuse=RGB(255, 105, 180), emission=RGB(76, 32, 54), shine=0.5, specular=RGB(255, 255, 255), transparency=0})
# Reach plane (this plane essentially does the cutting)
preview_33 = CustomPreview(Geometry=mircutsrf.ReachPlane, Shader=ColourSwatch(SwatchColor=RGB(10, 255, 210)))
# Offset plane (offsets the cuts from the mirror plane)
preview_34 = CustomPreview(Geometry=mircutsrf.OffsetPlane, Shader=ColourSwatch(SwatchColor=RGB(10, 22, 255)))
dom_4 = ConstructDomain(DomainStart=Slider(0.25, range=0..1), DomainEnd=Slider(0.801, range=0..1))
dom_5 = ConstructDomain(DomainStart=Slider(0.13, range=0..1), DomainEnd=number_slider_27)
# Two rail curves
crv_10 = Curve(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)
# Two rail curve
crv_11 = Curve(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)
# Sections to sweep
crv_12 = Curve([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])
cull = CullPattern(List=debrep.Faces, CullPattern=srftrimd_3)
srfclsd_2 = IsSurfaceClosed(Surface=srf_30)  # -> Closed, ClosedU, ClosedV
range_3 = Range(Domain=dom_5, Steps=Slider(5, range=0..10))
range_4 = Range(Domain=dom_4, Steps=Slider(6, range=0..10))
# Profile to extrude
crv_13 = Curve(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)
# Extrude along curve
# Curve to extrude along
crv_14 = Curve(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)
S_2 = Surface(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)
# Look at Rhino window
# to preview results
preview_35 = CustomPreview(
    Geometry=offsrf_2,
    Shader={ambient=RGB(0, 0, 0), diffuse=RGB(255, 105, 180), emission=RGB(76, 32, 54), shine=0.5, specular=RGB(255, 255, 255), transparency=0})
# Look at Rhino window
# to preview results
preview_36 = CustomPreview(
    Geometry=shellpsrf_2,
    Shader={ambient=RGB(0, 0, 0), diffuse=RGB(255, 105, 180), emission=RGB(76, 32, 54), shine=0.5, specular=RGB(255, 255, 255), transparency=0})
swpunsplit_2 = SweepUnsplitSurface(Sections=crv_12, Rail1=crv_10, Rail2=crv_11)
# Extract the trimmed faces
# Look at Rhino window
# to preview results
preview_37 = CustomPreview(
    Geometry=cull,
    Shader={ambient=RGB(0, 0, 0), diffuse=RGB(255, 105, 180), emission=RGB(76, 32, 54), shine=0.5, specular=RGB(255, 255, 255), transparency=0})
# A sphere for instance is a
# fully closed surface as solid
panel_40 = Panel(srfclsd_2.Closed)
panel_41 = Panel(srfclsd_2.ClosedV)
panel_42 = Panel(srfclsd_2.ClosedU)
extrunsplit_2 = ExtrudeUnsplitSurface(Profile=crv_13, Direction=crv_14)
paramsubdivsrf_2 = ParameterSubdivideSurface(Surface=S_2, ParametersU=range_4, ParametersV=range_3)
sdivide_6 = DivideSurface(Surface=swpunsplit_2, UCount=10, VCount=10)  # -> Points, Normals, Parameters
# Look at Rhino window
# to preview results
preview_38 = CustomPreview(
    Geometry=swpunsplit_2,
    Shader={ambient=RGB(0, 0, 0), diffuse=RGB(255, 105, 180), emission=RGB(76, 32, 54), shine=0.5, specular=RGB(255, 255, 255), transparency=0})
panel_43 = Panel(swpunsplit_2)
# Using unevenly spaced parameter
# values will result in uneven spaced
# grids. The grid spacing can be
# controlled with custom values
# such as values from graph mappers.
# Look at Rhino window
# to preview results
preview_39 = CustomPreview(
    Geometry=paramsubdivsrf_2,
    Shader={ambient=RGB(0, 0, 0), diffuse=RGB(255, 105, 180), emission=RGB(76, 32, 54), shine=0.5, specular=RGB(255, 255, 255), transparency=0})
sdivide_7 = DivideSurface(Surface=extrunsplit_2, UCount=10, VCount=10)  # -> Points, Normals, Parameters
# Look at Rhino window
# to preview results
preview_40 = CustomPreview(
    Geometry=extrunsplit_2,
    Shader={ambient=RGB(0, 0, 0), diffuse=RGB(255, 105, 180), emission=RGB(76, 32, 54), shine=0.5, specular=RGB(255, 255, 255), transparency=0})
panel_44 = Panel(extrunsplit_2)
# Splitting the list
number_slider_28 = Slider(-8.615, range=-20..20)
# Splitting the list
number_slider_29 = Slider(-8.615, range=-20..20)
yz_4 = YZPlane(Origin=Point(530.4016103, 400.3952381, 0))
range_5 = Range(Domain=Domain(0, 1), Steps=Slider(10, range=0..10))
yz_5 = YZPlane(Origin=Point(772.8575256, 394.8681756, 0))
range_6 = Range(Domain=Domain(0, 1), Steps=Slider(10, range=0..10))
X_3 = UnitX(Factor=number_slider_28)
X_4 = UnitX(Factor=number_slider_29)
S_3 = Surface(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)
# Profile to extrude
crv_15 = Curve(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)
# Extrude to point
# Point to extrude to
pt = Point(Point(1293.711271, 730.3317257, 88.97271923))
move_3 = Move(Geometry=yz_4, Motion=X_3)  # -> Geometry, Transform
move_4 = Move(Geometry=yz_5, Motion=X_4)  # -> Geometry, Transform
graph = GraphMapper(
    range_6,
    x0=0,
    x1=1,
    y0=0,
    y1=1,
    container_name="Bezier",
    cpx=[0, 0.7955461144, 0.533728838, 1],
    cpy=[0, 0.104544878, 0.4652709961, 1])
# Graphmappers creating gradient grid spacing.
graph_2 = GraphMapper(
    range_5,
    x0=0,
    x1=1,
    y0=0,
    y1=1,
    container_name="Bezier",
    cpx=[0, 0.161364466, 0.3795443475, 1],
    cpy=[0, 0.5532698631, 0.9518182874, 1])
extrunsplit_3 = ExtrudeUnsplitSurface(Profile=crv_15, Direction=pt)
deplane_3 = DeconstructPlane(Plane=move_3.Geometry)  # -> Origin, XAxis, YAxis, ZAxis
deplane_4 = DeconstructPlane(Plane=move_4.Geometry)  # -> Origin, XAxis, YAxis, ZAxis
sdivide_8 = DivideSurface(Surface=extrunsplit_3, UCount=10, VCount=10)  # -> Points, Normals, Parameters
# Look at Rhino window
# to preview results
preview_41 = CustomPreview(
    Geometry=extrunsplit_3,
    Shader={ambient=RGB(0, 0, 0), diffuse=RGB(255, 105, 180), emission=RGB(76, 32, 54), shine=0.5, specular=RGB(255, 255, 255), transparency=0})
panel_45 = Panel(extrunsplit_3)
paramsubdivsrf_3 = ParameterSubdivideSurface(Surface=S_3, ParametersU=graph, ParametersV=graph_2)
rot3d_3 = Rotate3D(Geometry=move_3.Geometry, Angle=degrees(Slider(48, range=0..360)), Center=deplane_3.Origin, Axis=deplane_3.YAxis)  # -> Geometry, Transform
rot3d_4 = Rotate3D(Geometry=move_4.Geometry, Angle=degrees(Slider(33, range=0..360)), Center=deplane_4.Origin, Axis=deplane_4.YAxis)  # -> Geometry, Transform
srf_31 = Surface(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)
brep_7 = Brep(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)
# Look at Rhino window
# to preview results
preview_42 = CustomPreview(
    Geometry=paramsubdivsrf_3,
    Shader={ambient=RGB(0, 0, 0), diffuse=RGB(255, 105, 180), emission=RGB(76, 32, 54), shine=0.5, specular=RGB(255, 255, 255), transparency=0})
mircutsrf_2 = MirrorCutSurface(
    Surface=srf_31,
    MirrorPlane=rot3d_4.Geometry,
    Reach=Slider(5.36, range=0..10),
    Offset=Slider(1.676, range=0..10),
    Flip=Toggle(False),
    Join=Toggle(False),
    Keep=Toggle(False),
    ConnectionType=Slider(2, range=0..10),
    Bulge=Slider(0.313, range=-1..1))  # -> MirrorCut, SplitIndex, ReachPlane, OffsetPlane, Intersected
mircutpsrf_2 = MirrorCutPolysurface(
    Polysurface=brep_7,
    MirrorPlane=rot3d_3.Geometry,
    Reach=Slider(5.36, range=0..10),
    Offset=Slider(1.676, range=0..10),
    Flip=Toggle(False),
    Join=Toggle(False),
    Keep=Toggle(False),
    ConnectionType=Slider(2, range=0..10),
    Bulge=Slider(0.006, range=-1..1))  # -> MirrorCut, SplitIndex, ReachPlane, OffsetPlane, Intersected
split = SplitList(List=mircutpsrf_2.MirrorCut, Index=mircutpsrf_2.SplitIndex)  # -> ListA, ListB
split_2 = SplitList(List=mircutsrf_2.MirrorCut, Index=mircutsrf_2.SplitIndex)  # -> ListA, ListB
# If  join is false you can use this index
# to split the list at the mirror seam.
swatch = ColourSwatch(SwatchColor=RGB(10, 22, 255))
# If  join is false you can use this index
# to split the list at the mirror seam.
swatch_2 = ColourSwatch(SwatchColor=RGB(10, 22, 255))
preview_43 = CustomPreview(Geometry=split.ListA, Shader=ColourSwatch(SwatchColor=RGB(10, 255, 210)))
# Look at Rhino window
# to preview results
preview_44 = CustomPreview(Geometry=split.ListB, Shader=swatch)
preview_45 = CustomPreview(Geometry=split_2.ListA, Shader=ColourSwatch(SwatchColor=RGB(10, 255, 210)))
# Look at Rhino window
# to preview results
preview_46 = CustomPreview(Geometry=split_2.ListB, Shader=swatch_2)
