# Grasshopper definition Pf_ClosestVectorLoopsSpaceFilling - Requires Anemone Plugin.gh (Grasshopper 0.9.76)
# plug-ins: Pufferfish, Anemone

# ---- group: Spin force random location
number_slider = Slider(20, range=0..100)
number_slider_2 = Slider(38.667, range=0..100)
number_slider_3 = Slider(20, range=0..100)
number_slider_4 = Slider(4, range=0..50)
box = CenterBox(Base=PlaneXY(0, 0, 0), X=number_slider_2, Y=number_slider_2, Z=number_slider_2)
pop3d = Populate3D(Region=box, Count=number_slider_4, Seed=Slider(467, range=0..1000))

# ---- group: Field start random location points
# Pufferfish
# By: Michael Pryor
# Pf_Closest Vector Loops Space Filling
# Closest Vector Fields
number_slider_5 = Slider(20, range=0..100)
# Just generating some vector field here to get some movement,
# you can make "swarm" type vectors anyway you like
# - for instance using the Boids plug-in
number_slider_6 = Slider(644, range=0..1000)
box_2 = CenterBox(Base=PlaneXY(0, 0, 0), X=number_slider_5, Y=Slider(20, range=0..100), Z=Slider(20, range=0..100))
pop3d_2 = Populate3D(Region=box_2, Count=Slider(1000, range=0..1000), Seed=number_slider_6)

# ---- group: random spin rotation axis 1
degree = Slider(308, range=0..360)
degree_2 = Slider(214.8, range=0..360)
dom = ConstructDomain(DomainStart=degree, DomainEnd=degree_2)
random = Random(Range=dom, Number=number_slider_4, Seed=Slider(544, range=0..1000))

# ---- group: random spin rotation axis 2
degree_3 = Slider(0, range=0..360)
degree_4 = Slider(0, range=0..360)
dom_2 = ConstructDomain(DomainStart=degree_3, DomainEnd=degree_4)
random_2 = Random(Range=dom_2, Number=number_slider_4, Seed=Slider(655, range=0..1000))

# ---- group: random spin strength
charge = Slider(0.3, range=-50..50)
charge_2 = Slider(0.1, range=-50..50)
dom_3 = ConstructDomain(DomainStart=charge, DomainEnd=charge_2)
random_3 = Random(Range=dom_3, Number=number_slider_4, Seed=Slider(645, range=0..1000))

# ---- group: random spin radius
charge_3 = Slider(15, range=-15..50)
charge_4 = Slider(15, range=-15..50)
dom_4 = ConstructDomain(DomainStart=charge_3, DomainEnd=charge_4)
random_4 = Random(Range=dom_4, Number=number_slider_4, Seed=Slider(587, range=0..1000))

# ---- group: random spin decay
charge_5 = Slider(7, range=-15..15)
charge_6 = Slider(7, range=-15..15)
dom_5 = ConstructDomain(DomainStart=charge_6, DomainEnd=charge_5)
random_5 = Random(Range=dom_5, Number=number_slider_4, Seed=Slider(665, range=0..1000))

# ----
# Double Click Loop Start to Run Loop
number_slider_7 = Slider(15, range=0..1000)

# ---- group: Rotation axis 1
xz = XZPlane(Origin=pop3d)
yz = YZPlane(Origin=pop3d)
rotate = Rotate(Geometry=xz, Angle=degrees(random), Plane=yz)  # -> Geometry, Transform

# ---- group: Rotation axis 2
xy = XYPlane(Origin=rotate.Geometry)
rotate_2 = Rotate(Geometry=rotate.Geometry, Angle=degrees(random_2), Plane=xy)  # -> Geometry, Transform

# ---- group: Loop Start (double click to run loop)
loop_start = LoopStart(Repeat=number_slider_7, Trigger=Toggle(False), Data=pop3d_2)  # -> port, Counter, Data

# ----
panel = Panel(loop_start.Counter)

# ---- group: Spin force
fspin = SpinForce(Plane=rotate_2.Geometry, Strength=random_3, Radius=random_4, Decay=random_5)

# ---- group: Merge and evaluate field
mergef = MergeFields(Fields=fspin)
evf = EvaluateField(Field=mergef, Point=loop_start.Data)  # -> Tensor, Strength

# ----
# Closest vector and vector star
number_slider_8 = Slider(1, range=0..10)
vec = Vector(evf.Tensor)
vecstar = VectorStar(Plane=PlaneXY(0, 0, 0), Resolution=number_slider_8, StarType=0, Dimensionality=False)  # -> Vectors, Lines
# Switch between continuous
# and discrete vectors
number_slider_9 = Slider(1, range=0..1)
# Look at Rhino window
# to preview results
cvec = ClosestVector(Reference=vec, Targets=vecstar.Vectors, KeepLength=False)  # -> Closest, Index, Angle
filter = StreamFilter(Gate=number_slider_9, Stream0=vec, Stream1=cvec.Closest)

# ---- group: Move point in field
amp = Amplitude(Vector=filter, Amplitude=Slider(2, range=0..5))
move = Move(Geometry=loop_start.Data, Motion=amp)  # -> Geometry, Transform

# ----
geometry_to_fill = Geometry(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)

# ---- group: Keep in geometry
brepinc = PointInBrep(Brep=geometry_to_fill, Point=move.Geometry, Strict=True)
sift = SiftPattern(List=move.Geometry, SiftPattern=brepinc)  # -> Output0, Output1
data = Data(sift.Output0)
data_2 = Data(sift.Output1)
pull = PullPoint(Point=data, Geometry=geometry_to_fill, ClosestOnly=True)  # -> ClosestPoint, Distance
combine = CombineData(Input0=pull.ClosestPoint, Input1=data_2)  # -> Result, Index

# ----
loop_end = LoopEnd(port=loop_start.port, Exit=False, Data=combine.Result, pausedState=False, state="Constant & Record", TimeOutVal=0)

# ---- group: Make curves
flip = FlipMatrix(Data=loop_end)
pline = PolyLine(Vertices=flip, Closed=False)
simplify = SimplifyCurve(Curve=pline)  # -> Curve, Simplified

# ----
# Look at Rhino window
# to preview results
preview = CustomPreview(Geometry=simplify.Curve, Shader=ColourSwatch(SwatchColor=RGB(17, 20, 189)))
