# Grasshopper definition Pf_MirrorCutMeshArray - Requires Anemone Plugin.gh (Grasshopper 0.9.76)
# plug-ins: Pufferfish, Anemone

# Pf_Mirror Cut Mesh Array
# Double Click Loop Start to Run Loop
# Number of versions to create
number_slider = Slider(10, range=0..100)

# ---- group: Loop Start (double click to run loop)
# Pufferfish
# By: Michael Pryor
loop_start = LoopStart(Repeat=number_slider)  # -> port, Counter, Data

# ---- group: Random values for rotation
dom = ConstructDomain(DomainStart="0", DomainEnd="1080")
addition = Addition(A=loop_start.Counter, B=[Slider(5, range=0..10), Slider(4, range=0..10)])
random = Random(Range=dom, Number=1, Seed=addition)
bang = ExplodeTree(Data=random)  # -> Branch0, Branch1

# ----
panel = Panel(loop_start.Counter)

# ---- group: Mesh to mirror cut
mbox = MeshBox(Base={Plane=PlaneXY(0, 0, 0), X=Domain(-10, 10), Y=Domain(-10, 10), Z=Domain(-10, 10)}, XCount=10, YCount=10, ZCount=10)

# ---- group: Rotate mirror cut plane
volume = Volume(Geometry=mbox)  # -> Volume, Centroid
xy = XYPlane(Origin=volume.Centroid)
yz = YZPlane(Origin=volume.Centroid)
# Here we use keep as true, in case
# the mirror cuts the mesh into non
# existance in any of the loops, then
# we wont get a null but will still get
# a mesh to keep cutting with.
xz = XZPlane(Origin=volume.Centroid)
rotate = Rotate(Geometry=xy, Angle=degrees(bang.Branch1), Plane=yz)  # -> Geometry, Transform
rotate_2 = Rotate(Geometry=rotate.Geometry, Angle=degrees(bang.Branch0), Plane=xz)  # -> Geometry, Transform

# ---- group: Mirror Cut Mesh Options
number_slider_2 = Slider(2, range=0..10)
number_slider_3 = Slider(4, range=0..10)
number_slider_4 = Slider(4.09, range=0..100)
number_slider_5 = Slider(4.368, range=0..10)
number_slider_6 = Slider(-0.634, range=-1..1)
toggle = BooleanToggle(False)
toggle_2 = BooleanToggle(True)

# ---- group: Move mirror cut plane
move = Move(Geometry=rotate_2.Geometry, Motion=Vector(0, 0, 10))  # -> Geometry, Transform

# ----
mircutmsh = MirrorCutMesh(
    Mesh=mbox,
    MirrorPlane=move.Geometry,
    Reach=number_slider_5,
    Offset=number_slider_4,
    Flip=toggle,
    Join=toggle_2,
    Keep=Toggle(True),
    ConnectionType=number_slider_2,
    Bulge=number_slider_6,
    Divisions=number_slider_3,
    WeldTolerance=0.01)  # -> MirrorCut, SplitIndex, ReachPlane, OffsetPlane, Intersected
loop_end = LoopEnd(port=loop_start.port, Exit=False, Data=mircutmsh.MirrorCut, pausedState=False, state="Last & Record", TimeOutVal=0)  # -> flatten(Data)

# ---- group: Line up versions along array
number_slider_7 = Slider(36, range=0..100)
lng = ListLength(List=loop_end)
series = Series(Start=number_slider_7, Step=number_slider_7, Count=lng)
X = UnitX(Factor=series)
move_2 = Move(Geometry=loop_end, Motion=X)  # -> Geometry, Transform

# ---- group: Mesh smoothing
msmooth = SmoothMesh(Mesh=move_2.Geometry, Strength=Slider(0.415, range=0..1), SkipNaked=True, Iterations=Slider(10, range=0..10))

# ---- group: Result Preview
preview = CustomPreview(
    Geometry=msmooth,
    Shader={ambient=RGB(0, 0, 0), diffuse=RGB(255, 105, 180), emission=RGB(76, 32, 54), shine=0.5, specular=RGB(255, 255, 255), transparency=0})
