# Grasshopper definition Pf_TwistedBoxArrayInGeometry.gh (Grasshopper 0.9.76)
# plug-ins: Pufferfish

# ---- group: Rotate the twisted box array orientation
# Rotating the plane for the bounding box
# will allow the array to orient in different ways.
number_slider = Slider(314, range=0..1000)
# Pf_Twisted Box Array In Geometry
xy = XYPlane(Origin=Point(0, 0, 0))
rotate = Rotate(Geometry=xy, Angle=degrees(Slider(341, range=0..1000)), Plane=PlaneXY(0, 0, 0))  # -> Geometry, Transform
yz = YZPlane(Origin=Point(0, 0, 0))
rotate_2 = Rotate(Geometry=rotate.Geometry, Angle=degrees(number_slider), Plane=yz)  # -> Geometry, Transform

# ---- group: Number of twisted boxes in each direction of the array
range = Range(Domain=Domain(0, 1), Steps=Slider(19, range=0..100))
range_2 = Range(Domain=Domain(0, 1), Steps=Slider(24, range=0..100))
# Can also change the domain of these
# ranges as well as use graph mappers
# to vary the spacing and coverage of
# the twisted boxes.
range_3 = Range(Domain=Domain(0, 1), Steps=Slider(26, range=0..100))

# ---- group: Input mesh
# Pufferfish
# By: Michael Pryor
mesh = Mesh(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)

# ---- group: Bounding Box which the array goes in
bbox = BoundingBox(Content=mesh, Plane=rotate_2.Geometry)  # -> Box, Box_2

# ----
tboxarr = TwistedBoxArray(Box=bbox.Box, ParametersX=range, ParametersY=range_2, ParametersZ=range_3)
tboxcents = TwistedBoxCenters(TwistedBox=tboxarr, CenterType=0)  # -> flatten(Center)

# ---- group: Remove twisted boxes outside of the mesh
minc = MeshInclusion(Mesh=mesh, Point=tboxcents, Strict=True)
cull = CullPattern(List=tboxarr, CullPattern=minc)

# ----
mesh_2 = Mesh(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)
bbox_2 = BoundingBox(Content=mesh_2, Plane=PlaneXY(0, 0, 0))  # -> Box, Box_2
# Box Morphing
morph = BoxMorph(Geometry=mesh_2, Reference=bbox_2.Box, Target=cull)
rebmsh = RebuildMesh(
    Mesh=morph,
    RebuildNormals=Toggle(True),
    CullUnused=False,
    IdenticalCombine=False,
    WeldVertices=0,
    UnifyNormals=False,
    FlipNormals=False)
# Recompute mesh normals to fix
# display issues that the box morph
# component sometimes causes
# when morphing meshes.
swatch = ColourSwatch(SwatchColor=RGB(64, 255, 204))
# Look at Rhino window
# to preview results
preview = CustomPreview(Geometry=rebmsh, Shader=swatch)
