# Grasshopper definition Pf_TwistedBoxMeshLSystem - Requires Anemone Plugin.gh (Grasshopper 0.9.76)
# plug-ins: Pufferfish, Anemone

# ---- group: Making the L-System Component / The trunk of the L-System Component
Z = UnitZ(Factor=1)
# Pf_Twisted Box Mesh L-System
panel = Panel("0,0,0")
# Pufferfish
# By: Michael Pryor
line = LineSDL(Start=panel, Direction=Z, Length=Slider(5.396, range=0..25))

# ---- group: Making the L-System Component / The two branches of the L-System Component
genes = GenePool(Decimals=2, Maximum=55, Minimum=0, Value=[55, 55])
genes_2 = GenePool(Decimals=2, Maximum=1, Minimum=-1, Value=[-0.67, -0.29])
genes_3 = GenePool(Decimals=2, Maximum=1, Minimum=-1, Value=[0.62, 0.16])
genes_4 = GenePool(Decimals=2, Maximum=1, Minimum=-1, Value=[0.2, 1])
vec = VectorXYZ(XComponent=genes_2, YComponent=genes_4, ZComponent=genes_3)  # -> Vector, Length
end = EndPoints(Curve=line)  # -> Start, End
line_2 = LineSDL(Start=end.End, Direction=vec.Vector, Length=genes)

# ---- group: Making the L-System Component / Planes at the branch ends to define the mesh planes
end_2 = EndPoints(Curve=line_2)  # -> Start, End
genes_5 = GenePool(Decimals=2, Maximum=360, Minimum=0, Value=[82.57, 171.29])
genes_6 = GenePool(Decimals=2, Maximum=360, Minimum=0, Value=[255.36, 192.23])
xy = XYPlane(Origin=end_2.End)
rotate = Rotate(Geometry=xy, Angle=degrees(genes_6), Plane=xy)  # -> Geometry, Transform
deplane = DeconstructPlane(Plane=rotate.Geometry)  # -> Origin, XAxis, YAxis, ZAxis
rot3d = Rotate3D(Geometry=rotate.Geometry, Angle=degrees(genes_5), Center=end_2.End, Axis=deplane.XAxis)  # -> Geometry, Transform

# ---- group: Making the L-System Component / Mesh planes at the branch ends that will be morphed onto
genes_7 = GenePool(Decimals=2, Maximum=10, Minimum=0, Value=[2.6, 6.89])
neg = Negative(Value=genes_7)
dom = ConstructDomain(DomainStart=neg, DomainEnd=genes_7)
rectangle = Rectangle(Plane=rot3d.Geometry, XSize=dom, YSize=dom, Radius=0)  # -> Rectangle, Length
mplane = MeshPlane(Boundary=rectangle.Rectangle, WidthCount=1, HeightCount=1)  # -> Mesh, Area

# ----
# Number of Iterations
number_slider = Slider(10, range=0..12)

# ---- group: Making the L-System Component / Group the trunk, branches, and mesh planes
group = Group(Objects=[line, line_2, mplane.Mesh])

# ----
fastloopstart = FastLoopStart(Iterations=number_slider, Data=group)  # -> port, Counter, Data

# ---- group: Iterative Morphing of the L-System Component / Get only the mesh planes
ungroup = Ungroup(Group=fastloopstart.Data)
# Don't mind the red error, we are
# just using this to filter out the meshes
mesh = Mesh(ungroup)
clean = CleanTree(RemoveNulls=True, RemoveInvalid=True, RemoveEmpty=False, Tree=mesh)

# ---- group: Iterative Morphing of the L-System Component / Factor of thickness to subtract relating to the iteration count
range = Range(Domain=Slider(0.234, range=0..1), Steps=number_slider)
item = ListItem(List=range, Index=fastloopstart.Counter, Wrap=True)

# ---- group: Iterative Morphing of the L-System Component / Thickness of the twisted box on the planes
genes_8 = GenePool(Decimals=2, Maximum=1, Minimum=0, Value=[0.34, 0.46])
subtraction = Subtraction(A=genes_8, B=item)

# ---- group: Iterative Morphing of the L-System Component / The reference box to morph the L-System Component from
number_slider_2 = Slider(7.72, range=0..10)
number_slider_3 = Slider(7.675, range=0..10)
neg_2 = Negative(Value=number_slider_2)
neg_3 = Negative(Value=number_slider_3)
Z_2 = UnitZ(Factor=Slider(1.038, range=0..5))
dom_2 = ConstructDomain(DomainStart=neg_2, DomainEnd=number_slider_2)
dom_3 = ConstructDomain(DomainStart=neg_3, DomainEnd=number_slider_3)
planesrf = PlaneSurface(Plane=PlaneXY(0, 0, 0), XSize=dom_3, YSize=dom_2)
extr = Extrude(Base=planesrf, Direction=Z_2)

# ---- group: Iterative Morphing of the L-System Component / Recompute the mesh plane normals because they get messed up sometimes when morphing
rebmsh = RebuildMesh(
    Mesh=clean,
    RebuildNormals=Toggle(True),
    CullUnused=False,
    IdenticalCombine=False,
    WeldVertices=0,
    UnifyNormals=False,
    FlipNormals=False)

# ---- group: Iterative Morphing of the L-System Component / Create one twisted box per mesh face
tboxmsh = TwistedBoxMesh(Mesh=rebmsh, Thickness=subtraction, ParametersW=1)

# ---- group: Iterative Morphing of the L-System Component / Morph the L-System Component to the mesh twisted boxes
morph = BoxMorph(Geometry=group, Reference=extr, Target=tboxmsh)

# ----
fastloopend = FastLoopEnd(port=fastloopstart.port, Exit=False, Data=morph, RecordData=True, TimeOutVal=0)

# ---- group: Ungroup the L-System Components and get only the curves
# Don't mind the red error, we are
# just using this to filter out the curves
ungroup_2 = Ungroup(Group=fastloopend)  # -> flatten(Objects)
crv = Curve(ungroup_2)
# Option 1: Use the Cocoon plug-in to mesh the curves.
# You can download Cocoon here: www.bespokegeometry.com/2015/07/22/cocoon/
# 
# Option 2: Use the mesh pipe component from the Mesh Tools plug-in,
# Import the mesh pipes into ZBrush and run Nanomesh on them to
# create one closed mesh shell.
# You can download Mesh Tools here: www.grasshopper3d.com/photo/mesh-tools
# How to Mesh
clean_2 = CleanTree(RemoveNulls=True, RemoveInvalid=True, RemoveEmpty=False, Tree=crv)
