# Grasshopper definition Pf_TwistedBoxSubdivideAttractor.gh (Grasshopper 0.9.76)
# plug-ins: Pufferfish

# ---- group: Number of twisted boxes in each surface direction
range = Range(Domain=Domain(0, 1), Steps=Slider(2, range=0..5))
range_2 = Range(Domain=Domain(0, 1), Steps=Slider(17, range=0..100))
range_3 = Range(Domain=Domain(0, 1), Steps=Slider(14, range=0..100))

# ---- group: Thickness of twisted boxes on surface
# Pf_Twisted Box Subdivide Attractor
number_slider = Slider(7, range=0..10)

# ---- group: Surface to put twisted boxes on
# Pufferfish
# By: Michael Pryor
srf = Surface(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)

# ---- group: Pf_Twisted Box Surface
tboxsrf = TwistedBoxSurface(Surface=srf, Thickness=number_slider, ParametersU=range_3, ParametersV=range_2, ParametersW=range)

# ---- group: Pf_Twisted Box Centers
tboxcents = TwistedBoxCenters(TwistedBox=tboxsrf, CenterType=0)  # -> flatten(Center)

# ---- group: Attractor curve
crv = Curve(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)
crv_cp = CurveClosestPoint(Point=tboxcents, Curve=crv)  # -> Point, Parameter, Distance

# ---- group: Remap attractor distances to the bounds of the resolutions
toggle = BooleanToggle(True)

# ---- group: Resolutions: Number of subdivision iterations
panel = Panel("""0
1
2""")

# ---- group: Pf_Round To Nearest
roundn = RoundToNearest(NumbersX=crv_cp.Distance, NumbersY=panel, RemapX=toggle)  # -> Nearest, RemappedX

# ---- group: Pf_Subdivide Twisted Box
subdivtbox = SubdivideTwistedBox(TwistedBox=tboxsrf, Resolution=roundn.Nearest)

# ----
panel_2 = Panel(roundn.Nearest)

# ---- group: Box morph geometry
geo = Geometry(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)
bbox = BoundingBox(Content=geo, Plane=PlaneXY(0, 0, 0))  # -> Box, Box_2
morph = BoxMorph(Geometry=geo, Reference=bbox.Box, Target=subdivtbox)  # -> flatten(Geometry)

# ----
preview = CustomPreview(Geometry=subdivtbox, Shader=ColourSwatch(SwatchColor=RGB(255, 255, 255)))
preview_2 = CustomPreview(
    Geometry=morph,
    Shader={ambient=RGB(0, 0, 0), diffuse=RGB(255, 105, 180), emission=RGB(76, 32, 54), shine=0.5, specular=RGB(255, 255, 255), transparency=0})
