# Grasshopper definition 01-Basic.gh (Grasshopper 0.9.76)

# ---- group: POINT PER SERIES
spacer = Slider(2, range=1..10)
count = Slider(34, range=0..50)
count_2 = Slider(34, range=0..50)
spacer_2 = Slider(2, range=1..10)
series = Series(Start=0, Step=spacer, Count=count)
series_2 = Series(Start=0, Step=spacer_2, Count=count_2)
panel = Panel(series_2)
panel_2 = Panel(series)
pt = ConstructPoint(XCoordinate=series, YCoordinate=series_2, ZCoordinate=0)

# ---- group: Series
spacer_3 = Slider(2, range=1..10)
count_3 = Slider(34, range=0..50)
series_3 = Series(Start=0, Step=spacer_3, Count=count_3)
panel_3 = Panel(series_3)

# ----
frecuency = Slider(0.5, range=0..5)
spacer_4 = Slider(2, range=1..10)
count_4 = Slider(34, range=0..50)
series_4 = Series(Start=0, Step=spacer_4, Count=count_4)
series_5 = Series(Start=0, Step=frecuency, Count=count_4)
panel_4 = Panel(series_5)
pi = Pi(Factor=series_5)
panel_5 = Panel(series_4)
panel_6 = Panel(pi)
sin = Sine(Value=pi)
amplitude = Slider(9, range=0..10)
panel_7 = Panel(sin)
multiplication = Multiplication(A=sin, B=amplitude)
panel_8 = Panel(multiplication)
pt_2 = PointXYZ(XComponent=series_4, YComponent=multiplication, ZComponent=0, System=PlaneXY(0, 0, 0))
panel_9 = Panel(pt_2)
intcrv = Interpolate(Vertices=pt_2, Degree=3, Periodic=False, KnotStyle=1)  # -> Curve, Length, Domain

# ---- group: conect multiple points
pt_3 = Point(<point referenced from the Rhino model>)
pt_4 = Point(<point referenced from the Rhino model>)
pt_5 = Point(<point referenced from the Rhino model>)
pt_6 = Point(<point referenced from the Rhino model>)
pt_7 = Point([<point referenced from the Rhino model> x4])
crv = Curve(Vertices=[pt_3, pt_4, pt_5, pt_6], Degree=Slider(2, range=0..5), Periodic=Toggle(False))  # -> Curve, Length, Domain
panel_10 = Panel(pt_7)
points = PointList(Points=pt_7, Tags=True, Lines=True, Size=Slider(3, range=0..100))
panel_11 = Panel(crv.Length)

# ----
slider = Slider(40, range=0..100)
crv_2 = Curve(<curve referenced from the Rhino model>)
crv_3 = Curve(<curve referenced from the Rhino model>)
divide = DivideCurve(Curve=crv_2, Count=slider, Kinks=False)  # -> Points, Tangents, Parameters
divide_2 = DivideCurve(Curve=crv_3, Count=slider, Kinks=False)  # -> Points, Tangents, Parameters
ln = Line(StartPoint=divide_2.Points, EndPoint=divide.Points)
loft = Loft(Curves=ln, Options={Adjust=False, Closed=False, LoftEnds=0, LoftSimp=0, LoftType=0, Rebuild=10, Refit=0.01})

# ---- group: create you own point
y_coordinate = Slider(18, range=0..100)
slider_2 = Slider(50, range=50..120)
panel_12 = Panel("10")

# ---- group: LOFT
slider_3 = Slider(40, range=0..100)
crv_4 = Curve(<curve referenced from the Rhino model>)
crv_5 = Curve(<curve referenced from the Rhino model>)
crv_6 = Curve(<curve referenced from the Rhino model>)
divide_3 = DivideCurve(Curve=crv_6, Count=slider_3, Kinks=False)  # -> Points, Tangents, Parameters
divide_4 = DivideCurve(Curve=crv_4, Count=slider_3, Kinks=False)  # -> Points, Tangents, Parameters
divide_5 = DivideCurve(Curve=crv_5, Count=slider_3, Kinks=False)  # -> Points, Tangents, Parameters
merge = Merge(Data1=crv_5, Data2=crv_4, Data3=crv_6)
loft_2 = Loft(Curves=merge, Options={Adjust=False, Closed=False, LoftEnds=0, LoftSimp=0, LoftType=0, Rebuild=10, Refit=0.01})

# ---- group: AROS SUPERFICIE
slider_4 = Slider(40, range=0..100)
crv_7 = Curve(<curve referenced from the Rhino model>)
crv_8 = Curve(<curve referenced from the Rhino model>)
crv_9 = Curve(<curve referenced from the Rhino model>)
slider_5 = Slider(1, range=0..10)
divide_6 = DivideCurve(Curve=crv_9, Count=slider_4, Kinks=False)  # -> Points, Tangents, Parameters
divide_7 = DivideCurve(Curve=crv_8, Count=slider_4, Kinks=False)  # -> Points, Tangents, Parameters
divide_8 = DivideCurve(Curve=crv_7, Count=slider_4, Kinks=False)  # -> Points, Tangents, Parameters
slider_6 = Slider(1, range=0..10)
points_2 = PointList(Points=divide_7.Points, Tags=True, Lines=True, Size=Slider(1, range=0..10))
points_3 = PointList(Points=divide_6.Points, Tags=True, Lines=slider_5, Size=slider_5)
points_4 = PointList(Points=divide_8.Points, Tags=True, Lines=slider_6, Size=slider_6)
circle = Circle3Pt(PointA=divide_7.Points, PointB=divide_8.Points, PointC=divide_6.Points)  # -> Circle, Plane, Radius
loft_3 = Loft(Curves=circle.Circle, Options={Adjust=False, Closed=False, LoftEnds=0, LoftSimp=0, LoftType=0, Rebuild=10, Refit=0.01})

# ---- group: Line
pt_8 = Point(<point referenced from the Rhino model>)
pt_9 = Point(<point referenced from the Rhino model>)
ln_2 = Line(StartPoint=pt_8, EndPoint=pt_9)

# ----
pt_10 = ConstructPoint(XCoordinate=panel_12, YCoordinate=y_coordinate, ZCoordinate=slider_2)

points_5 = PointList(Points=divide_2.Points, Tags=True, Lines=True, Size=Slider(1, range=0..10))

slider_7 = Slider(1, range=0..10)
points_6 = PointList(Points=divide.Points, Tags=True, Lines=slider_7, Size=slider_7)

# ---- group: LOFT
points_7 = PointList(Points=divide_5.Points, Tags=True, Lines=True, Size=Slider(1, range=0..10))

slider_8 = Slider(1, range=0..10)
points_8 = PointList(Points=divide_3.Points, Tags=True, Lines=slider_8, Size=slider_8)

slider_9 = Slider(1, range=0..10)
points_9 = PointList(Points=divide_4.Points, Tags=True, Lines=slider_9, Size=slider_9)

# ----
frecuency_2 = Slider(2, range=0..5)
spacer_5 = Slider(2, range=1..10)
count_5 = Slider(34, range=0..50)
series_6 = Series(Start=0, Step=spacer_5, Count=count_5)
series_7 = Series(Start=0, Step=frecuency_2, Count=count_5)
panel_13 = Panel(series_6)
panel_14 = Panel(series_7)
amplitude_2 = Slider(1, range=0..10)

pt_11 = ConstructPoint(XCoordinate=series_6, YCoordinate=0, ZCoordinate=0)

panel_15 = Panel(pt_11)
intcrv_2 = Interpolate(Vertices=pt_11, Degree=3, Periodic=False, KnotStyle=1)  # -> Curve, Length, Domain
