# Grasshopper definition 04-Grow-Scale-RotateSurface.gh (Grasshopper 0.9.76)

slider = Slider(10, range=0..10)
radius = Slider(11, range=0..100)
series = Series(Start=0, Step=Slider(3.5, range=0..10), Count=slider)
polygon = Polygon(Plane=PlaneXY(0, 0, 0), Radius=radius, Segments=6, FilletRadius=0)  # -> Polygon, Length
Z = UnitZ(Factor=series)
number_to_substract = Slider(1, range=0..1)
move = Move(Geometry=polygon.Polygon, Motion=Z)  # -> Geometry, Transform
pt = PointXYZ(XComponent=0, YComponent=0, ZComponent=0, System=PlaneXY(0, 0, 0))
vdis = VectorDisplay(Anchor=pt, Vector=Z)
domain_finish = Slider(1, range=0..10)
domain_start = Slider(0, range=0..1)
subtraction = Subtraction(A=slider, B=number_to_substract)
dom = Domain(DomainStart=domain_start, DomainEnd=domain_finish)
series_2 = Series(Start=0, Step=1, Count=10)
range = Range(Domain=dom, Steps=subtraction)
panel = Panel(dom)
area = Area(Geometry=move.Geometry)  # -> Area, Centroid
panel_2 = Panel(range)
graph = GraphMapper(range, x0=0, x1=1, y0=0, y1=1, container_name="Sine", Equation_px=[0, 0.4891228974], Equation_py=[0, 1])
panel_3 = Panel(graph)
addition = Addition(A=panel_3, B=Slider(0.6, range=0..1))
multiplication = Multiplication(A=addition, B=Slider(0.6, range=0..1))
panel_4 = Panel(addition)
scale = Scale(Geometry=move.Geometry, Center=area.Centroid, Factor=multiplication)  # -> Geometry, Transform
panel_5 = Panel(multiplication)
multiplication_2 = Multiplication(A=addition, B=Slider(1, range=0..1))
rotate = Rotate(Geometry=scale.Geometry, Angle=multiplication_2, Plane=area.Centroid)  # -> Geometry, Transform
loft = Loft(Curves=rotate.Geometry, Options={Adjust=False, Closed=False, LoftEnds=0, LoftSimp=0, LoftType=0, Rebuild=10, Refit=0.01})
