# Grasshopper definition 06-ExtrusionDistance.gh (Grasshopper 0.9.76)

series = Series(Start=0, Step=1, Count=10)
series_2 = Series(Start=0, Step=1, Count=10)
# because the 0.5 come from the distance of the point of the grid in the first series component
pt = ConstructPoint(XCoordinate=0, YCoordinate=Slider(18, range=0..100), ZCoordinate=0)
# because the 0.5 come from the distance of the point of the grid in the first series component
pt_2 = ConstructPoint(XCoordinate=0, YCoordinate=Slider(18, range=0..100), ZCoordinate=0)
pt_3 = ConstructPoint(XCoordinate=graft(series), YCoordinate=series, ZCoordinate=0)  # -> flatten(Point)
pt_4 = ConstructPoint(XCoordinate=graft(series_2), YCoordinate=series_2, ZCoordinate=0)  # -> flatten(Point)
dist = Distance(PointA=pt_3, PointB=pt)
dist_2 = Distance(PointA=pt_4, PointB=pt_2)
division = Division(A=dist, B=Slider(71.9, range=0.1..100))
division_2 = Division(A=dist_2, B=Slider(63.2, range=0.1..100))
panel = Panel(division)
panel_2 = Panel(division_2)
min = Minimum(A=division, B=".5")
min_2 = Minimum(A=division_2, B=".5")
max = Maximum(A=division, B=".5")
max_2 = Maximum(A=division_2, B=".5")
panel_3 = Panel(max)
panel_4 = Panel(min)
panel_5 = Panel(max_2)
panel_6 = Panel(min_2)
cir = Circle(Plane=pt_3, Radius=min)
cir_2 = Circle(Plane=pt_4, Radius=min_2)
area = Area(Geometry=cir_2)  # -> Area, Centroid
pt_5 = ConstructPoint(XCoordinate=Slider(12, range=0..100), YCoordinate=Slider(10, range=0..100), ZCoordinate=0)
pt_6 = Point(area.Centroid)
pull = PullPoint(Point=pt_6, Geometry=pt_5, ClosestOnly=True)  # -> ClosestPoint, Distance
panel_7 = Panel(pull.Distance)
ln = Line(StartPoint=pt_6, EndPoint=pull.ClosestPoint)

# ---- group: remap the range of the height to the one we want
number_slider = Slider(20, range=0..100)
number_slider_2 = Slider(1, range=0..10)
bnd = Bounds(Numbers=flatten(pull.Distance))
panel_8 = Panel(bnd)
dom = ConstructDomain(DomainStart=number_slider_2, DomainEnd=number_slider)
remap = RemapNumbers(Value=pull.Distance, Source=bnd, Target=dom)  # -> Mapped, Clipped
panel_9 = Panel(remap.Mapped)

# ----
Z = UnitZ(Factor=remap.Mapped)
extr = Extrude(Base=cir_2, Direction=Z)
cap = CapHoles(Brep=extr)
gradient = Gradient(
    LowerLimit=number_slider_2,
    UpperLimit=number_slider,
    Parameter=remap.Mapped,
    stops=[0: RGB(254, 123, 39), 0.438: RGB(255, 130, 160), 1: RGB(220, 0, 40)])
preview = CustomPreview(Geometry=cap, Shader=gradient)
