# Grasshopper definition 08-PressFit.gh (Grasshopper 1.0.4)
# plug-ins: Anemone

polygon = Polygon(Plane=PlaneXY(0, 0, 0), Radius=Slider(6, range=0..10), Segments=Slider(3, range=0..10), FilletRadius=0)  # -> Polygon, Length
explode = Explode(Curve=polygon.Polygon, Recursive=True)  # -> Segments, Vertices
area = Area(Geometry=polygon.Polygon)  # -> Area, Centroid
rectangle = Rectangle(Plane=PlaneXY(0, 0, 0), XSize=Slider(0.9, range=0.1..3), YSize=Slider(1.4, range=0.1..3), Radius=0)  # -> Rectangle, Length
eval = EvaluateCurve(Curve=reparameterize(explode.Segments), Parameter="0.5")  # -> Point, Tangent, Angle
vector_2pt = Vector2Pt(PointA=eval.Point, PointB=area.Centroid, Unitize=False)  # -> Vector, Length
explode_2 = Explode(Curve=rectangle.Rectangle, Recursive=True)  # -> Segments, Vertices
vdis = VectorDisplay(Anchor=eval.Point, Vector=vector_2pt.Vector)

rad = Radians(Degrees=Slider(90, range=0..100))
Z = UnitZ(Factor=1)
vrot = Rotate(Vector=vector_2pt.Vector, Axis=Z, Angle=rad)

eval_2 = EvaluateCurve(Curve=reparameterize(explode_2.Segments), Parameter="0.5")  # -> Point, Tangent, Angle
item = ListItem(List=eval_2.Point, Index=0, Wrap=True)
pl = ConstructPlane(Origin=eval.Point, XAxis=vrot, YAxis=vector_2pt.Vector)
xy = XYPlane(Origin=item)
orient = Orient(Geometry=rectangle.Rectangle, Source=xy, Target=pl)  # -> Geometry, Transform
geo = Geometry(polygon.Polygon)
rdiff = RegionDifference(CurvesA=geo, CurvesB=orient.Geometry)
boundary = BoundarySurfaces(Edges=rdiff)
unit_z = UnitZ(Factor=Slider(1, range=0..10))
extrude = Extrude(Base=boundary, Direction=unit_z)
cap_holes = CapHoles(Brep=extrude)

# ----
# RIGHT CLICK THIS COMPONENET AND CLICK 'ENABLED'
number_slider = Slider(10, range=0..100)
number_slider_2 = Slider(10, range=0..10)
loop_start = LoopStart(Repeat=number_slider, Trigger=Button(), Data=cap_holes)  # -> port, Counter, Data; disabled
reverse_list = ReverseList(List=loop_start.Data)
panel = Panel(loop_start.Counter)
list_item = ListItem(List=reverse_list, Index=Slider(0, range=0..100), Wrap=True)
deconstruct_brep = DeconstructBrep(Brep=list_item)  # -> Faces, Edges, Vertices
addition = Addition(A=loop_start.Counter, B=Slider(1, range=0..1))
area_2 = Area(Geometry=deconstruct_brep.Faces)  # -> Area, Centroid
curve = Curve(reparameterize(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))
multiplication = Multiplication(A=addition, B=Slider(0.012, range=0..1))
number_slider_3 = Slider(3, range=0..10)
sort_list = SortList(Keys=area_2.Area, ValuesValuesA=deconstruct_brep.Faces, ValuesA=area_2.Centroid)  # -> Keys, ValuesValuesA, ValuesA
evaluate_curve = EvaluateCurve(Curve=curve, Parameter=multiplication)  # -> Point, Tangent, Angle
split_list = SplitList(List=sort_list.ValuesValuesA, Index=number_slider_3)  # -> ListA, ListB
split_list_2 = SplitList(List=sort_list.ValuesA, Index=number_slider_3)  # -> ListA, ListB
closest_point = ClosestPoint(Point=evaluate_curve.Point, Cloud=split_list_2.ListA)  # -> ClosestPoint, CPIndex, Distance
geometry = Geometry([split_list.ListA, split_list_2.ListA])
list_item_2 = ListItem(List=split_list.ListA, Index=closest_point.CPIndex, Wrap=True)
md_slider = MDSlider(
    slider_value=Point(0.8463432498, 0.8658536585, 0.5),
    SliderMode=0,
    x_domain=Domain(0, 1),
    y_domain=Domain(0, 1),
    z_domain=Domain(0, 1))
evaluate_surface = EvaluateSurface(Surface=reparameterize(list_item_2), Point=md_slider)  # -> Point, Normal, Frame
plane_normal = PlaneNormal(Origin=closest_point.ClosestPoint, ZAxis=evaluate_surface.Normal)
mirror = Mirror(Geometry=list_item, Plane=plane_normal)  # -> Geometry, Transform
Z_2 = UnitZ(Factor=Slider(10, range=0..100))
rotate = Rotate(Geometry=mirror.Geometry, Angle=1.570796327, Plane=plane_normal)  # -> Geometry, Transform
merge = Merge(Data1=loop_start.Data, Data2=rotate.Geometry)  # -> flatten(Result)
loop_end = LoopEnd(port=loop_start.port, Exit=False, Data=merge, pausedState=False, state="Constant output", TimeOutVal=0)
geometry_2 = Geometry(loop_end)
move = Move(Geometry=geometry_2, Motion=Z_2)  # -> Geometry, Transform
preview = CustomPreview(Geometry=move.Geometry, Material=ColourSwatch(SwatchColor=RGB(117, 117, 117)))
